# Dynamo graph 2_TrackersSuperficieAlignmentsRepresentacionFeatures_v04.dyn (Dynamo 2.19.4.6671)
# Unificado NS/EO. Input 'Orientacion (NS/EO)' selecciona la logica de creacion de ejes en Python1 (NS=columnas/eje N->S, EO=filas/eje O->E). El resto del pipeline (superficie, perfiles TN/Trackers, ProfileViews, limpieza, proyeccion FL) es comun. | v03: boundaries con cota real (fix embudos Z=0) | v04: FL_C fuera de breaklines + anclas MDT + auditoria Z final
# packages: Civil3DToolkit 1.1.14

# group: INPUTS
capa_de_contornos = StringInput("_contornos")  # graph input
capa_de_trackers = StringInput("_lineas_rotura")  # graph input
mdt_nombre_del_data_shortcut = StringInput("MDT_PruebaCaso")  # graph input
orientacion_ns_eo = StringInput("EO")  # graph input
origin_X = DoubleInput(295615.068)  # graph input
origin_Y = DoubleInput(4028361.445)  # graph input

capa_ejes_alignment_layer = StringInput("EJES")  # graph input
tolerancia_agrupacion_m = DoubleInput(2)  # graph input
extension_extremos_m = DoubleInput(1)  # graph input
current = Autodesk.AutoCAD.DynamoNodes.Document.Current()
nombre_superficie_trackers = StringInput("Trackers_Caso")  # graph input
estilo_featureline_tracker = StringInput("tracker alignment")  # graph input
python_tracker_surface = Python(IN[0]=mdt_nombre_del_data_shortcut, IN[1]=capa_de_contornos, IN[2]=capa_de_trackers, IN[3]=nombre_superficie_trackers, IN[4]=estilo_featureline_tracker)  # CPython3
# ---------- python_tracker_surface.python (503 lines) ----------
# -*- coding: utf-8 -*-
# =============================================================================
# Tracker_Surface  -  Nodo Python principal
# Civil 3D 2024 / Dynamo / CPython3
#
# Flujo:
#   - Por cada polilinea de contorno: FeatureLine + AssignElevationsFromSurface
#     (insertIntermediateGradeBreakPoints=True)
#   - Por cada polilinea de tracker: FeatureLine + AssignElevationsFromSurface
#     (insertIntermediateGradeBreakPoints=False)
#   - Todas las FeatureLines se anyaden a la superficie como breaklines.
#   - Contornos como boundary (primero Outer, resto Show).
#   - Estilo de FeatureLine aplicado mediante indexador directo (robusto).
#
# IN[0] : str  nombre del MDT
# IN[1] : str  capa de contornos
# IN[2] : str  capa de trackers
# IN[3] : str  nombre de la nueva superficie de trackers
# IN[4] : str  nombre del estilo de FeatureLine
# =============================================================================

import clr
import traceback

clr.AddReference('AcMgd')
clr.AddReference('AcCoreMgd')
clr.AddReference('AcDbMgd')
clr.AddReference('AecBaseMgd')
clr.AddReference('AeccDbMgd')

from Autodesk.AutoCAD.ApplicationServices import Application as AcadApp
from Autodesk.AutoCAD.DatabaseServices import (
    OpenMode, BlockTable, BlockTableRecord,
    Polyline, SymbolUtilityServices, ObjectIdCollection, ObjectId
)
from Autodesk.AutoCAD.Geometry import Point3d, Point3dCollection
from Autodesk.Civil import SurfaceBoundaryType
from Autodesk.Civil.ApplicationServices import CivilApplication
from Autodesk.Civil.DatabaseServices import TinSurface, FeatureLine
from System import String as SysString

# --------------------------------------------------------------------------- #
# Inputs
# --------------------------------------------------------------------------- #
mdt_name       = str(IN[0])
contour_layer  = str(IN[1])
tracker_layer  = str(IN[2])
out_surf_name  = str(IN[3])
fl_style_name  = str(IN[4])

log = []

try:
    doc  = AcadApp.DocumentManager.MdiActiveDocument
    db   = doc.Database
    cdoc = CivilApplication.ActiveDocument

    dlock = doc.LockDocument()
    try:
        tr = db.TransactionManager.StartTransaction()
        try:

            # ---------------------------------------------------------------- #
            # 1. MDT
            # ---------------------------------------------------------------- #
            mdt_surf = None
            mdt_surf_id = None
            for sid in cdoc.GetSurfaceIds():
                s = tr.GetObject(sid, OpenMode.ForRead)
                if s.Name == mdt_name:
                    mdt_surf = s
                    mdt_surf_id = sid
                    break
            if mdt_surf is None:
                raise Exception("No se ha encontrado el MDT '{}'.".format(mdt_name))

            # ---------------------------------------------------------------- #
            # 2. Recoger polylines por capa y borrar FLs previas
            # ---------------------------------------------------------------- #
            bt   = tr.GetObject(db.BlockTableId, OpenMode.ForRead)
            ms_id = SymbolUtilityServices.GetBlockModelSpaceId(db)
            btr  = tr.GetObject(ms_id, OpenMode.ForWrite)

            contour_poly_ids = []
            contour_xy_lists = []
            tracker_poly_ids = []
            old_fls_to_erase = []

            for oid in btr:
                obj = tr.GetObject(oid, OpenMode.ForRead)
                if isinstance(obj, FeatureLine):
                    try:
                        nm = obj.Name
                        if nm and (nm.startswith("FL_C") or nm.startswith("FL_T")):
                            old_fls_to_erase.append(oid)
                    except:
                        pass
                    continue
                if not isinstance(obj, Polyline):
                    continue
                lay = obj.Layer
                n = obj.NumberOfVertices
                if lay == contour_layer and n >= 3:
                    pts = []
                    for i in range(n):
                        p = obj.GetPoint2dAt(i)
                        pts.append((p.X, p.Y))
                    contour_xy_lists.append(pts)
                    contour_poly_ids.append(oid)
                elif lay == tracker_layer and n >= 2:
                    tracker_poly_ids.append(oid)

            n_erased = 0
            for oid in old_fls_to_erase:
                try:
                    fl_old = tr.GetObject(oid, OpenMode.ForWrite)
                    fl_old.Erase()
                    n_erased += 1
                except:
                    pass
            if n_erased > 0:
                log.append("FeatureLines previas borradas: {}".format(n_erased))

            if not contour_poly_ids:
                raise Exception("No hay polilineas en la capa de contorno '{}'.".format(contour_layer))
            if not tracker_poly_ids:
                raise Exception("No hay polilineas en la capa de trackers '{}'.".format(tracker_layer))

            log.append("Polilineas contorno: {}".format(len(contour_poly_ids)))
            log.append("Polilineas tracker:  {}".format(len(tracker_poly_ids)))

            # ---------------------------------------------------------------- #
            # 2b. Buscar estilo de FeatureLine — ROBUSTO
            #
            # FeatureLineStyle.Name es ilegible via pythonnet (bug conocido).
            # Estrategia: usar el indexador directo de la coleccion de estilos,
            # que acepta el nombre como string y devuelve el ObjectId sin
            # necesidad de leer .Name desde fuera.
            # ---------------------------------------------------------------- #
            fl_style_id = ObjectId.Null
            wanted = fl_style_name.strip()

            if wanted:
                # --- Metodo 1: get_Item(string) en la coleccion ---
                try:
                    coll = cdoc.Styles.FeatureLineStyles
                    try:
                        fl_style_id = coll.get_Item(wanted)
                        log.append("Estilo FL encontrado (get_Item): '{}'".format(wanted))
                    except:
                        pass
                except:
                    pass

                # --- Metodo 2: indexador con corchetes ---
                if fl_style_id == ObjectId.Null:
                    try:
                        coll = cdoc.Styles.FeatureLineStyles
                        fl_style_id = coll[wanted]
                        log.append("Estilo FL encontrado (indexer): '{}'".format(wanted))
                    except:
                        pass

                # --- Metodo 3: reflexion para invocar get_Item(String) ---
                if fl_style_id == ObjectId.Null:
                    try:
                        coll = cdoc.Styles.FeatureLineStyles
                        ct = clr.GetClrType(coll.GetType())
                        gi = ct.GetMethod("get_Item", [clr.GetClrType(SysString)])
                        if gi is not None:
                            fl_style_id = gi.Invoke(coll, [wanted])
                            if fl_style_id is not None and fl_style_id != ObjectId.Null:
                                log.append("Estilo FL encontrado (reflection): '{}'".format(wanted))
                    except:
                        pass

                # --- Metodo 4: iterar e intentar leer Name con bare except ---
                if fl_style_id == ObjectId.Null:
                    try:
                        coll = cdoc.Styles.FeatureLineStyles
                        found_names = []
                        for stid in coll:
                            try:
                                st = tr.GetObject(stid, OpenMode.ForRead)
                                try:
                                    nm = st.Name
                                    found_names.append(nm)
                                    if nm.strip().lower() == wanted.lower():
                                        fl_style_id = stid
                                        log.append("Estilo FL encontrado (iter): '{}'".format(nm))
                                        break
                                except:
                                    found_names.append("<ilegible>")
                            except:
                                pass
                        if fl_style_id == ObjectId.Null:
                            log.append("Estilos encontrados: {}".format(found_names))
                    except Exception as ex:
                        log.append("Error iterando estilos: {}".format(str(ex)))

                if fl_style_id == ObjectId.Null:
                    log.append("AVISO: estilo FL '{}' NO encontrado.".format(wanted))

            # ---------------------------------------------------------------- #
            # 3. Crear FeatureLines y asignar elevaciones
            # ---------------------------------------------------------------- #
            def make_fl(poly_id, name):
                errors = []
                try:
                    return FeatureLine.Create(name, poly_id)
                except Exception as e1:
                    errors.append("v1(2args): " + str(e1))
                try:
                    return FeatureLine.Create(name, poly_id, ObjectId.Null)
                except Exception as e2:
                    errors.append("v2(3args): " + str(e2))
                raise Exception(" || ".join(errors))

            def assign_z(fl_obj, insert_grade_breaks):
                errors = []
                try:
                    return fl_obj.AssignElevationsFromSurface(
                        mdt_surf_id, insert_grade_breaks)
                except Exception as e1:
                    errors.append("v1(2args): " + str(e1))
                try:
                    return fl_obj.AssignElevationsFromSurface(mdt_surf_id)
                except Exception as e2:
                    errors.append("v2(1arg): " + str(e2))
                raise Exception(" || ".join(errors))

            featureline_ids = ObjectIdCollection()
            contour_fl_ids  = ObjectIdCollection()   # v04: FL_C FUERA de breaklines
            n_fl_contour = 0
            n_fl_tracker = 0
            first_fl_err = None
            first_assign_err = None
            n_styled = 0
            first_style_err = None

            # -- contornos: CON grade break points --
            for i, poly_id in enumerate(contour_poly_ids):
                fl_name = "FL_C{:02d}".format(i + 1)
                try:
                    fl_id = make_fl(poly_id, fl_name)
                except Exception as ex_cr:
                    if first_fl_err is None:
                        first_fl_err = str(ex_cr)
                    continue
                try:
                    fl_obj = tr.GetObject(fl_id, OpenMode.ForWrite)
                    assign_z(fl_obj, True)
                    if fl_style_id != ObjectId.Null:
                        try:
                            fl_obj.StyleId = fl_style_id
                            n_styled += 1
                        except Exception as ex_sty:
                            if first_style_err is None:
                                first_style_err = str(ex_sty)
                    contour_fl_ids.Add(fl_id)   # v04: no entran como breakline
                    n_fl_contour += 1
                except Exception as ex_az:
                    if first_assign_err is None:
                        first_assign_err = str(ex_az)

            # -- trackers: SIN grade break points --
            for i, poly_id in enumerate(tracker_poly_ids):
                fl_name = "FL_T{:02d}".format(i + 1)
                try:
                    fl_id = make_fl(poly_id, fl_name)
                except Exception as ex_cr:
                    if first_fl_err is None:
                        first_fl_err = str(ex_cr)
                    continue
                try:
                    fl_obj = tr.GetObject(fl_id, OpenMode.ForWrite)
                    assign_z(fl_obj, False)
                    if fl_style_id != ObjectId.Null:
                        try:
                            fl_obj.StyleId = fl_style_id
                            n_styled += 1
                        except Exception as ex_sty:
                            if first_style_err is None:
                                first_style_err = str(ex_sty)
                    featureline_ids.Add(fl_id)
                    n_fl_tracker += 1
                except Exception as ex_az:
                    if first_assign_err is None:
                        first_assign_err = str(ex_az)

            log.append("FeatureLines contorno: {}".format(n_fl_contour))
            log.append("FeatureLines tracker:  {}".format(n_fl_tracker))
            if fl_style_id != ObjectId.Null:
                log.append("FLs con estilo '{}' aplicado: {}".format(wanted, n_styled))
                if first_style_err:
                    log.append("Primer error estilo: {}".format(first_style_err))
            if first_fl_err:
                log.append("Primer error FL.Create: {}".format(first_fl_err))
                try:
                    sigs = []
                    ct = clr.GetClrType(FeatureLine)
                    for mm in ct.GetMethods():
                        if mm.Name == "Create":
                            params = ", ".join(p.ParameterType.Name + " " + p.Name
                                               for p in mm.GetParameters())
                            sigs.append("Create(" + params + ")")
                    if sigs:
                        log.append("Firmas FeatureLine.Create:")
                        for s in sigs:
                            log.append("  " + s)
                except:
                    pass
            if first_assign_err:
                log.append("Primer error AssignElevations: {}".format(first_assign_err))

            # ---------------------------------------------------------------- #
            # 4. Crear superficie TIN
            # ---------------------------------------------------------------- #
            existing_id = None
            for sid in cdoc.GetSurfaceIds():
                s = tr.GetObject(sid, OpenMode.ForRead)
                if s.Name == out_surf_name:
                    existing_id = sid
                    break
            if existing_id is not None:
                sx = tr.GetObject(existing_id, OpenMode.ForWrite)
                sx.Erase()

            new_surf_id = TinSurface.Create(db, out_surf_name)
            new_surf    = tr.GetObject(new_surf_id, OpenMode.ForWrite)

            # ---------------------------------------------------------------- #
            # 5. Breaklines
            # ---------------------------------------------------------------- #
            if featureline_ids.Count > 0:
                try:
                    new_surf.BreaklinesDefinition.AddStandardBreaklines(
                        featureline_ids,
                        1.0,    # midOrdinateDistance
                        100.0,  # maximumDistance
                        0.0,    # weedingDistance
                        0.0     # weedingAngle
                    )
                    log.append("Breaklines anyadidas (solo trackers, v04): {}".format(featureline_ids.Count))
                except Exception as ex_bl:
                    log.append("ERROR AddStandardBreaklines: {}".format(ex_bl))

            try:
                new_surf.Rebuild()
            except:
                pass

            n_tri = -1
            try:
                gp = new_surf.GetGeneralProperties()
                for prop_name in ("NumberOfTriangles", "TriangleCount", "NumTriangles"):
                    if hasattr(gp, prop_name):
                        n_tri = getattr(gp, prop_name)
                        break
                if n_tri >= 0:
                    log.append("Triangulos: {}".format(n_tri))
            except:
                pass

            # ---------------------------------------------------------------- #
            # 5b. (v04) ANCLAS DE CONTORNO: puntos directos del MDT
            #
            # POR QUE: AssignElevationsFromSurface(surf, True) dejaba a Z=0,
            # SIN excepcion, vertices ORIGINALES de 4 de las 10 FL de contorno
            # (FL_C04/07/09/10: 207 puntos muertos -> x5 rampas de suplementado
            # -> 1023 vertices envenenados -> volumenes fantasma ~250 m).
            # Las FL_C se siguen creando pero YA NO entran como breaklines.
            # Sustituto equivalente y sin intermediarios: anillo del contorno
            # muestreado cada PASO_ANCLA m con cota REAL del MDT -> AddVertices.
            # ---------------------------------------------------------------- #
            PASO_ANCLA = 2.0
            pc_anclas = Point3dCollection()
            n_ancla = 0
            n_ancla_ko = 0
            for c in contour_xy_lists:
                m_c = len(c)
                for i2 in range(m_c):
                    ax, ay = c[i2]
                    bx, by = c[(i2 + 1) % m_c]
                    seg = ((bx - ax) ** 2 + (by - ay) ** 2) ** 0.5
                    nsub = max(1, int(seg / PASO_ANCLA))
                    for s2 in range(nsub):
                        t2 = float(s2) / float(nsub)
                        px = ax + t2 * (bx - ax)
                        py = ay + t2 * (by - ay)
                        try:
                            z2 = float(mdt_surf.FindElevationAtXY(px, py))
                        except Exception:
                            n_ancla_ko += 1
                            continue
                        pc_anclas.Add(Point3d(px, py, z2))
                        n_ancla += 1
            if pc_anclas.Count > 0:
                try:
                    new_surf.AddVertices(pc_anclas)
                    log.append("Anclas de contorno (v04, paso {:.1f} m): {} puntos, {} sin cota MDT".format(
                        PASO_ANCLA, n_ancla, n_ancla_ko))
                except Exception as ex_anc:
                    log.append("ERROR AddVertices anclas: {}".format(str(ex_anc)[:120]))
            else:
                log.append("AVISO: 0 anclas de contorno generadas ({} sin cota MDT)".format(n_ancla_ko))

            # ---------------------------------------------------------------- #
            # 6. Boundaries  (v03: vertices del boundary con cota REAL)
            #
            # BUG v02: el boundary se pasaba como Point3dCollection con Z=0.0
            # en todos los vertices. Con corte exacto (ultimo param True),
            # Civil 3D INSERTA esos vertices en el TIN con la Z que traen ->
            # cada esquina de contorno sobre datos creaba un embudo a cota 0
            # (1023 vertices anomalos en 121 esquinas; volumenes del Script 4
            # con diferencias fantasma de hasta ~248 m en Zona01/05/09/10).
            #
            # FIX v03 (receta del Script 0 v05): Rebuild previo para poder
            # consultar la superficie recien definida, y cota REAL de la
            # propia superficie (FindElevationAtXY) en cada vertice del
            # contorno. Si un vertice cae fuera de los datos, FindElevation
            # falla y se deja Z=0: ahi no hay triangulo que cortar, no se
            # inyecta vertice (comportamiento identico al v02 en ese caso).
            # ---------------------------------------------------------------- #
            try:
                new_surf.Rebuild()
            except Exception as ex_rb:
                log.append("AVISO Rebuild pre-boundary: {}".format(str(ex_rb)[:100]))
            n_bnd = 0
            n_anc = 0
            n_noz = 0
            first = True
            for c in contour_xy_lists:
                pts_xy = list(c)
                if (pts_xy[0][0], pts_xy[0][1]) != (pts_xy[-1][0], pts_xy[-1][1]):
                    pts_xy.append((pts_xy[0][0], pts_xy[0][1]))
                pc = Point3dCollection()
                for (x, y) in pts_xy:
                    try:
                        z = float(mdt_surf.FindElevationAtXY(x, y))  # v04: cota del MDT (cubre todo el anillo)
                        n_anc += 1
                    except Exception:
                        z = 0.0
                        n_noz += 1
                    pc.Add(Point3d(x, y, z))
                btype = SurfaceBoundaryType.Outer if first else SurfaceBoundaryType.Show
                try:
                    new_surf.BoundariesDefinition.AddBoundaries(pc, 1.0, btype, True)
                    n_bnd += 1
                except Exception as ex_bn:
                    log.append("AVISO boundary: {}".format(ex_bn))
                first = False
            log.append("Boundaries anyadidos: {} (vertices con cota real: {}, fuera de datos: {})".format(
                n_bnd, n_anc, n_noz))

            # ---------------------------------------------------------------- #
            # 7. (v04) AUDITORIA FINAL DE COTAS [LOG-DISCIPLINA]
            # Ningun Z anomalo puede volver a salir de aqui en silencio.
            # ---------------------------------------------------------------- #
            try:
                new_surf.Rebuild()
            except Exception as ex_rb2:
                log.append("AVISO Rebuild final: {}".format(str(ex_rb2)[:100]))
            try:
                zs_aud = []
                for v_aud in new_surf.Vertices:
                    zs_aud.append(v_aud.Location.Z)
                if zs_aud:
                    zs_srt = sorted(zs_aud)
                    z_med = zs_srt[len(zs_srt) // 2]
                    umbral_aud = z_med - 50.0
                    malos_aud = []
                    for v_aud in new_surf.Vertices:
                        loc_aud = v_aud.Location
                        if loc_aud.Z < umbral_aud:
                            malos_aud.append((loc_aud.X, loc_aud.Y, loc_aud.Z))
                    if malos_aud:
                        log.append("")
                        log.append("!!!!!! AUDITORIA Z: {} vertices por debajo de {:.1f} !!!!!!".format(
                            len(malos_aud), umbral_aud))
                        for (xa, ya, za) in malos_aud[:10]:
                            log.append("   ({:.2f}, {:.2f}) Z={:.2f}".format(xa, ya, za))
                        log.append("   -> SUPERFICIE NO VALIDA para volumenes. Revisar antes de continuar.")
                    else:
                        log.append("AUDITORIA Z: OK ({} vertices, minimo {:.2f}, mediana {:.2f})".format(
                            len(zs_aud), zs_srt[0], z_med))
            except Exception as ex_aud:
                log.append("AVISO auditoria Z: {}".format(str(ex_aud)[:120]))

            tr.Commit()
        finally:
            tr.Dispose()
    finally:
        dlock.Dispose()

    log.append("")
    log.append("=== RESUMEN ===")
    log.append("Superficie creada: {}".format(out_surf_name))

    OUT = "\n".join(log)

except Exception as ex:
    OUT = "ERROR:\n" + str(ex) + "\n\n" + traceback.format_exc()
# ----------------------------------------
normalizar_true_convierte_false = BoolSelector(true)  # "NORMALIZAR (True=convierte, False=solo informa)"; graph input
normalizar_geometria_line_pl2d = Python(IN[0]=capa_de_contornos, IN[1]=capa_de_trackers, IN[2]=normalizar_true_convierte_false)  # "NORMALIZAR geometria (LINE/PL2D/PL3D -> LWPOLYLINE)"; CPython3
# ---------- normalizar_geometria_line_pl2d.python (368 lines) ----------
# -*- coding: utf-8 -*-
# =============================================================================
# NORMALIZAR GEOMETRIA v01  -  nodo previo comun a los scripts del pipeline
# =============================================================================
# Los scripts leen contornos, ejes y trackers como LWPOLYLINE. En la practica
# esas capas llegan con LINE sueltas (layouts, DXF), POLYLINE 2D antiguas o
# POLYLINE 3D. Este nodo las normaliza ANTES de que corra el script:
#
#   - LINE      : se encadenan por extremos (tolerancia de empalme TOL_EMPALME)
#                 y cada cadena pasa a ser UNA LWPOLYLINE. Si la cadena cierra
#                 sobre si misma (hueco <= TOL_CIERRE) se marca Closed.
#                 Una LINE aislada -> LWPOLYLINE de 2 vertices.
#   - POLYLINE2D / POLYLINE3D : se reescriben como LWPOLYLINE plana (Z ignorada),
#                 conservando el flag Closed.
#   - LWPOLYLINE: no se toca.
#
# Los originales NO se borran: se mueven a la capa '<capa>_ORIG' (se crea si
# no existe y se deja apagada). Es reversible: mover de vuelta y borrar las
# LWPOLYLINE nuevas.
#
# ENTRADAS (numero variable): IN[0..n-2] nombres de capa (str; vacios se
#   ignoran; tambien acepta listas de str). El ULTIMO input IN[n-1] es
#   APLICAR: True convierte; False solo informa (dry-run).
# SALIDA: OUT = [log_str, n_convertidas]. Conectar OUT como barrera al primer
#   nodo de trabajo del script para forzar que esto corra antes.
# =============================================================================
import math
import time
import traceback

import clr
clr.AddReference('AcMgd')
clr.AddReference('AcCoreMgd')
clr.AddReference('AcDbMgd')

from Autodesk.AutoCAD.ApplicationServices import Application
from Autodesk.AutoCAD.DatabaseServices import (
    OpenMode, Polyline, Polyline2d, Polyline3d, Line,
    SymbolUtilityServices, LayerTableRecord, ObjectId)
from Autodesk.AutoCAD.Geometry import Point2d

TOL_EMPALME = 0.05   # m: dos extremos a menos de esto se consideran unidos
TOL_CIERRE = 0.50    # m: regla del proyecto para contornos visualmente cerrados

# [DYNAMO-DAG] todo dentro de run(): nunca SystemExit a nivel de modulo
def run():
    # ------------------------------ entradas -----------------------------------
    _ins = list(IN)
    if not _ins:
        return ["NORMALIZAR: sin entradas", 0]
    _ap = _ins[-1]
    if isinstance(_ap, str):
        APLICAR = _ap.strip().upper() in ("S", "SI", "TRUE", "1", "V")
    else:
        APLICAR = bool(_ap)
    capas = []
    for v in _ins[:-1]:
        if v is None:
            continue
        if isinstance(v, (list, tuple)):
            for x in v:
                if x is not None and str(x).strip():
                    capas.append(str(x).strip())
        elif str(v).strip():
            capas.append(str(v).strip())
    # dedup conservando orden
    _vist = set()
    capas = [c for c in capas if not (c in _vist or _vist.add(c))]

    L = []


    def w(s=""):
        L.append(str(s))


    t_ini = time.perf_counter()
    w("=" * 72)
    w(" NORMALIZAR GEOMETRIA v01  -  {}".format(
        "APLICAR (convierte)" if APLICAR else "DRY-RUN (solo informa)"))
    w("=" * 72)
    w("capas: {}".format(", ".join(capas) if capas else "(ninguna)"))
    w("tolerancias: empalme {:.2f} m, cierre {:.2f} m".format(TOL_EMPALME, TOL_CIERRE))

    if not capas:
        w("Nada que hacer.")
        w("")
        w("==== RESUMEN DE TIEMPOS ====")
        w("{:<27}{:>7.2f} s".format("TOTAL", time.perf_counter() - t_ini))
        return ["\n".join(L), 0]


    def _key(p):
        """Celda de rejilla para agrupar extremos con tolerancia."""
        return (int(math.floor(p[0] / TOL_EMPALME)),
                int(math.floor(p[1] / TOL_EMPALME)))


    def _cerca(a, b):
        return math.hypot(a[0] - b[0], a[1] - b[1]) <= TOL_EMPALME


    def encadenar(segs):
        """segs: lista de (p_ini, p_fin) 2D. Devuelve lista de (pts, cerrada).
        Recorre cada segmento una sola vez; en bifurcaciones toma el primer
        vecino libre (suficiente para contornos y ejes; los nudos raros se
        reportan como cadenas abiertas y el usuario los ve en el log)."""
        n = len(segs)
        usado = [False] * n
        idx = {}
        for i, (a, b) in enumerate(segs):
            for p in (a, b):
                k = _key(p)
                for dx in (-1, 0, 1):
                    for dy in (-1, 0, 1):
                        idx.setdefault((k[0] + dx, k[1] + dy), []).append(i)
        # dedup listas
        for k in idx:
            vist = set()
            idx[k] = [i for i in idx[k] if not (i in vist or vist.add(i))]

        def vecino_libre(p, excluir):
            for j in idx.get(_key(p), []):
                if usado[j] or j == excluir:
                    continue
                a, b = segs[j]
                if _cerca(p, a):
                    return j, b
                if _cerca(p, b):
                    return j, a
            return None, None

        cadenas = []
        for i in range(n):
            if usado[i]:
                continue
            usado[i] = True
            a, b = segs[i]
            pts = [a, b]
            # extender por el final
            cur = b
            last = i
            while True:
                j, nxt = vecino_libre(cur, last)
                if j is None:
                    break
                usado[j] = True
                pts.append(nxt)
                cur = nxt
                last = j
                if _cerca(cur, pts[0]) and len(pts) > 3:
                    break
            # extender por el principio (si no cerro)
            if not _cerca(pts[-1], pts[0]):
                cur = pts[0]
                last = i
                while True:
                    j, nxt = vecino_libre(cur, last)
                    if j is None:
                        break
                    usado[j] = True
                    pts.insert(0, nxt)
                    cur = nxt
                    last = j
                    if _cerca(pts[0], pts[-1]) and len(pts) > 3:
                        break
            cerrada = False
            if len(pts) >= 4 and math.hypot(pts[0][0] - pts[-1][0],
                                            pts[0][1] - pts[-1][1]) <= TOL_CIERRE:
                cerrada = True
                # si el ultimo punto duplica al primero, quitarlo
                if _cerca(pts[0], pts[-1]):
                    pts = pts[:-1]
            cadenas.append((pts, cerrada))
        return cadenas


    def pts_polyline2d(ent, tr):
        pts = []
        try:
            for vid in ent:
                v = tr.GetObject(vid, OpenMode.ForRead)
                p = v.Position
                pts.append((p.X, p.Y))
        except Exception:
            pts = []
        return pts


    def pts_polyline3d(ent, tr):
        pts = []
        try:
            for vid in ent:
                v = tr.GetObject(vid, OpenMode.ForRead)
                p = v.Position
                pts.append((p.X, p.Y))
        except Exception:
            pts = []
        return pts


    adoc = Application.DocumentManager.MdiActiveDocument
    db = adoc.Database
    n_total_conv = 0
    tiempos = []

    dlock = adoc.LockDocument()
    try:
        tr = db.TransactionManager.StartTransaction()
        try:
            ms_id = SymbolUtilityServices.GetBlockModelSpaceId(db)
            ms = tr.GetObject(ms_id, OpenMode.ForWrite if APLICAR else OpenMode.ForRead)
            lt = tr.GetObject(db.LayerTableId, OpenMode.ForRead)

            # ---- inventario por capa -----------------------------------------
            t0 = time.perf_counter()
            por_capa = {c: {"lw": 0, "line": [], "p2d": [], "p3d": [], "otros": {}}
                        for c in capas}
            for oid in ms:
                try:
                    ent = tr.GetObject(oid, OpenMode.ForRead)
                except Exception:
                    continue
                lay = ent.Layer
                if lay not in por_capa:
                    continue
                d = por_capa[lay]
                if isinstance(ent, Polyline):
                    d["lw"] += 1
                elif isinstance(ent, Line):
                    d["line"].append(oid)
                elif isinstance(ent, Polyline2d):
                    d["p2d"].append(oid)
                elif isinstance(ent, Polyline3d):
                    d["p3d"].append(oid)
                else:
                    try:
                        tn = ent.GetType().Name
                    except Exception:
                        tn = type(ent).__name__
                    d["otros"][tn] = d["otros"].get(tn, 0) + 1
            tiempos.append(("inventario", time.perf_counter() - t0))

            w("")
            w("{:<28}{:>6}{:>7}{:>7}{:>7}  otros".format(
                "capa", "LWPL", "LINE", "PL2D", "PL3D"))
            w("-" * 72)
            for c in capas:
                d = por_capa[c]
                otros = ", ".join("{} x {}".format(v, k) for k, v in
                                  sorted(d["otros"].items())) or "-"
                existe = lt.Has(c)
                w("{:<28}{:>6}{:>7}{:>7}{:>7}  {}{}".format(
                    c[:28], d["lw"], len(d["line"]), len(d["p2d"]),
                    len(d["p3d"]), otros, "" if existe else "   !! CAPA NO EXISTE"))

            # ---- conversion ---------------------------------------------------
            t0 = time.perf_counter()
            for c in capas:
                d = por_capa[c]
                pendientes = len(d["line"]) + len(d["p2d"]) + len(d["p3d"])
                if pendientes == 0:
                    continue
                w("")
                w("[{}]".format(c))

                nuevas = []   # (pts, cerrada, origen)
                # LINE -> cadenas
                if d["line"]:
                    segs = []
                    for oid in d["line"]:
                        ent = tr.GetObject(oid, OpenMode.ForRead)
                        a = ent.StartPoint
                        b = ent.EndPoint
                        segs.append(((a.X, a.Y), (b.X, b.Y)))
                    cadenas = encadenar(segs)
                    n_cer = sum(1 for _, z in cadenas if z)
                    w("  LINE: {} segmentos -> {} cadenas ({} cerradas, {} abiertas)"
                      .format(len(segs), len(cadenas), n_cer, len(cadenas) - n_cer))
                    for pts, cerrada in cadenas:
                        nuevas.append((pts, cerrada, "LINE"))
                for oid in d["p2d"]:
                    ent = tr.GetObject(oid, OpenMode.ForRead)
                    pts = pts_polyline2d(ent, tr)
                    if len(pts) >= 2:
                        nuevas.append((pts, bool(ent.Closed), "PL2D"))
                    else:
                        w("  PL2D handle {}: sin vertices legibles, se deja".format(ent.Handle))
                for oid in d["p3d"]:
                    ent = tr.GetObject(oid, OpenMode.ForRead)
                    pts = pts_polyline3d(ent, tr)
                    if len(pts) >= 2:
                        nuevas.append((pts, bool(ent.Closed), "PL3D"))
                    else:
                        w("  PL3D handle {}: sin vertices legibles, se deja".format(ent.Handle))

                for pts, cerrada, origen in nuevas:
                    w("  {} -> LWPOLYLINE {} vertices{}".format(
                        origen, len(pts), " (cerrada)" if cerrada else ""))

                if not APLICAR:
                    w("  dry-run: {} LWPOLYLINE se crearian; {} originales irian a '{}_ORIG'"
                      .format(len(nuevas), pendientes, c))
                    continue

                # capa destino de la geometria original
                capa_orig = c + "_ORIG"
                if lt.Has(capa_orig):
                    id_orig = lt.get_Item(capa_orig)
                else:
                    lt.UpgradeOpen()
                    ltr = LayerTableRecord()
                    ltr.Name = capa_orig
                    ltr.IsOff = True
                    id_orig = lt.Add(ltr)
                    tr.AddNewlyCreatedDBObject(ltr, True)
                    lt.DowngradeOpen()
                    w("  capa '{}' creada (apagada)".format(capa_orig))
                id_capa = lt.get_Item(c)

                n_new = 0
                for pts, cerrada, origen in nuevas:
                    pl = Polyline()
                    for i, (x, y) in enumerate(pts):
                        pl.AddVertexAt(i, Point2d(x, y), 0.0, 0.0, 0.0)
                    pl.Closed = cerrada
                    pl.LayerId = id_capa
                    ms.AppendEntity(pl)
                    tr.AddNewlyCreatedDBObject(pl, True)
                    n_new += 1
                n_mov = 0
                for oid in d["line"] + d["p2d"] + d["p3d"]:
                    try:
                        ent = tr.GetObject(oid, OpenMode.ForWrite)
                        ent.LayerId = id_orig
                        n_mov += 1
                    except Exception as ex:
                        w("  KO moviendo handle: {}".format(str(ex)[:80]))
                w("  creadas {} LWPOLYLINE; {} originales movidas a '{}'".format(
                    n_new, n_mov, capa_orig))
                n_total_conv += n_new
            tiempos.append(("conversion", time.perf_counter() - t0))

            if APLICAR:
                tr.Commit()
        finally:
            tr.Dispose()
    except Exception:
        w("")
        w("!!!!!! EXCEPCION NO CONTROLADA")
        for linea in traceback.format_exc().split("\n"):
            w("  " + linea)
    finally:
        dlock.Dispose()

    w("")
    w("RESULTADO: {} LWPOLYLINE {}".format(
        n_total_conv, "creadas" if APLICAR else "se crearian (dry-run)"))
    w("")
    w("==== RESUMEN DE TIEMPOS ====")
    for et, sg in tiempos:
        w("{:<27}{:>7.2f} s".format(et, sg))
    w("{:<27}{:>7.2f} s".format("TOTAL", time.perf_counter() - t_ini))

    return ["\n".join(L), n_total_conv]


OUT = run()
# ----------------------------------------
python1_phase_1 = Python(IN[0]=capa_de_contornos, IN[1]=capa_de_trackers, IN[2]=capa_ejes_alignment_layer, IN[3]=tolerancia_agrupacion_m, IN[4]=extension_extremos_m, IN[5]=current, IN[6]=python_tracker_surface, IN[7]=orientacion_ns_eo, IN[8]=normalizar_geometria_line_pl2d)  # CPython3
# ---------- python1_phase_1.python (366 lines) ----------
# IN[8]: BARRERA de sincronizacion del nodo NORMALIZAR (contenido ignorado).
# -*- coding: utf-8 -*-
# =============================================================================
# Tracker_Alignments_Merged.dyn - Python1 (Fase 1)  --  UNIFICADO NS / EO
# Crea polilineas helper en la capa de ejes a partir de contornos y trackers.
# Mantiene los contornos. Borra los trackers originales al terminar. Borra
# tambien los ejes previos de la capa de ejes para permitir re-ejecutar limpio.
#
# ORIENTACION (IN[7]):
#   "NS" -> mesas verticales. Agrupa por COLUMNAS (X). Eje N->S
#           (estacionamiento crece de norte a sur). Contornos ordenados
#           izquierda->derecha (por X minimo).
#   "EO" -> mesas horizontales. Agrupa por FILAS (Y). Eje O->E
#           (estacionamiento crece de oeste a este). Contornos ordenados
#           norte->sur (por Y maximo). Filas numeradas norte->sur.
#   En ambos casos el nombre es AL_Cxx_yy (xx = contorno, yy = grupo).
#
# Sin comprobaciones defensivas de "fuera de contorno" o "coincidencia con
# dos contornos": el layout lo valida un tecnico antes de ejecutar.
#
# Inputs:
#   IN[0] : str    capa de contornos
#   IN[1] : str    capa de trackers
#   IN[2] : str    capa de ejes (e.g. "EJES")
#   IN[3] : float  tolerancia agrupacion (m) -- en NS aplica a X, en EO a Y
#   IN[4] : float  extension extremos (m)
#   IN[5] : Document  Dynamo Document (para forzar orden de ejecucion)
#   IN[6] : any    trigger de orden (Tracker_Surface debe correr antes)
#   IN[7] : str    orientacion: "NS" o "EO"
#
# Output:
#   OUT : Document (passthrough)
# =============================================================================

import clr
import sys
import traceback

clr.AddReference('AcMgd')
clr.AddReference('AcCoreMgd')
clr.AddReference('AcDbMgd')

from Autodesk.AutoCAD.ApplicationServices import Application as AcadApp
from Autodesk.AutoCAD.DatabaseServices import (
    OpenMode, Polyline, Line, SymbolUtilityServices, ObjectId,
    LayerTableRecord
)
from Autodesk.AutoCAD.Geometry import Point2d

contour_layer = str(IN[0])
tracker_layer = str(IN[1])
axis_layer    = str(IN[2])
group_tol     = float(IN[3])
ext_m         = float(IN[4])
dyn_doc_in    = IN[5]
_surface_trigger = IN[6]   # trigger de orden: Tracker_Surface debe correr antes
orientation   = str(IN[7]).strip().upper() if (len(IN) > 7 and IN[7] is not None) else "NS"

log = []

def pip(px, py, poly):
    inside = False
    n = len(poly)
    if n < 3:
        return False
    j = n - 1
    for i in range(n):
        xi, yi = poly[i]
        xj, yj = poly[j]
        if ((yi > py) != (yj > py)) and \
           (px < (xj - xi) * (py - yi) / ((yj - yi) if (yj - yi) != 0 else 1e-12) + xi):
            inside = not inside
        j = i
    return inside

def vertical_intersections(xv, poly):
    # Recta vertical en x=xv: devuelve los Y donde corta el contorno (modo NS).
    ys = []
    n = len(poly)
    for i in range(n):
        x1, y1 = poly[i]
        x2, y2 = poly[(i + 1) % n]
        if x1 == x2:
            continue
        if xv < min(x1, x2) or xv > max(x1, x2):
            continue
        t = (xv - x1) / (x2 - x1)
        if 0.0 <= t <= 1.0:
            ys.append(y1 + t * (y2 - y1))
    return ys

def horizontal_intersections(yv, poly):
    # Recta horizontal en y=yv: devuelve los X donde corta el contorno (modo EO).
    xs = []
    n = len(poly)
    for i in range(n):
        x1, y1 = poly[i]
        x2, y2 = poly[(i + 1) % n]
        if y1 == y2:
            continue
        if yv < min(y1, y2) or yv > max(y1, y2):
            continue
        t = (yv - y1) / (y2 - y1)
        if 0.0 <= t <= 1.0:
            xs.append(x1 + t * (x2 - x1))
    return xs

names_in_order = []
handles_in_order = []

try:
    if orientation not in ("NS", "EO"):
        raise Exception("Orientacion invalida '{}'. Usa 'NS' o 'EO'.".format(orientation))

    doc = AcadApp.DocumentManager.MdiActiveDocument
    db  = doc.Database

    dlock = doc.LockDocument()
    try:
        tr = db.TransactionManager.StartTransaction()
        try:
            ms_id = SymbolUtilityServices.GetBlockModelSpaceId(db)
            btr   = tr.GetObject(ms_id, OpenMode.ForWrite)

            contours = []
            trackers = []
            old_axis_oids = []

            # v03: los trackers pueden ser LWPOLYLINE (primer y ultimo
            # vertice) o LINE (StartPoint/EndPoint). Los ejes helper que crea
            # este mismo script siguen siendo polilineas y se borran igual.
            censo = {}
            n_trk_pl = 0
            n_trk_ln = 0
            for oid in btr:
                obj = tr.GetObject(oid, OpenMode.ForRead)
                es_pl = isinstance(obj, Polyline)
                es_ln = isinstance(obj, Line)
                lay = obj.Layer
                if lay == contour_layer or lay == tracker_layer:
                    try:
                        tipo_obj = obj.GetType().Name
                    except Exception:
                        tipo_obj = type(obj).__name__
                    clave = (lay, tipo_obj)
                    censo[clave] = censo.get(clave, 0) + 1
                if not (es_pl or es_ln):
                    continue
                if es_pl:
                    n = obj.NumberOfVertices
                    if lay == axis_layer:
                        old_axis_oids.append(oid)
                        continue
                    if lay == contour_layer and n >= 3:
                        pts = []
                        for i in range(n):
                            p = obj.GetPoint2dAt(i)
                            pts.append((p.X, p.Y))
                        contours.append(pts)
                    elif lay == tracker_layer and n >= 2:
                        p1 = obj.GetPoint2dAt(0)
                        p2 = obj.GetPoint2dAt(n - 1)
                        xmid = (p1.X + p2.X) / 2.0
                        ymid = (p1.Y + p2.Y) / 2.0
                        trackers.append({"xmid": xmid, "ymid": ymid, "oid": oid})
                        n_trk_pl += 1
                elif lay == tracker_layer:
                    p1 = obj.StartPoint
                    p2 = obj.EndPoint
                    xmid = (p1.X + p2.X) / 2.0
                    ymid = (p1.Y + p2.Y) / 2.0
                    trackers.append({"xmid": xmid, "ymid": ymid, "oid": oid})
                    n_trk_ln += 1

            def _censo_txt(capa):
                filas = ["{} x {}".format(v, k[1]) for k, v in censo.items()
                         if k[0] == capa]
                return ", ".join(sorted(filas)) if filas else "ningun objeto"

            if not contours:
                raise Exception(
                    "No hay polilineas (LWPOLYLINE, >=3 vertices) en la capa "
                    "'{}'. En esa capa hay: {}."
                    .format(contour_layer, _censo_txt(contour_layer)))
            if not trackers:
                raise Exception(
                    "No hay trackers (LWPOLYLINE o LINE) en la capa '{}'. "
                    "En esa capa hay: {}. Comprueba nombre exacto de capa, "
                    "que no esten en un bloque/XREF, y el tipo de objeto."
                    .format(tracker_layer, _censo_txt(tracker_layer)))

            log.append("Orientacion: {}".format(orientation))
            log.append("Contornos: {}".format(len(contours)))
            log.append("Trackers:  {}  (polilineas {}, lineas {})"
                       .format(len(trackers), n_trk_pl, n_trk_ln))

            # Borrar ejes previos (helpers de ejecuciones anteriores)
            n_old_axis = 0
            for oid in old_axis_oids:
                try:
                    o = tr.GetObject(oid, OpenMode.ForWrite)
                    o.Erase()
                    n_old_axis += 1
                except:
                    pass
            if n_old_axis:
                log.append("Ejes previos borrados: {}".format(n_old_axis))

            # Asegurar capa ejes
            lt = tr.GetObject(db.LayerTableId, OpenMode.ForRead)
            axis_layer_id = ObjectId.Null
            if lt.Has(axis_layer):
                try:
                    axis_layer_id = lt.get_Item(axis_layer)
                except:
                    for lid in lt:
                        lrec = tr.GetObject(lid, OpenMode.ForRead)
                        if lrec.Name == axis_layer:
                            axis_layer_id = lid
                            break
            else:
                lt.UpgradeOpen()
                ltr = LayerTableRecord()
                ltr.Name = axis_layer
                axis_layer_id = lt.Add(ltr)
                tr.AddNewlyCreatedDBObject(ltr, True)
                log.append("Capa '{}' creada.".format(axis_layer))

            # ----------------------------------------------------------------
            # Ordenacion de contornos segun orientacion
            # ----------------------------------------------------------------
            if orientation == "NS":
                # izquierda -> derecha por X minimo
                contours_sorted = sorted(contours, key=lambda c: min(p[0] for p in c))
                unidad = "columnas"
            else:  # EO
                # norte -> sur por Y maximo
                contours_sorted = sorted(contours, key=lambda c: -max(p[1] for p in c))
                unidad = "filas"

            # ----------------------------------------------------------------
            # AGRUPACION POR CONTORNO. axes_to_create guarda PUNTOS COMPLETOS
            # (name, (x0,y0), (x1,y1)) para que el dibujo sea comun a ambos modos.
            # ----------------------------------------------------------------
            axes_to_create = []
            for c_idx, cont in enumerate(contours_sorted):
                inside = [t for t in trackers if pip(t["xmid"], t["ymid"], cont)]
                if not inside:
                    log.append("Contorno C{:02d}: 0 trackers dentro".format(c_idx + 1))
                    continue

                if orientation == "NS":
                    # Agrupar por X (columnas), izquierda->derecha
                    inside.sort(key=lambda t: t["xmid"])
                    groups = []
                    cur = [inside[0]]
                    for t in inside[1:]:
                        if t["xmid"] - cur[-1]["xmid"] <= group_tol:
                            cur.append(t)
                        else:
                            groups.append(cur)
                            cur = [t]
                    groups.append(cur)
                    log.append("Contorno C{:02d}: {} trackers -> {} {}".format(
                        c_idx + 1, len(inside), len(groups), unidad))
                    for idx, grp in enumerate(groups):
                        col_x = sum(tt["xmid"] for tt in grp) / len(grp)
                        ys = sorted(vertical_intersections(col_x, cont))
                        if len(ys) < 2:
                            log.append("  grupo[{}] C{:02d} sin interseccion (ys={}) -> saltado".format(
                                idx + 1, c_idx + 1, len(ys)))
                            continue
                        y_min = ys[0]
                        y_max = ys[-1]
                        name = "AL_C{:02d}_{:02d}".format(c_idx + 1, idx + 1)
                        # N->S: vertice 0 arriba (norte), vertice 1 abajo (sur)
                        axes_to_create.append(
                            (name, (col_x, y_max + ext_m), (col_x, y_min - ext_m)))
                else:  # EO
                    # Agrupar por Y (filas), norte->sur (Y descendente)
                    inside.sort(key=lambda t: -t["ymid"])
                    groups = []
                    cur = [inside[0]]
                    for t in inside[1:]:
                        if cur[-1]["ymid"] - t["ymid"] <= group_tol:
                            cur.append(t)
                        else:
                            groups.append(cur)
                            cur = [t]
                    groups.append(cur)
                    log.append("Contorno C{:02d}: {} trackers -> {} {}".format(
                        c_idx + 1, len(inside), len(groups), unidad))
                    for idx, grp in enumerate(groups):
                        row_y = sum(tt["ymid"] for tt in grp) / len(grp)
                        xs = sorted(horizontal_intersections(row_y, cont))
                        if len(xs) < 2:
                            log.append("  grupo[{}] C{:02d} sin interseccion (xs={}) -> saltado".format(
                                idx + 1, c_idx + 1, len(xs)))
                            continue
                        x_min = xs[0]
                        x_max = xs[-1]
                        name = "AL_C{:02d}_{:02d}".format(c_idx + 1, idx + 1)
                        # O->E: vertice 0 al oeste, vertice 1 al este
                        axes_to_create.append(
                            (name, (x_min - ext_m, row_y), (x_max + ext_m, row_y)))

            log.append("Ejes a crear: {}".format(len(axes_to_create)))

            # ----------------------------------------------------------------
            # Crear polilineas helper (comun a ambos modos).
            # vertice 0 = inicio, vertice 1 = fin. El sentido (N->S o O->E)
            # ya viene codificado en el orden de los puntos.
            # ----------------------------------------------------------------
            for (name, p_start, p_end) in axes_to_create:
                pl = Polyline()
                pl.AddVertexAt(0, Point2d(p_start[0], p_start[1]), 0.0, 0.0, 0.0)
                pl.AddVertexAt(1, Point2d(p_end[0],   p_end[1]),   0.0, 0.0, 0.0)
                pl.LayerId = axis_layer_id
                btr.AppendEntity(pl)
                tr.AddNewlyCreatedDBObject(pl, True)
                names_in_order.append(name)
                try:
                    h_str = pl.Handle.ToString()
                except:
                    try:
                        h_str = pl.ObjectId.Handle.ToString()
                    except:
                        h_str = None
                handles_in_order.append(h_str)

            log.append("Polilineas helper creadas: {}".format(len(names_in_order)))

            # Borrar trackers originales (los contornos se mantienen)
            n_t_erased = 0
            for t in trackers:
                try:
                    tr.GetObject(t["oid"], OpenMode.ForWrite).Erase()
                    n_t_erased += 1
                except:
                    pass
            log.append("Trackers originales borrados: {}".format(n_t_erased))
            log.append("Contornos originales: MANTENIDOS")

            tr.Commit()
        finally:
            tr.Dispose()
    finally:
        dlock.Dispose()

    main_mod = sys.modules.get('__main__')
    if main_mod is None:
        import __main__ as main_mod
    main_mod._tracker_align_names   = names_in_order
    main_mod._tracker_align_handles = handles_in_order
    main_mod._tracker_align_log     = "\n".join(log)

    OUT = dyn_doc_in

except Exception as ex:
    main_mod = sys.modules.get('__main__')
    if main_mod is None:
        import __main__ as main_mod
    main_mod._tracker_align_names   = []
    main_mod._tracker_align_handles = []
    main_mod._tracker_align_log     = "ERROR:\n" + str(ex) + "\n\n" + traceback.format_exc()
    OUT = dyn_doc_in
# ----------------------------------------
python_namesgetter = Python(IN[0]=python1_phase_1)  # CPython3
# ---------- python_namesgetter.python (10 lines) ----------
# -*- coding: utf-8 -*-
# Lee la lista de nombres ordenados que Python1 dejo en globales.
# IN[0] es solo para forzar orden de ejecucion (recibe el Document
# de Python1 para asegurar que Python1 ya termino).
import sys
_doc = IN[0]   # passthrough trigger
main_mod = sys.modules.get('__main__')
if main_mod is None:
    import __main__ as main_mod
OUT = list(getattr(main_mod, '_tracker_align_names', []))
# ----------------------------------------
acObjectTypes = AcObjectTypes("Polyline")
modelSpace = Autodesk.AutoCAD.DynamoNodes.Document.ModelSpace(document=python1_phase_1)
acObjectsOfType = AcObjectsOfType(type=acObjectTypes, block=modelSpace)
python_polylinefilter = Python(IN[0]=acObjectsOfType)  # CPython3
# ---------- python_polylinefilter.python (82 lines) ----------
# -*- coding: utf-8 -*-
# PolylineFilter - filtra las polylines de AcObjectsOfType para devolver
# solo las polylines helper creadas por Python1 (Fase 1), en el mismo
# orden que _tracker_align_names.
#
# Usa los Handles (ID unico de AutoCAD) que Python1 guardo en
# _tracker_align_handles. Asi ignoramos las polylines de contornos
# aunque sigan en el ModelSpace.
#
# IN[0] = lista de Dynamo Polylines (salida de AcObjectsOfType)
# OUT   = lista filtrada y reordenada para CreateAlignmentByPolyline

import sys
import traceback

pls_in = IN[0]
if pls_in is None:
    pls = []
elif isinstance(pls_in, list):
    pls = pls_in
else:
    pls = [pls_in]

main_mod = sys.modules.get('__main__')
if main_mod is None:
    import __main__ as main_mod

handles_wanted = list(getattr(main_mod, '_tracker_align_handles', []) or [])

def get_handle(p):
    # 1) propiedad Handle directa
    try:
        h = p.Handle
        if h is not None:
            return str(h)
    except:
        pass
    # 2) via InternalObjectId / ObjectId
    for attr in ('InternalObjectId', 'ObjectId', 'InternalObjectID', 'objectId'):
        try:
            oid = getattr(p, attr)
            if oid is not None:
                return oid.Handle.ToString()
        except:
            pass
    # 3) via InternalDBObject
    try:
        dbo = p.InternalDBObject
        if dbo is not None:
            return dbo.Handle.ToString()
    except:
        pass
    return None

try:
    by_handle = {}
    unknown = 0
    for p in pls:
        h = get_handle(p)
        if h is None:
            unknown += 1
            continue
        by_handle[h] = p

    ordered = []
    missing = 0
    for h in handles_wanted:
        if h in by_handle:
            ordered.append(by_handle[h])
        else:
            missing += 1

    line = "Filter: in={}, wanted={}, matched={}, missing={}, unknown={}".format(
        len(pls), len(handles_wanted), len(ordered), missing, unknown)
    prev = getattr(main_mod, '_tracker_align_log', '') or ''
    main_mod._tracker_align_log = prev + "\n" + line

    OUT = ordered
except Exception as ex:
    prev = getattr(main_mod, '_tracker_align_log', '') or ''
    main_mod._tracker_align_log = prev + "\nFILTER ERROR: " + str(ex) + "\n" + traceback.format_exc()
    OUT = []
# ----------------------------------------
site_vacio_none = StringInput("")  # graph input
estilo_de_alignment = StringInput("Standard")  # graph input
label_set = StringInput("_No Labels")  # graph input
add_curves = BoolSelector(false)  # graph input
createAlignmentByPolyline = Autodesk.Civil.DynamoNodes.AlignmentExtensions.CreateAlignmentByPolyline(name=python_namesgetter, polyline=python_polylinefilter, site=site_vacio_none, layer=capa_ejes_alignment_layer, style=estilo_de_alignment, labelSet=label_set, addCurves=add_curves)
python_loggetter = Python(IN[0]=createAlignmentByPolyline)  # CPython3
# ---------- python_loggetter.python (15 lines) ----------
# -*- coding: utf-8 -*-
# Lee el log que Python1 dejo en globales y lo presenta.
# IN[0] = lista de Alignments creados por el wrapper (solo para
# forzar orden: Python_log corre despues del wrapper).
import sys
_aligns = IN[0]
main_mod = sys.modules.get('__main__')
if main_mod is None:
    import __main__ as main_mod
log_text = getattr(main_mod, '_tracker_align_log', "(sin log)")
try:
    n_al = len(list(_aligns)) if _aligns is not None else 0
except:
    n_al = "?"
OUT = "{}\n\nAlignments procesados por wrapper: {}".format(log_text, n_al)
# ----------------------------------------
log = Watch(python_loggetter)  # graph output
log_surface = Watch(python_tracker_surface)  # graph output

# group: Cadena compartida (Document / Alignments / EndStation / contadores)
count = List.Count(list=createAlignmentByPolyline)
code_block = CodeBlock(n=count) { 1..#n..1; }
string_from_object = FromObject(obj=code_block)
number_insert_idx = DoubleInput(0)
number_offset = DoubleInput(0)
endStation = Autodesk.Civil.DynamoNodes.Alignment.EndStation(alignment=createAlignmentByPolyline)

# group: INPUTS — Terreno Natural (TN)
prefix_TN = StringInput("TN_")  # graph input
style_TN = StringInput("Perfil TN")  # graph input
labelSet_TN = StringInput("Inclinacion porcentaje TN")  # graph input

# group: INPUTS — Trackers (+ Layer compartido)
layer = StringInput("0")  # graph input
prefix_Trackers = StringInput("Trackers_Proyecto")  # graph input
style_Trackers = StringInput("LINEAS TRACKERS")  # graph input
labelSet_Trackers = StringInput("Inclinacion porcentaje Seguidor Modificado")  # graph input

# group: Crea perfil del Terreno Natural en TODOS los alignments
string_insert_tn = String.Insert(string=string_from_object, index=number_insert_idx, toInsert=prefix_TN)
python_delete_tn = Python(IN[0]=createAlignmentByPolyline, IN[1]=string_insert_tn)  # CPython3
# ---------- python_delete_tn.python (85 lines) ----------
# Deletes any existing profile (matching the target name) on each
# alignment before AddProfileBySurface runs. Runs once per execution.
#
# IN[0] : list[Alignment]   (Civil 3D Toolkit / Civil DynamoNodes wrappers)
# IN[1] : list[str]         (target profile names, parallel to IN[0])
# OUT   : list[Alignment]   (the same alignments, passed through)

import clr
import sys
import traceback

clr.AddReference("AcMgd")
clr.AddReference("AcDbMgd")
clr.AddReference("AcCoreMgd")
clr.AddReference("AcCui")

from Autodesk.AutoCAD.ApplicationServices import Application
from Autodesk.AutoCAD.DatabaseServices import OpenMode

alignments = IN[0]
target_names = IN[1]

# Allow scalar inputs (Dynamo sometimes auto-unwraps single-element lists)
if not isinstance(alignments, list):
    alignments = [alignments]
if not isinstance(target_names, list):
    target_names = [target_names]

doc = Application.DocumentManager.MdiActiveDocument
db = doc.Database

deleted = []
errors = []


def get_object_id(wrapper):
    """Robust extraction of an ObjectId from a Civil 3D Dynamo wrapper.
    The Civil3DToolkit / Autodesk Civil DynamoNodes wrappers expose the
    underlying DBObject as ``InternalDBObject``. We try a couple of
    fallbacks rather than guessing."""
    for attr in ("InternalDBObject", "InternalObject", "InternalAlignment"):
        if hasattr(wrapper, attr):
            obj = getattr(wrapper, attr)
            if obj is not None and hasattr(obj, "ObjectId"):
                return obj.ObjectId
    if hasattr(wrapper, "InternalObjectId"):
        return wrapper.InternalObjectId
    return None


doc_lock = doc.LockDocument()
try:
    tr = db.TransactionManager.StartTransaction()
    try:
        n_pairs = min(len(alignments), len(target_names))
        for i in range(n_pairs):
            wrapper = alignments[i]
            target = target_names[i]
            try:
                align_id = get_object_id(wrapper)
                if align_id is None:
                    errors.append("[{0}] no ObjectId from wrapper {1}".format(i, type(wrapper).__name__))
                    continue

                align = tr.GetObject(align_id, OpenMode.ForRead)
                prof_ids = align.GetProfileIds()

                for pid in prof_ids:
                    prof = tr.GetObject(pid, OpenMode.ForRead)
                    if prof.Name == target:
                        prof.UpgradeOpen()
                        prof.Erase()
                        deleted.append("{0} :: {1}".format(i, target))
                        break
            except Exception as ex:
                errors.append("[{0}] {1}: {2}".format(i, target, str(ex)))
        tr.Commit()
    finally:
        tr.Dispose()
finally:
    doc_lock.Dispose()

# Pass the alignments through so downstream AddProfileBySurface can consume them.
# We also tag the result with diagnostics in case the user wants to inspect them.
OUT = alignments
# ----------------------------------------
addprofilebysurface_tn = Autodesk.Civil.DynamoNodes.AlignmentExtensions.AddProfileBySurface(alignment=python_delete_tn, profileName=string_insert_tn, surface=mdt_nombre_del_data_shortcut, layer=layer, style=style_TN, labelSet=labelSet_TN, offset=number_offset, sampleStart=number_offset, sampleEnd=endStation, lacing=Longest)

# group: Crea perfil de Trackers en TODOS los alignments
string_insert_trk = String.Insert(string=string_from_object, index=number_insert_idx, toInsert=prefix_Trackers)
python_delete_trk = Python(IN[0]=createAlignmentByPolyline, IN[1]=string_insert_trk)  # CPython3; same code as python_delete_tn
addprofilebysurface_trk = Autodesk.Civil.DynamoNodes.AlignmentExtensions.AddProfileBySurface(alignment=python_delete_trk, profileName=string_insert_trk, surface=nombre_superficie_trackers, layer=layer, style=style_Trackers, labelSet=labelSet_Trackers, offset=number_offset, sampleStart=number_offset, sampleEnd=endStation, lacing=Longest)

# group: ProfileViews — agrupados por contorno (1 columna por Cxx)
colSpacing = DoubleInput(500)  # graph input
rowSpacing = DoubleInput(162)  # graph input
PV_Prefix = StringInput("PV")  # graph input
python_agrupar_por_contorno = Python(IN[0]=createAlignmentByPolyline, IN[1]=addprofilebysurface_tn, IN[2]=addprofilebysurface_trk, IN[3]=origin_X, IN[4]=origin_Y, IN[5]=colSpacing, IN[6]=rowSpacing, IN[7]=PV_Prefix)  # CPython3
# ---------- python_agrupar_por_contorno.python (136 lines) ----------
# Groups alignments by their 'Cxx' contour tag and lays them out as
# one column per contour. Returns 4 parallel lists for downstream nodes.
#
# IN[0] : list[Alignment]   - alignments (from Alignments node)
# IN[1] : list[Profile]     - TN profiles (SYNC BARRIER, content unused)
# IN[2] : list[Profile]     - Trackers profiles (SYNC BARRIER, content unused)
# IN[3] : float             - Origin X
# IN[4] : float             - Origin Y
# IN[5] : float             - Column spacing
# IN[6] : float             - Row spacing
# IN[7] : str               - Profile View name prefix
#
# OUT : [xs, ys, names, ordered_alignments] - 4 parallel sublists

import re
import clr

clr.AddReference("AcMgd")
clr.AddReference("AcDbMgd")
clr.AddReference("AcCoreMgd")
from Autodesk.AutoCAD.ApplicationServices import Application
from Autodesk.AutoCAD.DatabaseServices import OpenMode

alignments  = IN[0]
origin_x    = float(IN[3])
origin_y    = float(IN[4])
col_spacing = float(IN[5])
row_spacing = float(IN[6])
pv_prefix   = str(IN[7])

# Allow scalar inputs
if not isinstance(alignments, list):
    alignments = [alignments]

# Regex: first 'Cxx' in the name (case-insensitive). Captures the digits.
contour_re = re.compile(r"C(\d+)", re.IGNORECASE)

doc = Application.DocumentManager.MdiActiveDocument
db = doc.Database


def get_align_name(wrapper):
    """Return the alignment name. Try the wrapper's .Name first
    (works for Civil 3D Toolkit and Autodesk.Civil.DynamoNodes wrappers).
    Fall back to opening the underlying CivilDB Alignment in a transaction."""
    # Direct property on the wrapper
    if hasattr(wrapper, "Name"):
        try:
            n = wrapper.Name
            if n is not None:
                return str(n)
        except Exception:
            pass

    # Fallback: read from the underlying DBObject inside a transaction
    obj_id = None
    for attr in ("InternalDBObject", "InternalObject", "InternalAlignment"):
        if hasattr(wrapper, attr):
            obj = getattr(wrapper, attr)
            if obj is not None and hasattr(obj, "ObjectId"):
                obj_id = obj.ObjectId
                break
    if obj_id is None and hasattr(wrapper, "InternalObjectId"):
        obj_id = wrapper.InternalObjectId
    if obj_id is None:
        return None

    name = None
    doc_lock = doc.LockDocument()
    try:
        tr = db.TransactionManager.StartTransaction()
        try:
            entity = tr.GetObject(obj_id, OpenMode.ForRead)
            name = str(entity.Name)
            tr.Commit()
        finally:
            tr.Dispose()
    finally:
        doc_lock.Dispose()
    return name


# ---- Parse + group by contour ----
groups = {}        # int contour_id -> list of (name, wrapper)
unmatched = []

for w in alignments:
    name = get_align_name(w)
    if name is None:
        unmatched.append(w)
        continue
    m = contour_re.search(name)
    if not m:
        unmatched.append(w)
        continue
    cid = int(m.group(1))
    groups.setdefault(cid, []).append((name, w))

# Sort entries within each contour by full name (lexicographic), so that
# AL_C01_01 < AL_C01_02 < AL_C01_10 ...  We also pad numeric tail to ensure
# correct ordering for double-digit row indices.
def natural_key(s):
    return [int(t) if t.isdigit() else t.lower()
            for t in re.split(r"(\d+)", s)]

for cid in groups:
    groups[cid].sort(key=lambda pair: natural_key(pair[0]))

contour_ids = sorted(groups.keys())

# Append unmatched alignments as a synthetic trailing column
if unmatched:
    groups[-1] = [("", w) for w in unmatched]
    contour_ids.append(-1)

# ---- Layout: one column per contour ----
xs = []
ys = []
names = []
ordered = []

for col_idx, cid in enumerate(contour_ids):
    x = origin_x + col_idx * col_spacing
    pairs = groups[cid]
    for row_idx, (aname, wrapper) in enumerate(pairs):
        y = origin_y + row_idx * row_spacing
        if cid >= 0:
            pv_name = "{0}_C{1:02d}_{2:02d}".format(pv_prefix, cid, row_idx + 1)
        else:
            pv_name = "{0}_UNGROUPED_{1:02d}".format(pv_prefix, row_idx + 1)
        xs.append(x)
        ys.append(y)
        names.append(pv_name)
        ordered.append(wrapper)

OUT = [xs, ys, names, ordered]
# ----------------------------------------
codeblock_split_xs_ys_names_aln = CodeBlock(inp=python_agrupar_por_contorno) { inp[0]; inp[1]; inp[2]; inp[3]; }
byCoordinates = Point.ByCoordinates(x=codeblock_split_xs_ys_names_aln.out0, y=codeblock_split_xs_ys_names_aln.out1, z=number_offset)
bandSet = StringInput("TRAKERS PROFILE LYNKA")  # graph input
style = StringInput("LYNKA PERFIL LONGITUDINAL")  # graph input
byAlignmentPointName = Autodesk.Civil.DynamoNodes.ProfileView.ByAlignmentPointName(alignment=codeblock_split_xs_ys_names_aln.out3, insertPoint=byCoordinates, profileViewName=codeblock_split_xs_ys_names_aln.out2, bandSet=bandSet, style=style)

# group: Post-proceso: limpiar SampleLines, Labels PVI y Polylines EJES
python_borrar_samplelines = Python(IN[0]=createAlignmentByPolyline, IN[1]=byAlignmentPointName, IN[2]=capa_ejes_alignment_layer)  # CPython3
# ---------- python_borrar_samplelines.python (219 lines) ----------
# Post-proceso: limpia SampleLines, etiquetas PVI y Polylines EJES.
#
# PASS 1: por cada alignment, borra SampleLineGroups + SampleLines.
# PASS 2: barre ModelSpace borrando SampleLine huerfanas.
# PASS 3: SOLO borra etiquetas PVI (GetPVILabelGroupIds). NO toca bandas.
# PASS 4: borra Polylines de la capa de ejes.
#
# IN[0] : list[Alignment]   - alignments
# IN[1] : list[ProfileView] - barrera de sincronizacion
# IN[2] : str               - nombre de la capa de ejes

import clr

clr.AddReference("AcMgd")
clr.AddReference("AcDbMgd")
clr.AddReference("AcCoreMgd")
clr.AddReference("AeccDbMgd")

from Autodesk.AutoCAD.ApplicationServices import Application
from Autodesk.AutoCAD.DatabaseServices import (
    OpenMode, SymbolUtilityServices, Polyline
)
from Autodesk.Civil.DatabaseServices import SampleLine, SampleLineGroup


def to_list(x):
    if x is None:
        return []
    if isinstance(x, list):
        return x
    try:
        return list(x)
    except TypeError:
        return [x]


def get_object_id(wrapper):
    for attr in ("InternalDBObject", "InternalObject", "InternalAlignment"):
        if hasattr(wrapper, attr):
            obj = getattr(wrapper, attr)
            if obj is not None and hasattr(obj, "ObjectId"):
                return obj.ObjectId
    if hasattr(wrapper, "InternalObjectId"):
        return wrapper.InternalObjectId
    return None


alignments = to_list(IN[0])
axis_layer = str(IN[2]) if IN[2] is not None else ""

doc = Application.DocumentManager.MdiActiveDocument
db = doc.Database

sl_targeted = 0
slg_targeted = 0
sl_sweep = 0
pvi_labels_deleted = 0
polys_deleted = 0
errors = []

doc_lock = doc.LockDocument()
try:
    tr = db.TransactionManager.StartTransaction()
    try:
        # ================================================================
        # PASS 1: targeted SampleLine cleanup per alignment
        # ================================================================
        for i, wrapper in enumerate(alignments):
            try:
                al_id = get_object_id(wrapper)
                if al_id is None:
                    errors.append("[{0}] no ObjectId".format(i))
                    continue
                align = tr.GetObject(al_id, OpenMode.ForRead)
                try:
                    slg_id_coll = align.GetSampleLineGroupIds()
                except Exception as ex:
                    errors.append("[{0}] GetSLG: {1}".format(i, str(ex)))
                    continue
                slg_id_list = []
                for slg_id in slg_id_coll:
                    slg_id_list.append(slg_id)
                for slg_id in slg_id_list:
                    try:
                        slg = tr.GetObject(slg_id, OpenMode.ForRead)
                        sl_id_list = []
                        for sl_id in slg.GetSampleLineIds():
                            sl_id_list.append(sl_id)
                        for sl_id in sl_id_list:
                            try:
                                sl = tr.GetObject(sl_id, OpenMode.ForWrite)
                                sl.Erase()
                                sl_targeted += 1
                            except Exception as ex:
                                errors.append("[{0}] erase SL: {1}".format(i, str(ex)))
                        slg.UpgradeOpen()
                        slg.Erase()
                        slg_targeted += 1
                    except Exception as ex:
                        errors.append("[{0}] erase SLG: {1}".format(i, str(ex)))
            except Exception as ex:
                errors.append("[{0}] pass1: {1}".format(i, str(ex)))

        # ================================================================
        # PASS 2: sweep ModelSpace for orphan SampleLines
        # ================================================================
        try:
            ms_id = SymbolUtilityServices.GetBlockModelSpaceId(db)
            ms = tr.GetObject(ms_id, OpenMode.ForRead)
            ent_ids = []
            for oid in ms:
                ent_ids.append(oid)
            for oid in ent_ids:
                try:
                    ent = tr.GetObject(oid, OpenMode.ForRead)
                    if isinstance(ent, SampleLine):
                        ent.UpgradeOpen()
                        ent.Erase()
                        sl_sweep += 1
                except Exception:
                    pass
        except Exception as ex:
            errors.append("sweep SL: {0}".format(str(ex)))

        # ================================================================
        # PASS 3: delete PVI labels ONLY (NO toca bandas ni otras labels)
        # ================================================================
        for i, wrapper in enumerate(alignments):
            try:
                al_id = get_object_id(wrapper)
                if al_id is None:
                    continue
                align = tr.GetObject(al_id, OpenMode.ForRead)
                prof_ids = align.GetProfileIds()
                prof_id_list = []
                for pid in prof_ids:
                    prof_id_list.append(pid)
                for pid in prof_id_list:
                    try:
                        prof = tr.GetObject(pid, OpenMode.ForRead)
                        # SOLO GetPVILabelGroupIds
                        fn = getattr(prof, "GetPVILabelGroupIds", None)
                        if fn is not None:
                            try:
                                label_ids = fn()
                                lid_list = []
                                for lid in label_ids:
                                    lid_list.append(lid)
                                for lid in lid_list:
                                    try:
                                        lbl = tr.GetObject(lid, OpenMode.ForWrite)
                                        lbl.Erase()
                                        pvi_labels_deleted += 1
                                    except Exception:
                                        pass
                            except Exception as ex:
                                errors.append("[{0}] GetPVILabelGroupIds: {1}".format(i, str(ex)))
                    except Exception as ex:
                        errors.append("[{0}] pass3 prof: {1}".format(i, str(ex)))
            except Exception as ex:
                errors.append("[{0}] pass3: {1}".format(i, str(ex)))

        # Fallback sweep: SOLO PVILabel (no ProfileLabel generico)
        if pvi_labels_deleted == 0:
            try:
                ms_id = SymbolUtilityServices.GetBlockModelSpaceId(db)
                ms = tr.GetObject(ms_id, OpenMode.ForRead)
                ent_ids2 = []
                for oid in ms:
                    ent_ids2.append(oid)
                for oid in ent_ids2:
                    try:
                        ent = tr.GetObject(oid, OpenMode.ForRead)
                        tn = ent.GetType().Name
                        if "PVILabel" in tn:
                            ent.UpgradeOpen()
                            ent.Erase()
                            pvi_labels_deleted += 1
                    except Exception:
                        pass
            except Exception as ex:
                errors.append("sweep PVI: {0}".format(str(ex)))

        # ================================================================
        # PASS 4: delete helper Polylines on the EJES layer
        # ================================================================
        if axis_layer:
            try:
                ms_id = SymbolUtilityServices.GetBlockModelSpaceId(db)
                ms = tr.GetObject(ms_id, OpenMode.ForRead)
                ent_ids3 = []
                for oid in ms:
                    ent_ids3.append(oid)
                for oid in ent_ids3:
                    try:
                        ent = tr.GetObject(oid, OpenMode.ForRead)
                        if isinstance(ent, Polyline) and ent.Layer == axis_layer:
                            ent.UpgradeOpen()
                            ent.Erase()
                            polys_deleted += 1
                    except Exception:
                        pass
            except Exception as ex:
                errors.append("sweep EJES: {0}".format(str(ex)))

        tr.Commit()
    finally:
        tr.Dispose()
finally:
    doc_lock.Dispose()

OUT = {
    "sl_deleted_targeted": sl_targeted,
    "slg_deleted_targeted": slg_targeted,
    "sl_deleted_sweep": sl_sweep,
    "pvi_labels_deleted": pvi_labels_deleted,
    "polys_ejes_deleted": polys_deleted,
    "errors": errors,
}
# ----------------------------------------

# group: Paso final: Proyectar FL de trackers a las ProfileViews (via AECCPROJECTOBJECTSTOPROF + Auto-OK)
patron_nombre_fl_al_final = StringInput("FL_T*")  # "Patron nombre FL (* al final = prefijo; ',' = varios)"; graph input
tolerancia_matching_fl_alignment = DoubleInput(1)  # "Tolerancia matching FL-alignment (m)"; graph input
estilo_proyeccion_fl_ref = StringInput("")  # graph input
intentar_suprimir_dialogos_best = BoolSelector(true)  # "Intentar suprimir dialogos (best-effort)"; graph input
ruta_archivo_temporal = StringInput("C:\Temp\proyeccion_fl.txt")  # "Ruta archivo temporal intercambio LISP"; graph input
auto_ok_dialogos_via_powershell = BoolSelector(true)  # graph input
python_proyectar_fl = Python(IN[0]=codeblock_split_xs_ys_names_aln.out2, IN[1]=patron_nombre_fl_al_final, IN[2]=tolerancia_matching_fl_alignment, IN[3]=estilo_proyeccion_fl_ref, IN[4]=intentar_suprimir_dialogos_best, IN[5]=ruta_archivo_temporal, IN[6]=python_borrar_samplelines, IN[7]=auto_ok_dialogos_via_powershell)  # "Python: proyectar FL (AECCPROJECTOBJECTSTOPROF)"; CPython3
# ---------- python_proyectar_fl.python (1375 lines) ----------
# -*- coding: utf-8 -*-
# =============================================================================
# Proyectar_FL_a_PerfilLongitudinal.dyn
#
# Proyecta Feature Lines de una capa dada a las ProfileViews de los alignments
# indicados, invocando el comando nativo de Civil 3D:
#
#   _.AECCPROJECTOBJECTSTOPROF
#
# El comando NO esta expuesto en la API de Civil 3D 2024 (confirmado en los
# foros de Autodesk). Unica via: LISP enviado por SendStringToExecute.
#
# LIMITACION importante: el comando abre un dialogo modal ("Project Objects
# To Profile View") por cada invocacion, pidiendo estilo de proyeccion y
# label. El dialogo no se puede suprimir via FILEDIA/CMDDIA en C3D 2024.
# Mitigacion: el dialogo recuerda la ultima configuracion. Tras el primer
# OK, los siguientes se aceptan con Enter.
#
# ENTRADAS:
#   IN[0] : list[str]        NOMBRES DE PROFILE VIEWS a procesar. Cada
#                             item es un string tipo 'PV_C01_01'. Para
#                             cada PV, el script obtiene su alignment
#                             via pv.AlignmentId (no hay ambiguedad).
#                             Tambien acepta wrappers Dynamo si tienen
#                             .Name legible, pero el caso comun es el
#                             de nombres desde el code block de split.
#   IN[1] : str              PATRON DE NOMBRE de las Feature Lines a
#                             proyectar. Se admite sufijo comodin '*'.
#                             Ej: 'FL_T*' (todas las FL de tracker
#                             generadas por el pipeline).
#                             Tambien acepta varios patrones separados
#                             por coma: 'FL_T*,FL_C*'.
#                             Se ignora la capa y se filtra solo por
#                             nombre, porque el pipeline crea los FLs
#                             con nombres conocidos (FL_Txx, FL_Cxx).
#   IN[2] : float            tolerancia maxima (m) para considerar que una
#                             FL pertenece al perfil de un alignment. Se
#                             mide como distancia perpendicular del punto
#                             medio de la FL al polyline del alignment.
#   IN[3] : str (opcional)   nombre del estilo de proyeccion para FeatureLine.
#                             Se muestra como referencia en el log; el estilo
#                             real del dialogo se controla manualmente la
#                             primera vez y se recuerda despues.
#   IN[4] : bool             si True, intenta suprimir dialogos con
#                             FILEDIA/CMDDIA (best effort, normalmente
#                             NO funciona en C3D custom dialogs pero es
#                             inofensivo).
#   IN[5] : str              ruta del archivo temporal a usar para el
#                             intercambio con el LISP. Default: C:\\Temp\\
#                             proyeccion_fl.txt
#   IN[6] : any (opcional)   BARRERA DE SINCRONIZACION. Cualquier cosa
#                             conectada aqui (p.ej. el output del nodo
#                             de limpieza previo) fuerza a este nodo a
#                             ejecutarse DESPUES. El contenido se ignora.
#   IN[7] : bool (opcional)  AUTO-OK. Si True, lanza un script PowerShell
#                             en paralelo que detecta el dialogo "Project
#                             Objects To Profile View" y le envia Enter
#                             automaticamente. Usa los estilos configurados
#                             la ultima vez (Civil 3D los recuerda).
#                             Si False, el usuario pulsa OK manualmente.
#
# SALIDA: [log, comando_enviado_preview]
# =============================================================================

import clr
import os
import traceback

clr.AddReference("AcMgd")
clr.AddReference("AcDbMgd")
clr.AddReference("AcCoreMgd")
clr.AddReference("AeccDbMgd")

from Autodesk.AutoCAD.ApplicationServices import Application
from Autodesk.AutoCAD.DatabaseServices import (
    OpenMode, SymbolUtilityServices, ObjectId
)
from Autodesk.Civil.ApplicationServices import CivilApplication
from Autodesk.Civil.DatabaseServices import FeatureLine, ProfileView


# ============================================================================
# Inputs
# ============================================================================
alignments = IN[0] if IN[0] is not None else []
if not isinstance(alignments, list):
    alignments = [alignments]

fl_layer    = str(IN[1]).strip() if IN[1] else ""
# Parse patterns. Accept comma-separated list. '*' at end is prefix match.
_pat_list = [p.strip() for p in fl_layer.split(",") if p.strip()]

def _fl_name_matches(name):
    """Matcher simple, sin closures, evita cualquier edge case raro."""
    if not _pat_list or not name:
        return False
    # Normalizar a Python str por si pythonnet devuelve System.String
    try:
        name = str(name)
    except Exception:
        return False
    for pat in _pat_list:
        pat = str(pat)
        if pat.endswith("*"):
            if name.startswith(pat[:-1]):
                return True
        else:
            if name == pat:
                return True
    return False

# Debug: lista de (name, matched) de los primeros N FLs procesados
_match_debug = []
_MATCH_DEBUG_N = 5
tolerance   = float(IN[2]) if IN[2] is not None else 1.5
proj_style  = str(IN[3]).strip() if (len(IN) > 3 and IN[3]) else ""
suppress_dl = bool(IN[4]) if (len(IN) > 4 and IN[4] is not None) else True
tmp_file    = str(IN[5]) if (len(IN) > 5 and IN[5]) else r"C:\Temp\proyeccion_fl.txt"

# IN[6]: barrera de sincronizacion. Contenido ignorado; solo forzamos la
# lectura para que Dynamo marque la dependencia en el grafo.
_sync_barrier = IN[6] if len(IN) > 6 else None
_ = _sync_barrier

# IN[7]: auto-OK via PowerShell
auto_ok = bool(IN[7]) if (len(IN) > 7 and IN[7] is not None) else False

# Asegurar carpeta del temp_file
try:
    tmp_dir = os.path.dirname(tmp_file)
    if tmp_dir and not os.path.isdir(tmp_dir):
        os.makedirs(tmp_dir)
except Exception:
    pass

log = []
log.append("=== Proyectar FL a Profile View ===")
log.append("Patron(es) nombre FL: {}".format(
    _pat_list if _pat_list else "(ninguno — nada que proyectar)"))
log.append("Tolerancia matching: {:.2f} m".format(tolerance))
log.append("Auto-OK dialogos: {}".format("SI" if auto_ok else "NO"))
log.append("Estilo proyeccion: '{}'".format(proj_style or "(default)"))
log.append("Suprimir dialogos best-effort: {}".format(suppress_dl))
log.append("Archivo temp: {}".format(tmp_file))


# ============================================================================
# Helpers
# ============================================================================

def get_object_id(wrapper):
    """Misma pauta que en los otros .dyn del proyecto."""
    for attr in ("InternalDBObject", "InternalObject", "InternalAlignment"):
        if hasattr(wrapper, attr):
            obj = getattr(wrapper, attr)
            if obj is not None and hasattr(obj, "ObjectId"):
                return obj.ObjectId
    if hasattr(wrapper, "InternalObjectId"):
        return wrapper.InternalObjectId
    return None


def find_alignment_by_name(cdoc, tr, name):
    """Busca un alignment por nombre. Misma pauta que en otros scripts."""
    try:
        ids = cdoc.GetAlignmentIds()
        for i in range(ids.Count):
            try:
                aid = ids.get_Item(i)
            except Exception:
                try:
                    aid = ids[i]
                except Exception:
                    continue
            try:
                a = tr.GetObject(aid, OpenMode.ForRead)
                try:
                    if a.Name == name:
                        return aid, a
                except Exception:
                    pass
            except Exception:
                pass
    except Exception:
        pass
    return None, None


def resolve_alignment(item, cdoc, tr):
    """Recibe un item de IN[0]. Si es string, busca por nombre. Si es
    wrapper Dynamo, extrae ObjectId. Devuelve (alignment_id, alignment_obj,
    display_name) o (None, None, display_name).
    """
    # Caso 1: string con nombre de alignment
    if isinstance(item, str):
        aid, a = find_alignment_by_name(cdoc, tr, item)
        return aid, a, item
    # Caso 2: wrapper
    try:
        aid = get_object_id(item)
        if aid is not None:
            a = tr.GetObject(aid, OpenMode.ForRead)
            try:
                name = a.Name
            except Exception:
                name = "<unnamed>"
            return aid, a, name
    except Exception:
        pass
    return None, None, str(item)[:40]


def point_to_segment_distance(px, py, ax, ay, bx, by):
    """Distancia perpendicular 2D de P a la recta que pasa por A-B.
    Si la proyeccion cae fuera del segmento, devuelve la distancia al
    extremo mas cercano.
    """
    dx = bx - ax
    dy = by - ay
    if dx * dx + dy * dy < 1e-12:
        ddx = px - ax
        ddy = py - ay
        return (ddx * ddx + ddy * ddy) ** 0.5
    t = ((px - ax) * dx + (py - ay) * dy) / (dx * dx + dy * dy)
    if t < 0.0:
        t = 0.0
    elif t > 1.0:
        t = 1.0
    qx = ax + t * dx
    qy = ay + t * dy
    ddx = px - qx
    ddy = py - qy
    return (ddx * ddx + ddy * ddy) ** 0.5


def alignment_xy_at_station(alignment, station, diag=None):
    """Devuelve (x, y) en la estacion. Prueba 4 metodos (mismo patron
    que PerfilesRasantesCorredores.dyn). Si diag no es None apunta ahi
    los errores para diagnostico.
    """
    import System
    from System import Double
    errors = []

    # Metodo A: out params vuelven como tupla (CPython3 pythonnet default)
    try:
        result = alignment.PointLocation(float(station), 0.0)
        if isinstance(result, (tuple, list)):
            if len(result) >= 2:
                return float(result[0]), float(result[1])
            errors.append("A: tupla con {} elems".format(len(result)))
        elif result is None:
            errors.append("A: returno None")
        else:
            errors.append("A: tipo={}".format(type(result).__name__))
    except Exception as e:
        errors.append("A: " + str(e)[:100])

    # Metodo B: clr.Reference[Double]
    try:
        e_ref = clr.Reference[Double](0.0)
        n_ref = clr.Reference[Double](0.0)
        alignment.PointLocation(float(station), 0.0, e_ref, n_ref)
        return float(e_ref.Value), float(n_ref.Value)
    except Exception as e:
        errors.append("B: " + str(e)[:100])

    # Metodo C: StrongBox
    try:
        from System.Runtime.CompilerServices import StrongBox
        e_box = StrongBox[Double](0.0)
        n_box = StrongBox[Double](0.0)
        alignment.PointLocation(float(station), 0.0, e_box, n_box)
        return float(e_box.Value), float(n_box.Value)
    except Exception as e:
        errors.append("C: " + str(e)[:100])

    # Metodo D: reflexion para llamar con System.Double refs
    try:
        ct = clr.GetClrType(alignment.GetType())
        for m in ct.GetMethods():
            if m.Name == "PointLocation":
                ps = m.GetParameters()
                if len(ps) == 4:
                    args = System.Array[System.Object]([
                        float(station), 0.0, 0.0, 0.0])
                    m.Invoke(alignment, args)
                    return float(args[2]), float(args[3])
    except Exception as e:
        errors.append("D: " + str(e)[:100])

    if diag is not None:
        diag.extend(errors)
    return None, None


def align_vertices_2d(alignment, log=None, diagnose=False):
    """Devuelve vertices 2D (x,y) del alignment.
    Muestrea cada ~10m; con alineaciones casi-rectas de tracker basta.
    Si diagnose=True, captura errores de la 1a muestra en log.
    """
    pts = []
    try:
        start = alignment.StartingStation
        end   = alignment.EndingStation
    except Exception as ex:
        if log is not None:
            log.append("  align Station error: " + str(ex)[:100])
        return pts

    length = end - start
    if length <= 0:
        return pts
    step = max(1.0, min(10.0, length / 15.0))

    first_diag = [] if diagnose else None
    s = start
    idx = 0
    while s <= end + 1e-6:
        diag = first_diag if (diagnose and idx == 0) else None
        x, y = alignment_xy_at_station(alignment, s, diag)
        if x is not None:
            pts.append((x, y))
        s += step
        idx += 1
    # Incluir extremo final
    try:
        x, y = alignment_xy_at_station(alignment, end, None)
        if x is not None:
            if not pts or (abs(pts[-1][0] - x) > 0.01 or
                           abs(pts[-1][1] - y) > 0.01):
                pts.append((x, y))
    except Exception:
        pass

    if diagnose and log is not None and first_diag:
        log.append("  [DIAG 1a muestra] " + " | ".join(first_diag))

    return pts


def min_distance_point_to_polyline(px, py, poly_pts):
    """Distancia minima de (px,py) a la polyline formada por poly_pts."""
    if len(poly_pts) < 2:
        return float("inf")
    dmin = float("inf")
    for i in range(len(poly_pts) - 1):
        ax, ay = poly_pts[i]
        bx, by = poly_pts[i + 1]
        d = point_to_segment_distance(px, py, ax, ay, bx, by)
        if d < dmin:
            dmin = d
    return dmin


def get_name_safe(obj):
    try:
        return obj.Name
    except Exception:
        return None


def find_pv_for_alignment_id(cdoc, tr, db, alignment_id, alignment_obj,
                             align_name, log):
    """Busca la ProfileView asociada al alignment.
    Devuelve (pv_handle_str, pv_objectid, pv_name) o (None, None, None).
    Mismo patron que en PerfilesRasantesCorredores / Trackers...dyn.
    """
    # Metodo 1: GetProfileViewIds
    try:
        pv_ids = alignment_obj.GetProfileViewIds()
        for i in range(pv_ids.Count):
            try:
                pvid = pv_ids.get_Item(i)
            except Exception:
                try:
                    pvid = pv_ids[i]
                except Exception:
                    continue
            try:
                pv = tr.GetObject(pvid, OpenMode.ForRead)
                pv_name = get_name_safe(pv)
                handle_str = pv.Handle.ToString()
                return handle_str, pvid, pv_name
            except Exception:
                pass
    except Exception:
        pass

    # Metodo 2: iterar BlockTable (ModelSpace + Layouts)
    try:
        bt = tr.GetObject(db.BlockTableId, OpenMode.ForRead)
        for btr_id in bt:
            try:
                btr = tr.GetObject(btr_id, OpenMode.ForRead)
                for oid in btr:
                    try:
                        obj = tr.GetObject(oid, OpenMode.ForRead)
                        if isinstance(obj, ProfileView):
                            try:
                                if obj.AlignmentId == alignment_id:
                                    pv_name = get_name_safe(obj)
                                    handle_str = obj.Handle.ToString()
                                    return handle_str, oid, pv_name
                            except Exception:
                                pass
                    except Exception:
                        pass
            except Exception:
                pass
    except Exception as ex:
        log.append("  [{}] scan PV: {}".format(align_name, str(ex)[:120]))

    return None, None, None


# ============================================================================
# Main
# ============================================================================

doc = Application.DocumentManager.MdiActiveDocument
db  = doc.Database

# Recolectar datos: mapping pv_handle -> (pv_name, align_name, [fl_handles])
mapping = []   # list of (pv_handle, pv_name, align_name, [fl_handles])
n_fl_total = 0
n_fl_matched = 0
n_pv_with_fls = 0

lck = doc.LockDocument()
tr  = db.TransactionManager.StartTransaction()
try:
    cdoc = CivilApplication.ActiveDocument

    # -----------------------------------------------------------------------
    # 1. Recolectar todas las FeatureLines cuyo NOMBRE matchee los patrones
    # -----------------------------------------------------------------------
    # FeatureLines pueden estar en Sites (no siempre en ModelSpace directo).
    # Barremos BlockTable y tambien GetFeatureLineIds() de cada Site.
    # Filtrado SOLO por nombre — la capa depende del CLAYER activo cuando
    # se crearon y puede variar; el nombre es determinista (lo pone el
    # pipeline: FL_Txx, FL_Cxx).
    fl_info = []   # list of (handle_str, midx, midy, dirx, diry, name)
    fl_layer_stats = {}   # layer_name -> count (para diagnostico)
    fl_name_samples = {}  # layer_name -> set(ejemplos de nombres)

    # Contadores de diagnostico para cada fase de la ingesta
    _counters = {
        "total_fls_seen": 0,
        "name_matched":   0,
        "geom_ok":        0,
        "geom_fail":      0,
    }
    _first_geom_err = [None]   # usar lista para poder asignar desde inner fn

    def get_fl_polyline_2d(fl):
        """Devuelve [(x,y),(x,y),...] con al menos 2 puntos, o None + error.
        Intenta 5 metodos distintos porque la firma de GetPoints varia entre
        versiones de Civil 3D y pythonnet no siempre unifica los enums.
        """
        errors = []

        # Metodo 1: StartPoint / EndPoint (propiedades, siempre presentes)
        try:
            sp = fl.StartPoint
            ep = fl.EndPoint
            return [(float(sp.X), float(sp.Y)),
                    (float(ep.X), float(ep.Y))], None
        except Exception as e:
            errors.append("StartPoint/EndPoint: " + str(e)[:100])

        # Metodo 2: GetPoints() sin argumentos
        try:
            pts_raw = fl.GetPoints()
            pts = [(float(p.X), float(p.Y)) for p in pts_raw]
            if len(pts) >= 2:
                return pts, None
            errors.append("GetPoints(): solo {} pts".format(len(pts)))
        except Exception as e:
            errors.append("GetPoints(): " + str(e)[:100])

        # Metodo 3: GetPoints(FeatureLinePointType.AllPoints)
        try:
            from Autodesk.Civil import FeatureLinePointType
            pts_raw = fl.GetPoints(FeatureLinePointType.AllPoints)
            pts = [(float(p.X), float(p.Y)) for p in pts_raw]
            if len(pts) >= 2:
                return pts, None
            errors.append("GetPoints(AllPoints): solo {} pts".format(
                len(pts)))
        except Exception as e:
            errors.append("GetPoints(AllPoints): " + str(e)[:100])

        # Metodo 4: GetPoints(FeatureLinePointType.PIPoint)
        try:
            from Autodesk.Civil import FeatureLinePointType
            pts_raw = fl.GetPoints(FeatureLinePointType.PIPoint)
            pts = [(float(p.X), float(p.Y)) for p in pts_raw]
            if len(pts) >= 2:
                return pts, None
        except Exception as e:
            errors.append("GetPoints(PIPoint): " + str(e)[:100])

        # Metodo 5: reflexion para descubrir la firma real
        try:
            ct = clr.GetClrType(fl.GetType())
            sigs = []
            for m in ct.GetMethods():
                if m.Name == "GetPoints":
                    ps = m.GetParameters()
                    sigs.append("GetPoints({})".format(
                        ",".join(p.ParameterType.Name for p in ps)))
            errors.append("reflexion: " + " | ".join(sigs[:3]))
        except Exception:
            pass

        return None, " || ".join(errors)

    def ingest_fl_object(fl):
        _counters["total_fls_seen"] += 1
        try:
            actual_layer = fl.Layer
        except Exception:
            actual_layer = "<?>"
        try:
            fl_name = fl.Name
        except Exception:
            fl_name = None
        fl_layer_stats[actual_layer] = fl_layer_stats.get(actual_layer, 0) + 1
        if fl_name:
            samples = fl_name_samples.setdefault(actual_layer, set())
            if len(samples) < 3:
                samples.add(fl_name)
        # Debug: grabar los primeros N casos de match check
        matched = _fl_name_matches(fl_name)
        if len(_match_debug) < _MATCH_DEBUG_N:
            _match_debug.append((repr(fl_name), matched))
        if not matched:
            return
        _counters["name_matched"] += 1

        # Extraer geometria
        pts, err = get_fl_polyline_2d(fl)
        if pts is None or len(pts) < 2:
            _counters["geom_fail"] += 1
            if _first_geom_err[0] is None and err:
                _first_geom_err[0] = err
            return

        try:
            xs = [p[0] for p in pts]
            ys = [p[1] for p in pts]
            midx = (xs[0] + xs[-1]) / 2.0
            midy = (ys[0] + ys[-1]) / 2.0
            dx   = xs[-1] - xs[0]
            dy   = ys[-1] - ys[0]
            length = (dx * dx + dy * dy) ** 0.5
            if length < 1e-6:
                _counters["geom_fail"] += 1
                if _first_geom_err[0] is None:
                    _first_geom_err[0] = "length~0"
                return
            handle = fl.Handle.ToString()
            fl_info.append((handle, midx, midy, dx / length, dy / length,
                            fl_name))
            _counters["geom_ok"] += 1
        except Exception as e:
            _counters["geom_fail"] += 1
            if _first_geom_err[0] is None:
                _first_geom_err[0] = "post-geom: " + str(e)[:120]

    # 1a. ModelSpace + todos los BlockTableRecords (por si FLs estan en sites)
    try:
        bt = tr.GetObject(db.BlockTableId, OpenMode.ForRead)
        for btr_id in bt:
            try:
                btr = tr.GetObject(btr_id, OpenMode.ForRead)
                for oid in btr:
                    try:
                        obj = tr.GetObject(oid, OpenMode.ForRead)
                        if isinstance(obj, FeatureLine):
                            ingest_fl_object(obj)
                    except Exception:
                        pass
            except Exception:
                pass
    except Exception as ex:
        log.append("WARN: scan BlockTable: {}".format(str(ex)[:120]))

    # 1b. Sites (algunas FeatureLines estan asociadas a Site y no aparecen
    #     en ModelSpace durante el iterate). Buscar tambien via Sites.
    try:
        site_ids = cdoc.GetSiteIds()
        for i in range(site_ids.Count):
            try:
                sid = site_ids.get_Item(i)
            except Exception:
                try:
                    sid = site_ids[i]
                except Exception:
                    continue
            try:
                site = tr.GetObject(sid, OpenMode.ForRead)
                fl_coll = site.GetFeatureLineIds()
                for j in range(fl_coll.Count):
                    try:
                        fid = fl_coll.get_Item(j)
                    except Exception:
                        try:
                            fid = fl_coll[j]
                        except Exception:
                            continue
                    try:
                        fl = tr.GetObject(fid, OpenMode.ForRead)
                        if isinstance(fl, FeatureLine):
                            # Evitar duplicados: comprobamos que no este ya
                            h = fl.Handle.ToString()
                            if not any(x[0] == h for x in fl_info):
                                ingest_fl_object(fl)
                    except Exception:
                        pass
            except Exception:
                pass
    except Exception:
        pass

    n_fl_total = len(fl_info)
    log.append("FeatureLines que matchean patron(es) {}: {}".format(
        _pat_list, n_fl_total))

    # Contadores por fase
    log.append("  FLs totales vistas:         {}".format(
        _counters["total_fls_seen"]))
    log.append("  FLs que matchean nombre:    {}".format(
        _counters["name_matched"]))
    log.append("  FLs con geometria OK:       {}".format(
        _counters["geom_ok"]))
    log.append("  FLs con geometria FAIL:     {}".format(
        _counters["geom_fail"]))
    if _first_geom_err[0]:
        log.append("  Primer error geometria:   {}".format(
            _first_geom_err[0]))

    # Debug de match: para las primeras 5 FLs, mostrar el nombre tal cual se
    # leyo y si paso el filtro. Permite localizar bugs de encoding / closures.
    if _match_debug:
        log.append("")
        log.append("DEBUG match (primeras {} FLs):".format(len(_match_debug)))
        for rep, m in _match_debug:
            log.append("  name={}  -> match={}".format(rep, m))

    # Mostrar SIEMPRE las capas donde hay FLs + ejemplos de nombres.
    # Asi, aunque el match haya funcionado, el usuario ve que hay otras FLs
    # y puede decidir si extender el patron.
    if fl_layer_stats:
        log.append("")
        log.append("Inventario de FLs en el dibujo:")
        for lyr, cnt in sorted(fl_layer_stats.items(), key=lambda kv: -kv[1]):
            samples = fl_name_samples.get(lyr, set())
            ejemplos = ", ".join(sorted(samples)) if samples else "(sin nombre)"
            log.append("  capa '{}': {} FL(s) | ej. nombres: {}".format(
                lyr, cnt, ejemplos))

    if n_fl_total == 0:
        log.append("")
        log.append("ABORT: ninguna FL matchea el patron. Ajusta IN[1].")

    # -----------------------------------------------------------------------
    # 2. Iteramos PERFIL VIEWS (no alignments): cada item en IN[0] es un
    #    NOMBRE DE PROFILE VIEW. Para cada PV sacamos su alignment via
    #    pv.AlignmentId -- eso evita unwrappear wrappers y da la relacion
    #    1:1 PV-alignment garantizada por Civil 3D.
    # -----------------------------------------------------------------------
    matched_fl_handles = set()  # evitar proyectar la misma FL en varias PVs
    first_diag_iter = True

    # Construir un indice PV-by-name una sola vez para no iterar BT N veces
    # Guardamos tambien el PUNTO DE INSERCION (pv.Location) — el origen
    # geometrico de la rejilla. Ese punto es EXCLUSIVO de la PV (no solapa
    # con MDT, etiquetas, otros objetos), y por tanto es el candidato
    # ideal para el "click sintetico" que le hacemos al comando LISP.
    pv_by_name = {}   # name -> (pv_obj, pv_handle_str, alignment_id, loc_xy)
    pv_loc_debug = []  # primeras 3 muestras para log
    try:
        bt = tr.GetObject(db.BlockTableId, OpenMode.ForRead)
        for btr_id in bt:
            try:
                btr = tr.GetObject(btr_id, OpenMode.ForRead)
                for oid in btr:
                    try:
                        obj = tr.GetObject(oid, OpenMode.ForRead)
                        if isinstance(obj, ProfileView):
                            try:
                                pname = obj.Name
                                phandle = obj.Handle.ToString()
                                paid = obj.AlignmentId
                                # Extraer punto de insercion. La propiedad
                                # varia: algunas versiones lo llaman Location,
                                # otras LocationPoint. Probamos en cadena.
                                loc_xy = None
                                for prop_name in ("Location",
                                                  "LocationPoint"):
                                    try:
                                        pt = getattr(obj, prop_name)
                                        loc_xy = (float(pt.X), float(pt.Y))
                                        break
                                    except Exception:
                                        continue
                                pv_by_name[pname] = (obj, phandle, paid,
                                                     loc_xy)
                                if len(pv_loc_debug) < 3 and loc_xy:
                                    pv_loc_debug.append(
                                        (pname, loc_xy))
                            except Exception:
                                pass
                    except Exception:
                        pass
            except Exception:
                pass
    except Exception as ex:
        log.append("WARN: index PVs: {}".format(str(ex)[:120]))

    log.append("")
    log.append("PVs indexadas: {}".format(len(pv_by_name)))
    if pv_loc_debug:
        log.append("  Puntos de insercion (muestras):")
        for nm, xy in pv_loc_debug:
            log.append("    {} -> X={:.3f} Y={:.3f}".format(
                nm, xy[0], xy[1]))

    for idx, item in enumerate(alignments):
        # En el merged pipeline, `item` es un nombre de PV (p.ej. 'PV_C01_01').
        # Tambien podriamos haber recibido un wrapper — intentar extraer .Name.
        pv_name = None
        if isinstance(item, str):
            pv_name = item.strip()
        else:
            # Probar atributo Name
            try:
                pv_name = str(item.Name)
            except Exception:
                pv_name = None

        if not pv_name:
            log.append("[{}] item sin nombre legible ({}), skip".format(
                idx, type(item).__name__))
            continue

        if pv_name not in pv_by_name:
            log.append("[{}] PV '{}' no localizada en el dibujo, skip".format(
                idx, pv_name))
            continue

        pv_obj, pv_handle, aid, pv_loc = pv_by_name[pv_name]
        # Obtener alignment
        try:
            align = tr.GetObject(aid, OpenMode.ForRead)
            aname = align.Name
        except Exception as ex:
            log.append("[{}] PV '{}': no puedo abrir alignment: {}".format(
                idx, pv_name, str(ex)[:120]))
            continue

        # Muestrear vertices del alignment (diag detallado solo la 1a vez)
        poly_pts = align_vertices_2d(
            align, log=log, diagnose=first_diag_iter)
        first_diag_iter = False
        if len(poly_pts) < 2:
            log.append("[{}] PV '{}' align '{}': PointLocation fallo "
                       "({} vertices), skip".format(
                           idx, pv_name, aname, len(poly_pts)))
            continue

        # Buscar FLs cercanas al alignment
        fl_hs_matched = []
        for (h, midx, midy, dx, dy, fname) in fl_info:
            if h in matched_fl_handles:
                continue
            d = min_distance_point_to_polyline(midx, midy, poly_pts)
            if d <= tolerance:
                fl_hs_matched.append(h)
                matched_fl_handles.add(h)

        if fl_hs_matched:
            mapping.append((pv_handle, pv_name, aname, fl_hs_matched,
                            pv_loc))
            n_fl_matched += len(fl_hs_matched)
            n_pv_with_fls += 1
            log.append("[{}] PV '{}' <- {} FLs (align '{}')".format(
                idx, pv_name, len(fl_hs_matched), aname))
        else:
            log.append("[{}] PV '{}' sin FLs dentro de tolerancia "
                       "(align '{}')".format(idx, pv_name, aname))

    tr.Commit()
except Exception:
    log.append("ERROR matching: " + traceback.format_exc())
    try:
        tr.Abort()
    except Exception:
        pass
finally:
    try:
        tr.Dispose()
    except Exception:
        pass
    try:
        lck.Dispose()
    except Exception:
        pass


log.append("")
log.append("=== RESUMEN MATCHING ===")
log.append("PVs con FLs matched: {}".format(n_pv_with_fls))
log.append("Total FLs matched:  {}".format(n_fl_matched))
log.append("FLs sin match:      {}".format(n_fl_total - n_fl_matched))


# ============================================================================
# 3. Escribir archivo temporal con el mapping
# ============================================================================
# Formato:
#   pv_handle|fl_handle1,fl_handle2,...
#
# Una linea por PV.
# ============================================================================
cmd_preview = ""
try:
    if mapping:
        with open(tmp_file, "w") as f:
            for (pv_h, pv_n, aname, fl_hs, pv_loc) in mapping:
                if pv_loc is None:
                    # No debe pasar, pero nos protegemos
                    log.append("WARN: PV {} sin pv_loc, se omite".format(pv_h))
                    continue
                # Formato: handle|X|Y|fl_h1,fl_h2,...
                f.write("{}|{}|{}|{}\n".format(
                    pv_h, pv_loc[0], pv_loc[1],
                    ",".join(fl_hs)))
        log.append("")
        log.append("Archivo temp escrito: {} ({} lineas)".format(
            tmp_file, len(mapping)))
    else:
        log.append("Sin mapping, no se envia LISP.")
except Exception as ex:
    log.append("ERROR escribir temp: " + str(ex))


# ============================================================================
# 4. Construir y enviar LISP
# ============================================================================
# El LISP:
#   1. Opcional: FILEDIA/CMDDIA=0 (best effort, NO suele funcionar).
#   2. Opcional: (initcommandversion 2) para forzar la ultima version.
#   3. Por cada linea del archivo:
#      a. Parsea pv_handle y fl_handles.
#      b. Construye SelectionSet con los FL (via handent).
#      c. Obtiene ename del PV (via handent).
#      d. Llama (command "_.AECCPROJECTOBJECTSTOPROF" ss "" pv_ent "").
#      e. El dialogo modal aparecera -- pulsar OK.
# ============================================================================

if mapping:
    lisp_path = tmp_file.replace(".txt", ".lsp")
    tmp_file_lisp = tmp_file.replace("\\", "/")   # LISP prefiere forward slashes
    lisp_path_fwd = lisp_path.replace("\\", "/")

    # Construir LISP. Lo escribimos a un archivo y cargamos con (load ...)
    # para evitar problemas de escape en SendStringToExecute.

    lisp_code = '''(defun PROYECTAR-FL-A-PERFILES ( / f ln pos pos2 pv_h fl_str fl_list ss pv_e h ename nfl n_ok n_fail res1 res2 err_msg)
  ;; --- IMPORTANTE: funcion SIN prefijo c: para que NO sea un comando ---
  ;; Asi al invocarla con (PROYECTAR-FL-A-PERFILES) AutoCAD la evalua como
  ;; expresion LISP, CMDACTIVE=0, y (command ...) anidado funciona.
  (setvar "CMDECHO" 1)
  (setq n_ok 0 n_fail 0)
  (setq f (open "__TMP_FILE__" "r"))
  (if (null f)
    (progn (princ "\\nERROR: no abro archivo __TMP_FILE__") (princ))
    (progn
      (while (setq ln (read-line f))
        ;; Linea: pv_handle|X|Y|fl_h1,fl_h2,...
        ;; Los 4 campos se separan por "|" (ascii 124).
        (setq pv_h nil x_str nil y_str nil fl_str nil)
        (setq p1 (vl-string-position 124 ln))
        (if p1
          (progn
            (setq pv_h (substr ln 1 p1))
            (setq rest1 (substr ln (+ p1 2)))
            (setq p2 (vl-string-position 124 rest1))
            (if p2
              (progn
                (setq x_str (substr rest1 1 p2))
                (setq rest2 (substr rest1 (+ p2 2)))
                (setq p3 (vl-string-position 124 rest2))
                (if p3
                  (progn
                    (setq y_str (substr rest2 1 p3))
                    (setq fl_str (substr rest2 (+ p3 2))))))))
)
        (if (and pv_h x_str y_str fl_str)
          (progn
            ;; Parsear X e Y a numeros reales
            (setq pv_pt (list (atof x_str) (atof y_str) 0.0))

            ;; Split fl_str por "," (ascii 44)
            (setq fl_list (list))
            (while (setq pos2 (vl-string-position 44 fl_str))
              (setq fl_list (cons (substr fl_str 1 pos2) fl_list))
              (setq fl_str (substr fl_str (+ pos2 2))))
            (if (> (strlen fl_str) 0)
              (setq fl_list (cons fl_str fl_list)))
            (setq fl_list (reverse fl_list))

            ;; Construir SelectionSet con las FeatureLines
            (setq ss (ssadd))
            (setq nfl 0)
            (foreach h fl_list
              (setq ename (handent h))
              (if ename
                (progn (ssadd ename ss) (setq nfl (1+ nfl)))))

            ;; Obtener entity del PV (para zoom a su bbox)
            (setq pv_e (handent pv_h))

            (if (and pv_e (> nfl 0))
              (progn
                (princ (strcat "\\n>>> PV " pv_h
                               " pt=(" x_str "," y_str ")"
                               " <- " (itoa nfl) " FLs ... "))

                ;; 1. Zoom a la PV (segun bbox del objeto) para que el
                ;;    punto caiga dentro del viewport visible.
                (vl-catch-all-apply
                  '(lambda ()
                     (setq bb_obj (vlax-ename->vla-object pv_e))
                     (setq minpt (vlax-make-safearray vlax-vbDouble '(0 . 2)))
                     (setq maxpt (vlax-make-safearray vlax-vbDouble '(0 . 2)))
                     (vla-GetBoundingBox bb_obj 'minpt 'maxpt)
                     (setq mn (vlax-safearray->list minpt))
                     (setq mx (vlax-safearray->list maxpt))
                     (setq w (- (nth 0 mx) (nth 0 mn)))
                     (setq hh (- (nth 1 mx) (nth 1 mn)))
                     (setq mar_x (* w 0.15))
                     (setq mar_y (* hh 0.15))
                     (vl-cmdf "_.ZOOM" "_W"
                       (list (- (nth 0 mn) mar_x) (- (nth 1 mn) mar_y))
                       (list (+ (nth 0 mx) mar_x) (+ (nth 1 mx) mar_y)))))

                ;; 2. Preseleccion + comando con el PUNTO DE INSERCION
                ;;    que Python calculo (propiedad Location de la PV).
                ;;    Ese punto es el origen de la rejilla — cae siempre
                ;;    sobre la PV y solo sobre la PV.
                (sssetfirst nil ss)
                (setq res1
                  (vl-catch-all-apply 'vl-cmdf
                    (list "_.AECCPROJECTOBJECTSTOPROF" pv_pt "")))
                (if (not (vl-catch-all-error-p res1))
                  (progn
                    (princ "OK")
                    (setq n_ok (1+ n_ok)))
                  (progn
                    (princ (strcat "FAIL err="
                                   (vl-catch-all-error-message res1)))
                    (setq n_fail (1+ n_fail))))
                (sssetfirst nil nil))
              (progn
                (princ (strcat "\\n    SKIP: PV=" pv_h
                               " FL count=" (itoa nfl)))
                (setq n_fail (1+ n_fail)))))))
      (close f)))
  (princ (strcat "\\n\\n=== PROYECTAR-FL: OK=" (itoa n_ok)
                 " FAIL=" (itoa n_fail) " ==="))
  (princ)
)
'''.replace("__TMP_FILE__", tmp_file_lisp)

    # Escribir el LISP
    try:
        with open(lisp_path, "w") as f:
            f.write(lisp_code)
        log.append("LISP escrito: {}".format(lisp_path))
    except Exception as ex:
        log.append("ERROR escribir LISP: " + str(ex))
        mapping = []   # impedir el SendStringToExecute

if mapping:
    # ========================================================================
    # AUTO-OK: lanzar PowerShell en paralelo para pulsar Enter en cada dialogo
    # ========================================================================
    # Se ejecuta ANTES del SendStringToExecute del LISP, como proceso
    # detached, para que ya este monitorizando cuando el LISP empiece a
    # disparar comandos.
    # ========================================================================
    if auto_ok:
        ps_path = tmp_file.replace(".txt", "_auto_ok.ps1")
        n_dialogs = len(mapping)   # maximo de Enter a enviar
        ps_code = r"""# Auto-OK v4: Win32 nativo para dialogos MFC de Civil 3D.
# El dialogo Project Objects To Profile View es un dialogo MFC clasico:
# sus botones son CButton de Win32, no elementos WPF/UIA. Por eso el
# walker UIAutomation los ve vacios. Solucion: localizar los hijos con
# EnumChildWindows y hacerles BM_CLICK directamente via Win32.

param(
    [int]$MaxPresses = __MAXPRESSES__,
    [int]$TimeoutSec = 600
)

$ErrorActionPreference = "SilentlyContinue"
$logPath = "__LOG_PATH__"

function Write-Log {
    param([string]$msg)
    "[$(Get-Date -Format HH:mm:ss.fff)] $msg" |
        Out-File -FilePath $logPath -Encoding UTF8 -Append
}

"" | Out-File -FilePath $logPath -Encoding UTF8
Write-Log "Auto-OK v4 (Win32 nativo) iniciado. MaxPresses=$MaxPresses"

$winapi = @'
using System;
using System.Collections.Generic;
using System.Runtime.InteropServices;
using System.Text;
public class Win {
    public delegate bool EnumWindowsProc(IntPtr hWnd, IntPtr lParam);
    [DllImport("user32.dll")]
    public static extern bool EnumWindows(EnumWindowsProc callback, IntPtr lParam);
    [DllImport("user32.dll")]
    public static extern bool EnumChildWindows(IntPtr hWndParent, EnumWindowsProc callback, IntPtr lParam);
    [DllImport("user32.dll", CharSet = CharSet.Auto)]
    public static extern int GetWindowText(IntPtr hWnd, StringBuilder text, int count);
    [DllImport("user32.dll", CharSet = CharSet.Auto)]
    public static extern int GetClassName(IntPtr hWnd, StringBuilder text, int count);
    [DllImport("user32.dll")]
    public static extern bool IsWindowVisible(IntPtr hWnd);
    [DllImport("user32.dll")]
    public static extern bool IsWindowEnabled(IntPtr hWnd);
    [DllImport("user32.dll")]
    public static extern int GetDlgCtrlID(IntPtr hwndCtl);
    [DllImport("user32.dll", CharSet = CharSet.Auto)]
    public static extern IntPtr SendMessage(IntPtr hWnd, uint Msg, IntPtr wParam, IntPtr lParam);
    [DllImport("user32.dll")]
    public static extern bool PostMessage(IntPtr hWnd, uint Msg, IntPtr wParam, IntPtr lParam);

    public const uint BM_CLICK   = 0x00F5;
    public const uint WM_COMMAND = 0x0111;

    public static List<IntPtr> topHwnds = new List<IntPtr>();
    public static List<IntPtr> ListVisible() {
        topHwnds.Clear();
        EnumWindows(new EnumWindowsProc(EnumTopCallback), IntPtr.Zero);
        return topHwnds;
    }
    private static bool EnumTopCallback(IntPtr hWnd, IntPtr lParam) {
        if (IsWindowVisible(hWnd)) {
            StringBuilder sb = new StringBuilder(512);
            GetWindowText(hWnd, sb, 512);
            if (sb.Length > 0) {
                topHwnds.Add(hWnd);
            }
        }
        return true;
    }

    public static List<IntPtr> childHwnds = new List<IntPtr>();
    public static List<IntPtr> ListChildren(IntPtr parent) {
        childHwnds.Clear();
        EnumChildWindows(parent, new EnumWindowsProc(EnumChildCallback), IntPtr.Zero);
        return childHwnds;
    }
    private static bool EnumChildCallback(IntPtr hWnd, IntPtr lParam) {
        childHwnds.Add(hWnd);
        return true;
    }

    public static string GetTitle(IntPtr hWnd) {
        StringBuilder sb = new StringBuilder(512);
        GetWindowText(hWnd, sb, 512);
        return sb.ToString();
    }
    public static string GetClass(IntPtr hWnd) {
        StringBuilder sb = new StringBuilder(256);
        GetClassName(hWnd, sb, 256);
        return sb.ToString();
    }
}
'@
try {
    Add-Type -TypeDefinition $winapi
    Write-Log "WinAPI wrapper cargado"
} catch {
    Write-Log "ERROR cargando WinAPI: $($_.Exception.Message)"
    exit 1
}

$titlePatterns = @(
    "Project Objects",
    "Proyectar objetos",
    "proyectar objetos"
)
$okLabels = @("OK", "Ok", "Aceptar", "Accept", "&OK", "&Aceptar")

$endTime = (Get-Date).AddSeconds($TimeoutSec)
$pressCount = 0
$lastHwnd = [IntPtr]::Zero
$noDialogStreak = 0
$firstDump = $true

function Find-DialogHwnd {
    $hwnds = [Win]::ListVisible()
    foreach ($h in $hwnds) {
        $t = [Win]::GetTitle($h)
        if ($t) {
            foreach ($pat in $titlePatterns) {
                if ($t.ToLower().Contains($pat.ToLower())) {
                    return @{ Hwnd = $h; Title = $t }
                }
            }
        }
    }
    return $null
}

function Find-OK-Child {
    param($dialogHwnd, [bool]$dumpAll = $false)
    $children = [Win]::ListChildren($dialogHwnd)
    $buttons = @()
    foreach ($c in $children) {
        $cls = [Win]::GetClass($c)
        $vis = [Win]::IsWindowVisible($c)
        $ena = [Win]::IsWindowEnabled($c)
        $txt = [Win]::GetTitle($c)
        $id  = [Win]::GetDlgCtrlID($c)
        if ($cls -eq "Button" -and $vis -and $ena) {
            $buttons += @{ Hwnd = $c; Class = $cls; Text = $txt; Id = $id }
        }
    }
    if ($dumpAll) {
        Write-Log "    Botones ENABLED del dialogo ($($buttons.Count)):"
        foreach ($b in $buttons) {
            Write-Log ("      hwnd=0x{0:X} id={1} text='{2}'" -f
                       $b.Hwnd.ToInt64(), $b.Id, $b.Text)
        }
    }

    # Estrategia 1: texto exacto OK/Aceptar/...
    foreach ($lbl in $okLabels) {
        foreach ($b in $buttons) {
            if ($b.Text -eq $lbl) { return $b }
        }
    }
    # Estrategia 2: normalizar (quitar &) y comparar
    foreach ($b in $buttons) {
        $t = $b.Text
        if (-not $t) { continue }
        $normalized = $t.Replace("&", "").ToLower()
        if ($normalized -eq "ok" -or $normalized -eq "aceptar" -or
            $normalized -eq "accept") { return $b }
    }
    # Estrategia 3: dlg ctrl id == 1 (IDOK clasico)
    foreach ($b in $buttons) {
        if ($b.Id -eq 1) { return $b }
    }
    return $null
}

function Click-Via-Win32 {
    param($dialogHwnd, $btn)
    # Metodo A: BM_CLICK directo al boton
    try {
        [Win]::SendMessage($btn.Hwnd, [Win]::BM_CLICK,
                           [IntPtr]::Zero, [IntPtr]::Zero) | Out-Null
        return "BM_CLICK"
    } catch {
        Write-Log "    BM_CLICK fallo: $($_.Exception.Message)"
    }
    # Metodo B: WM_COMMAND al padre con el ID del boton en wParam
    try {
        $wp = [IntPtr]::new($btn.Id)
        [Win]::SendMessage($dialogHwnd, [Win]::WM_COMMAND,
                           $wp, $btn.Hwnd) | Out-Null
        return "WM_COMMAND"
    } catch {
        Write-Log "    WM_COMMAND fallo: $($_.Exception.Message)"
    }
    return $null
}

while ((Get-Date) -lt $endTime -and $pressCount -lt $MaxPresses) {
    $found = Find-DialogHwnd
    if ($found -eq $null) {
        $noDialogStreak++
        Start-Sleep -Milliseconds 120
        if ($pressCount -gt 0 -and $noDialogStreak -gt 170) {
            Write-Log "Sin dialogos por 20s tras $pressCount OKs. Salida."
            break
        }
        continue
    }
    $noDialogStreak = 0
    $hwnd = $found.Hwnd

    if ($hwnd -eq $lastHwnd) {
        Start-Sleep -Milliseconds 80
        continue
    }

    $dump = $firstDump
    $btn = Find-OK-Child -dialogHwnd $hwnd -dumpAll $dump
    $firstDump = $false

    if ($btn -eq $null) {
        Write-Log ("DIALOGO hwnd=0x{0:X} titulo='{1}' -> sin boton OK identificable" -f
                   $hwnd.ToInt64(), $found.Title)
        Start-Sleep -Milliseconds 200
        $firstDump = $true
        continue
    }

    Write-Log ("DIALOGO hwnd=0x{0:X} titulo='{1}' btn hwnd=0x{2:X} text='{3}' id={4}" -f
               $hwnd.ToInt64(), $found.Title,
               $btn.Hwnd.ToInt64(), $btn.Text, $btn.Id)

    $method = Click-Via-Win32 $hwnd $btn
    if ($method -ne $null) {
        $pressCount++
        $lastHwnd = $hwnd
        Write-Log "  OK #$pressCount via $method"
        Start-Sleep -Milliseconds 400
        $lastHwnd = [IntPtr]::Zero
    } else {
        Write-Log "  no pude invocar OK"
        Start-Sleep -Milliseconds 200
    }
}

Write-Log "Auto-OK terminado. Total presses=$pressCount"
""".replace("__MAXPRESSES__", str(n_dialogs)) \
   .replace("__LOG_PATH__",
            ps_path.replace(".ps1", "_log.txt").replace("\\", "\\\\"))

        # Estrategia robusta de escritura y lanzamiento del PS1.
        # Hasta 3 ubicaciones por si la principal esta bloqueada (archivo
        # abierto por sesion anterior, permisos de C:\Temp, etc).
        import os as _os
        import tempfile as _tempfile
        import subprocess
        import time as _time

        # Generamos un nombre unico con timestamp + PID para no colisionar
        _stamp = _time.strftime("%Y%m%d_%H%M%S")
        _pid = _os.getpid()
        _unique_suffix = "_{}_{}".format(_stamp, _pid)

        candidate_paths = []
        # 1) Junto al tmp_file pero con sufijo unico
        _base = tmp_file.replace(".txt", "")
        candidate_paths.append(_base + _unique_suffix + "_auto_ok.ps1")
        # 2) Directorio temp de usuario (siempre escribible)
        candidate_paths.append(_os.path.join(
            _tempfile.gettempdir(),
            "proyeccion_fl{}_auto_ok.ps1".format(_unique_suffix)))
        # 3) ProgramData como ultimo recurso
        candidate_paths.append(_os.path.join(
            _os.environ.get("PROGRAMDATA", r"C:\ProgramData"),
            "proyeccion_fl{}_auto_ok.ps1".format(_unique_suffix)))

        ps_path = None
        _write_error = None
        for _cand in candidate_paths:
            try:
                _cand_dir = _os.path.dirname(_cand)
                if _cand_dir and not _os.path.isdir(_cand_dir):
                    _os.makedirs(_cand_dir)
                # Regenerar ps_code con log path correcto para este cand
                _log_path = _cand.replace(".ps1", "_log.txt")
                _ps_code_resolved = ps_code.replace(
                    tmp_file.replace(".txt", "_auto_ok_log.txt").replace(
                        "\\", "\\\\"),
                    _log_path.replace("\\", "\\\\"))
                with open(_cand, "w", encoding="utf-8") as _f:
                    _f.write(_ps_code_resolved)
                ps_path = _cand
                break
            except Exception as _ex:
                _write_error = _ex

        if ps_path is None:
            log.append("WARN: no pude escribir Auto-OK PS en NINGUNA ruta. "
                       "Ultimo error: {}".format(_write_error))
            log.append("  -> deberas pulsar OK manualmente en los dialogos")
        else:
            log.append("Script Auto-OK escrito: {}".format(ps_path))
            try:
                CREATE_NO_WINDOW = 0x08000000
                # -ExecutionPolicy Bypass por si el sistema tiene restringido.
                # -NoProfile acelera arranque y evita efectos de $PROFILE.
                _proc = subprocess.Popen(
                    ["powershell",
                     "-NoProfile",
                     "-ExecutionPolicy", "Bypass",
                     "-WindowStyle", "Hidden",
                     "-File", ps_path],
                    creationflags=CREATE_NO_WINDOW,
                    close_fds=True)
                log.append(">>> PowerShell auto-OK lanzado en paralelo "
                           "(max {} Enters, timeout 600s)".format(
                               n_dialogs))
                log.append(">>> Log Auto-OK en: {}".format(
                    ps_path.replace(".ps1", "_log.txt")))
                log.append(">>> PowerShell PID: {}".format(_proc.pid))

                # Dar ~1.5s para que arranque y escriba la primera linea
                # en el log. Permite diagnosticar errores tempranos de
                # carga de UIAutomation.
                _time.sleep(1.5)
                _ps_log = ps_path.replace(".ps1", "_log.txt")
                try:
                    if _os.path.isfile(_ps_log):
                        with open(_ps_log, "r", encoding="utf-8") as _lf:
                            _early = _lf.read().strip()
                        if _early:
                            log.append(
                                ">>> PowerShell log (arranque):\n    {}"
                                .format(_early.replace("\n", "\n    ")))
                    else:
                        log.append(">>> Log aun no generado tras 1.5s — "
                                   "si al final tampoco lo ves, es que "
                                   "PowerShell fallo al arrancar.")
                except Exception as _lex:
                    log.append(">>> No pude leer log PS: {}".format(_lex))

                # Comprobar que el proceso sigue vivo (no se cayo nada mas
                # arrancar). poll() == None significa vivo.
                _pr = _proc.poll()
                if _pr is not None:
                    log.append(">>> ALERTA: PowerShell termino ya con "
                               "codigo {}. Posible fallo al cargar "
                               "UIAutomation. Revisa el log.".format(_pr))
                else:
                    log.append(">>> PowerShell corriendo OK (esperando "
                               "dialogos)")
            except Exception as ex:
                log.append("WARN: no pude LANZAR Auto-OK PS: " + str(ex))
                log.append("  -> deberas pulsar OK manualmente "
                           "en los dialogos")

    # Construir el comando que se envia a Civil 3D.
    # Nota: SendStringToExecute se ejecuta DESPUES de que Dynamo termine.
    # IMPORTANTE: la funcion se invoca SIN el prefijo c: porque no es un
    # comando, es una funcion LISP normal. Asi evitamos el error
    # "bad order function: COMMAND" que sale al anidar (command ...) dentro
    # de una funcion c: (comando-dentro-de-comando).
    full_cmd = '(load "{}")\n(PROYECTAR-FL-A-PERFILES)\n'.format(
        lisp_path_fwd)

    cmd_preview = full_cmd

    try:
        doc.SendStringToExecute(full_cmd, True, False, False)
        log.append("")
        log.append(">>> LISP encolado en AutoCAD.")
        log.append(">>> Se ejecutara al cerrarse Dynamo.")
        log.append(">>> AVISO: aparecera el dialogo 'Project Objects To")
        log.append(">>>        Profile View' por cada PV. Configura el")
        log.append(">>>        estilo de proyeccion la primera vez y luego")
        log.append(">>>        pulsa Enter repetidamente para acelerar.")
    except Exception as ex:
        log.append("ERROR SendStringToExecute: " + str(ex))


OUT = ["\n".join(log), cmd_preview]
# ----------------------------------------
log_proyeccion_fl = Watch(python_proyectar_fl)  # graph output

extraer_log_normalizar = Python(IN[0]=normalizar_geometria_line_pl2d)  # CPython3
# ---------- extraer_log_normalizar.python (2 lines) ----------
# Extrae el log (indice 0) de la salida del normalizador para el Watch
OUT = IN[0][0] if IN[0] is not None else "(sin salida)"
# ----------------------------------------
NORMALIZAR_LOG = Watch(extraer_log_normalizar)
