# Dynamo graph 3_CorreccionPendientes_v03.dyn "3_CorreccionPendientes_v24" (Dynamo 2.19.4.6671)
# Correccion de pendientes de trackers rigidos (FL_T*): fase longitudinal exacta (escalon maximo en juntas, cortes por hueco, extremos anclados, minimo movimiento) + fase transversal EO entre columnas vecinas por PITCH+-MARGEN y solape. LYNKA. v18: rescate PEINE EO (DP exacta por FILAS de mesas, un delta por mesa) para los pares que la relajacion por columnas no coordina; banner de imposibilidad con mejor esfuerzo explicito; guardarrail de limites sospechosos (pendiente del terreno vs limite). v19: work-list de columnas sucias en los barridos EO (mismo punto fijo, fraccion del coste) y barridos de filas intermedios al estancarse (el peine deja de ser solo rescate final).

# group: INPUTS
modo_ns_eo = StringInput("NS")  # graph input
PATRON_FL = StringInput("FL_T*")  # graph input
mdt_nombre_superficie_terreno = StringInput("MDT_RecEstera")  # graph input
superficie_trackers_rebuild = StringInput("Trackers_Estera")  # graph input
pendiente_max_ns = DoubleInput(1.5)  # graph input
pendiente_max_eo = DoubleInput(1.5)  # graph input
pitch_m = DoubleInput(6)  # graph input
margen_pitch_m = DoubleInput(2)  # graph input
escalon_max_m = DoubleInput(0.15)  # graph input
gap_contiguo_m = DoubleInput(5)  # graph input
tol_extremos_m = DoubleInput(2)  # graph input
tol_agrupacion_m = DoubleInput(2)  # graph input
aplicar_false_simulacion = BoolSelector(true)  # graph input
fase_long_long_eo = StringInput("LONG+EO")  # graph input
forzar_true_cumplir_todo_lo = BoolSelector(true)  # "FORZAR (True = cumplir todo lo posible)"; graph input
MAX_PASADAS_EO = DoubleInput(50)  # graph input
solape_min_m = DoubleInput(1)  # graph input
ratio_desmonte_terraplen = DoubleInput(1.2)  # "RATIO DESMONTE/TERRAPLEN (objetivo)"; graph input
rugosidad_m_banda_sin_mov = DoubleInput(0.05)  # "RUGOSIDAD (m) [banda sin mov. tierras]"; graph input
tol_rescate_m_0_sin_rescate = DoubleInput(1)  # graph input
tol_ratio = DoubleInput(0.5)  # graph input
deflexion_hinca_flexibles = DoubleInput(1.31)  # graph input

deflexion_ala_flexibles = DoubleInput(13.96)  # graph input

# group: USO - 3_CorreccionPendientes v20 | TRACKERS FLEXIBLES (nuevo): las FL con >2 vertices son flexibles y cada vertice interior es una HINCA; PENDIENTE_MAX_HINCAS (IN[21]) SUSTITUYE a la pendiente de mesa en ellas (cada vano hinca-hinca cumple su %), las hincas se mueven en Z como nodos del optimizador y se escriben por su indice real; EO comprobada tambien en cada hinca del solape. FL de 2 vertices = FIJO (todo como v19; bit-a-bit identico). PENDIENTE_MAX_HINCAS es dato FIJO. | WORK-LIST (nuevo): los barridos EO solo re-resuelven columnas cuyo entorno cambio (vecina movida, exigencia descartada, cambio de etapa o ella misma a medio viaje por la region de confianza): mismo resultado, fraccion del tiempo; el log reporta el ahorro. | BARRIDOS DE FILAS (nuevo): al estancarse la relajacion y con la cascada sin efecto, un barrido del peine (hasta 3, 6 filas cada uno) cruza la planta en un disparo de DP y la relajacion continua puliendo; solo acepta lo que mejora la verificacion global. | Hereda v18: PEINE EO como rescate final, banner de imposibilidad con mejor esfuerzo, guardarrail de limites (p85 terreno vs limite), autopsia corregida. | Hereda v17: techo EO dinamico, ESCENARIOS, FORZAR (IN[14]), LOG A FICHERO, RECETA. FIJOS (nunca se tocan): PITCH/MARGEN, TOL_AGRUPACION, GAP_CONTIGUO, SOLAPE_MIN, ESCALON_MAX, RUGOSIDAD y PENDIENTES. Flujo: 1) dry-run, 2) leer AUTOPSIA + QUE TOCAR + RECETA, 3) FASE=FORZAR si quieres receta verificada, 4) APLICAR=True. Idempotente contra el MDT.
n3_CorreccionPendientes_v24 = Python(IN[0]=modo_ns_eo, IN[1]=PATRON_FL, IN[2]=mdt_nombre_superficie_terreno, IN[3]=superficie_trackers_rebuild, IN[4]=pendiente_max_ns, IN[5]=pendiente_max_eo, IN[6]=pitch_m, IN[7]=margen_pitch_m, IN[8]=escalon_max_m, IN[9]=gap_contiguo_m, IN[10]=tol_extremos_m, IN[11]=tol_agrupacion_m, IN[12]=aplicar_false_simulacion, IN[13]=fase_long_long_eo, IN[14]=forzar_true_cumplir_todo_lo, IN[15]=MAX_PASADAS_EO, IN[16]=solape_min_m, IN[17]=ratio_desmonte_terraplen, IN[18]=rugosidad_m_banda_sin_mov, IN[19]=tol_rescate_m_0_sin_rescate, IN[20]=tol_ratio, IN[21]=deflexion_hinca_flexibles, IN[22]=deflexion_ala_flexibles)  # "3_CorreccionPendientes_v24"; CPython3
# ---------- n3_CorreccionPendientes_v24.python (4165 lines) ----------
# -*- coding: utf-8 -*-
# =============================================================================
# 3_CorreccionPendientes_v20  -  LYNKA  -  Civil 3D 2024 + Dynamo 2.19 (CPython3)
#
# Corrige las cotas de los extremos de las FeatureLines de trackers (FL_T*)
# para que cada cuerda cumpla la pendiente maxima longitudinal, respetando:
#   - escalon maximo en juntas entre trackers inmediatamente consecutivos
#     (separacion en planta <= GAP_CONTIGUO); el limite real de cada junta es
#     max(ESCALON_MAX, peldano natural del terreno) para NO tocar juntas sanas
#   - huecos > GAP_CONTIGUO cortan la cadena (subcadenas independientes)
#   - los dos puntos mas exteriores de cada eje quedan anclados a terreno;
#     solo se mueven si es imprescindible y dentro de TOL_EXTREMOS, y si no
#     llega, el eje se marca KO NO RESUELTO y no se toca
#   - minimo movimiento total (desmonte Y terraplen permitidos); en empates
#     se prefiere bajar el punto mas alto
#   - cotas de terreno SIEMPRE recalculadas del MDT (idempotente)
#   - solo se cambia la Z (XY intacto); cotas corregidas en rejilla de 1 cm
#   - APLICAR=False => simulacion pura: no se modifica NADA, solo log
#
# INPUTS:
#   IN[0]  MODO ("NS" / "EO")
#   IN[1]  PATRON_FL ("FL_T*", '*' sufijo, ',' para varios)
#   IN[2]  MDT (nombre superficie terreno)
#   IN[3]  SUPERFICIE_TRACKERS (nombre; se reconstruye al final si APLICAR)
#   IN[4]  PENDIENTE_MAX_NS (%)      IN[5]  PENDIENTE_MAX_EO (%)
#   IN[6]  PITCH (m)                 IN[7]  MARGEN_PITCH (m)   [reservados v-transversal]
#   IN[8]  ESCALON_MAX (m)           IN[9]  GAP_CONTIGUO (m)
#   IN[10] TOL_EXTREMOS (m)          IN[11] TOL_AGRUPACION (m)
#   IN[12] APLICAR (bool)
#   IN[13] FASE (LONG | LONG+EO)   IN[14] FORZAR (True = cumplir todo)
#   IN[15] MAX_PASADAS_EO          IN[16] SOLAPE_MIN (m)
#   IN[17] RATIO D/T (objetivo)    IN[18] RUGOSIDAD (m)
#   IN[19] TOL_RESCATE (m)         IN[20] TOL_RATIO (+-)
#   IN[21] DEFLEXION_HINCA (%)  [flexibles: quiebro max por hinca]
#   IN[22] DEFLEXION_ALA (%)    [flexibles: suma |quiebros| por ala]
# OUT: log (conectar a Watch 1500x950)
#
# v05: FASE RESCATE opcional (TOL_RESCATE > 0). Tras la pasada normal, SOLO
# lo que quedo KO se reintenta con condiciones mas libres: (a) ejes KO por
# deficit -> anclas hasta +-TOL_RESCATE y, si ni asi, pendiente minima
# factible (etiquetado RESCATADO con la p lograda); (b) pares EO KO ->
# anclas ampliadas a +-TOL_RESCATE SOLO en los ejes implicados + barridos
# extra (corte primero). Lo que cumplia con las condiciones estrictas no
# se toca ni se relaja.
#
# v06: ARRASTRE TRANSVERSAL. Cuando los barridos convergen (o agotan
# presupuesto) con pares KO, una DP global desplaza columnas ENTERAS
# (preserva pendientes longitudinales y juntas) propagando el movimiento
# por las vecinas dentro de SUS limites hasta donde hay holgura: las zonas
# con margen absorben ('desahogan') a las rojas y las columnas sobradas ni
# se mueven. En rescate, los topes de ancla se amplian a todo el
# componente conectado con KOs (ampliar tope no es mover).
#
# v07: OBJETIVO DE TIERRAS. IN[16] pasa a ser el RATIO desmonte/terraplen
# objetivo del MOV. DE TIERRAS (orientativo, banda +-TOL_RATIO). Un bucle
# exterior ejecuta la optimizacion completa con distintos precios corte/
# relleno (biseccion sobre una escalera, <=~5 pasadas) y adopta la que cae
# en banda; si la geometria/anclas no lo permiten, adopta la mas cercana y
# lo avisa. RATIO <= 0 desactiva el objetivo (pesos neutros).
#
# v08: PARES EN PUNTA. Mesas de columnas vecinas SIN solape suficiente
# (escalones/diagonales de la implantacion) se emparejan por sus extremos
# enfrentados si la diagonal en planta es <= 15 m (el lado de triangulo
# del analisis de pendientes): desnivel limitado por p_trans x diagonal
# REAL. Cierra los picos rojos de las zonas en escalera que antes quedaban
# sin restriccion. Recomendado: PITCH=7, MARGEN=3 (ventana 4-10 m, igual
# que el Slope Analysis).
#
# v09: GUARDARRAIL DE ORIENTACION (si salta el aviso de orientacion con
# APLICAR=True, se fuerza simulacion y NO se escribe nada) + escalera de
# precios refinada (peldanos 1/5, 1/7, 1/8) para que el objetivo de
# tierras no salte por encima de la banda en plantas con pocas tierras.
#
# v10: AUTOPSIA DE PARES KO. Para cada par no resuelto, el log explica POR
# QUE con numeros: cierre necesario, cuanto puede bajar el lado alto y
# subir el bajo (modelo de desplazamiento uniforme de la cascada), que lo
# limita (tope de ancla, tope MOV o el par vecino mas justo, con nombre y
# margen) y veredicto: FALTAN X m ESTRUCTURAL o residuo de acople fino.
#
# v11: QUE TOCAR. Cuando algo queda KO, el log propone ACCIONES concretas
# sobre los inputs con cifras: el TOL_RESCATE minimo que haria factible el
# re-tilt (calculado ejecutando la propia cascada en modo simulacion con
# topes ampliados), activar rescate para deficits, subir MAX_PASADAS en
# residuos de acople, ampliar PITCH/MARGEN si hay huecos de cobertura, o
# -- si ningun input llega -- el menu de implantacion cuantificado.
# Son estimaciones estaticas: verificar siempre en dry-run.
#
# v12: QUE TOCAR con PRIORIDADES. Palancas modificables (unicas que se
# recomiendan): P1 MAX_PASADAS_EO (solo tiempo, residuos de acople) ->
# P2 TOL_RESCATE (tierras quirurgicas en lo KO; valor minimo calculado
# ejecutando la cascada en modo simulacion) -> P3 TOL_EXTREMOS
# (alternativa global, menos quirurgica) -> IMPLANTACION cuantificada si
# ningun input llega. FIJOS por proyecto (nunca se recomiendan):
# PITCH/MARGEN, TOL_AGRUPACION, GAP_CONTIGUO, SOLAPE_MIN, ESCALON_MAX,
# RUGOSIDAD y PENDIENTES (la cobertura fuera de ventana pasa a linea
# INFO). Estimaciones estaticas: verificar en dry-run.
#
# v13: RECETA + MODO FORZAR. Si quedan KOs, el RESUMEN imprime la RECETA
# (valores explicitos de las palancas para cumplir TODA la planta):
# estimada en fases normales, y VERIFICADA con FASE=FORZAR, que escala
# solo P1 MAX_PASADAS y P2 TOL_RESCATE en reintentos completos
# (respetando los inputs iniciales como punto de partida) hasta cumplir
# todo o reportar los irreducibles como implantacion. En FORZAR el
# objetivo de tierras se desactiva (el cumplimiento manda).
#
# v14: LOG A FICHERO. Cada ejecucion guarda el log completo en un .txt
# (carpeta del DWG; si no es escribible, %TEMP%) con timestamp+PID, y la
# ultima linea del Watch indica la ruta. Trazabilidad por pasada y fin de
# los problemas de copiar/adjuntar el Watch.
#
# v15: FORZAR pasa a ser un INPUT propio (booleano, IN[14], debajo de
# FASE). True = modo cumplir todo; por compatibilidad, escribir FORZAR
# en FASE sigue funcionando.
#
# v16: ESCENARIOS COMPARATIVOS. Si la pasada real deja KOs (y no es modo
# FORZAR), el script resuelve DE VERDAD dos casos automaticos sin
# aplicarlos: CASO A quirurgico (EXTREMO actual + RESCATE = receta) y
# CASO B global (EXTREMO = RESCATE = receta), y los tabula junto a la
# fila REAL: KOs, tierras D/T, anclas movidas y dZmax, con la
# conclusion 'cumple con menos tierras'. Ratio desactivado en los casos.
#
# v17: PRESUPUESTO Y TOPE ACORDES AL TOL. Con TOLs grandes los viajes
# son largos: los ESCENARIOS, el FORZAR y la receta auto-escalan ahora
# las pasadas (~25 + 20xTOL, tope 120) y el techo de movimiento EO pasa
# a ser dinamico (max(1.0, TOL+0.5)). Corrige la paradoja de 'mas
# libertad, mas KOs': eran corridas cortadas a mitad de redistribucion
# (sintoma: terraplen ~0 con muchos KOs = etapa de rellenos abortada).
#
# v17: TECHO DE MOVIMIENTO EO DINAMICO. El tope interno de +-1.0 m sobre
# el estado post-longitudinal pasa a max(1.0, tope_efectivo + 0.2), de
# modo que TOL_EXTREMOS/TOL_RESCATE grandes (>1 m) se pueden ejercer de
# verdad (antes quedaban estrangulados: maximos clavados en ~1.0). Ademas
# los ESCENARIOS avisan cuando un caso sale peor que REAL (heuristica no
# monotona).
#
# v18: PEINE EO (rescate por FILAS). Cuando relajacion y cascada dejan
# pares KO, una DP exacta resuelve la FILA de mesas que cruza la
# estacion del KO (W->E, un delta por MESA o grupo solidario, no por
# columna): los topes salen de las anclas de ESA mesa, del techo MOV y
# del margen de junta/escalon con sus vecinas N-S; la holgura de las
# columnas con margen se ejerce de verdad y el rizado coordinado multi-
# columna que el Gauss-Seidel no encuentra sale en un solo disparo. Si
# el DP no llega, amplia el grupo mesa a mesa por las juntas (la cuna
# se degrada por los escalones) y reintenta; solo ACEPTA resultados que
# MEJORAN la verificacion global (sin regresiones posibles). Caso
# origen: Estera, FL_T519<->FL_T520 (exceso 0.02 m irresoluble con 120
# pasadas: la movilidad alcanzaba pero el acople por columnas no
# convergia).
#
# v18: BANNER DE IMPOSIBILIDAD + MEJOR ESFUERZO. Si tras FORZAR + PEINE
# quedan irreducibles, el log lo grita en un banner gigante y declara
# el resultado de la corrida como MEJOR ESFUERZO explicito (aplicado o
# disponible), con el peor par y el exceso total cuantificados.
#
# v18: GUARDARRAIL DE LIMITES SOSPECHOSOS. Antes de optimizar se mide
# la pendiente longitudinal del terreno bajo los trackers (p50/p85):
# si el p85 supera 2x el limite configurado, el log avisa de que los
# limites probablemente NO son los de esta planta (leccion Apamate:
# terreno 20-40% contra limites 6-10% por configuracion, no por
# fisica).
#
# v19: WORK-LIST DE COLUMNAS SUCIAS. Los barridos EO solo re-resuelven
# las columnas cuyo entorno cambio desde su ultima resolucion (vecinas
# movidas, exigencia descartada o cambio de etapa): el resto esta en
# su optimo local y re-resolverlo daria lo mismo. Mismo punto fijo,
# fraccion del coste (el log reporta el ahorro). Los resets de etapa,
# cascadas y peine re-ensucian todo.
#
# v19: BARRIDOS DE FILAS INTERMEDIOS. El peine deja de ser solo el
# rescate final: al estancarse la relajacion (residuo <= 1 cm o ciclo)
# y con la cascada sin efecto, se lanza un barrido de filas (hasta 3
# por optimizacion, 6 filas por barrido) que cruza la planta en un
# disparo de DP; si aplica algo, la relajacion por columnas continua
# puliendo desde ese estado. Misma garantia del peine: solo acepta lo
# que mejora la verificacion global.
#
# v20: TRACKERS FLEXIBLES (HINCAS). Clasificacion automatica por FL: 2
# vertices = FIJO (todo como antes); >2 vertices = FLEXIBLE, cada vertice
# interior es una HINCA. v22, segun ficha de fabricante:
#   (1) TECHO ABSOLUTO: ningun vano supera la pendiente general del modo
#       (NS/EO); la CUERDA (1a-ultima hinca) queda garantizada <= general y
#       es la pendiente de referencia del analisis.
#   (2) DEFLEXION por hinca: el cambio de pendiente entre el vano que llega
#       y el que sale de cada hinca <= DEFLEXION_HINCA (%; 0,75 grados =
#       1,31 %). Se impone tras el optimizador con un PULIDO por tracker
#       (extremos fijos, minimo movimiento, solo-mejora).
#   (3) DEFLEXION acumulada por ALA: suma de |quiebros| desde la hinca
#       MOTORA (vertice interior mas cercano al punto medio; empate lado A)
#       hasta cada extremo <= DEFLEXION_ALA (%; 8 grados = 13,96 %). El
#       quiebro de la propia motora es origen de medida: NO computa en
#       ningun ala (si respeta su limite individual).
# Las hincas se mueven en Z como nodos
# mas del optimizador (rugosidad, tierras, desmonte-primero, anclas de
# columna, juntas, EO, cascada, peine y rescate: todo igual). La fase EO
# usa el perfil REAL (polilinea) de cada mesa y comprueba tambien en cada
# estacion de hinca dentro del solape. Las hincas se ESCRIBEN por su
# indice de vertice real y se re-anclan a terreno si estaban desviadas.
# DEFLEXION_HINCA y DEFLEXION_ALA son datos FIJOS de fabricante (no se
# recomiendan como palancas).
# Con todas las FL de 2 vertices el motor es bit-a-bit identico a v19.
import sys
import time
import math
import traceback

import clr
clr.AddReference('AcMgd')
clr.AddReference('AcCoreMgd')
clr.AddReference('AcDbMgd')
clr.AddReference('AecBaseMgd')
clr.AddReference('AeccDbMgd')

from Autodesk.AutoCAD.ApplicationServices import Application as AcadApp
from Autodesk.AutoCAD.DatabaseServices import (OpenMode, BlockTableRecord,
                                               SymbolUtilityServices)
from Autodesk.Civil.ApplicationServices import CivilApplication
from Autodesk.Civil.DatabaseServices import FeatureLine, TinSurface

# --- enum FeatureLinePointType: vive en Autodesk.Civil (patron confirmado),
#     con fallback por reflexion sobre todos los ensamblados cargados --------
PIPOINT = None
try:
    from Autodesk.Civil import FeatureLinePointType
    PIPOINT = FeatureLinePointType.PIPoint
except Exception:
    try:
        import System
        for _asm in System.AppDomain.CurrentDomain.GetAssemblies():
            _found = None
            try:
                for _tp in _asm.GetTypes():
                    if _tp.IsEnum and _tp.Name == 'FeatureLinePointType':
                        _found = _tp
                        break
            except Exception:
                continue
            if _found is not None:
                PIPOINT = System.Enum.Parse(_found, 'PIPoint')
                break
    except Exception:
        PIPOINT = None


# -*- coding: utf-8 -*-
# =============================================================================
# NUCLEO DE OPTIMIZACION (puro Python, sin Civil 3D) - Script 3 v02
#
# FASE LONG (v01, intacta): por (sub)cadena de nodos (extremos de trackers
# ordenados a lo largo del eje):
#     minimizar  sum_i |z_i - t_i|      (desmonte Y terraplen permitidos)
#     sujeto a   |z_i - z_{i-1}| <= b_i (pendiente por tracker / escalon
#                                        en juntas contiguas)
#                z_j = valor fijo       (extremos exteriores anclados)
# DP EXACTA en enteros sobre rejilla de 1 cm; desempate a la cota mas baja
# ("baja el punto mas alto").
#
# FASE EO (v02): acopla columnas vecinas (emparejadas por PITCH+-MARGEN y
# solape a lo largo del eje >= SOLAPE_MIN). Restriccion por par de mesas:
# |Z_i(s) - Z_j(s)| <= p_trans * d en todo el solape; como ambas cuerdas son
# rectas, basta exigirlo en los DOS EXTREMOS del solape. Resolucion por
# barridos alternos (descenso por bloques-columna): cada columna se
# re-resuelve con la MISMA DP exacta anadiendo cajas [lo,hi] por nodo
# derivadas de las vecinas en su estado actual. Garantiza SIEMPRE la fase
# longitudinal; la transversal se verifica par a par al final y los pares
# irresolubles (tipicamente entre extremos anclados) se listan como KO.
# =============================================================================

GRID = 0.01          # rejilla de cotas (m)
INF_I = 10 ** 15     # infinito entero para la DP
K_LEX = 10 ** 6      # jerarquia: mov. tierras (fuera de rugosidad)
                     # domina; desviacion v03 solo desempata


def _round_half_up(x):
    import math
    return int(math.floor(x + 0.5))


def _to_k(v, z_ref):
    return _round_half_up((v - z_ref) / GRID)


def _sliding_min(a, w):
    """g[k] = min(a[max(0,k-w) .. min(n-1,k+w)]) con deque, O(n)."""
    from collections import deque
    n = len(a)
    if w <= 0:
        return list(a)
    g = [0] * n
    dq = deque()
    j = 0
    for k in range(n):
        hi = k + w
        if hi > n - 1:
            hi = n - 1
        while j <= hi:
            aj = a[j]
            while dq and a[dq[-1]] >= aj:
                dq.pop()
            dq.append(j)
            j += 1
        lo = k - w
        while dq[0] < lo:
            dq.popleft()
        g[k] = a[dq[0]]
    return g


def solve_chain_grid(tk, wsteps, fixed, boxes=None, pesos=None, rug=0):
    """DP exacta en enteros.
    tk     : list[int]  cota objetivo (indice de rejilla) por nodo.
    wsteps : list[int]  len n-1, holgura maxima |k_i - k_{i-1}| por arista.
    fixed  : dict {idx: k}  nodos clavados a un valor exacto (ignoran cajas).
    boxes  : dict {idx: (lo_k, hi_k)} cajas por nodo. Opcional.
    pesos  : list[(w_dn, w_up)] por nodo. Coste = w_dn*(t-k) si k<t (DESMONTE)
             o w_up*(k-t) si k>t (TERRAPLEN). None = (1,1) simetrico.
    Devuelve list[int] zk optima o None si es infactible.
    Desempate: cota mas baja entre optimos (prioriza desmonte tambien ahi).
    """
    n = len(tk)
    vals = list(tk) + list(fixed.values())
    if boxes:
        for (lo, hi) in boxes.values():
            vals.append(lo)
            vals.append(hi)
    kmin = min(vals) - 1
    kmax = max(vals) + 1
    S = kmax - kmin + 1

    def node_cost(i, F_shift):
        out = [INF_I] * S
        if i in fixed:
            kf = fixed[i] - kmin
            if 0 <= kf < S and F_shift[kf] < INF_I:
                out[kf] = F_shift[kf]
            return out
        lo, hi = 0, S - 1
        if boxes is not None and i in boxes:
            blo, bhi = boxes[i]
            if blo - kmin > lo:
                lo = blo - kmin
            if bhi - kmin < hi:
                hi = bhi - kmin
            if lo > hi:
                return out
        ti = tk[i] - kmin
        if pesos is None:
            wd = wu = 1
        else:
            wd, wu = pesos[i]
        for k in range(lo, hi + 1):
            base = F_shift[k]
            if base < INF_I:
                d = k - ti
                if d >= 0:
                    exc = d - rug
                    c = wu * (K_LEX * (exc if exc > 0 else 0) + d)
                else:
                    dd = -d
                    exc = dd - rug
                    c = wd * (K_LEX * (exc if exc > 0 else 0) + dd)
                out[k] = base + c
        return out

    F = []
    zeros = [0] * S
    F.append(node_cost(0, zeros))
    for i in range(1, n):
        g = _sliding_min(F[i - 1], wsteps[i - 1])
        F.append(node_cost(i, g))

    last = F[n - 1]
    best = INF_I
    kbest = -1
    for k in range(S):
        if last[k] < best:
            best = last[k]
            kbest = k
    if best >= INF_I:
        return None

    zk = [0] * n
    zk[n - 1] = kbest
    for i in range(n - 1, 0, -1):
        w = wsteps[i - 1]
        lo = zk[i] - w
        hi = zk[i] + w
        if lo < 0:
            lo = 0
        if hi > S - 1:
            hi = S - 1
        Fi = F[i - 1]
        bb = INF_I
        kb = -1
        for k in range(lo, hi + 1):
            if Fi[k] < bb:
                bb = Fi[k]
                kb = k
        zk[i - 1] = kb
    return [k + kmin for k in zk]


# =============================================================================
# PREPARAR / RESOLVER / CLASIFICAR un eje (fase LONG identica a v01)
# =============================================================================
def EXT(prep, j):
    """Indice real en la cadena del extremo j (convencion 2i=A, 2i+1=B).
    Con trackers fijos es la identidad."""
    m = prep.get('ext')
    return j if m is None else m[j]


def preparar_eje(trs, p_frac, escalon_m, gap_cont_m, tol_ext_m,
                 w_fill=3, w_anc=10, rug_m=0.0, w_cut=1, p_hincas=None):
    """Construye la estructura del eje. trs ORDENADOS a lo largo del eje;
    extremo A = primero en el sentido del eje.
    Tracker FIJO (sin 'h' o vacio): cadena A-B con arista de mesa p_frac.
    Tracker FLEXIBLE (tr['h'] = [(x,y,z_t),...] hincas interiores):
    cadena A-h1-..-hk-B con una arista por vano a p_hincas (el limite de
    CUERDA vs pendiente general queda garantizado aguas arriba capando
    p_hincas <= p_frac). 'ext' mapea la convencion 2i/2i+1 al indice real."""
    import math
    n = len(trs)
    ko = {'status': 'KO', 'res': [], 'anc': {'a_mov': None, 'b_mov': None},
          'stats': {}, 'n': n, 'trs': trs}
    if n == 0:
        ko['msg'] = 'eje sin trackers'
        return ko
    for tr in trs:
        if tr['len'] < 0.05:
            ko['msg'] = ('tracker {} con longitud en planta {:.3f} m (<0.05)'
                         .format(tr['id'], tr['len']))
            return ko
    if p_hincas is None:
        p_hincas = p_frac

    t_ex = []
    ext = []
    ns_de = []          # por tracker: lista de indices de sus nodos
    flex = []
    for tr in trs:
        hs = tr.get('h') or []
        i0 = len(t_ex)
        t_ex.append(tr['az_t'])
        for h in hs:
            t_ex.append(h[2])
        t_ex.append(tr['bz_t'])
        i1 = len(t_ex) - 1
        ext.append(i0)
        ext.append(i1)
        ns_de.append(list(range(i0, i1 + 1)))
        flex.append(len(hs) > 0)

    z_ref = _round_half_up(min(t_ex) * 100.0) / 100.0
    tk = [_to_k(v, z_ref) for v in t_ex]

    esc_steps = int((escalon_m + 1e-9) / GRID)
    edges = []
    for i, tr in enumerate(trs):
        if flex[i]:
            pts = [(tr['ax'], tr['ay'])] + [(h[0], h[1]) for h in tr['h']] \
                + [(tr['bx'], tr['by'])]
            for q in range(len(pts) - 1):
                ds = math.hypot(pts[q + 1][0] - pts[q][0],
                                pts[q + 1][1] - pts[q][1])
                if ds < 0.05:
                    ds = 0.05
                edges.append(('H', int((p_hincas * ds + 1e-9) / GRID)))
        else:
            edges.append(('T', int((p_frac * tr['len'] + 1e-9) / GRID)))
        if i < n - 1:
            g = math.hypot(trs[i + 1]['ax'] - tr['bx'],
                           trs[i + 1]['ay'] - tr['by'])
            if g <= gap_cont_m:
                nat = abs(tk[ext[2 * i + 1]] - tk[ext[2 * i + 2]])
                edges.append(('J', max(esc_steps, nat)))
            else:
                edges.append(('X', 0))

    N = len(t_ex)
    jidx = {}
    for j, (tipo, _) in enumerate(edges):
        if tipo in ('J', 'X'):
            jidx[len(jidx)] = j
    subch = []
    start = 0
    for j, (tipo, _) in enumerate(edges):
        if tipo == 'X':
            subch.append((start, j))
            start = j + 1
    subch.append((start, N - 1))

    tol_steps = int((tol_ext_m + 1e-9) / GRID)
    last = N - 1
    anc_box = {0: (tk[0] - tol_steps, tk[0] + tol_steps),
               last: (tk[last] - tol_steps, tk[last] + tol_steps)}
    pesos = [(w_cut, w_fill)] * N
    pesos[0] = (w_anc * w_cut, w_anc * w_fill)
    pesos[last] = (w_anc * w_cut, w_anc * w_fill)

    if len(subch) == 1:
        wsum = 0
        for (tipo, w) in edges:
            wsum += w
        need = abs(tk[0] - tk[last]) - wsum
        if need > 2 * tol_steps:
            ko['msg'] = ('deficit de pendiente: hay que mover los '
                         'extremos {:.2f} m en total y TOL_EXTREMOS '
                         '({:.2f} m por extremo) no llega. Sube la '
                         'tolerancia o revisa el eje.').format(
                             need * GRID, tol_ext_m)
            ko['stats'] = {'deficit_m': need * GRID}
            return ko

    return {'status': 'OK', 'msg': '', 'n': n, 'trs': trs,
            'p_frac': p_frac, 'p_hincas': p_hincas, 't_ex': t_ex,
            'z_ref': z_ref, 'tk': tk, 'edges': edges, 'subch': subch,
            'fixed': {}, 'anc_box': anc_box, 'pesos': pesos,
            'rug': int((rug_m + 1e-9) / GRID),
            'ext': ext, 'ns_de': ns_de, 'flex': flex, 'jidx': jidx,
            'anc': {'a_mov': None, 'b_mov': None}}


def resolver_eje(prep, boxes=None):
    """Resuelve las subcadenas del eje. boxes: {idx_global: (lo_k, hi_k)}
    (exigencias EO). El tope duro de las anclas (anc_box, +-TOL) se fusiona
    SIEMPRE: si una exigencia EO cae fuera del tope, se pega al borde del
    tope (las anclas nunca superan TOL_EXTREMOS)."""
    n = prep['n']
    tk = prep['tk']
    edges = prep['edges']
    zk = [None] * len(prep['tk'])
    for (s, e) in prep['subch']:
        tks = tk[s:e + 1]
        ws = [edges[j][1] for j in range(s, e)]
        pes = prep['pesos'][s:e + 1]
        bx = {}
        for i, v in prep['anc_box'].items():
            if s <= i <= e:
                bx[i - s] = v
        if boxes:
            for i, v in boxes.items():
                if s <= i <= e:
                    li = i - s
                    lo, hi = v
                    if li in bx:
                        alo, ahi = bx[li]
                        nlo = lo if lo > alo else alo
                        nhi = hi if hi < ahi else ahi
                        if nlo > nhi:
                            nlo = nhi = (ahi if lo > ahi else alo)
                        bx[li] = (nlo, nhi)
                    else:
                        bx[li] = (lo, hi)
        sol = solve_chain_grid(tks, ws, {}, bx if bx else None, pes,
                               prep.get('rug', 0))
        if sol is None:
            return None
        for off, k in enumerate(sol):
            zk[s + off] = k
    return zk


def z_eff(prep, zk, i):
    """Cota efectiva REAL del nodo i (indice REAL de la cadena): rejilla si
    se toca, terreno exacto si queda intacto (los intactos no se escriben).
    Para extremos con la convencion 2i/2i+1 usar z_ext()."""
    if zk[i] != prep['tk'][i]:
        return round(prep['z_ref'] + zk[i] * GRID, 2)
    return prep['t_ex'][i]


def z_ext(prep, zk, j):
    """Cota efectiva del EXTREMO j (convencion 2i=A, 2i+1=B), traducido al
    indice real via EXT (identidad con trackers fijos)."""
    return z_eff(prep, zk, EXT(prep, j))


DEFLEX_CFG = {'d_h': 0.0131, 'd_ala': 0.1396}


def _geom_flex(prep, i):
    """(pts_xy, ds, z_terreno, idx_motora) del tracker flexible i.
    Motora = vertice interior mas cercano al punto medio de la longitud
    (empate: lado A). Indices sobre la polilinea 0..k+1 (0=A, k+1=B)."""
    import math
    tr = prep['trs'][i]
    hs = tr['h']
    pts = [(tr['ax'], tr['ay'])] + [(h[0], h[1]) for h in hs] \
        + [(tr['bx'], tr['by'])]
    z_t = [tr['az_t']] + [h[2] for h in hs] + [tr['bz_t']]
    ds = []
    for q in range(len(pts) - 1):
        d = math.hypot(pts[q + 1][0] - pts[q][0],
                       pts[q + 1][1] - pts[q][1])
        ds.append(d if d > 0.05 else 0.05)
    total = sum(ds)
    st = [0.0]
    for d in ds:
        st.append(st[-1] + d)
    m = 1
    best = None
    for j in range(1, len(pts) - 1):
        dist = abs(st[j] - total / 2.0)
        if best is None or dist < best - 1e-9:
            best = dist
            m = j
    return pts, ds, z_t, m


def _deflex_tracker(zs, ds, m, d_h, d_ala, hold=0.0):
    """Evalua deflexiones: (quiebro_max, ala_A, ala_B, n_ko_quiebro,
    n_ko_ala). El quiebro de la motora (vertice m) NO computa en las alas
    pero SI en el maximo/KO individual. hold = holgura absoluta extra."""
    ps = [(zs[q + 1] - zs[q]) / ds[q] for q in range(len(ds))]
    qmax = 0.0
    n_ko_q = 0
    ala_a = 0.0
    ala_b = 0.0
    for j in range(1, len(zs) - 1):
        qb = abs(ps[j] - ps[j - 1])
        if qb > qmax:
            qmax = qb
        if qb > d_h + 0.012 / min(ds[j - 1], ds[j]) + hold + 1e-9:
            n_ko_q += 1
        if j < m:
            ala_a += qb
        elif j > m:
            ala_b += qb
    n_ko_a = 0
    for v in (ala_a, ala_b):
        if v > d_ala + hold + 1e-9:
            n_ko_a += 1
    return qmax, ala_a, ala_b, n_ko_q, n_ko_a


def _pulir_tracker(z_obj, z_cur, ds, m, p_max, d_h, d_ala):
    """Reajusta las hincas interiores (extremos fijos) para cumplir
    quiebro <= d_h y suma de |quiebros| por ala <= d_ala (motora excluida),
    manteniendo cada vano <= p_max y moviendose lo minimo respecto a z_obj
    (el objetivo original, normalmente el terreno). Barrido de proyeccion
    por intervalos + endurecimiento progresivo si el ala no cumple.
    Devuelve (z_nueva, d_h_efectivo)."""
    n = len(z_cur)
    z = list(z_cur)
    d_eff = d_h

    def _intervalo(j, dh):
        lo = -1e18
        hi = 1e18
        # vanos j-1 y j contra p_max
        lo = max(lo, z[j - 1] - p_max * ds[j - 1])
        hi = min(hi, z[j - 1] + p_max * ds[j - 1])
        lo = max(lo, z[j + 1] - p_max * ds[j])
        hi = min(hi, z[j + 1] + p_max * ds[j])
        # quiebro en j: |(z[j+1]-zj)/ds[j] - (zj-z[j-1])/ds[j-1]| <= dh
        a = 1.0 / ds[j] + 1.0 / ds[j - 1]
        b = z[j + 1] / ds[j] + z[j - 1] / ds[j - 1]
        lo = max(lo, (b - dh) / a)
        hi = min(hi, (b + dh) / a)
        # quiebro en j-1 (si es interior): zj solo entra en p_{j-1}
        if j - 1 >= 1:
            p_prev = (z[j - 1] - z[j - 2]) / ds[j - 2]
            lo = max(lo, z[j - 1] + (p_prev - dh) * ds[j - 1])
            hi = min(hi, z[j - 1] + (p_prev + dh) * ds[j - 1])
        # quiebro en j+1 (si es interior): zj solo entra en p_j
        if j + 1 <= n - 2:
            p_next = (z[j + 2] - z[j + 1]) / ds[j + 1]
            lo = max(lo, z[j + 1] - (p_next + dh) * ds[j])
            hi = min(hi, z[j + 1] - (p_next - dh) * ds[j])
        return lo, hi

    for _ronda in range(40):
        for _sweep in range(60):
            cambio = 0.0
            for j in range(1, n - 1):
                lo, hi = _intervalo(j, d_eff)
                if lo > hi:
                    zj = (lo + hi) / 2.0
                else:
                    zj = z_obj[j]
                    if zj < lo:
                        zj = lo
                    elif zj > hi:
                        zj = hi
                if abs(zj - z[j]) > 1e-6:
                    cambio = max(cambio, abs(zj - z[j]))
                    z[j] = zj
            if cambio < 1e-5:
                break
        qmax, ala_a, ala_b, ko_q, ko_a = _deflex_tracker(
            z, ds, m, d_h, d_ala)
        if ko_q == 0 and ko_a == 0:
            return z, d_eff
        d_eff *= 0.7
        if d_eff < 1e-4:
            break
    # ultimo recurso: tubo recto A-B (siempre factible: cuerda <= p_max)
    st = [0.0]
    for d in ds:
        st.append(st[-1] + d)
    total = st[-1]
    z = [z[0] + (z[n - 1] - z[0]) * (st[j] / total) for j in range(n)]
    return z, 0.0


def _z_eff_tracker(prep, zk, i):
    """Cotas efectivas actuales de la polilinea del tracker i."""
    nodos = prep['ns_de'][i]
    pts, ds, z_t, m = _geom_flex(prep, i)
    zs = []
    for q, idx in enumerate(nodos):
        if zk[idx] != prep['tk'][idx]:
            zs.append(prep['z_ref'] + zk[idx] * GRID)
        else:
            zs.append(z_t[q])
    return nodos, ds, z_t, m, zs


def _aplicar_shift(prep, zk, i, s_m):
    """Desplaza en bloque (uniforme) todas las cotas del tracker i.
    Un shift uniforme conserva pendientes de vano, quiebros y alas."""
    nodos, ds, z_t, m, zs = _z_eff_tracker(prep, zk, i)
    for q, idx in enumerate(nodos):
        zk[idx] = int(round((zs[q] + s_m - prep['z_ref']) / GRID))


def _ventana_shift(prep, zk, i):
    """Intervalo de shift uniforme admisible del tracker i: anclas de
    extremos (terreno +- tol_ext) y escalon con los contiguos del eje."""
    tol = DEFLEX_CFG.get('tol_ext', 0.0)
    esc = DEFLEX_CFG.get('esc', 0.15)
    gapc = DEFLEX_CFG.get('gapc', 5.0)
    import math
    nodos, ds, z_t, m, zs = _z_eff_tracker(prep, zk, i)
    lo = -1e9
    hi = 1e9
    # anclas: extremos dentro de terreno +- tol (mas margen de rejilla)
    for q in (0, len(nodos) - 1):
        lo = max(lo, (z_t[q] - tol) - zs[q] - 0.006)
        hi = min(hi, (z_t[q] + tol) - zs[q] + 0.006)
    # escalon con contiguos (mismo eje)
    trs = prep['trs']
    tr = trs[i]
    for j, o in enumerate(trs):
        if j == i or not prep['flex'][j] and False:
            continue
        if j == i:
            continue
        # distancia entre extremos enfrentados en planta
        d1 = math.hypot(tr['ax'] - o['bx'], tr['ay'] - o['by'])
        d2 = math.hypot(tr['bx'] - o['ax'], tr['by'] - o['ay'])
        if min(d1, d2) > gapc:
            continue
        nod_o, ds_o, zt_o, m_o, zs_o = _z_eff_tracker(prep, zk, j)
        if d1 <= d2:
            z_mio, z_suyo = zs[0], zs_o[-1]
        else:
            z_mio, z_suyo = zs[-1], zs_o[0]
        lo = max(lo, (z_suyo - esc) - z_mio - 0.006)
        hi = min(hi, (z_suyo + esc) - z_mio + 0.006)
    return lo, hi


def _reconciliar_flex(preps, zks, pares, p_trans, rep):
    """Tras el pulido coordinado: resuelve pares EO rotos moviendo mesas
    ENTERAS (shift uniforme, conserva deflexiones) dentro de sus ventanas
    de ancla y escalon. Greedy con aceptacion solo-mejora por par."""
    if not pares:
        return
    for _sweep in range(6):
        kos = verificar_pares(preps, zks, pares, p_trans)
        if not kos:
            break
        mejoro = False
        vistos = set()
        for ko in kos:
            par = pares[ko['pi']]
            clave = (ko['pi'],)
            if clave in vistos:
                continue
            vistos.add(clave)
            lados = [(par['ea'], par['ta']), (par['eb'], par['tb'])]
            # cota de cada lado en la estacion del KO
            e_a, t_a = lados[0]
            e_b, t_b = lados[1]
            za = perfil_z(preps[e_a], zks[e_a], t_a, ko['s'], par['modo'])
            zb = perfil_z(preps[e_b], zks[e_b], t_b, ko['s'], par['modo'])
            nece = ko['exceso'] + 0.005
            alto, bajo = (0, 1) if za > zb else (1, 0)
            plan = []
            # bajar el alto y/o subir el bajo, repartido por holgura real
            for lado, signo in ((alto, -1.0), (bajo, +1.0)):
                e_i, t_i = lados[lado]
                lo, hi = _ventana_shift(preps[e_i], zks[e_i], t_i)
                disp = (-lo) if signo < 0 else hi
                plan.append((e_i, t_i, signo, max(0.0, disp)))
            total = plan[0][3] + plan[1][3]
            if total < nece - 1e-9:
                continue
            resto = nece
            for e_i, t_i, signo, disp in plan:
                mov = min(disp, resto)
                if mov <= 1e-6:
                    continue
                antes = len(verificar_pares(preps, zks, pares, p_trans))
                _aplicar_shift(preps[e_i], zks[e_i], t_i, signo * mov)
                despues = len(verificar_pares(preps, zks, pares,
                                              p_trans))
                if despues > antes:
                    _aplicar_shift(preps[e_i], zks[e_i], t_i,
                                   -signo * mov)
                else:
                    resto -= mov
                    mejoro = True
                    rep['shifts'] += 1
                    if mov > rep['shift_max']:
                        rep['shift_max'] = mov
                if resto <= 1e-6:
                    break
        if not mejoro:
            break


def _pulir_deflexiones_planta(preps, zks, pares, p_trans):
    """v24: pulido COORDINADO en dos pasadas. (1) Se pulen TODOS los
    trackers flexibles de la planta (sin guardia: los ejes vecinos, con
    terreno parecido, se alisan de forma parecida y se mueven coherentes).
    (2) Los pares EO que queden rotos se reconcilian con desplazamientos
    uniformes por mesa (conservan deflexiones) dentro de anclas/escalon.
    Los pares restantes se reportan. Deflexiones = restriccion dura;
    tierras = objetivo (cada hinca se mueve lo minimo del terreno)."""
    d_h = DEFLEX_CFG['d_h']
    d_ala = DEFLEX_CFG['d_ala']
    rep = {'ejes_tocados': 0, 'trackers_pulidos': 0, 'hincas_ajustadas': 0,
           'dz_max_pulido': 0.0, 'rectos': 0, 'conflictos': [],
           'shifts': 0, 'shift_max': 0.0,
           'pares_ko_antes': 0, 'pares_ko_despues': 0,
           'd_h': d_h, 'd_ala': d_ala}
    if pares:
        rep['pares_ko_antes'] = len(
            verificar_pares(preps, zks, pares, p_trans))
    # ---- pasada 1: pulir toda la planta ----
    for e, prep in enumerate(preps):
        if prep['status'] != 'OK' or zks[e] is None:
            continue
        if not prep.get('flex') or not any(prep['flex']):
            continue
        zk = zks[e]
        tocado_eje = False
        for i, tr in enumerate(prep['trs']):
            if not prep['flex'][i]:
                continue
            nodos = prep['ns_de'][i]
            pts, ds, z_t, m = _geom_flex(prep, i)
            z_cur = []
            for q, idx in enumerate(nodos):
                if zk[idx] != prep['tk'][idx]:
                    z_cur.append(prep['z_ref'] + zk[idx] * GRID)
                else:
                    z_cur.append(z_t[q])
            qmax, aa, ab, ko_q, ko_a = _deflex_tracker(
                z_cur, ds, m, d_h, d_ala)
            if ko_q == 0 and ko_a == 0:
                continue
            z_new, d_eff = _pulir_tracker(z_t, z_cur, ds, m,
                                          prep['p_frac'], d_h, d_ala)
            n_adj = 0
            for q, idx in enumerate(nodos):
                if q == 0 or q == len(nodos) - 1:
                    continue
                k_new = int(round((z_new[q] - prep['z_ref']) / GRID))
                if k_new != zk[idx]:
                    dzp = abs(z_new[q] - z_cur[q])
                    if dzp > rep['dz_max_pulido']:
                        dzp2 = dzp
                        rep['dz_max_pulido'] = dzp
                    zk[idx] = k_new
                    n_adj += 1
            if n_adj:
                rep['trackers_pulidos'] += 1
                rep['hincas_ajustadas'] += n_adj
                tocado_eje = True
                if d_eff == 0.0:
                    rep['rectos'] += 1
        if tocado_eje:
            rep['ejes_tocados'] += 1
    # ---- pasada 2: reconciliar pares con shifts uniformes ----
    if pares:
        _reconciliar_flex(preps, zks, pares, p_trans, rep)
        rep['pares_ko_despues'] = len(
            verificar_pares(preps, zks, pares, p_trans))
    return rep


def clasificar_eje(prep, zk, zk_long=None):
    """Salida por tracker + stats (formato v01). Si zk_long se aporta,
    distingue clase 'EO' (intacto tras fase LONG, movido tras fase EO).
    Trackers FLEXIBLES: ademas 'hz' (cotas finales de hincas), 'hdz'
    (deltas), 'vanos_ko_antes/despues' y 's_vano_antes/despues'. v21: la
    pendiente reportada de una mesa flexible es la de su CUERDA (primera a
    ultima hinca) contra la pendiente general; los vanos se comprueban
    aparte contra p_hincas."""
    import math
    trs = prep['trs']
    tk = prep['tk']
    res = []
    rug_v = prep.get('rug', 0) * GRID
    p_h = prep.get('p_hincas', prep['p_frac'])
    stats = {'violaban': 0, 'corregidos': 0, 'arrastrados': 0,
             'ajuste_eo': 0, 'sin_tocar': 0, 'dz_max': 0.0, 'dz_max_id': '',
             'suma_desmonte': 0.0, 'suma_terraplen': 0.0,
             'mt_desmonte': 0.0, 'mt_terraplen': 0.0, 'absorbidos': 0,
             's_max_antes': 0.0, 's_max_despues': 0.0,
             'subcadenas': len(prep['subch']),
             'flex': 0, 'hincas': 0, 'vanos': 0, 'vanos_ko_antes': 0,
             'vanos_ko_despues': 0, 'cuerda_ko_antes': 0,
             'cuerda_ko_despues': 0, 'q_ko_a': 0, 'q_ko_d': 0,
             'ala_ko_a': 0, 'ala_ko_d': 0, 'qmax_a': 0.0, 'qmax_d': 0.0,
             'alamax_a': 0.0, 'alamax_d': 0.0, 'hincas_movidas': 0,
             'h_desmonte': 0.0, 'h_terraplen': 0.0, 'h_absorbidos': 0}

    def contab(dz, tid):
        if abs(dz) > abs(stats['dz_max']):
            stats['dz_max'] = dz
            stats['dz_max_id'] = tid
        if dz < 0:
            stats['suma_desmonte'] += -dz
            if -dz > rug_v + 1e-9:
                stats['mt_desmonte'] += (-dz - rug_v)
            else:
                stats['absorbidos'] += 1
        elif dz > 0:
            stats['suma_terraplen'] += dz
            if dz > rug_v + 1e-9:
                stats['mt_terraplen'] += (dz - rug_v)
            else:
                stats['absorbidos'] += 1

    for i, tr in enumerate(trs):
        ia, ib = EXT(prep, 2 * i), EXT(prep, 2 * i + 1)
        wa = zk[ia] != tk[ia]
        wb = zk[ib] != tk[ib]
        za = round(prep['z_ref'] + zk[ia] * GRID, 2) if wa else tr['az_t']
        zb = round(prep['z_ref'] + zk[ib] * GRID, 2) if wb else tr['bz_t']
        dza = (za - tr['az_t']) if wa else 0.0
        dzb = (zb - tr['bz_t']) if wb else 0.0
        es_flex = bool(prep.get('flex') and prep['flex'][i])
        if es_flex:
            hs = tr['h']
            nodos = prep['ns_de'][i]
            pts_xy = [(tr['ax'], tr['ay'])] + [(h[0], h[1]) for h in hs] \
                + [(tr['bx'], tr['by'])]
            z_t = [tr['az_t']] + [h[2] for h in hs] + [tr['bz_t']]
            z_f = []
            hz = []
            hdz = []
            wh = False
            for q, idx in enumerate(nodos):
                mov = zk[idx] != tk[idx]
                zq = round(prep['z_ref'] + zk[idx] * GRID, 2) if mov \
                    else z_t[q]
                z_f.append(zq)
                if 0 < q < len(nodos) - 1:
                    hz.append(zq)
                    d = (zq - z_t[q]) if mov else 0.0
                    hdz.append(d)
                    if mov:
                        wh = True
                        stats['hincas_movidas'] += 1
                        contab(d, tr['id'])
                        if d < 0:
                            stats['h_desmonte'] += -d
                        else:
                            stats['h_terraplen'] += d
                        if abs(d) <= rug_v + 1e-9:
                            stats['h_absorbidos'] += 1
            s_a = 0.0
            s_d = 0.0
            ko_a = 0
            ko_d = 0
            for q in range(len(pts_xy) - 1):
                ds = math.hypot(pts_xy[q + 1][0] - pts_xy[q][0],
                                pts_xy[q + 1][1] - pts_xy[q][1])
                if ds < 0.05:
                    ds = 0.05
                pa = abs(z_t[q + 1] - z_t[q]) / ds
                pd = abs(z_f[q + 1] - z_f[q]) / ds
                if pa > s_a:
                    s_a = pa
                if pd > s_d:
                    s_d = pd
                if pa > p_h + 1e-9:
                    ko_a += 1
                if pd > p_h + 0.006 / ds + 1e-9:
                    ko_d += 1
            stats['flex'] += 1
            stats['hincas'] += len(hs)
            stats['vanos'] += len(pts_xy) - 1
            stats['vanos_ko_antes'] += ko_a
            stats['vanos_ko_despues'] += ko_d
            # v21: pendiente de la mesa flexible = su CUERDA (1a-ultima
            # hinca) contra la pendiente general; el peor vano se guarda
            # aparte (s_vano_*). 'viol' = cuerda o algun vano fuera.
            l_ch = tr['len'] if tr['len'] > 0.05 else 0.05
            c_a = abs(z_t[-1] - z_t[0]) / l_ch
            c_d = abs(z_f[-1] - z_f[0]) / l_ch
            if c_a > prep['p_frac'] + 1e-9:
                stats['cuerda_ko_antes'] += 1
            if c_d > prep['p_frac'] + 0.006 / l_ch + 1e-9:
                stats['cuerda_ko_despues'] += 1
            s_vano_a = s_a
            s_vano_d = s_d
            # v22: deflexiones (quiebros) antes y despues; motora excluida
            # de las alas por convencion de fabricante
            _pts2, _ds2, _zt2, _m2 = _geom_flex(prep, i)
            d_h2 = DEFLEX_CFG['d_h']
            d_ala2 = DEFLEX_CFG['d_ala']
            qa, aa_a, ab_a, koq_a, koal_a = _deflex_tracker(
                z_t, _ds2, _m2, d_h2, d_ala2)
            qd, aa_d, ab_d, koq_d, koal_d = _deflex_tracker(
                z_f, _ds2, _m2, d_h2, d_ala2)
            stats['q_ko_a'] += koq_a
            stats['q_ko_d'] += koq_d
            stats['ala_ko_a'] += koal_a
            stats['ala_ko_d'] += koal_d
            if qa > stats['qmax_a']:
                stats['qmax_a'] = qa
            if qd > stats['qmax_d']:
                stats['qmax_d'] = qd
            if max(aa_a, ab_a) > stats['alamax_a']:
                stats['alamax_a'] = max(aa_a, ab_a)
            if max(aa_d, ab_d) > stats['alamax_d']:
                stats['alamax_d'] = max(aa_d, ab_d)
            s_antes = c_a
            s_desp = c_d
            viol = (ko_a > 0) or (c_a > prep['p_frac'] + 1e-9) \
                or (koq_a > 0) or (koal_a > 0)
            tocado = wa or wb or wh
        else:
            hz = None
            hdz = None
            s_antes = abs(tr['az_t'] - tr['bz_t']) / tr['len']
            s_desp = abs(za - zb) / tr['len']
            viol = s_antes > prep['p_frac'] + 1e-9
            tocado = wa or wb
        if viol:
            stats['violaban'] += 1
        if tocado:
            if viol:
                clase = 'CORRIGE'
                stats['corregidos'] += 1
            else:
                tocado_long = True
                if zk_long is not None:
                    tocado_long = any(zk_long[j] != tk[j]
                                      for j in prep['ns_de'][i]) \
                        if es_flex else (zk_long[ia] != tk[ia]
                                         or zk_long[ib] != tk[ib])
                if tocado_long:
                    clase = 'ARRASTRE'
                    stats['arrastrados'] += 1
                else:
                    clase = 'EO'
                    stats['ajuste_eo'] += 1
        else:
            clase = 'OK'
            stats['sin_tocar'] += 1
        for dz in (dza, dzb):
            contab(dz, tr['id'])
        if s_antes > stats['s_max_antes']:
            stats['s_max_antes'] = s_antes
        if s_desp > stats['s_max_despues']:
            stats['s_max_despues'] = s_desp
        item = {'za': za, 'zb': zb, 'wa': wa, 'wb': wb, 'clase': clase,
                's_antes': s_antes, 's_despues': s_desp,
                'dza': dza, 'dzb': dzb}
        if es_flex:
            item['flex'] = True
            item['hz'] = hz
            item['hdz'] = hdz
            item['s_vano_antes'] = s_vano_a
            item['s_vano_despues'] = s_vano_d
            item['quiebro_max'] = qd
            item['alas'] = (aa_d, ab_d)
            item['motora'] = _m2
        res.append(item)
    last = len(tk) - 1
    a_mov = round((zk[0] - tk[0]) * GRID, 2) if zk[0] != tk[0] else None
    b_mov = round((zk[last] - tk[last]) * GRID, 2) \
        if zk[last] != tk[last] else None
    return {'status': 'OK', 'msg': '', 'res': res,
            'anc': {'a_mov': a_mov, 'b_mov': b_mov}, 'stats': stats}


def edges_lim(prep, i_tracker):
    """Limite longitudinal (m) de la cuerda i (w de su arista 'T')."""
    cnt = -1
    for (tipo, w) in prep['edges']:
        if tipo == 'T':
            cnt += 1
            if cnt == i_tracker:
                return w * GRID
    return 0.0


def procesar_eje(trs, p_frac, escalon_m, gap_cont_m, tol_ext_m,
                 w_fill=3, w_anc=10, rug_m=0.0, w_cut=1, p_hincas=None):
    """Wrapper compatible v01: preparar + resolver + clasificar."""
    prep = preparar_eje(trs, p_frac, escalon_m, gap_cont_m, tol_ext_m,
                        w_fill, w_anc, rug_m, 1, p_hincas)
    if prep['status'] == 'KO':
        return {'status': 'KO', 'msg': prep['msg'], 'res': [],
                'anc': {'a_mov': None, 'b_mov': None},
                'stats': prep.get('stats', {})}
    zk = resolver_eje(prep)
    if zk is None:
        return {'status': 'KO',
                'msg': 'subcadena infactible (inesperado)', 'res': [],
                'anc': {'a_mov': None, 'b_mov': None}, 'stats': {}}
    return clasificar_eje(prep, zk)


# =============================================================================
# FASE EO: emparejado, cajas, barridos y verificacion (v02)
# =============================================================================
def _geo_tracker(tr, modo):
    """(s_a, s_b, c_mid): coordenada 'a lo largo' de A y B y 'transversal'
    media del tracker."""
    if modo == 'NS':
        return tr['ay'], tr['by'], 0.5 * (tr['ax'] + tr['bx'])
    return tr['ax'], tr['bx'], 0.5 * (tr['ay'] + tr['by'])


def _est_nodos(prep, t, modo):
    """Estaciones (a lo largo del eje) de TODOS los nodos del tracker t:
    [sA, s_h1, ..., sB] en el orden de la cadena."""
    tr = prep['trs'][t]
    sa, sb, _ = _geo_tracker(tr, modo)
    hs = tr.get('h') or []
    if not hs:
        return [sa, sb]
    if modo == 'NS':
        est = [sa] + [h[1] for h in hs] + [sb]
    else:
        est = [sa] + [h[0] for h in hs] + [sb]
    return est


def perfil_z(prep, zk, t, s, modo):
    """Cota del perfil REAL de la mesa t en la estacion s: polilinea por
    todos sus nodos (con hincas); con trackers fijos es la cuerda A-B."""
    nodos = prep['ns_de'][t] if prep.get('ns_de') else [2 * t, 2 * t + 1]
    est = _est_nodos(prep, t, modo)
    zs = [z_eff(prep, zk, j) for j in nodos]
    if len(est) == 2:
        return _interp_z(est[0], zs[0], est[1], zs[1], s)
    # orden creciente de estacion (A puede ser la mayor en NS)
    pares_es = sorted(zip(est, zs))
    e0, z0 = pares_es[0]
    if s <= e0:
        return z0
    for k in range(1, len(pares_es)):
        e1, z1 = pares_es[k]
        if s <= e1 + 1e-9:
            return _interp_z(e0, z0, e1, z1, s)
        e0, z0 = e1, z1
    return z0


def _interp_z(sa, za, sb, zb, s):
    if abs(sb - sa) < 1e-9:
        return 0.5 * (za + zb)
    lam = (s - sa) / (sb - sa)
    if lam < 0.0:
        lam = 0.0
    if lam > 1.0:
        lam = 1.0
    return za + (zb - za) * lam


def emparejar_pares(preps, modo, pitch, margen, solape_min):
    """Pares de mesas entre ejes vecinos: distancia transversal entre ejes
    dentro de [pitch-margen, pitch+margen] y solape a lo largo >= solape_min.
    Devuelve lista de dicts."""
    coords = []
    for e, prep in enumerate(preps):
        if prep['status'] != 'OK':
            coords.append(None)
            continue
        cs = [_geo_tracker(tr, modo)[2] for tr in prep['trs']]
        coords.append(sum(cs) / len(cs))
    orden = sorted([e for e in range(len(preps)) if coords[e] is not None],
                   key=lambda e: coords[e])
    lo_w = pitch - margen
    hi_w = pitch + margen
    pares = []
    for ii, ea in enumerate(orden):
        for jj in range(ii + 1, len(orden)):
            eb = orden[jj]
            dax = coords[eb] - coords[ea]
            if dax > hi_w:
                break
            if dax < lo_w:
                continue
            for ta, tra in enumerate(preps[ea]['trs']):
                sa1, sb1, c1 = _geo_tracker(tra, modo)
                lo1, hi1 = min(sa1, sb1), max(sa1, sb1)
                for tb, trb in enumerate(preps[eb]['trs']):
                    sa2, sb2, c2 = _geo_tracker(trb, modo)
                    lo2, hi2 = min(sa2, sb2), max(sa2, sb2)
                    s_lo = max(lo1, lo2)
                    s_hi = min(hi1, hi2)
                    d = abs(c2 - c1)
                    if d < 1e-6:
                        continue
                    if s_hi - s_lo >= solape_min:
                        pares.append({'ea': ea, 'ta': ta, 'eb': eb,
                                      'tb': tb, 'd': d, 's_lo': s_lo,
                                      's_hi': s_hi})
                        continue
                    # PARES EN PUNTA (escalones/diagonales): extremos
                    # enfrentados de mesas sin solape suficiente. Limite
                    # sobre la DIAGONAL real en planta (max 15 m, como el
                    # lado de triangulo del analisis de pendientes).
                    mejor = None
                    for u in (sa1, sb1):
                        for v in (sa2, sb2):
                            ds = u - v if u >= v else v - u
                            if mejor is None or ds < mejor[0]:
                                mejor = (ds, u, v)
                    ds, u, v = mejor
                    d_pl = (d * d + ds * ds) ** 0.5
                    if d_pl > 15.0:
                        continue
                    pares.append({'ea': ea, 'ta': ta, 'eb': eb, 'tb': tb,
                                  'd': d_pl, 's_lo': u if u < v else v,
                                  's_hi': v if u < v else u,
                                  'punta': True})
    return pares


PASO_EO = 0.10    # region de confianza: movimiento max por nodo y pasada (m)
MOV_EO_MAX = 1.00  # tope BASE de movimiento EO respecto al terreno (m)
MOV_DIN = [MOV_EO_MAX]   # tope EO dinamico (se ajusta al TOL)
_MOV_EFF = MOV_DIN[0]  # techo efectivo (dinamico por pasada)


def _cajas_para_eje(e, preps, zks, pares_eje, p_trans, paso=PASO_EO,
                    descartes=None, z_base=None, paso_up=None):
    """Cajas por nodo del eje e contra el estado ACTUAL de sus vecinas.
    (a) Mis extremos dentro del solape: caja directa contra la cuerda vecina
        interpolada en su posicion.
    (b) Extremos del solape que NO coinciden con extremos mios (tipicamente
        el ancla de la mesa vecina cayendo en el interior de mi cuerda):
        se acota mi extremo despejando la interpolacion con el valor actual
        del otro extremo. Amplificacion limitada: peso propio >= 0.25.
    Estabilidad: si dos exigencias se cruzan, la caja pasa a ser el
    intervalo PUENTE entre ambas (no un punto); y toda caja se recorta a la
    region de confianza [z_actual +- PASO_EO] para acotar el movimiento por
    pasada (la convergencia reparte los grandes ajustes entre pasadas)."""
    import math
    prep = preps[e]
    fixed = prep['fixed']
    raw = {}     # idx -> (lo, hi) en metros

    def add_box(idx, lo, hi):
        if idx in raw:
            plo, phi = raw[idx]
            if plo > lo:
                lo = plo
            if phi < hi:
                hi = phi
            if lo > hi:
                lo, hi = hi, lo          # puente entre exigencias cruzadas
        raw[idx] = (lo, hi)

    for par in pares_eje:
        pi = par.get('pi', -1)
        d0 = descartes is not None and (pi, 0) in descartes
        d1 = descartes is not None and (pi, 1) in descartes
        if d0 and d1:
            continue
        if par['ea'] == e:
            t_mio, e_vec, t_vec = par['ta'], par['eb'], par['tb']
        else:
            t_mio, e_vec, t_vec = par['tb'], par['ea'], par['ta']
        pv = preps[e_vec]
        zv = zks[e_vec]
        if zv is None:
            continue
        trv = pv['trs'][t_vec]
        sav, sbv, _ = _geo_tracker(trv, par['modo'])
        zav = z_ext(pv, zv, 2 * t_vec)
        zbv = z_ext(pv, zv, 2 * t_vec + 1)
        lim = p_trans * par['d']
        trm = prep['trs'][t_mio]
        sam, sbm, _ = _geo_tracker(trm, par['modo'])
        ia, ib = EXT(prep, 2 * t_mio), EXT(prep, 2 * t_mio + 1)
        # cajas directas: TODOS mis nodos del tracker (A, hincas, B) cuya
        # estacion cae en el solape, contra el perfil REAL de la vecina
        mis_nodos = prep['ns_de'][t_mio] if prep.get('ns_de') else [ia, ib]
        mis_est = _est_nodos(prep, t_mio, par['modo'])
        for idx, s_n in zip(mis_nodos, mis_est):
            if s_n < par['s_lo'] - 1e-9 or s_n > par['s_hi'] + 1e-9:
                continue
            if idx in fixed:
                continue
            en_lo = abs(s_n - par['s_lo']) < 1e-6
            en_hi = abs(s_n - par['s_hi']) < 1e-6
            if (en_lo and d0) or (en_hi and d1) \
                    or (not en_lo and not en_hi and d0 and d1):
                continue
            zj = perfil_z(pv, zv, t_vec, s_n, par['modo'])
            add_box(idx, zj - lim, zj + lim)

        den = sbm - sam
        if abs(den) < 1e-9:
            continue
        za_cur = z_eff(prep, zks[e], ia)
        zb_cur = z_eff(prep, zks[e], ib)
        anc = prep['anc_box']
        a_anc = ia in anc
        b_anc = ib in anc
        lo_m = sam if sam < sbm else sbm
        hi_m = sbm if sam < sbm else sam
        for i_end, s_star in enumerate((par['s_lo'], par['s_hi'])):
            if (i_end == 0 and d0) or (i_end == 1 and d1):
                continue
            if s_star < lo_m - 1e-6 or s_star > hi_m + 1e-6:
                continue          # estacion fuera de mi cuerda: no extrapolar
            if abs(s_star - sam) < 1e-6 or abs(s_star - sbm) < 1e-6:
                continue
            wb = (s_star - sam) / den
            wa = 1.0 - wb
            zj = perfil_z(pv, zv, t_vec, s_star, par['modo'])
            lo, hi = zj - lim, zj + lim
            cand = []
            if wa >= 0.25:
                cand.append((a_anc, -wa, ia, wa, wb, zb_cur))
            if wb >= 0.25:
                cand.append((b_anc, -wb, ib, wb, wa, za_cur))
            if not cand:
                continue
            cand.sort()   # primero no-ancla; a igualdad, mayor peso propio
            _, _, sel, w_self, w_other, otro = cand[0]
            add_box(sel, (lo - w_other * otro) / w_self,
                    (hi - w_other * otro) / w_self)

    boxes = {}
    for idx, (lo, hi) in raw.items():
        zc = z_eff(prep, zks[e], idx)
        t_i = z_base[idx] if z_base is not None else prep['t_ex'][idx]
        tlo = zc - paso
        thi = zc + (paso if paso_up is None else paso_up)
        if t_i - _MOV_EFF > tlo:
            tlo = t_i - _MOV_EFF
        if t_i + _MOV_EFF < thi:
            thi = t_i + _MOV_EFF
        if tlo > thi:
            tlo = thi = 0.5 * (tlo + thi)
        if lo > thi:                     # exigencia entera por encima
            lo = hi = thi
        elif hi < tlo:                   # exigencia entera por debajo
            lo = hi = tlo
        else:
            if lo < tlo:
                lo = tlo
            if hi > thi:
                hi = thi
        lo_k = int(math.ceil((lo - prep['z_ref']) / GRID - 1e-9))
        hi_k = int(math.floor((hi - prep['z_ref']) / GRID + 1e-9))
        if lo_k > hi_k:                  # caja mas fina que una celda
            lo_k = hi_k = _round_half_up(
                (0.5 * (lo + hi) - prep['z_ref']) / GRID)
        boxes[idx] = (lo_k, hi_k)
    return boxes


def _dp_offsets(caps, pesos, aristas):
    """DP exacta sobre desplazamientos UNIFORMES por columna (en pasos).
    caps[i]   : (lo, hi) tope de delta_i.
    pesos[i]  : (c_dn, c_up) coste por paso (desmonte/terraplen).
    aristas[i]: (LO, HI) restriccion delta_i - delta_{i+1} in [LO, HI],
                o None si no hay enlace (subcadenas independientes).
    Devuelve lista de deltas optima o None si infactible."""
    n = len(caps)
    kmin = min(lo for lo, hi in caps) - 1
    kmax = max(hi for lo, hi in caps) + 1
    S = kmax - kmin + 1
    if S <= 1 or S > 4000:
        return None

    def ncost(i, base):
        lo, hi = caps[i]
        wd, wu = pesos[i]
        out = [INF_I] * S
        for k in range(lo - kmin, hi - kmin + 1):
            if k < 0 or k > S - 1:
                continue
            b = base[k]
            if b >= INF_I:
                continue
            d = k + kmin
            out[k] = b + (wu * d if d > 0 else wd * (-d))
        return out

    F = [ncost(0, [0] * S)]
    padres = [None]
    for i in range(1, n):
        ar = aristas[i - 1]
        prev = F[-1]
        base = [INF_I] * S
        pad = [-1] * S
        if ar is None:
            bb = INF_I
            kb = -1
            for u in range(S):
                if prev[u] < bb:
                    bb = prev[u]
                    kb = u
            for k in range(S):
                base[k] = bb
                pad[k] = kb
        else:
            LO, HI = ar
            for k in range(S):
                d = k + kmin
                u0 = d + LO - kmin
                u1 = d + HI - kmin
                if u0 < 0:
                    u0 = 0
                if u1 > S - 1:
                    u1 = S - 1
                bb = INF_I
                kb = -1
                for u in range(u0, u1 + 1):
                    if prev[u] < bb:
                        bb = prev[u]
                        kb = u
                base[k] = bb
                pad[k] = kb
        F.append(ncost(i, base))
        padres.append(pad)
    last = F[-1]
    best = INF_I
    kb = -1
    for k in range(S):
        if last[k] < best:
            best = last[k]
            kb = k
    if best >= INF_I:
        return None
    sol = [0] * n
    sol[n - 1] = kb
    for i in range(n - 1, 0, -1):
        sol[i - 1] = padres[i][sol[i]]
    return [k + kmin for k in sol]


def _cascada_arrastre(preps, zks, pares, p_trans, bases, w_fill,
                      dry_extra=None):
    """Forzado con arrastre: desplaza columnas ENTERAS (preserva pendientes
    longitudinales y juntas) para que los pares KO cumplan, propagando el
    movimiento por las vecinas dentro de SUS limites y topes de ancla.
    Devuelve (columnas_movidas, delta_max_m)."""
    if isinstance(w_fill, tuple):
        w_c, w_f = w_fill
    else:
        w_c, w_f = 1, w_fill
    kos = verificar_pares(preps, zks, pares, p_trans)
    if not kos:
        return 0, 0.0
    modo = pares[0]['modo']
    ady = {}
    for par in pares:
        ady.setdefault(par['ea'], set()).add(par['eb'])
        ady.setdefault(par['eb'], set()).add(par['ea'])
    ko_ejes = set()
    for k in kos:
        ko_ejes.add(k['ea'])
        ko_ejes.add(k['eb'])
    coord = {}
    for e in ady:
        cs = [_geo_tracker(tr, modo)[2] for tr in preps[e]['trs']]
        coord[e] = sum(cs) / len(cs)
    MOVK = int((_MOV_EFF + 1e-9) / GRID)
    extra_k = 0 if dry_extra is None else int((dry_extra + 1e-9) / GRID)
    comps_ok = 0
    comps_tot = 0
    vistos = set()
    movidas = 0
    dmax = 0
    for e0 in sorted(ko_ejes):
        if e0 in vistos:
            continue
        comp = []
        pila = [e0]
        vistos.add(e0)
        while pila:
            x = pila.pop()
            comp.append(x)
            for v in ady.get(x, ()):
                if v not in vistos:
                    vistos.add(v)
                    pila.append(v)
        comp.sort(key=lambda e: coord[e])
        idx_de = {e: i for i, e in enumerate(comp)}
        n = len(comp)
        if n < 2:
            continue
        aristas = [None] * (n - 1)
        for par in pares:
            a, b2 = par['ea'], par['eb']
            if a not in idx_de or b2 not in idx_de:
                continue
            ia, ib = idx_de[a], idx_de[b2]
            if abs(ia - ib) != 1:
                continue
            if ia < ib:
                w_, e_, tw, te = a, b2, par['ta'], par['tb']
                k_ar = ia
            else:
                w_, e_, tw, te = b2, a, par['tb'], par['ta']
                k_ar = ib
            pw, pe = preps[w_], preps[e_]
            trw = pw['trs'][tw]
            tre = pe['trs'][te]
            swa, swb, _ = _geo_tracker(trw, modo)
            sea, seb, _ = _geo_tracker(tre, modo)
            zwa = z_ext(pw, zks[w_], 2 * tw)
            zwb = z_ext(pw, zks[w_], 2 * tw + 1)
            zea = z_ext(pe, zks[e_], 2 * te)
            zeb = z_ext(pe, zks[e_], 2 * te + 1)
            lim_hold = int((p_trans * par['d'] + 0.010) / GRID)
            lim_fix = int((p_trans * par['d'] + 0.002) / GRID)
            if lim_fix < 1:
                lim_fix = 1
            for s in (par['s_lo'], par['s_hi']):
                zi = _interp_z(swa, zwa, swb, zwb, s)
                zj = _interp_z(sea, zea, seb, zeb, s)
                gk = _round_half_up((zi - zj) / GRID)
                limk = lim_fix if (gk > lim_hold or -gk > lim_hold) \
                    else lim_hold
                lo = -limk - gk
                hi = limk - gk
                if aristas[k_ar] is None:
                    aristas[k_ar] = (lo, hi)
                else:
                    plo, phi = aristas[k_ar]
                    aristas[k_ar] = (max(plo, lo), min(phi, hi))
        caps = []
        pesos_c = []
        for e in comp:
            prep = preps[e]
            zk = zks[e]
            base = bases.get(e)
            lo_c, hi_c = -160, 160
            for idx in range(len(zk)):
                if idx in prep['anc_box']:
                    alo, ahi = prep['anc_box'][idx]
                    lo_c = max(lo_c, alo - extra_k - zk[idx])
                    hi_c = min(hi_c, ahi + extra_k - zk[idx])
                if base is not None:
                    bk = _round_half_up((base[idx] - prep['z_ref']) / GRID)
                    lo_c = max(lo_c, bk - MOVK - zk[idx])
                    hi_c = min(hi_c, bk + MOVK - zk[idx])
            if lo_c > 0:
                lo_c = 0
            if hi_c < 0:
                hi_c = 0
            caps.append((lo_c, hi_c))
            nn = len(zk)
            pesos_c.append((nn * w_c, nn * w_f))
        for i in range(n - 1):
            if aristas[i] is not None:
                lo, hi = aristas[i]
                if lo > hi:
                    aristas[i] = (hi, lo)
        sol = _dp_offsets(caps, pesos_c, aristas)
        if dry_extra is not None:
            comps_tot += 1
            if sol is not None:
                comps_ok += 1
            continue
        eps = 1
        while sol is None and eps <= 4096:
            ar2 = [None if a is None else (a[0] - eps, a[1] + eps)
                   for a in aristas]
            sol = _dp_offsets(caps, pesos_c, ar2)
            eps *= 2
        if sol is None:
            continue
        for i, e in enumerate(comp):
            d = sol[i]
            if d:
                zks[e] = [k + d for k in zks[e]]
                movidas += 1
                if abs(d) > dmax:
                    dmax = abs(d)
    if dry_extra is not None:
        return comps_ok, comps_tot
    return movidas, dmax * GRID



def _peine_eo(preps, zks, pares, p_trans, bases, w_fill,
              max_filas=12, max_exp=4, n_win=12):
    """v18 PEINE EO: rescate por FILAS de mesas (el movimiento que el
    Gauss-Seidel por columnas no coordina). Para cada par KO toma la fila
    de mesas que cruza su estacion (una mesa por columna, W->E, ventana
    de n_win columnas a cada lado del par) y la resuelve con la DP exacta
    (_dp_offsets) con UN delta por MESA:
      aristas = pares EO entre mesas seleccionadas de columnas vecinas
                (ambos extremos del solape, misma cuantizacion que la
                cascada);
      topes   = anclas de los nodos de la mesa + techo MOV vs base +
                margen de junta/escalon con las vecinas N-S no
                seleccionadas + pares EO con mesas no seleccionadas.
    Si el DP no resuelve, amplia el grupo una mesa por junta a cada lado
    (la cuna se degrada por los escalones) y reintenta; el ultimo intento
    ademas triplica la ventana de columnas. Solo ACEPTA un resultado si
    la verificacion GLOBAL mejora estrictamente (n KOs, exceso total):
    cualquier aproximacion del modelo queda vetada por la verificacion,
    de modo que el peine NUNCA puede empeorar el estado."""
    if isinstance(w_fill, tuple):
        w_c, w_f = w_fill
    else:
        w_c, w_f = 1, w_fill
    info = {'filas': 0, 'aplicadas': 0, 'mesas_movidas': 0, 'dmax': 0.0,
            'ampliaciones': 0, 'infactibles': 0, 'kos_ini': 0,
            'kos_fin': 0}
    kos0 = verificar_pares(preps, zks, pares, p_trans)
    info['kos_ini'] = len(kos0)
    if not kos0 or not pares:
        info['kos_fin'] = len(kos0)
        return info
    modo = pares[0]['modo']
    MOVK = int((_MOV_EFF + 1e-9) / GRID)

    ady = {}
    pares_de = {}
    for par in pares:
        ady.setdefault(par['ea'], set()).add(par['eb'])
        ady.setdefault(par['eb'], set()).add(par['ea'])
        pares_de.setdefault(par['ea'], []).append(par)
        pares_de.setdefault(par['eb'], []).append(par)
    coord = {}
    for e in ady:
        if preps[e]['status'] != 'OK' or zks[e] is None:
            continue
        cs = [_geo_tracker(t, modo)[2] for t in preps[e]['trs']]
        coord[e] = sum(cs) / len(cs)

    def cuerda(e, t, s):
        prep = preps[e]
        tr = prep['trs'][t]
        sa, sb, _ = _geo_tracker(tr, modo)
        return _interp_z(sa, z_ext(prep, zks[e], 2 * t),
                         sb, z_ext(prep, zks[e], 2 * t + 1), s)

    def lims_par(par):
        lim_hold = int((p_trans * par['d'] + 0.010) / GRID)
        lim_fix = int((p_trans * par['d'] + 0.002) / GRID)
        if lim_fix < 1:
            lim_fix = 1
        return lim_hold, lim_fix

    def mesa_en(e, s):
        best = None
        for t in range(preps[e]['n']):
            sa, sb, _ = _geo_tracker(preps[e]['trs'][t], modo)
            lo, hi = (sa, sb) if sa <= sb else (sb, sa)
            if lo - 1e-9 <= s <= hi + 1e-9:
                d = 0.0
            elif s < lo:
                d = lo - s
            else:
                d = s - hi
            if best is None or d < best[0]:
                best = (d, t)
        if best is None or best[0] > 15.0:
            return None
        return best[1]

    def grupo(e, t0, radio):
        edges = preps[e]['edges']
        lo = hi = t0
        for _ in range(radio):
            if lo > 0 and edges[preps[e]['jidx'][lo - 1]][0] == 'J':
                lo -= 1
            if hi < preps[e]['n'] - 1 and edges[preps[e]['jidx'][hi]][0] == 'J':
                hi += 1
        return list(range(lo, hi + 1))

    def score():
        ks = verificar_pares(preps, zks, pares, p_trans)
        exc = 0.0
        for k in ks:
            exc += k['exceso']
        return (len(ks), round(exc, 3))

    def resolver_fila(chain, grupos):
        idx_de = {e2: i for i, e2 in enumerate(chain)}
        caps = []
        pesos_c = []
        for e2 in chain:
            prep = preps[e2]
            zk = zks[e2]
            G = grupos[e2]
            lo_c, hi_c = -MOVK, MOVK
            fijo = False
            base = bases.get(e2)
            for t in G:
                for idx in prep['ns_de'][t]:
                    if idx in prep['fixed']:
                        fijo = True
                    if idx in prep['anc_box']:
                        alo, ahi = prep['anc_box'][idx]
                        l2 = alo - zk[idx]
                        h2 = ahi - zk[idx]
                        if l2 > lo_c:
                            lo_c = l2
                        if h2 < hi_c:
                            hi_c = h2
                    if base is not None:
                        bk = _round_half_up((base[idx] - prep['z_ref'])
                                            / GRID)
                        l2 = bk - MOVK - zk[idx]
                        h2 = bk + MOVK - zk[idx]
                        if l2 > lo_c:
                            lo_c = l2
                        if h2 < hi_c:
                            hi_c = h2
            edges = prep['edges']
            t_lo, t_hi = G[0], G[-1]
            if t_lo > 0 and edges[prep['jidx'][t_lo - 1]][0] == 'J':
                w = edges[prep['jidx'][t_lo - 1]][1]
                g = zk[EXT(prep, 2 * t_lo)] - zk[EXT(prep, 2 * t_lo - 1)]
                if -w - g > lo_c:
                    lo_c = -w - g
                if w - g < hi_c:
                    hi_c = w - g
            if t_hi < prep['n'] - 1 and edges[prep['jidx'][t_hi]][0] == 'J':
                w = edges[prep['jidx'][t_hi]][1]
                g = zk[EXT(prep, 2 * t_hi + 1)] - zk[EXT(prep, 2 * t_hi + 2)]
                if -w - g > lo_c:
                    lo_c = -w - g
                if w - g < hi_c:
                    hi_c = w - g
            for par in pares_de.get(e2, ()):
                if par['ea'] == e2:
                    t_m, e_o, t_o = par['ta'], par['eb'], par['tb']
                else:
                    t_m, e_o, t_o = par['tb'], par['ea'], par['ta']
                if t_m not in G:
                    continue
                if e_o in idx_de and t_o in grupos.get(e_o, ()):
                    continue                          # va a aristas
                if zks[e_o] is None:
                    continue
                lim_hold, lim_fix = lims_par(par)
                for s2 in (par['s_lo'], par['s_hi']):
                    zm = cuerda(e2, t_m, s2)
                    zo = cuerda(e_o, t_o, s2)
                    gk = _round_half_up((zm - zo) / GRID)
                    limk = lim_fix if (gk > lim_hold or -gk > lim_hold) \
                        else lim_hold
                    if -limk - gk > lo_c:
                        lo_c = -limk - gk
                    if limk - gk < hi_c:
                        hi_c = limk - gk
            if fijo:
                lo_c = hi_c = 0
            if lo_c > 0:
                lo_c = 0
            if hi_c < 0:
                hi_c = 0
            caps.append((int(lo_c), int(hi_c)))
            nn = sum(len(prep['ns_de'][t]) for t in G)
            pesos_c.append((nn * w_c, nn * w_f))
        aristas = [None] * (len(chain) - 1)
        for par in pares:
            a, b2 = par['ea'], par['eb']
            if a not in idx_de or b2 not in idx_de:
                continue
            if par['ta'] not in grupos[a] or par['tb'] not in grupos[b2]:
                continue
            ia, ib = idx_de[a], idx_de[b2]
            if abs(ia - ib) != 1:
                continue      # no modelable en cadena: si molestara, lo
                              # vetaria la verificacion global
            if ia < ib:
                e_w, t_w, e_e, t_e, k_ar = a, par['ta'], b2, par['tb'], ia
            else:
                e_w, t_w, e_e, t_e, k_ar = b2, par['tb'], a, par['ta'], ib
            lim_hold, lim_fix = lims_par(par)
            for s2 in (par['s_lo'], par['s_hi']):
                zw = cuerda(e_w, t_w, s2)
                ze = cuerda(e_e, t_e, s2)
                gk = _round_half_up((zw - ze) / GRID)
                limk = lim_fix if (gk > lim_hold or -gk > lim_hold) \
                    else lim_hold
                lo2 = -limk - gk
                hi2 = limk - gk
                if aristas[k_ar] is None:
                    aristas[k_ar] = (lo2, hi2)
                else:
                    plo, phi = aristas[k_ar]
                    aristas[k_ar] = (plo if plo > lo2 else lo2,
                                     phi if phi < hi2 else hi2)
        for i in range(len(aristas)):
            if aristas[i] is not None:
                lo2, hi2 = aristas[i]
                if lo2 > hi2:
                    aristas[i] = (hi2, lo2)
        return _dp_offsets(caps, pesos_c, aristas)

    tratados = set()
    for _fila in range(max_filas):
        kos = verificar_pares(preps, zks, pares, p_trans)
        if not kos:
            break
        kos.sort(key=lambda k: -k['exceso'])
        ko = None
        for k in kos:
            if (k['pi'], k['end']) not in tratados:
                ko = k
                break
        if ko is None:
            break
        tratados.add((ko['pi'], ko['end']))
        info['filas'] += 1
        par0 = pares[ko['pi']]
        s_ko = ko['s']
        comp = set()
        pila = [ko['ea'], ko['eb']]
        while pila:
            x = pila.pop()
            if x in comp or x not in coord:
                continue
            comp.add(x)
            for v in ady.get(x, ()):
                if v not in comp:
                    pila.append(v)
        if ko['ea'] not in comp or ko['eb'] not in comp:
            continue
        cols_all = sorted(comp, key=lambda e2: coord[e2])
        pos = {e2: i for i, e2 in enumerate(cols_all)}
        p_lo = pos[ko['ea']] if pos[ko['ea']] < pos[ko['eb']] \
            else pos[ko['eb']]
        p_hi = pos[ko['ea']] if pos[ko['ea']] > pos[ko['eb']] \
            else pos[ko['eb']]
        score_ini = score()
        for radio in range(0, max_exp + 1):
            if radio > 0:
                info['ampliaciones'] += 1
            win = n_win if radio < max_exp else 3 * n_win
            cols = [e2 for e2 in cols_all
                    if p_lo - win <= pos[e2] <= p_hi + win]
            sel = {}
            for e2 in cols:
                t0 = mesa_en(e2, s_ko)
                if t0 is not None:
                    sel[e2] = t0
            sel[ko['ea']] = par0['ta']
            sel[ko['eb']] = par0['tb']
            chain = [e2 for e2 in cols if e2 in sel]
            if len(chain) < 2:
                break
            grupos = {e2: grupo(e2, sel[e2], radio) for e2 in chain}
            sol = resolver_fila(chain, grupos)
            if sol is None:
                info['infactibles'] += 1
                continue
            if not any(sol):
                continue
            back = {}
            for i, e2 in enumerate(chain):
                d = sol[i]
                if d:
                    back[e2] = zks[e2]
                    z2 = list(zks[e2])
                    for t in grupos[e2]:
                        for _q in preps[e2]['ns_de'][t]:
                            z2[_q] += d
                    zks[e2] = z2
            if score() < score_ini:
                info['aplicadas'] += 1
                for i, e2 in enumerate(chain):
                    if sol[i]:
                        info['mesas_movidas'] += len(grupos[e2])
                        dm = abs(sol[i]) * GRID
                        if dm > info['dmax']:
                            info['dmax'] = dm
                break
            for e2, z0 in back.items():
                zks[e2] = z0
    info['kos_fin'] = len(verificar_pares(preps, zks, pares, p_trans))
    return info


def verificar_pares(preps, zks, pares, p_trans, holgura=0.011):
    """Comprueba cada par sobre cotas efectivas REALES en los dos extremos
    del solape y, si alguna de las dos mesas es flexible, tambien en cada
    estacion de hinca dentro del solape (perfil real por polilinea)."""
    kos = []
    for i_par, par in enumerate(pares):
        pa, pb = preps[par['ea']], preps[par['eb']]
        za_, zb_ = zks[par['ea']], zks[par['eb']]
        if za_ is None or zb_ is None:
            continue
        tra = pa['trs'][par['ta']]
        trb = pb['trs'][par['tb']]
        modo = par['modo']
        lim = p_trans * par['d']
        ests = [(0, par['s_lo']), (1, par['s_hi'])]
        fa = bool(pa.get('flex') and pa['flex'][par['ta']])
        fb = bool(pb.get('flex') and pb['flex'][par['tb']])
        if fa or fb:
            extra = []
            if fa:
                extra += _est_nodos(pa, par['ta'], modo)[1:-1]
            if fb:
                extra += _est_nodos(pb, par['tb'], modo)[1:-1]
            for s_h in extra:
                if par['s_lo'] + 1e-6 < s_h < par['s_hi'] - 1e-6:
                    ests.append((2, s_h))
        for i_end, s in ests:
            zi = perfil_z(pa, za_, par['ta'], s, modo)
            zj = perfil_z(pb, zb_, par['tb'], s, modo)
            exceso = abs(zi - zj) - lim - holgura
            if exceso > 1e-9:
                kos.append({'ea': par['ea'], 'ida': tra['id'],
                            'eb': par['eb'], 'idb': trb['id'], 's': s,
                            'dz': abs(zi - zj), 'lim': lim,
                            'exceso': exceso, 'pi': i_par, 'end': i_end})
    return kos
def procesar_planta(ejes_trs, modo, p_long, p_trans, escalon_m, gap_cont_m,
                    tol_ext_m, pitch, margen, solape_min, fase,
                    max_pasadas, w_fill=3, w_anc=10, rug_m=0.0,
                    tol_rescate=0.0, w_cut=1,
                    p_hincas=None):
    """Pipeline completo: fase LONG exacta por eje + fase EO por barridos.
    Devuelve {'ejes': [dict formato v01 por eje], 'eo': {...}}."""
    global _MOV_EFF
    _MOV_EFF = MOV_DIN[0]
    for t_v in (tol_ext_m, tol_rescate):
        if t_v + 0.2 > _MOV_EFF:
            _MOV_EFF = t_v + 0.2
    eff_tol = tol_rescate if tol_rescate > tol_ext_m else tol_ext_m
    MOV_DIN[0] = (MOV_EO_MAX if eff_tol + 0.5 < MOV_EO_MAX
                  else eff_tol + 0.5)
    if p_hincas is None:
        p_hincas = p_long

    def _ph(p_esc):
        # pendiente de hincas escalada en la misma proporcion que p_long
        return p_hincas * (p_esc / p_long) if p_long > 0 else p_hincas
    preps = []
    for trs in ejes_trs:
        prep = preparar_eje(trs, p_long, escalon_m, gap_cont_m,
                        tol_ext_m, w_fill, w_anc, rug_m, w_cut,
                        p_hincas)
        if (prep['status'] == 'KO' and tol_rescate > tol_ext_m
                and 'deficit_m' in prep.get('stats', {})):
            # (a) anclas mas libres
            p2 = preparar_eje(trs, p_long, escalon_m, gap_cont_m,
                        tol_rescate, w_fill, w_anc, rug_m, w_cut,
                        p_hincas)
            if p2['status'] == 'OK':
                p2['rescate'] = {'tipo': 'ANCLAS', 'tol': tol_rescate,
                                 'p_eff': p_long}
                prep = p2
            else:
                # (b) pendiente minima factible (busqueda binaria)
                dz = abs(trs[0]['az_t'] - trs[-1]['bz_t'])
                sl = sum(t['len'] for t in trs)
                hi = dz / sl + 0.01 if sl > 0 else p_long
                p3 = preparar_eje(trs, hi, escalon_m, gap_cont_m,
                        tol_rescate, w_fill, w_anc, rug_m, w_cut,
                        _ph(hi))
                intentos = 0
                while p3['status'] != 'OK' and intentos < 6:
                    hi *= 2.0
                    p3 = preparar_eje(trs, hi, escalon_m, gap_cont_m,
                        tol_rescate, w_fill, w_anc, rug_m, w_cut,
                        _ph(hi))
                    intentos += 1
                if p3['status'] == 'OK':
                    lo = p_long
                    mejor_p = p3
                    p_ok = hi
                    for _ in range(40):
                        mid = 0.5 * (lo + hi)
                        pm = preparar_eje(trs, mid, escalon_m, gap_cont_m,
                        tol_rescate, w_fill, w_anc, rug_m, w_cut,
                        _ph(mid))
                        if pm['status'] == 'OK':
                            hi = mid
                            mejor_p = pm
                            p_ok = mid
                        else:
                            lo = mid
                    mejor_p['rescate'] = {'tipo': 'PENDIENTE',
                                          'tol': tol_rescate, 'p_eff': p_ok}
                    prep = mejor_p
        preps.append(prep)
    zks = []
    for prep in preps:
        zks.append(resolver_eje(prep) if prep['status'] == 'OK' else None)
    zk_long = [list(z) if z is not None else None for z in zks]
    w_fill = (w_cut, w_fill)   # par de pesos para la cascada

    eo = {'activa': False, 'pares': 0, 'pasadas': 0, 'convergio': True,
          'relajaciones': 0, 'col_sin_resolver': 0, 'ko_pares': [],
          'nodos_movidos_eo': 0}
    if fase == 'LONG+EO' and p_trans > 0:
        eo['activa'] = True
        pares = emparejar_pares(preps, modo, pitch, margen, solape_min)
        for i_par, par in enumerate(pares):
            par['modo'] = modo
            par['pi'] = i_par
        eo['pares'] = len(pares)
        eo['pares_punta'] = sum(1 for p in pares if p.get('punta'))
        pares_por_eje = {}
        for par in pares:
            pares_por_eje.setdefault(par['ea'], []).append(par)
            pares_por_eje.setdefault(par['eb'], []).append(par)

        coords = {}
        for e, prep in enumerate(preps):
            if prep['status'] == 'OK':
                cs = [_geo_tracker(tr, modo)[2] for tr in prep['trs']]
                coords[e] = sum(cs) / len(cs)
        orden_base = sorted(coords.keys(), key=lambda e: coords[e])
        # ---- v19: work-list de columnas sucias --------------------------
        vecinos = {}
        for par in pares:
            vecinos.setdefault(par['ea'], set()).add(par['eb'])
            vecinos.setdefault(par['eb'], set()).add(par['ea'])
        sucias = set(pares_por_eje.keys())
        eo['wl_resueltas'] = 0
        eo['wl_potencial'] = 0
        eo['peine_sw'] = None
        bases = {}
        for e in pares_por_eje:
            if zk_long[e] is not None:
                bases[e] = [z_eff(preps[e], zk_long[e], i)
                            for i in range(len(zk_long[e]))]

        convergio = False
        mejor = None      # (score, snapshot zks, pasada)
        descartes = set()
        racha = {}
        exc_prev = {}
        firmas = []
        solo_desmonte = True      # etapa 1: subir congelado (prioriza corte)
        eo['pasadas_desmonte'] = 0
        eo['arrastre_casc'] = 0
        eo['arrastre_cols'] = 0
        eo['arrastre_max'] = 0.0
        cascadas = 0
        peines_sw = 0

        def _peine_sweep():
            # v19: barrido de FILAS al estancarse, antes de rendirse.
            # Reutiliza el peine (solo acepta si mejora la verificacion
            # global) y devuelve True si aplico algo, para que la
            # relajacion por columnas continue puliendo desde ahi.
            nonlocal peines_sw, firmas, descartes, racha, exc_prev, \
                sucias, mejor
            if peines_sw >= 3:
                return False
            if not verificar_pares(preps, zks, pares, p_trans):
                return False
            peines_sw += 1
            pinfo = _peine_eo(preps, zks, pares, p_trans, bases, w_fill,
                              max_filas=6)
            ac = eo.get('peine_sw')
            if ac is None:
                eo['peine_sw'] = dict(pinfo)
                eo['peine_sw']['barridos'] = 1
            else:
                for k_a in ('filas', 'aplicadas', 'mesas_movidas',
                            'ampliaciones', 'infactibles'):
                    ac[k_a] += pinfo[k_a]
                if pinfo['dmax'] > ac['dmax']:
                    ac['dmax'] = pinfo['dmax']
                ac['kos_fin'] = pinfo['kos_fin']
                ac['barridos'] += 1
            if not pinfo['aplicadas']:
                return False
            firmas = []
            descartes = set()
            racha = {}
            exc_prev = {}
            sucias = set(pares_por_eje.keys())
            kos_s = verificar_pares(preps, zks, pares, p_trans)
            exc_s = 0.0
            for k_s in kos_s:
                exc_s += k_s['exceso']
            mov_s = 0
            for e_s in range(len(preps)):
                if zks[e_s] is None or zk_long[e_s] is None:
                    continue
                for a_s, b_s in zip(zks[e_s], zk_long[e_s]):
                    mov_s += (a_s - b_s) if a_s >= b_s else (b_s - a_s)
            score_s = (len(kos_s), round(exc_s, 3), mov_s)
            if mejor is None or score_s < mejor[0]:
                mejor = (score_s,
                         [list(z) if z is not None else None
                          for z in zks],
                         eo['pasadas'])
            return True

        for pasada in range(1, max_pasadas + 1):
            eo['pasadas'] = pasada
            paso = PASO_EO
            paso_sube = 0.0 if solo_desmonte else PASO_EO
            cambio_max = 0
            orden = orden_base if pasada % 2 == 1 else orden_base[::-1]
            eo['wl_potencial'] += len(pares_por_eje)
            for e in orden:
                if e not in pares_por_eje or e not in sucias:
                    continue
                sucias.discard(e)
                eo['wl_resueltas'] += 1
                boxes = _cajas_para_eje(e, preps, zks, pares_por_eje[e],
                                        p_trans, paso, descartes,
                                        bases.get(e), paso_sube)
                if boxes:
                    nuevo = resolver_eje(preps[e], boxes)
                else:
                    # sin exigencias vivas: vuelve al optimo longitudinal
                    nuevo = resolver_eje(preps[e])
                if nuevo is None:
                    s = 1
                    while nuevo is None and s <= 16384:
                        b2 = {i: (lo - s, hi + s)
                              for i, (lo, hi) in boxes.items()}
                        nuevo = resolver_eje(preps[e], b2)
                        s *= 2
                    eo['relajaciones'] += 1
                if nuevo is None:
                    eo['col_sin_resolver'] += 1
                    continue
                if nuevo != zks[e]:
                    d = 0
                    for a, b in zip(nuevo, zks[e]):
                        ab = a - b
                        if ab < 0:
                            ab = -ab
                        if ab > d:
                            d = ab
                    if d > cambio_max:
                        cambio_max = d
                    zks[e] = nuevo
                    sucias.add(e)      # la region de confianza (PASO_EO)
                    #                    puede dejarla a medio viaje: sigue
                    #                    sucia hasta quedarse quieta
                    for v_e in vecinos.get(e, ()):
                        sucias.add(v_e)
            kos_p = verificar_pares(preps, zks, pares, p_trans)
            exc_p = 0.0
            ko_keys = set()
            for k in kos_p:
                exc_p += k['exceso']
                key = (k['pi'], k['end'])
                ko_keys.add(key)
                if key in descartes:
                    continue
                if key in exc_prev and k['exceso'] >= exc_prev[key] - 0.01:
                    racha[key] = racha.get(key, 0) + 1
                else:
                    racha[key] = 1
                exc_prev[key] = k['exceso']
                if racha[key] >= 3:
                    descartes.add(key)
                    par_d = pares[key[0]]
                    sucias.add(par_d['ea'])
                    sucias.add(par_d['eb'])
            for key in list(racha.keys()):
                if key not in ko_keys:
                    racha.pop(key, None)
                    exc_prev.pop(key, None)
            mov_p = 0
            for e in range(len(preps)):
                if zks[e] is None or zk_long[e] is None:
                    continue
                for a, b in zip(zks[e], zk_long[e]):
                    mov_p += (a - b) if a >= b else (b - a)
            exc_mx = 0.0
            for k in kos_p:
                if k['exceso'] > exc_mx:
                    exc_mx = k['exceso']
            eo.setdefault('_hist', []).append(
                (pasada, len(kos_p), round(exc_mx, 3), round(exc_p, 2),
                 mov_p, len(descartes)))
            score = (len(kos_p), round(exc_p, 3), mov_p)
            if mejor is None or score < mejor[0]:
                mejor = (score,
                         [list(z) if z is not None else None for z in zks],
                         pasada)
            if cambio_max <= 1:      # residuo <= 1 cm: etapa convergida
                if solo_desmonte:
                    solo_desmonte = False
                    firmas = []
                    descartes = set()
                    racha = {}
                    exc_prev = {}
                    sucias = set(pares_por_eje.keys())
                    eo['pasadas_desmonte'] = pasada
                    continue
                if cascadas < 3:
                    mv, dmx = _cascada_arrastre(preps, zks, pares, p_trans,
                                                bases, w_fill)
                    if mv:
                        cascadas += 1
                        eo['arrastre_casc'] = cascadas
                        eo['arrastre_cols'] += mv
                        if dmx > eo['arrastre_max']:
                            eo['arrastre_max'] = dmx
                        firmas = []
                        descartes = set()
                        racha = {}
                        exc_prev = {}
                        sucias = set(pares_por_eje.keys())
                        continue
                if _peine_sweep():
                    continue
                convergio = True
                break
            firmas.append(hash(tuple(tuple(z) if z is not None else None
                                     for z in zks)))
            if len(firmas) >= 3 and firmas[-1] == firmas[-3]:
                if solo_desmonte:
                    solo_desmonte = False
                    firmas = []
                    descartes = set()
                    racha = {}
                    exc_prev = {}
                    sucias = set(pares_por_eje.keys())
                    eo['pasadas_desmonte'] = pasada
                    continue
                if cascadas < 3:
                    mv, dmx = _cascada_arrastre(preps, zks, pares, p_trans,
                                                bases, w_fill)
                    if mv:
                        cascadas += 1
                        eo['arrastre_casc'] = cascadas
                        eo['arrastre_cols'] += mv
                        if dmx > eo['arrastre_max']:
                            eo['arrastre_max'] = dmx
                        firmas = []
                        descartes = set()
                        racha = {}
                        exc_prev = {}
                        sucias = set(pares_por_eje.keys())
                        continue
                if _peine_sweep():
                    continue
                break            # ciclo de periodo 2: estado ya visitado
            if solo_desmonte and pasada >= max_pasadas // 2:
                solo_desmonte = False
                firmas = []
                descartes = set()
                racha = {}
                exc_prev = {}
                sucias = set(pares_por_eje.keys())
                eo['pasadas_desmonte'] = pasada
        if not convergio and cascadas < 3:
            mv, dmx = _cascada_arrastre(preps, zks, pares, p_trans, bases,
                                        w_fill)
            if mv:
                cascadas += 1
                eo['arrastre_casc'] = cascadas
                eo['arrastre_cols'] += mv
                if dmx > eo['arrastre_max']:
                    eo['arrastre_max'] = dmx
                kos_p = verificar_pares(preps, zks, pares, p_trans)
                exc_p = 0.0
                for k in kos_p:
                    exc_p += k['exceso']
                mov_p = 0
                for e in range(len(preps)):
                    if zks[e] is None or zk_long[e] is None:
                        continue
                    for a, b in zip(zks[e], zk_long[e]):
                        mov_p += (a - b) if a >= b else (b - a)
                score = (len(kos_p), round(exc_p, 3), mov_p)
                if mejor is None or score < mejor[0]:
                    mejor = (score,
                             [list(z) if z is not None else None
                              for z in zks], eo['pasadas'])
        eo['rescate'] = {'activo': False, 'ejes': 0, 'pares_obj': 0,
                         'resueltos': 0, 'pasadas': 0}
        if tol_rescate > tol_ext_m:
            if mejor is not None:
                zks = mejor[1]
            kos0 = verificar_pares(preps, zks, pares, p_trans)
            if kos0:
                resc = eo['rescate']
                resc['activo'] = True
                resc['pares_obj'] = len(kos0)
                tr_steps = int((tol_rescate + 1e-9) / GRID)
                ejes_r = set()
                for k in kos0:
                    ejes_r.add(k['ea'])
                    ejes_r.add(k['eb'])
                ady_r = {}
                for par in pares:
                    ady_r.setdefault(par['ea'], set()).add(par['eb'])
                    ady_r.setdefault(par['eb'], set()).add(par['ea'])
                frente = list(ejes_r)
                while frente:
                    x = frente.pop()
                    for v in ady_r.get(x, ()):
                        if v not in ejes_r:
                            ejes_r.add(v)
                            frente.append(v)
                resc['ejes'] = len(ejes_r)
                for e in ejes_r:
                    pr = preps[e]
                    for idx in list(pr['anc_box'].keys()):
                        tkv = pr['tk'][idx]
                        pr['anc_box'][idx] = (tkv - tr_steps, tkv + tr_steps)
                descartes = set()
                racha = {}
                exc_prev = {}
                firmas = []
                solo2 = True
                casc2 = 0
                for pas2 in range(1, max_pasadas + 1):
                    resc['pasadas'] = pas2
                    paso2 = 0.0 if solo2 else PASO_EO
                    cambio_max = 0
                    orden = orden_base if pas2 % 2 == 1 else orden_base[::-1]
                    for e in orden:
                        if e not in pares_por_eje:
                            continue
                        boxes = _cajas_para_eje(e, preps, zks,
                                                pares_por_eje[e], p_trans,
                                                PASO_EO, descartes,
                                                bases.get(e), paso2)
                        if boxes:
                            nuevo = resolver_eje(preps[e], boxes)
                        else:
                            nuevo = resolver_eje(preps[e])
                        if nuevo is None:
                            s = 1
                            while nuevo is None and s <= 16384:
                                b2 = {i: (lo - s, hi + s)
                                      for i, (lo, hi) in boxes.items()}
                                nuevo = resolver_eje(preps[e], b2)
                                s *= 2
                            eo['relajaciones'] += 1
                        if nuevo is None:
                            eo['col_sin_resolver'] += 1
                            continue
                        if nuevo != zks[e]:
                            d = 0
                            for a, b in zip(nuevo, zks[e]):
                                ab = a - b
                                if ab < 0:
                                    ab = -ab
                                if ab > d:
                                    d = ab
                            if d > cambio_max:
                                cambio_max = d
                            zks[e] = nuevo
                    kos_p = verificar_pares(preps, zks, pares, p_trans)
                    exc_p = 0.0
                    ko_keys = set()
                    for k in kos_p:
                        exc_p += k['exceso']
                        key = (k['pi'], k['end'])
                        ko_keys.add(key)
                        if key in descartes:
                            continue
                        if key in exc_prev \
                                and k['exceso'] >= exc_prev[key] - 0.01:
                            racha[key] = racha.get(key, 0) + 1
                        else:
                            racha[key] = 1
                        exc_prev[key] = k['exceso']
                        if racha[key] >= 3:
                            descartes.add(key)
                    for key in list(racha.keys()):
                        if key not in ko_keys:
                            racha.pop(key, None)
                            exc_prev.pop(key, None)
                    mov_p = 0
                    for e in range(len(preps)):
                        if zks[e] is None or zk_long[e] is None:
                            continue
                        for a, b in zip(zks[e], zk_long[e]):
                            mov_p += (a - b) if a >= b else (b - a)
                    score = (len(kos_p), round(exc_p, 3), mov_p)
                    if mejor is None or score < mejor[0]:
                        mejor = (score,
                                 [list(z) if z is not None else None
                                  for z in zks],
                                 eo['pasadas'] + pas2)
                    if cambio_max <= 1:
                        if solo2:
                            solo2 = False
                            firmas = []
                            descartes = set()
                            racha = {}
                            exc_prev = {}
                            continue
                        if casc2 < 3:
                            mv, dmx = _cascada_arrastre(preps, zks, pares,
                                                        p_trans, bases,
                                                        w_fill)
                            if mv:
                                casc2 += 1
                                eo['arrastre_casc'] += 1
                                eo['arrastre_cols'] += mv
                                if dmx > eo['arrastre_max']:
                                    eo['arrastre_max'] = dmx
                                firmas = []
                                descartes = set()
                                racha = {}
                                exc_prev = {}
                                continue
                        break
                    firmas.append(hash(tuple(tuple(z) if z is not None
                                             else None for z in zks)))
                    if len(firmas) >= 3 and firmas[-1] == firmas[-3]:
                        if solo2:
                            solo2 = False
                            firmas = []
                            descartes = set()
                            racha = {}
                            exc_prev = {}
                            continue
                        if casc2 < 3:
                            mv, dmx = _cascada_arrastre(preps, zks, pares,
                                                        p_trans, bases,
                                                        w_fill)
                            if mv:
                                casc2 += 1
                                eo['arrastre_casc'] += 1
                                eo['arrastre_cols'] += mv
                                if dmx > eo['arrastre_max']:
                                    eo['arrastre_max'] = dmx
                                firmas = []
                                descartes = set()
                                racha = {}
                                exc_prev = {}
                                continue
                        break
                    if solo2 and pas2 >= max_pasadas // 2:
                        solo2 = False
                        firmas = []
                        descartes = set()
                        racha = {}
                        exc_prev = {}
        if eo.get('rescate', {}).get('activo') \
                and eo.get('arrastre_casc', 0) < 6:
            mv, dmx = _cascada_arrastre(preps, zks, pares, p_trans, bases,
                                        w_fill)
            if mv:
                eo['arrastre_casc'] = eo.get('arrastre_casc', 0) + 1
                eo['arrastre_cols'] += mv
                if dmx > eo['arrastre_max']:
                    eo['arrastre_max'] = dmx
                kos_p = verificar_pares(preps, zks, pares, p_trans)
                exc_p = 0.0
                for k in kos_p:
                    exc_p += k['exceso']
                mov_p = 0
                for e in range(len(preps)):
                    if zks[e] is None or zk_long[e] is None:
                        continue
                    for a, b in zip(zks[e], zk_long[e]):
                        mov_p += (a - b) if a >= b else (b - a)
                score = (len(kos_p), round(exc_p, 3), mov_p)
                if mejor is None or score < mejor[0]:
                    mejor = (score,
                             [list(z) if z is not None else None
                              for z in zks],
                             eo['pasadas'] + eo['rescate']['pasadas'])
        if mejor is not None:
            zks = mejor[1]
            eo['mejor_pasada'] = mejor[2]
        # ---- v18: PEINE EO (rescate por filas) --------------------------
        try:
            if verificar_pares(preps, zks, pares, p_trans):
                eo['peine'] = _peine_eo(preps, zks, pares, p_trans,
                                        bases, w_fill)
        except Exception as ex_pe:
            eo['peine'] = {'error': str(ex_pe)[:120], 'kos_ini': 1,
                           'kos_fin': 1, 'filas': 0, 'aplicadas': 0,
                           'mesas_movidas': 0, 'dmax': 0.0,
                           'ampliaciones': 0, 'infactibles': 0}
        eo['descartes'] = len(descartes)
        eo['_desc'] = descartes
        eo['convergio'] = convergio
        eo['ko_pares'] = verificar_pares(preps, zks, pares, p_trans)
        if eo.get('rescate', {}).get('activo'):
            eo['rescate']['resueltos'] = max(
                0, eo['rescate']['pares_obj'] - len(eo['ko_pares']))
        eo['autopsias'] = autopsia_kos(preps, zks, pares, p_trans, bases,
                                       eo['ko_pares'])
        movidos = 0
        for e in range(len(preps)):
            if zks[e] is None or zk_long[e] is None:
                continue
            for i in range(len(zks[e])):
                if zks[e][i] != zk_long[e][i]:
                    movidos += 1
        eo['nodos_movidos_eo'] = movidos

    # v22: pulido de deflexiones de hincas (flexibles) tras todo el
    # optimizador (LONG+EO+peine+rescate). Solo-mejora respecto a pares.
    try:
        eo['deflex'] = _pulir_deflexiones_planta(
            preps, zks, pares if eo.get('activa') else [], p_trans)
    except Exception as ex_dfx:
        eo['deflex'] = {'error': str(ex_dfx)[:120]}

    ejes_out = []
    for e, prep in enumerate(preps):
        if prep['status'] == 'KO':
            ejes_out.append({'status': 'KO', 'msg': prep['msg'], 'res': [],
                             'anc': {'a_mov': None, 'b_mov': None},
                             'stats': prep.get('stats', {})})
        else:
            res_e = clasificar_eje(prep, zks[e], zk_long[e])
            if 'rescate' in prep:
                res_e['rescate'] = prep['rescate']
            ejes_out.append(res_e)
    try:
        eo['recos'] = _recomendaciones(
            preps, zks, pares if eo.get('activa') else [],
            p_trans, bases if eo.get('activa') else {}, eo, ejes_out,
            p_long, tol_ext_m, tol_rescate, pitch, margen, w_fill,
            escalon_m, gap_cont_m, max_pasadas)
    except Exception as ex:
        eo['recos'] = ['(recomendaciones no disponibles: '
                       + str(ex)[:90] + ')']
    return {'ejes': ejes_out, 'eo': eo, '_preps': preps, '_zks': zks}


def autopsia_kos(preps, zks, pares, p_trans, bases, kos):
    """Para cada par KO final: cierre necesario, movilidad efectiva de cada
    lado (desplazamiento uniforme de su columna, el modelo de la cascada),
    que la limita (tope de ancla, tope MOV o el par vecino mas justo) y
    veredicto estructural. Solo diagnostico: no mueve nada."""
    out = []
    if not kos:
        return out
    modo = pares[0]['modo']
    MOVK = int((_MOV_EFF + 1e-9) / GRID)

    def cuerda(e, t, s):
        prep = preps[e]
        tr = prep['trs'][t]
        sa, sb, _ = _geo_tracker(tr, modo)
        za = z_ext(prep, zks[e], 2 * t)
        zb = z_ext(prep, zks[e], 2 * t + 1)
        return _interp_z(sa, za, sb, zb, s)

    def movilidad(e, subir, pi_skip):
        prep = preps[e]
        zk = zks[e]
        cap = 10.0
        etq = 'sin tope cercano'
        for idx, (alo, ahi) in prep['anc_box'].items():
            h = ((ahi - zk[idx]) if subir else (zk[idx] - alo)) * GRID
            if h < cap:
                cap = h
                etq = 'ancla %s al tope' % ('N' if idx == 0 else 'S')
        base = bases.get(e)
        if base is not None:
            for i in range(len(zk)):
                bk = _round_half_up((base[i] - prep['z_ref']) / GRID)
                h = ((bk + MOVK - zk[i]) if subir
                     else (zk[i] - (bk - MOVK))) * GRID
                if h < cap:
                    cap = h
                    etq = 'tope MOV +-%.1f m' % _MOV_EFF
        vecs = []
        for j, par in enumerate(pares):
            if j == pi_skip:
                continue
            if par['ea'] == e:
                yo_t, oe, ot = par['ta'], par['eb'], par['tb']
            elif par['eb'] == e:
                yo_t, oe, ot = par['tb'], par['ea'], par['ta']
            else:
                continue
            L = p_trans * par['d'] + 0.011
            m_dir = 10.0
            marg = 10.0
            for s2 in (par['s_lo'], par['s_hi']):
                g = cuerda(e, yo_t, s2) - cuerda(oe, ot, s2)
                a = (L - g) if subir else (L + g)
                if a < m_dir:
                    m_dir = a
                mg = L - (g if g >= 0 else -g)
                if mg < marg:
                    marg = mg
            vecs.append((m_dir, marg, preps[oe]['trs'][ot]['id']))
        vecs.sort()
        if vecs and vecs[0][0] < cap:
            cap = vecs[0][0]
            etq = 'par con %s (margen %.2f m)' % (vecs[0][2], vecs[0][1])
        if cap < 0.0:
            cap = 0.0
        top = [(v[2], round(v[1], 2)) for v in vecs[:3]]
        return cap, etq, top

    for k in kos:
        par = pares[k['pi']]
        zi = cuerda(par['ea'], par['ta'], k['s'])
        zj = cuerda(par['eb'], par['tb'], k['s'])
        if zi >= zj:
            alto, t_al = par['ea'], par['ta']
            bajo, t_ba = par['eb'], par['tb']
        else:
            alto, t_al = par['eb'], par['tb']
            bajo, t_ba = par['ea'], par['ta']
        m_al, l_al, v_al = movilidad(alto, False, k['pi'])
        m_ba, l_ba, v_ba = movilidad(bajo, True, k['pi'])
        falta = k['exceso'] - m_al - m_ba
        out.append({'ida': preps[alto]['trs'][t_al]['id'],
                    'idb': preps[bajo]['trs'][t_ba]['id'],
                    'pi': k['pi'], 'e_alto': alto, 'e_bajo': bajo,
                    's': k['s'], 'dz': k['dz'], 'lim': k['lim'],
                    'exceso': k['exceso'],
                    'mov_alto': round(m_al, 2), 'lim_alto': l_al,
                    'vecinos_alto': v_al,
                    'mov_bajo': round(m_ba, 2), 'lim_bajo': l_ba,
                    'vecinos_bajo': v_ba,
                    'faltan': round(falta if falta > 0 else 0.0, 2)})
    return out


def _pasadas_para(tol_eff, base):
    n = 25 + int(20.0 * tol_eff)
    p = int(base)
    if n > p:
        p = n
    return 120 if p > 120 else p


def _sube05(x):
    n = int((x + 0.0499) / 0.05)
    return n * 0.05


# Prioridades pactadas (LYNKA): P1 MAX_PASADAS_EO -> P2 TOL_RESCATE ->
# P3 ESCALON_MAX (solo si la junta del tracker lo admite) -> IMPLANTACION.
# FIJOS (nunca se recomiendan): pitch/ventana, TOL_AGRUPACION,
# GAP_CONTIGUO, SOLAPE_MIN, RUGOSIDAD y las PENDIENTES limite.
def _recomendaciones(preps, zks, pares, p_trans, bases, eo, res_ejes,
                     p_long, tol_ext_m, tol_rescate, pitch, margen,
                     w_fill, escalon_m, gap_cont_m, max_pasadas=30):
    """Acciones SOLO sobre los inputs modificables, por prioridad:
      P1 MAX_PASADAS_EO (solo tiempo)  ->  P2 TOL_RESCATE (tierras
      quirurgicas en lo KO)  ->  P3 TOL_EXTREMOS (alternativa global,
      menos quirurgica)  ->  IMPLANTACION (ningun input llega).
    FIJOS por decision de proyecto (nunca se recomiendan): PITCH/MARGEN,
    TOL_AGRUPACION, GAP_CONTIGUO, SOLAPE_MIN, ESCALON_MAX, RUGOSIDAD y
    las PENDIENTES. Estimaciones estaticas: verificar en dry-run."""
    recos = []
    eff = tol_rescate if tol_rescate > tol_ext_m else tol_ext_m
    aus = eo.get('autopsias') or []

    acop = [a for a in aus if a['faltan'] <= 0]
    if acop:
        ids = ', '.join('%s<->%s' % (a['ida'], a['idb'])
                        for a in acop[:4])
        if len(acop) > 4:
            ids += ', ...'
        sug = int((max_pasadas * 1.5 + 9.0) // 10) * 10
        recos.append('P1: SUBE MAX_PASADAS_EO a %d (solo tiempo): %d '
                     'par(es) con movilidad suficiente y residuo de '
                     'acople (%s).' % (sug, len(acop), ids))

    defs = []
    for r in res_ejes:
        if r.get('status') == 'KO':
            dm = (r.get('stats') or {}).get('deficit_m')
            if dm:
                defs.append(dm)
    p2_val = None
    if defs:
        p2_val = _sube05(max(d / 2.0 for d in defs))
        recos.append('P2: ACTIVA/SUBE TOL_RESCATE a >= %.2f m: '
                     'rescataria %d eje(s) KO por deficit (los que '
                     'excedan iran a pendiente minima, etiqueta '
                     'RESCATADO).' % (p2_val, len(defs)))
    estructurales = [a for a in aus if a['faltan'] > 0]
    sin_tol = False
    parcial = None
    hallado = None
    if estructurales and pares:
        for extra in (0.05, 0.10, 0.15, 0.20, 0.30, 0.40, 0.50,
                      0.75, 1.0, 1.5, 2.0):
            ok, tot = _cascada_arrastre(preps, zks, pares, p_trans, bases,
                                        w_fill, dry_extra=extra)
            if tot and ok == tot:
                hallado = (extra, tot)
                break
            if tot and ok > 0 and parcial is None:
                parcial = (extra, ok, tot)
        if hallado is not None:
            v = _sube05(eff + hallado[0])
            if p2_val is None or v > p2_val:
                p2_val = v
            aviso = (' (ATENCION: escalada grande, valora '
                     'implantacion)' if hallado[0] > 0.50 else '')
            recos.append('P2: SUBE TOL_RESCATE a %.2f m: haria factible '
                         'el re-tilt de los %d componente(s) con pares '
                         'KO.%s' % (v, hallado[1], aviso))
        elif parcial is not None:
            v = _sube05(eff + parcial[0])
            if p2_val is None or v > p2_val:
                p2_val = v
            recos.append('P2: SUBE TOL_RESCATE a %.2f m: desbloquearia '
                         '%d de %d componente(s) con KO; el resto pasa '
                         'a IMPLANTACION.' % (v, parcial[1], parcial[2]))
            sin_tol = True
        else:
            recos.append('P2: ningun TOL_RESCATE (probado hasta +2.00 m) '
                         'hace factible el re-tilt.')
            sin_tol = True

    if p2_val is not None:
        recos.append('P3 (alternativa, menos quirurgica): TOL_EXTREMOS = '
                     '%.2f m hace lo mismo en fase normal, moviendo '
                     'tambien columnas sanas.' % p2_val)

    if sin_tol and estructurales:
        cab = 'IMPLANTACION (ningun input modificable llega):'
        if parcial is not None:
            cab = ('IMPLANTACION (para los componentes que el TOL no '
                   'desbloquea; verifica cuales en dry-run):')
        recos.append(cab)
        for a in estructurales:
            if p_trans > 0:
                recos.append('   %s<->%s: separar filas a >= %.1f m '
                             '(hoy %.1f) para el %.0f %%, talud entre '
                             'filas, o recolocar la mesa.'
                             % (a['ida'], a['idb'], a['dz'] / p_trans,
                                a['lim'] / p_trans, p_trans * 100.0))

    peffs = [r['rescate']['p_eff'] for r in res_ejes
             if r.get('rescate')
             and r['rescate'].get('tipo') == 'PENDIENTE']
    if peffs:
        recos.append('NOTA: %d eje(s) RESCATADOS por pendiente minima '
                     '(hasta %.2f %% > %.2f %%): las pendientes son dato '
                     'fijo -> si no se admite, es implantacion en esos '
                     'ejes.' % (len(peffs), max(peffs) * 100.0,
                                p_long * 100.0))
    if pares and eo.get('activa') and len(preps) > 1:
        modo = pares[0]['modo']
        cs = []
        for prep in preps:
            if prep['status'] != 'OK':
                continue
            vals = [_geo_tracker(tr, modo)[2] for tr in prep['trs']]
            cs.append(sum(vals) / len(vals))
        cs.sort()
        win_lo = pitch - margen
        win_hi = pitch + margen
        fuera = []
        for i in range(len(cs) - 1):
            dnb = cs[i + 1] - cs[i]
            if win_hi < dnb <= 12.0 or 2.0 <= dnb < win_lo:
                fuera.append(dnb)
        if fuera:
            recos.append('INFO (ventana fija [%.1f, %.1f]): %d hueco(s) '
                         'entre columnas de %.1f-%.1f m quedan sin '
                         'vigilar (dato, no accion).'
                         % (win_lo, win_hi, len(fuera), min(fuera),
                            max(fuera)))
    # -------- receta para el resumen y el MODO FORZAR --------------------
    if acop:
        eo['receta_pasadas'] = int((max_pasadas * 1.5 + 9.0) // 10) * 10
    else:
        eo['receta_pasadas'] = int(max_pasadas)
    full_ok = (not estructurales) or (hallado is not None)
    eo['receta_tol_total'] = p2_val if (p2_val is not None
                                        and full_ok) else None
    if eo['receta_tol_total'] is not None:
        eo['receta_pasadas'] = _pasadas_para(eo['receta_tol_total'],
                                             eo['receta_pasadas'])
    eo['receta_estructural'] = (
        [(a['ida'], a['idb']) for a in estructurales]
        if (estructurales and hallado is None) else [])
    return recos


def procesar_planta_forzar(ejes_trs, modo, p_long, p_trans,
                           escalon_m, gap_cont_m, tol_ext_m, pitch,
                           margen, solape_min, max_pasadas, w_anc=10,
                           rug_m=0.0, tol_rescate=0.0,
                           p_hincas=None):
    """MODO FORZAR: reintentos completos escalando SOLO las palancas
    modificables (P1 MAX_PASADAS, P2 TOL_RESCATE via la receta de cada
    pasada) hasta cumplir toda la planta o agotar la escalada. Los
    inputs fijos jamas se tocan; el objetivo de tierras se desactiva.
    Devuelve (rp_mejor, receta_verificada). Determinista."""
    def kos_de(rp):
        n_e = sum(1 for r in rp['ejes'] if r.get('status') == 'KO')
        kop = rp['eo'].get('ko_pares') or []
        exc = 0.0
        for k in kop:
            exc += k['exceso']
        return n_e + len(kop), round(exc, 3)

    tolr = tol_rescate if tol_rescate > tol_ext_m else tol_ext_m
    if tolr < 0.0:
        tolr = 0.0
    pas = _pasadas_para(tolr, max_pasadas)
    intentos = []
    mejor = None
    for _paso in range(4):
        rp = procesar_planta(ejes_trs, modo, p_long, p_trans, escalon_m,
                             gap_cont_m, tol_ext_m, pitch, margen,
                             solape_min, 'LONG+EO', pas, w_fill=3,
                             w_anc=w_anc, rug_m=rug_m, tol_rescate=tolr, p_hincas=p_hincas)
        n, exc = kos_de(rp)
        intentos.append((round(tolr, 2), pas, n, exc))
        clave = (n, exc)
        if mejor is None or clave < mejor[0]:
            mejor = (clave, rp, round(tolr, 2), pas)
        if n == 0:
            break
        eo = rp['eo']
        obj = eo.get('receta_tol_total')
        pas_obj = eo.get('receta_pasadas') or pas
        subio = False
        if obj is not None and obj > tolr + 1e-9:
            tolr = obj
            p2 = _pasadas_para(tolr, pas)
            if p2 > pas:
                pas = p2
            subio = True
        if pas_obj > pas:
            pas = min(int(pas_obj), 120)
            subio = True
        if not subio:
            if pas < min(2 * int(max_pasadas), 120):
                pas = min(2 * int(max_pasadas), 120)
            else:
                break
    clave, rp, tolr_f, pas_f = mejor
    receta = {'cumple': clave[0] == 0,
              'tol_ini': round(tol_rescate if tol_rescate > 0.0
                               else 0.0, 2),
              'pas_ini': int(max_pasadas),
              'tol_fin': tolr_f, 'pas_fin': pas_f,
              'intentos': intentos, 'kos': clave[0],
              'irreducibles': [(k['ida'], k['idb'])
                               for k in (rp['eo'].get('ko_pares')
                                         or [])]}
    return rp, receta


def escenarios_comparativos(ejes_trs, modo, p_long, p_trans,
                            escalon_m, gap_cont_m, pitch, margen,
                            solape_min, max_pasadas, w_anc, rug_m,
                            tol_ext_m, tol_rescate, rp_real,
                            p_hincas=None):
    """Escenarios automaticos resueltos DE VERDAD y NO aplicados, para
    comparar con la pasada real cuando esta deja KOs:
      CASO A (quirurgico): EXTREMO actual + RESCATE = receta.
      CASO B (global):     EXTREMO = RESCATE = receta (fase normal).
    Ratio de tierras desactivado en los casos (se reporta el logrado).
    Devuelve lista de filas de metricas (REAL primero). Determinista."""
    def met(rp, ext, resc, pas, nombre):
        n_e = sum(1 for r in rp['ejes'] if r.get('status') == 'KO')
        kop = rp['eo'].get('ko_pares') or []
        D = T = 0.0
        anc_n = 0
        anc_mx = 0.0
        dzmx = 0.0
        for r in rp['ejes']:
            if r.get('status') != 'OK':
                continue
            st = r['stats']
            D += st.get('mt_desmonte', 0.0)
            T += st.get('mt_terraplen', 0.0)
            for mv in (r['anc']['a_mov'], r['anc']['b_mov']):
                if mv is not None:
                    anc_n += 1
                    if abs(mv) > anc_mx:
                        anc_mx = abs(mv)
            for x in r['res']:
                for dz in (x['dza'], x['dzb']):
                    if abs(dz) > dzmx:
                        dzmx = abs(dz)
        return {'nombre': nombre, 'ext': ext, 'resc': resc, 'pas': pas,
                'kos': n_e + len(kop), 'D': round(D, 2),
                'T': round(T, 2), 'anc_n': anc_n,
                'anc_max': round(anc_mx, 2), 'dzmax': round(dzmx, 2)}

    eo = rp_real['eo']
    base_eff = tol_rescate if tol_rescate > tol_ext_m else tol_ext_m
    obj = eo.get('receta_tol_total')
    if obj is None:
        obj = _sube05(base_eff + 0.50)
    pas = int(eo.get('receta_pasadas') or max_pasadas)
    if pas < int(max_pasadas):
        pas = int(max_pasadas)
    real_c = (round(tol_ext_m, 2), round(tol_rescate, 2))
    combos = []
    for c in ((round(tol_ext_m, 2), round(obj, 2)),
              (round(obj, 2), round(obj, 2))):
        if c == real_c and pas == int(max_pasadas):
            continue
        if c not in combos:
            combos.append(c)
    filas = [met(rp_real, real_c[0], real_c[1], int(max_pasadas),
                 'REAL')]
    letras = ('CASO A', 'CASO B', 'CASO C')
    for i in range(len(combos[:3])):
        ext, resc = combos[i]
        mx = ext if ext > resc else resc
        pas_c = _pasadas_para(mx, pas)
        rp = procesar_planta(ejes_trs, modo, p_long, p_trans, escalon_m,
                             gap_cont_m, ext, pitch, margen, solape_min,
                             'LONG+EO', pas_c, w_fill=3, w_anc=w_anc,
                             rug_m=rug_m, tol_rescate=resc, p_hincas=p_hincas)
        filas.append(met(rp, ext, resc, pas_c, letras[i]))
    return filas


ESCALERA_PESOS = [(6, 1), (4, 1), (3, 1), (2, 1), (3, 2), (6, 5), (1, 1),
                  (5, 6), (2, 3), (1, 2), (1, 3), (1, 4), (1, 5), (1, 6),
                  (1, 7), (1, 8), (1, 10)]


def procesar_planta_ratio(ejes_trs, modo, p_long, p_trans, escalon_m,
                          gap_cont_m, tol_ext_m, pitch, margen, solape_min,
                          fase, max_pasadas, ratio_obj=1.2, ratio_tol=0.1,
                          w_anc=10, rug_m=0.0, tol_rescate=0.0,
                          p_hincas=None):
    """Busca por biseccion sobre una escalera de precios corte/relleno el
    resultado cuyo ratio de MOV. DE TIERRAS desmonte/terraplen cae en
    [obj - tol, obj + tol]. Si la geometria/anclas no lo permiten, adopta
    el mas cercano (desempate: menos tierras) y lo marca fuera de banda.
    Determinista; <= ~5 optimizaciones completas."""
    def medir(rp):
        D = T = 0.0
        for g in rp['ejes']:
            if g['status'] != 'OK':
                continue
            D += g['stats'].get('mt_desmonte', 0.0)
            T += g['stats'].get('mt_terraplen', 0.0)
        return D, T

    cache = {}

    def correr(i):
        if i in cache:
            return cache[i]
        wd, wu = ESCALERA_PESOS[i]
        rp = procesar_planta(ejes_trs, modo, p_long, p_trans, escalon_m,
                             gap_cont_m, tol_ext_m, pitch, margen,
                             solape_min, fase, max_pasadas, w_fill=wu,
                             w_anc=w_anc, rug_m=rug_m,
                             tol_rescate=tol_rescate, w_cut=wd, p_hincas=p_hincas)
        D, T = medir(rp)
        if D + T < 0.05:
            r = None
        elif T <= 1e-9:
            r = float('inf')
        elif D <= 1e-9:
            r = 0.0
        else:
            r = D / T
        cache[i] = (rp, r, D, T, (wd, wu))
        return cache[i]

    info = {'activo': True, 'objetivo': ratio_obj, 'tol': ratio_tol,
            'historial': [], 'en_banda': False, 'nota': ''}
    if ratio_obj <= 0:
        rp = procesar_planta(ejes_trs, modo, p_long, p_trans, escalon_m,
                             gap_cont_m, tol_ext_m, pitch, margen,
                             solape_min, fase, max_pasadas, w_fill=1,
                             w_anc=w_anc, rug_m=rug_m,
                             tol_rescate=tol_rescate, w_cut=1, p_hincas=p_hincas)
        info['activo'] = False
        info['nota'] = 'sin objetivo de ratio (pesos neutros 1/1)'
        info['logrado'] = -1.0
        info['iteraciones'] = 1
        return rp, info
    lo, hi = 0, len(ESCALERA_PESOS) - 1
    elegido = None
    while lo <= hi:
        i = (lo + hi) // 2
        rp, r, D, T, pesos = correr(i)
        info['historial'].append((pesos[0], pesos[1],
                                  -1.0 if r is None else r,
                                  round(D, 2), round(T, 2)))
        if r is None:
            info['nota'] = ('movimiento de tierras despreciable: el ratio '
                            'no aplica')
            elegido = i
            break
        if ratio_obj - ratio_tol <= r <= ratio_obj + ratio_tol:
            info['en_banda'] = True
            elegido = i
            break
        if r < ratio_obj:
            lo = i + 1      # falta desmonte -> encarecer el relleno
        else:
            hi = i - 1      # sobra desmonte -> abaratar el relleno
    if elegido is None:
        mejor = None
        for i in cache:
            rp_i, r, D, T, pesos = cache[i]
            rv = 999.0 if (r is None or r == float('inf')) else r
            key = (abs(rv - ratio_obj), D + T, i)
            if mejor is None or key < mejor[0]:
                mejor = (key, i)
        elegido = mejor[1]
        info['nota'] = ('objetivo inalcanzable con esta geometria/anclas: '
                        'se adopta el mas cercano')
    rp, r, D, T, pesos = cache[elegido]
    info['logrado'] = -1.0 if r is None else r
    info['D'] = D
    info['T'] = T
    info['pesos'] = pesos
    info['iteraciones'] = len(cache)
    return rp, info



# =============================================================================

# CAPA CIVIL 3D
# =============================================================================
def _txt(v, dflt=''):
    if v is None:
        return dflt
    s = str(v).strip()
    return s if s else dflt


def _num(v, dflt):
    if v is None:
        return float(dflt)
    if isinstance(v, bool):
        return float(dflt)
    if isinstance(v, (int, float)):
        return float(v)
    s = str(v).strip().replace(',', '.')
    try:
        return float(s)
    except Exception:
        return float(dflt)


def _boo(v):
    if isinstance(v, bool):
        return v
    return str(v).strip().lower() in ('true', '1', 'si', 'sí', 'yes', 'y')


def _match(nombre, patron):
    if not nombre:
        return False
    for p in [x.strip() for x in patron.split(',') if x.strip()]:
        if p.endswith('*'):
            if nombre.startswith(p[:-1]):
                return True
        elif nombre == p:
            return True
    return False


def _pts_de_fl(fl):
    """Puntos de la FL: cascada probada StartPoint/EndPoint <- GetPoints."""
    lista = []
    pts = None
    if PIPOINT is not None:
        try:
            pts = fl.GetPoints(PIPOINT)
        except Exception:
            pts = None
    if pts is None:
        try:
            pts = fl.GetPoints()
        except Exception:
            pts = None
    if pts is not None:
        try:
            for k in range(pts.Count):
                p = pts[k]
                lista.append((p.X, p.Y, p.Z))
        except Exception:
            try:
                en = pts.GetEnumerator()
                while en.MoveNext():
                    p = en.Current
                    lista.append((p.X, p.Y, p.Z))
            except Exception:
                lista = []
    if len(lista) < 2:
        sp = fl.StartPoint
        ep = fl.EndPoint
        lista = [(sp.X, sp.Y, sp.Z), (ep.X, ep.Y, ep.Z)]
    return lista


def _busca_superficie(tr, cdoc, nombre):
    sids = cdoc.GetSurfaceIds()
    nombres = []
    for i in range(sids.Count):
        try:
            o = tr.GetObject(sids[i], OpenMode.ForRead)
            nm = ''
            try:
                nm = o.Name
            except Exception:
                nm = ''
            nombres.append(nm)
            if nm == nombre:
                return o, nombres
        except Exception:
            nombres.append('<error lectura>')
    return None, nombres
def run():
    log = []
    T = {}
    t00 = time.perf_counter()

    MODO = _txt(IN[0], 'NS').upper()
    PATRON = _txt(IN[1], 'FL_T*')
    MDT_N = _txt(IN[2], '')
    SUP_TR = _txt(IN[3], '')
    P_NS = _num(IN[4], 12.0)
    P_EO = _num(IN[5], 8.0)
    PITCH = _num(IN[6], 4.0)
    MPITCH = _num(IN[7], 1.0)
    ESC = _num(IN[8], 0.02)
    GAPC = _num(IN[9], 0.5)
    TOLE = _num(IN[10], 0.0)
    TOLA = _num(IN[11], 0.2)
    APL = _boo(IN[12])
    FASE = _txt(IN[13], 'LONG').upper().replace(' ', '')
    FORZAR_M = _boo(IN[14]) or 'FORZAR' in FASE
    MAXP = _num(IN[15], 30.0)
    SOLAPE_MIN = _num(IN[16], 1.0)
    RATIO = _num(IN[17], 1.2)
    RUG = max(0.0, _num(IN[18], 0.0))
    TOLR = max(0.0, _num(IN[19], 0.0))
    TOLRAT = max(0.01, _num(IN[20], 0.1))
    D_HINCA = _num(IN[21], 1.31) if len(IN) > 21 else 1.31
    if D_HINCA <= 0:
        D_HINCA = 1.31
    D_ALA = _num(IN[22], 13.96) if len(IN) > 22 else 13.96
    if D_ALA <= 0:
        D_ALA = 13.96
    DEFLEX_CFG['d_h'] = D_HINCA / 100.0
    DEFLEX_CFG['d_ala'] = D_ALA / 100.0
    # v23: guardarrail de unidades. La rugosidad es una banda fisica de la
    # hinca: mas de 5 m no es real; casi seguro llego en mm (Excel). Se
    # convierte y se avisa en gigante para que se corrija la hoja.
    if RUG > 5.0:
        log.append('!!!!!! RUGOSIDAD %.2f m NO ES FISICA: se interpreta '
                   'como mm -> %.3f m. CORRIGE LA HOJA (rugosidad_m en '
                   'METROS).' % (RUG, RUG / 1000.0))
        RUG = RUG / 1000.0
    DEFLEX_CFG['tol_ext'] = max(TOLE, 0.0)
    DEFLEX_CFG['esc'] = ESC
    DEFLEX_CFG['gapc'] = GAPC

    log.append('=== 3_CorreccionPendientes v24 ===')
    if MODO not in ('NS', 'EO'):
        log.append('!!!! MODO "%s" no valido (usa "NS" o "EO"). Abortado.' % MODO)
        return '\n'.join(log)
    p_frac = (P_NS if MODO == 'NS' else P_EO) / 100.0
    # v22 flexibles: vano <= pendiente general (techo absoluto) => cuerda
    # <= general por construccion; deflexiones por PULIDO post-optimizador.
    log.append('FLEXIBLES: techo por vano = p_max long %.2f %% | deflexion '
               'por hinca <= %.2f %% (%.2f gr) | acumulada por ala <= '
               '%.2f %% (%.2f gr) | motora = vertice central (su quiebro '
               'no computa en las alas)'
               % (p_frac * 100.0, D_HINCA,
                  math.degrees(math.atan(D_HINCA / 100.0)),
                  D_ALA, math.degrees(math.atan(D_ALA / 100.0))))
    log.append('Modo %s | p_max long = %.2f %% | escalon = %.3f m | '
               'gap contiguo = %.2f m' % (MODO, p_frac * 100.0, ESC, GAPC))
    log.append('Patron FL: %s | MDT: %s | Sup. trackers: %s'
               % (PATRON, MDT_N if MDT_N else '(vacio)',
                  SUP_TR if SUP_TR else '(vacio: sin rebuild)'))
    log.append('TOL_EXTREMOS = %.2f m | agrupacion = %.2f m | APLICAR = %s'
               % (TOLE, TOLA, APL))
    FASE_EFF = 'LONG+EO' if 'EO' in FASE else 'LONG'
    p_trans = (P_EO if MODO == 'NS' else P_NS) / 100.0
    log.append('FASE: %s | p_trans (%s) = %.2f %% | pitch = %.2f +- %.2f m'
               ' | solape min = %.2f m | max pasadas EO = %d'
               % ('FORZAR' if FORZAR_M else FASE_EFF,
                  'EO' if MODO == 'NS' else 'NS',
                  p_trans * 100.0, PITCH, MPITCH, SOLAPE_MIN, int(MAXP)))
    log.append('v20: objetivo TIERRAS D/T = %.2f +- %.2f | anclas hasta '
               '+-TOL_EXTREMOS (coste x10; TOL=0 = fijas) | rugosidad = '
               '%.2f m | rescate KO: %s'
               % (RATIO, TOLRAT, RUG,
                  'OFF' if TOLR <= TOLE else
                  'TOL_RESCATE = %.2f m' % TOLR))
    log.append('-' * 70)
    if p_frac <= 0:
        log.append('!!!! Pendiente maxima <= 0. Abortado.')
        return '\n'.join(log)
    if not MDT_N:
        log.append('!!!! Falta el nombre del MDT. Abortado.')
        return '\n'.join(log)

    doc = AcadApp.DocumentManager.MdiActiveDocument
    if doc is None:
        log.append('!!!! No hay documento activo. Abortado.')
        return '\n'.join(log)
    db = doc.Database
    cdoc = CivilApplication.ActiveDocument

    lock = doc.LockDocument()
    tr = db.TransactionManager.StartTransaction()
    n_escritos = 0
    n_reanclados = 0
    rebuild_txt = '(no solicitado)'
    audit_txt = '(sin rebuild: no aplica)'
    try:
        # ------------------------------------------------ LECTURA FLs ----
        t0 = time.perf_counter()
        oids = []
        vistos = set()
        n_ms = 0
        n_sites = 0
        ko_lect = 0
        try:
            ms_id = SymbolUtilityServices.GetBlockModelSpaceId(db)
            btr = tr.GetObject(ms_id, OpenMode.ForRead)
            for oid in btr:
                try:
                    ent = tr.GetObject(oid, OpenMode.ForRead)
                    if isinstance(ent, FeatureLine) and _match(ent.Name, PATRON):
                        h = str(ent.Handle)
                        if h not in vistos:
                            vistos.add(h)
                            oids.append(oid)
                            n_ms += 1
                except Exception as ex:
                    ko_lect += 1
                    log.append('  [KO] lectura entidad ModelSpace: '
                               + str(ex)[:120])
        except Exception as ex:
            log.append('!!!! No se pudo recorrer ModelSpace: ' + str(ex)[:160])
            return '\n'.join(log)
        # Sites (best-effort; las FL_T del pipeline son siteless)
        try:
            sids = cdoc.GetSiteIds()
            for i in range(sids.Count):
                try:
                    site = tr.GetObject(sids[i], OpenMode.ForRead)
                    fl_ids = None
                    for attr in ('GetFeatureLineIds', 'FeatureLineIds'):
                        try:
                            m = getattr(site, attr)
                            fl_ids = m() if callable(m) else m
                            if fl_ids is not None:
                                break
                        except Exception:
                            fl_ids = None
                    if fl_ids is None:
                        continue
                    for j in range(fl_ids.Count):
                        try:
                            ent = tr.GetObject(fl_ids[j], OpenMode.ForRead)
                            if isinstance(ent, FeatureLine) and \
                                    _match(ent.Name, PATRON):
                                h = str(ent.Handle)
                                if h not in vistos:
                                    vistos.add(h)
                                    oids.append(fl_ids[j])
                                    n_sites += 1
                        except Exception as ex:
                            ko_lect += 1
                            log.append('  [KO] FL en Site %d: ' % i
                                       + str(ex)[:120])
                except Exception as ex:
                    log.append('  [i] Site %d no accesible: ' % i
                               + str(ex)[:100])
        except Exception as ex:
            log.append('  [i] Sites no accesibles (no critico): '
                       + str(ex)[:100])
        T['Lectura FLs'] = time.perf_counter() - t0

        # ------------------------------------------------ GEOMETRIA ------
        t0 = time.perf_counter()
        flz = []
        n_pis_raros = 0
        n_flex = 0
        n_hincas = 0
        for oid in oids:
            try:
                fl = tr.GetObject(oid, OpenMode.ForRead)
                nm = fl.Name
                h = str(fl.Handle)
                pts = _pts_de_fl(fl)
                npts = len(pts)
                if npts < 2:
                    n_pis_raros += 1
                    log.append('  [KO] %s (%s): %d puntos (<2). Se EXCLUYE.'
                               % (nm, h, npts))
                    continue
                p0, p1 = pts[0], pts[-1]
                # vertices interiores = HINCAS (tracker FLEXIBLE si hay)
                hin = [(k, pts[k][0], pts[k][1], pts[k][2])
                       for k in range(1, npts - 1)]
                if hin:
                    n_flex += 1
                    n_hincas += len(hin)
                flz.append({'oid': oid, 'nombre': nm, 'handle': h,
                            'x0': p0[0], 'y0': p0[1], 'zact0': p0[2],
                            'x1': p1[0], 'y1': p1[1], 'zact1': p1[2],
                            'i0': 0, 'i1': npts - 1, 'hin': hin})
            except Exception as ex:
                ko_lect += 1
                log.append('  [KO] geometria FL: ' + str(ex)[:120])
        log.append('FLs candidatas: %d (ModelSpace %d, Sites %d) | '
                   'KO lectura: %d | excluidas (<2 puntos): %d'
                   % (len(oids), n_ms, n_sites, ko_lect, n_pis_raros))
        log.append('Trackers FIJOS (2 vertices): %d | FLEXIBLES (>2): %d '
                   '| hincas interiores: %d | deflexion hinca/ala: '
                   '%.2f / %.2f %%'
                   % (len(flz) - n_flex, n_flex, n_hincas, D_HINCA, D_ALA))
        if not flz:
            log.append('!!!! Ninguna FL valida con el patron "%s". Abortado.'
                       % PATRON)
            return '\n'.join(log)
        T['Geometria'] = time.perf_counter() - t0

        # ------------------------------------------------ TERRENO (MDT) --
        t0 = time.perf_counter()
        surf_mdt, nombres_sup = _busca_superficie(tr, cdoc, MDT_N)
        if surf_mdt is None:
            log.append('!!!! MDT "%s" no encontrado. Superficies en el DWG: %s'
                       % (MDT_N, ', '.join(nombres_sup) if nombres_sup
                          else '(ninguna)'))
            return '\n'.join(log)
        ko_terr = 0
        for f in flz:
            try:
                f['t0'] = float(surf_mdt.FindElevationAtXY(f['x0'], f['y0']))
                f['t1'] = float(surf_mdt.FindElevationAtXY(f['x1'], f['y1']))
                f['hin_t'] = []
                for (k, hx, hy, hz) in f.get('hin', []):
                    f['hin_t'].append(
                        (k, hx, hy,
                         float(surf_mdt.FindElevationAtXY(hx, hy)), hz))
                f['ok'] = True
            except Exception as ex:
                f['ok'] = False
                ko_terr += 1
                log.append('  [KO] %s (%s): sin cota en MDT (%s). Se EXCLUYE;'
                           ' la cadena se corta ahi.'
                           % (f['nombre'], f['handle'], str(ex)[:80]))
        flz = [f for f in flz if f.get('ok')]
        if ko_terr:
            log.append('  [i] FLs sin cota MDT excluidas: %d' % ko_terr)
        if not flz:
            log.append('!!!! Ninguna FL con cota valida sobre el MDT. '
                       'Abortado.')
            return '\n'.join(log)
        T['Terreno (MDT)'] = time.perf_counter() - t0

        # ------------------------------------------------ AGRUPACION -----
        t0 = time.perf_counter()
        for f in flz:
            f['xm'] = 0.5 * (f['x0'] + f['x1'])
            f['ym'] = 0.5 * (f['y0'] + f['y1'])
        ejes = []
        if MODO == 'NS':
            flz.sort(key=lambda f: f['xm'])
            cur = [flz[0]]
            for f in flz[1:]:
                if f['xm'] - cur[-1]['xm'] <= TOLA:
                    cur.append(f)
                else:
                    ejes.append(cur)
                    cur = [f]
            ejes.append(cur)
            for e in ejes:
                e.sort(key=lambda f: -f['ym'])
        else:
            flz.sort(key=lambda f: -f['ym'])
            cur = [flz[0]]
            for f in flz[1:]:
                if cur[-1]['ym'] - f['ym'] <= TOLA:
                    cur.append(f)
                else:
                    ejes.append(cur)
                    cur = [f]
            ejes.append(cur)
            for e in ejes:
                e.sort(key=lambda f: f['xm'])
        log.append('Ejes detectados: %d (%s)' % (len(ejes), MODO))
        log.append('-' * 70)
        T['Agrupacion ejes'] = time.perf_counter() - t0

        # ------------------------------------------------ OPTIMIZACION ---
        t0 = time.perf_counter()
        detalle = []
        n_det_max = 400
        tot = {'trk': 0, 'viol': 0, 'corr': 0, 'arr': 0, 'eoaj': 0, 'ok': 0,
               'ejes_ko': 0, 'ext_mov': 0, 'ext_mov_max': 0.0,
               'dzmax': 0.0, 'dzmax_id': '', 'desm': 0.0, 'terr': 0.0,
               'mtd': 0.0, 'mtt': 0.0, 'abs': 0, 'resc': 0,
               'flex': 0, 'hincas': 0, 'vanos': 0, 'vko_a': 0, 'vko_d': 0,
               'cko_a': 0, 'cko_d': 0, 'qko_a': 0, 'qko_d': 0,
               'alko_a': 0, 'alko_d': 0, 'qmx': 0.0, 'almx': 0.0,
               'hmov': 0, 'habs': 0}
        planes = []   # (fl_dict, idx, cota) a escribir
        reset = []    # (fl_dict, idx, cota_terreno) re-anclar a terreno
        ver_max_p = 0.0
        ver_max_e = 0.0
        ejes_trs = []
        coords_lbl = []
        for k_eje, e in enumerate(ejes):
            trs = []
            for f in e:
                if MODO == 'NS':
                    a_first = f['y0'] >= f['y1']
                else:
                    a_first = f['x0'] <= f['x1']
                if a_first:
                    ax, ay, ta, ia = f['x0'], f['y0'], f['t0'], f['i0']
                    bx, by, tb, ib = f['x1'], f['y1'], f['t1'], f['i1']
                    za_act, zb_act = f['zact0'], f['zact1']
                else:
                    ax, ay, ta, ia = f['x1'], f['y1'], f['t1'], f['i1']
                    bx, by, tb, ib = f['x0'], f['y0'], f['t0'], f['i0']
                    za_act, zb_act = f['zact1'], f['zact0']
                L = math.hypot(bx - ax, by - ay)
                hs = list(f.get('hin_t', []))
                if not a_first:
                    hs = hs[::-1]
                trd = {'id': f['nombre'], 'ax': ax, 'ay': ay,
                       'az_t': ta, 'bx': bx, 'by': by, 'bz_t': tb,
                       'len': L, '_f': f, '_ia': ia, '_ib': ib,
                       '_za_act': za_act, '_zb_act': zb_act}
                if hs:
                    trd['h'] = [(hx, hy, ht) for (k, hx, hy, ht, hz) in hs]
                    trd['_hidx'] = [k for (k, hx, hy, ht, hz) in hs]
                    trd['_hz_act'] = [hz for (k, hx, hy, ht, hz) in hs]
                trs.append(trd)
            coord = ('X~%.2f' % (sum(t['ax'] for t in trs) / len(trs))) \
                if MODO == 'NS' else \
                ('Y~%.2f' % (sum(t['ay'] for t in trs) / len(trs)))
            ejes_trs.append(trs)
            coords_lbl.append(coord)
        ORI_MAL = False
        dxs = []
        dys = []
        for trs in ejes_trs:
            for t in trs:
                dxs.append(abs(t['bx'] - t['ax']))
                dys.append(abs(t['by'] - t['ay']))
        if dxs:
            dxs.sort()
            dys.sort()
            med_x = dxs[len(dxs) // 2]
            med_y = dys[len(dys) // 2]
            if MODO == 'EO' and med_x < med_y:
                log.append('!! AVISO ORIENTACION: MODO=EO pero las FL se '
                           'extienden mas en Y (mediana |dY| = %.1f m) que '
                           'en X (%.1f m). Parecen trackers N-S: '
                           'probablemente MODO deberia ser NS.'
                           % (med_y, med_x))
                ORI_MAL = True
            elif MODO == 'NS' and med_y < med_x:
                log.append('!! AVISO ORIENTACION: MODO=NS pero las FL se '
                           'extienden mas en X (mediana |dX| = %.1f m) que '
                           'en Y (%.1f m). Parecen filas E-O: '
                           'probablemente MODO deberia ser EO.'
                           % (med_x, med_y))
                ORI_MAL = True
        if ORI_MAL and APL:
            APL = False
            log.append('!' * 66)
            log.append('!! GUARDARRAIL: aviso de orientacion con '
                       'APLICAR=True -> SE FUERZA')
            log.append('!! SIMULACION. NO se escribira nada. Revisa MODO '
                       'y vuelve a ejecutar.')
            log.append('!' * 66)
        # ---- v18: guardarrail de limites sospechosos --------------------
        try:
            s_ter = []
            for trs_g in ejes_trs:
                for t_g in trs_g:
                    if t_g['len'] > 0.05:
                        s_ter.append(abs(t_g['az_t'] - t_g['bz_t'])
                                     / t_g['len'])
            if s_ter and p_frac > 0:
                s_ter.sort()
                g50 = s_ter[len(s_ter) // 2] * 100.0
                i85 = int(len(s_ter) * 0.85)
                if i85 > len(s_ter) - 1:
                    i85 = len(s_ter) - 1
                g85 = s_ter[i85] * 100.0
                if g85 > 2.0 * p_frac * 100.0:
                    log.append('!' * 66)
                    log.append('!! GUARDARRAIL DE LIMITES: pendiente '
                               'longitudinal del terreno bajo')
                    log.append('!! los trackers: mediana %.1f %% / p85 '
                               '%.1f %%, frente a un limite'
                               % (g50, g85))
                    log.append('!! configurado de %.1f %%. Una diferencia '
                               'asi suele ser'
                               % (p_frac * 100.0))
                    log.append('!! CONFIGURACION, no fisica (leccion '
                               'Apamate): CONFIRMA que los')
                    log.append('!! limites de esta planta son realmente '
                               'NS=%.1f %% / EO=%.1f %%'
                               % (P_NS, P_EO))
                    log.append('!! antes de fiarte del resultado.')
                    log.append('!' * 66)
                else:
                    log.append('Guardarrail de limites: terreno long. '
                               'p50 %.1f %% / p85 %.1f %% vs limite '
                               '%.1f %% -> coherente.'
                               % (g50, g85, p_frac * 100.0))
        except Exception as ex_g:
            log.append('(guardarrail de limites no disponible: %s)'
                       % str(ex_g)[:80])
        if FORZAR_M:
            rp, RECETA = procesar_planta_forzar(
                ejes_trs, MODO, p_frac, p_trans, ESC, GAPC, TOLE, PITCH,
                MPITCH, SOLAPE_MIN, int(MAXP), rug_m=RUG,
                tol_rescate=TOLR, p_hincas=None)
            RINF = {'activo': False,
                    'nota': 'modo FORZAR: objetivo de tierras '
                            'desactivado'}
        else:
            RECETA = None
            rp, RINF = procesar_planta_ratio(
                ejes_trs, MODO, p_frac, p_trans, ESC, GAPC, TOLE, PITCH,
                MPITCH, SOLAPE_MIN, FASE_EFF, int(MAXP), ratio_obj=RATIO,
                ratio_tol=TOLRAT, rug_m=RUG, tol_rescate=TOLR, p_hincas=None)
        eo = rp['eo']
        for k_eje, trs in enumerate(ejes_trs):
            coord = coords_lbl[k_eje]
            r = rp['ejes'][k_eje]
            if r['status'] == 'KO':
                tot['ejes_ko'] += 1
                tot['trk'] += len(trs)
                log.append('EJE %02d %s | %d trk | KO NO RESUELTO: %s'
                           % (k_eje + 1, coord, len(trs), r['msg']))
                continue
            st = r['stats']
            tot['trk'] += len(trs)
            tot['viol'] += st['violaban']
            tot['corr'] += st['corregidos']
            tot['arr'] += st['arrastrados']
            tot['eoaj'] += st.get('ajuste_eo', 0)
            tot['ok'] += st['sin_tocar']
            tot['desm'] += st['suma_desmonte']
            tot['terr'] += st['suma_terraplen']
            tot['mtd'] += st.get('mt_desmonte', 0.0)
            tot['mtt'] += st.get('mt_terraplen', 0.0)
            tot['abs'] += st.get('absorbidos', 0)
            tot['flex'] += st.get('flex', 0)
            tot['hincas'] += st.get('hincas', 0)
            tot['vanos'] += st.get('vanos', 0)
            tot['vko_a'] += st.get('vanos_ko_antes', 0)
            tot['vko_d'] += st.get('vanos_ko_despues', 0)
            tot['cko_a'] += st.get('cuerda_ko_antes', 0)
            tot['cko_d'] += st.get('cuerda_ko_despues', 0)
            tot['qko_a'] += st.get('q_ko_a', 0)
            tot['qko_d'] += st.get('q_ko_d', 0)
            tot['alko_a'] += st.get('ala_ko_a', 0)
            tot['alko_d'] += st.get('ala_ko_d', 0)
            if st.get('qmax_d', 0.0) > tot['qmx']:
                tot['qmx'] = st['qmax_d']
            if st.get('alamax_d', 0.0) > tot['almx']:
                tot['almx'] = st['alamax_d']
            tot['hmov'] += st.get('hincas_movidas', 0)
            tot['habs'] += st.get('h_absorbidos', 0)
            if abs(st['dz_max']) > abs(tot['dzmax']):
                tot['dzmax'] = st['dz_max']
                tot['dzmax_id'] = st['dz_max_id']
            anc = r['anc']
            etq_a = 'fijo' if anc['a_mov'] is None else '%+0.2f m (ancla)' \
                % anc['a_mov']
            etq_b = 'fijo' if anc['b_mov'] is None else '%+0.2f m (ancla)' \
                % anc['b_mov']
            for mv in (anc['a_mov'], anc['b_mov']):
                if mv is not None:
                    tot['ext_mov'] += 1
                    if abs(mv) > tot['ext_mov_max']:
                        tot['ext_mov_max'] = abs(mv)
            lado = ('N', 'S') if MODO == 'NS' else ('O', 'E')
            if st['violaban'] or st['corregidos'] or st['arrastrados'] \
                    or st.get('ajuste_eo', 0) or anc['a_mov'] is not None \
                    or anc['b_mov'] is not None or st['subcadenas'] > 1:
                log.append('EJE %02d %s | %d trk | subcad %d | violaban %d |'
                           ' corrige %d | arrastre %d | eo %d | sin tocar %d'
                           ' | dZmax %+0.2f | extremos: %s %s / %s %s'
                           % (k_eje + 1, coord, len(trs), st['subcadenas'],
                              st['violaban'], st['corregidos'],
                              st['arrastrados'], st.get('ajuste_eo', 0),
                              st['sin_tocar'], st['dz_max'],
                              lado[0], etq_a, lado[1], etq_b))
            else:
                log.append('EJE %02d %s | %d trk | conforme, sin tocar'
                           % (k_eje + 1, coord, len(trs)))
            if r.get('rescate'):
                rc = r['rescate']
                tot['resc'] += 1
                log.append('        RESCATADO: %s (TOL %.2f m%s)'
                           % ('anclas ampliadas' if rc['tipo'] == 'ANCLAS'
                              else 'pendiente minima factible',
                              rc['tol'],
                              '' if rc['tipo'] == 'ANCLAS' else
                              ', p lograda = %.2f %%'
                              % (rc['p_eff'] * 100.0)))
            p_ver = r['rescate']['p_eff'] if r.get('rescate') else p_frac
            eff = []
            for tr_d, res in zip(trs, r['res']):
                f = tr_d['_f']
                ea = res['za'] if res['wa'] else tr_d['az_t']
                eb = res['zb'] if res['wb'] else tr_d['bz_t']
                if res['wa']:
                    planes.append((f, tr_d['_ia'], res['za']))
                elif abs(tr_d['_za_act'] - tr_d['az_t']) > 0.005:
                    reset.append((f, tr_d['_ia'], tr_d['az_t']))
                if res['wb']:
                    planes.append((f, tr_d['_ib'], res['zb']))
                elif abs(tr_d['_zb_act'] - tr_d['bz_t']) > 0.005:
                    reset.append((f, tr_d['_ib'], tr_d['bz_t']))
                if res.get('flex') and tr_d.get('_hidx'):
                    for q, k_pi in enumerate(tr_d['_hidx']):
                        h_t = tr_d['h'][q][2]
                        if abs(res['hdz'][q]) > 1e-9:
                            planes.append((f, k_pi, res['hz'][q]))
                        elif abs(tr_d['_hz_act'][q] - h_t) > 0.005:
                            reset.append((f, k_pi, h_t))
                eff.append((ea, eb))
                exceso = abs(ea - eb) - (p_ver * tr_d['len'] + 0.006)
                if exceso > ver_max_p:
                    ver_max_p = exceso
                if res['clase'] in ('CORRIGE', 'ARRASTRE', 'EO'):
                    if len(detalle) < n_det_max:
                        detalle.append(
                            '    EJE %02d %s (%s) %5.2f%% -> %5.2f%%  '
                            'dA=%+0.2f dB=%+0.2f  %s'
                            % (k_eje + 1, tr_d['id'], f['handle'],
                               res['s_antes'] * 100.0,
                               res['s_despues'] * 100.0,
                               res['dza'], res['dzb'], res['clase']))
            for i in range(len(trs) - 1):
                g = math.hypot(trs[i + 1]['ax'] - trs[i]['bx'],
                               trs[i + 1]['ay'] - trs[i]['by'])
                if g <= GAPC:
                    nat = abs(trs[i]['bz_t'] - trs[i + 1]['az_t'])
                    d = abs(eff[i][1] - eff[i + 1][0])
                    exceso = d - (max(ESC, nat) + 0.006)
                    if exceso > ver_max_e:
                        ver_max_e = exceso
        T['Optimizacion'] = time.perf_counter() - t0
        if detalle:
            log.append('-' * 70)
            log.append('DETALLE (solo trackers modificados; max %d lineas):'
                       % n_det_max)
            log.extend(detalle)
            resto = tot['corr'] + tot['arr'] + tot['eoaj'] - len(detalle)
            if resto > 0:
                log.append('    ... y %d modificados mas (no listados)'
                           % resto)
        if eo['activa']:
            log.append('-' * 70)
            log.append('FASE EO: pares %d | pasadas %d%s | estado adoptado:'
                       ' pasada %s | nodos movidos por EO: %d'
                       % (eo['pares'], eo['pasadas'],
                          '' if eo['convergio'] else
                          ' (tope/ciclo, sin converger del todo)',
                          eo.get('mejor_pasada', '-'),
                          eo['nodos_movidos_eo']))
            log.append('         relajaciones %d | exigencias descartadas %d'
                       ' | col. sin resolver %d | etapa solo-desmonte: '
                       '%s pasadas'
                       % (eo['relajaciones'], eo.get('descartes', 0),
                          eo['col_sin_resolver'],
                          eo.get('pasadas_desmonte', 0)))
            if eo.get('wl_potencial'):
                ah = 100.0 * (1.0 - float(eo['wl_resueltas'])
                              / eo['wl_potencial'])
                log.append('         WORK-LIST (v19): %d columnas '
                           'resueltas de %d posibles (ahorro %.0f %%)'
                           % (eo['wl_resueltas'], eo['wl_potencial'],
                              ah))
            if eo.get('pares_punta'):
                log.append('         pares en punta/diagonal (escalones): %d'
                           ' de %d' % (eo['pares_punta'], eo['pares']))
            if eo.get('arrastre_casc'):
                log.append('         ARRASTRE transversal: %d cascadas | %d '
                           'desplazamientos de columna | max %.2f m'
                           % (eo['arrastre_casc'], eo['arrastre_cols'],
                              eo['arrastre_max']))
            psw = eo.get('peine_sw')
            if psw:
                log.append('         PEINE EO (v19, barridos intermedios):'
                           ' %d barridos | filas %d (%d aplicadas) | '
                           'mesas %d (max %.2f m)'
                           % (psw.get('barridos', 0), psw['filas'],
                              psw['aplicadas'], psw['mesas_movidas'],
                              psw['dmax']))
            pe = eo.get('peine')
            if pe is not None:
                if pe.get('error'):
                    log.append('         PEINE EO (v18): ERROR %s'
                               % pe['error'])
                elif pe.get('kos_ini', 0) > 0:
                    log.append('         PEINE EO (v18, rescate por filas):'
                               ' KOs %d -> %d | filas %d (%d aplicadas)'
                               % (pe['kos_ini'], pe['kos_fin'],
                                  pe['filas'], pe['aplicadas']))
                    if pe.get('aplicadas'):
                        log.append('                  mesas movidas %d | '
                                   'delta max %.2f m | ampliaciones %d | '
                                   'DP infactibles %d'
                                   % (pe['mesas_movidas'], pe['dmax'],
                                      pe['ampliaciones'],
                                      pe['infactibles']))
            if eo['pares'] == 0:
                log.append('   !! 0 pares detectados: ninguna pareja de '
                           'mesas vecinas cumple ventana y solape. Revisa '
                           'MODO (orientacion de las FL), PITCH +- MARGEN '
                           '(ventana actual %.2f - %.2f m) y SOLAPE_MIN '
                           '(%.2f m).'
                           % (PITCH - MPITCH, PITCH + MPITCH, SOLAPE_MIN))
            if eo['ko_pares']:
                log.append('!! PARES EO NO RESUELTOS: %d (tipicos: entre '
                           'extremos anclados a terreno)'
                           % len(eo['ko_pares']))
                for k in eo['ko_pares'][:80]:
                    log.append('    EJE %02d %s <-> EJE %02d %s en s=%.2f: '
                               'dZ=%.2f > lim %.2f (exceso %.2f m)'
                               % (k['ea'] + 1, k['ida'], k['eb'] + 1,
                                  k['idb'], k['s'], k['dz'], k['lim'],
                                  k['exceso']))
                if len(eo['ko_pares']) > 80:
                    log.append('    ... y %d mas'
                               % (len(eo['ko_pares']) - 80))
            else:
                log.append('   Todos los pares EO cumplen (holgura 11 mm).')
            rc = eo.get('rescate', {})
            if rc.get('activo'):
                log.append('FASE RESCATE (TOL_RESCATE %.2f m): %d pares KO '
                           'objetivo -> %d resueltos | %d ejes con anclas '
                           'ampliadas | %d pasadas extra'
                           % (TOLR, rc['pares_obj'], rc['resueltos'],
                              rc['ejes'], rc['pasadas']))
            aus = eo.get('autopsias') or []
            if aus:
                log.append('AUTOPSIA DE PARES KO (por que no se corrigen):')
                for i2, a in enumerate(aus):
                    log.append(' %d) %s(ALTO) <-> %s(BAJO) en s=%.1f | '
                               'salto %.2f | lim %.2f | cierre necesario '
                               '%.2f m'
                               % (i2 + 1, a['ida'], a['idb'], a['s'],
                                  a['dz'], a['lim'], a['exceso']))
                    log.append('    ALTO %s: puede bajar %.2f m  '
                               '[limita: %s]'
                               % (a['ida'], a['mov_alto'], a['lim_alto']))
                    if a['vecinos_alto']:
                        log.append('         pares mas justos: ' + ' | '
                                   .join('%s %.2f m' % v
                                         for v in a['vecinos_alto']))
                    log.append('    BAJO %s: puede subir %.2f m  '
                               '[limita: %s]'
                               % (a['idb'], a['mov_bajo'], a['lim_bajo']))
                    if a['vecinos_bajo']:
                        log.append('         pares mas justos: ' + ' | '
                                   .join('%s %.2f m' % v
                                         for v in a['vecinos_bajo']))
                    if a['faltan'] > 0:
                        log.append('    VEREDICTO: movilidad %.2f + %.2f '
                                   '= %.2f < %.2f -> FALTAN %.2f m: '
                                   'ESTRUCTURAL (implantacion, talud o '
                                   'mas TOL a sabiendas)'
                                   % (a['mov_alto'], a['mov_bajo'],
                                      a['mov_alto'] + a['mov_bajo'],
                                      a['exceso'], a['faltan']))
                    else:
                        pe_a = eo.get('peine') or {}
                        if pe_a and not pe_a.get('error'):
                            log.append('    VEREDICTO: la movilidad '
                                       'alcanza (%.2f >= %.2f) pero el '
                                       'acople NO converge ni con el '
                                       'PEINE EO -> subir MAX_PASADAS o '
                                       'TOL ya NO ayuda: implantacion o '
                                       'retoque manual local (cuna E-O)'
                                       % (a['mov_alto'] + a['mov_bajo'],
                                          a['exceso']))
                        else:
                            log.append('    VEREDICTO: la movilidad '
                                       'alcanza (%.2f >= %.2f) -> residuo '
                                       'de acople fino: sube MAX_PASADAS '
                                       'o TOL_RESCATE'
                                       % (a['mov_alto'] + a['mov_bajo'],
                                          a['exceso']))

        # ------------------------------------------------ ESCRITURA ------
        t0 = time.perf_counter()
        if APL:
            for f, idx, cota in planes:
                try:
                    fl = tr.GetObject(f['oid'], OpenMode.ForWrite)
                    fl.SetPointElevation(idx, float(cota))
                    n_escritos += 1
                except Exception as ex:
                    log.append('  [KO] escritura %s (%s) idx %d: %s'
                               % (f['nombre'], f['handle'], idx,
                                  str(ex)[:100]))
            for f, idx, cota in reset:
                try:
                    fl = tr.GetObject(f['oid'], OpenMode.ForWrite)
                    fl.SetPointElevation(idx, float(cota))
                    n_reanclados += 1
                except Exception as ex:
                    log.append('  [KO] re-anclaje %s (%s) idx %d: %s'
                               % (f['nombre'], f['handle'], idx,
                                  str(ex)[:100]))
        T['Escritura'] = time.perf_counter() - t0

        # ------------------------------------------------ REBUILD --------
        t0 = time.perf_counter()
        surf_tr_obj = None
        if APL and SUP_TR and (n_escritos + n_reanclados) > 0:
            try:
                surf_tr_obj, _ = _busca_superficie(tr, cdoc, SUP_TR)
                if surf_tr_obj is None:
                    rebuild_txt = 'KO: superficie "%s" no encontrada' % SUP_TR
                else:
                    s_w = tr.GetObject(surf_tr_obj.ObjectId,
                                       OpenMode.ForWrite)
                    s_w.Rebuild()
                    rebuild_txt = 'OK'
            except Exception as ex:
                rebuild_txt = 'KO: ' + str(ex)[:140]
        elif APL and SUP_TR:
            rebuild_txt = '(sin cambios: no necesario)'
        elif APL:
            rebuild_txt = '(nombre vacio: omitido)'
        T['Rebuild'] = time.perf_counter() - t0

        # ------------------------------------------------ AUDITORIA Z ----
        t0 = time.perf_counter()
        if APL and rebuild_txt == 'OK' and surf_tr_obj is not None:
            try:
                zs = []
                xy_min = (0.0, 0.0)
                zmin = None
                en = surf_tr_obj.Vertices.GetEnumerator()
                while en.MoveNext():
                    v = en.Current
                    z = v.Location.Z
                    zs.append(z)
                    if zmin is None or z < zmin:
                        zmin = z
                        xy_min = (v.Location.X, v.Location.Y)
                if zs:
                    zs.sort()
                    med = zs[len(zs) // 2]
                    if zmin < med - 50.0:
                        audit_txt = ('!!!!!! AUDITORIA Z: vertice anomalo '
                                     'Z=%.2f en (%.2f, %.2f); mediana %.2f. '
                                     'SUPERFICIE NO VALIDA.'
                                     % (zmin, xy_min[0], xy_min[1], med))
                    else:
                        audit_txt = ('AUDITORIA Z: OK (n=%d, min=%.2f, '
                                     'mediana=%.2f)' % (len(zs), zmin, med))
                else:
                    audit_txt = 'AUDITORIA Z: superficie sin vertices (?)'
            except Exception as ex:
                audit_txt = 'AUDITORIA Z: KO ' + str(ex)[:140]
        T['Auditoria Z'] = time.perf_counter() - t0

        if APL:
            tr.Commit()
        else:
            tr.Abort()
    except Exception:
        try:
            tr.Abort()
        except Exception:
            pass
        log.append('!!!! EXCEPCION:')
        log.append(traceback.format_exc())
        return '\n'.join(log)
    finally:
        try:
            tr.Dispose()
        except Exception:
            pass
        try:
            lock.Dispose()
        except Exception:
            pass

    # ---------------------------------------------------- RESUMEN --------
    log.append('-' * 70)
    log.append('RESUMEN GLOBAL')
    log.append('  Ejes: %d (OK %d, KO NO RESUELTO %d) | Trackers: %d'
               % (len(ejes), len(ejes) - tot['ejes_ko'], tot['ejes_ko'],
                  tot['trk']))
    log.append('  Violaban pendiente: %d | Corregidos: %d | Arrastrados: %d'
               ' | Ajuste EO: %d | Sin tocar: %d'
               % (tot['viol'], tot['corr'], tot['arr'], tot['eoaj'],
                  tot['ok']))
    log.append('  Extremos exteriores movidos: %d (max %.2f m) | '
               'dZ max global: %+0.2f m (%s)'
               % (tot['ext_mov'], tot['ext_mov_max'], tot['dzmax'],
                  tot['dzmax_id'] if tot['dzmax_id'] else '-'))
    if tot['flex']:
        log.append('  HINCAS (flexibles): %d mesas | %d hincas | %d vanos | '
                   'vanos KO antes %d -> despues %d | CUERDA vs p_max long: '
                   'KO antes %d -> despues %d | hincas movidas %d '
                   '(absorbidas por rugosidad %d)'
                   % (tot['flex'], tot['hincas'], tot['vanos'], tot['vko_a'],
                      tot['vko_d'], tot['cko_a'], tot['cko_d'], tot['hmov'],
                      tot['habs']))
        log.append('  DEFLEXIONES: quiebros KO antes %d -> despues %d '
                   '(max final %.2f %%) | ALAS (motora excluida) KO antes '
                   '%d -> despues %d (max final %.2f %%)'
                   % (tot['qko_a'], tot['qko_d'], tot['qmx'] * 100.0,
                      tot['alko_a'], tot['alko_d'], tot['almx'] * 100.0))
        try:
            dfx = eo.get('deflex')
        except Exception:
            dfx = None
        conf_txt = ''
        if dfx and 'pares_ko_antes' in dfx:
            conf_txt = (' | RECONCILIACION EO: shifts %d (max %.2f m), '
                        'pares KO %d -> %d'
                        % (dfx.get('shifts', 0), dfx.get('shift_max', 0.0),
                           dfx.get('pares_ko_antes', 0),
                           dfx.get('pares_ko_despues', 0)))
        if dfx and 'error' in dfx:
            log.append('  !! PULIDO DEFLEXIONES fallo: %s' % dfx['error'])
        elif dfx:
            log.append('  PULIDO: %d mesas ajustadas (%d hincas, dZ max '
                       '%.3f m, %d rectificadas al maximo) en %d ejes%s'
                       % (dfx['trackers_pulidos'],
                          dfx['hincas_ajustadas'],
                          dfx['dz_max_pulido'], dfx['rectos'],
                          dfx['ejes_tocados'], conf_txt))
        log.append('  Deflexiones finales: quiebros KO %d | alas KO %d%s'
                   % (tot['qko_d'], tot['alko_d'],
                      ' -> OK' if not (tot['qko_d'] or tot['alko_d'])
                      else ' -> !! NO RESUELTAS (guardia de solape en los '
                           'ejes en conflicto o hincas insuficientes para '
                           'el quiebro del terreno)'))
    log.append('  Suma |dZ| en puntos (no son m3): desmonte %.2f m | '
               'terraplen %.2f m' % (tot['desm'], tot['terr']))
    log.append('  MOV. TIERRAS (descontada rugosidad %.2f m): desmonte '
               '%.2f m | terraplen %.2f m | puntos absorbidos por la '
               'hinca: %d' % (RUG, tot['mtd'], tot['mtt'], tot['abs']))
    ver_ok_p = ver_max_p <= 1e-9
    ver_ok_e = ver_max_e <= 1e-9
    log.append('  Verificacion final (holgura 6 mm por anclaje exacto a '
               'terreno): pendientes %s | juntas %s'
               % ('OK' if ver_ok_p else
                  '!! REVISAR (exceso %.3f m)' % ver_max_p,
                  'OK' if ver_ok_e else
                  '!! REVISAR (exceso %.3f m)' % ver_max_e))
    if RECETA is not None:
        log.append('MODO FORZAR - RECETA VERIFICADA:')
        for tl, ps, nk, ex in RECETA['intentos']:
            log.append('   intento TOL_RESCATE=%.2f MAX_PASADAS=%d -> '
                       'KOs %d (exceso %.2f)' % (tl, ps, nk, ex))
        if RECETA['cumple']:
            log.append('   CUMPLE TODA LA PLANTA con TOL_RESCATE=%.2f y '
                       'MAX_PASADAS_EO=%d (iniciales: %.2f / %d). Resto '
                       'de inputs: los actuales.'
                       % (RECETA['tol_fin'], RECETA['pas_fin'],
                          RECETA['tol_ini'], RECETA['pas_ini']))
        else:
            log.append('   NO CUMPLE TODO: quedan %d KO -> implantacion: '
                       '%s' % (RECETA['kos'],
                               ', '.join('%s<->%s' % p for p in
                                         RECETA['irreducibles'][:5])))
            kos_b = eo.get('ko_pares') or []
            exc_tot = 0.0
            peor = None
            for k_b in kos_b:
                exc_tot += k_b['exceso']
                if peor is None or k_b['exceso'] > peor['exceso']:
                    peor = k_b
            log.append('!' * 70)
            log.append('!!')
            log.append('!!   IMPOSIBLE CUMPLIR EL 100% CON ESTOS LIMITES '
                       'Y TOPES')
            log.append('!!   (verificado: FORZAR escalado + PEINE EO '
                       'agotados)')
            log.append('!!')
            log.append('!!   KOs irreducibles: %d | exceso total %.2f m%s'
                       % (RECETA['kos'], exc_tot,
                          (' | peor: %s<->%s (%.2f m en s=%.1f)'
                           % (peor['ida'], peor['idb'], peor['exceso'],
                              peor['s'])) if peor is not None else ''))
            log.append('!!   MEJOR ESFUERZO %s: el resultado de ESTA '
                       'corrida'
                       % ('APLICADO' if APL else
                          'DISPONIBLE (dry-run: APLICAR=True para '
                          'escribirlo)'))
            log.append('!!   (todo lo demas cumple). Salidas: '
                       'implantacion en los pares')
            log.append('!!   listados, explanacion/terraceo local o '
                       'aceptar el exceso residual.')
            log.append('!!')
            log.append('!' * 70)
    elif (eo.get('ko_pares')
          or any(r.get('status') == 'KO' for r in rp['ejes'])):
        rt = eo.get('receta_tol_total')
        rpas = eo.get('receta_pasadas') or int(MAXP)
        if rt is not None or rpas > int(MAXP):
            log.append('RECETA ESTIMADA para cumplir toda la planta: '
                       'TOL_RESCATE ~ %s | MAX_PASADAS_EO ~ %d | resto '
                       'de inputs: los actuales. Verificable con '
                       'FASE=FORZAR.'
                       % (('%.2f m' % rt) if rt is not None
                          else ('%.2f m (actual)' % TOLR), rpas))
        else:
            log.append('RECETA: ninguna combinacion de palancas cumple '
                       'todo -> implantacion en los pares listados '
                       '(FASE=FORZAR lo confirmaria).')
            log.append('!' * 70)
            log.append('!!  PROBABLE IMPOSIBILIDAD CON ESTOS LIMITES '
                       '(estimacion estatica):')
            log.append('!!  ninguna palanca llega. Confirmalo con '
                       'FORZAR=True; el resultado')
            log.append('!!  actual queda como MEJOR ESFUERZO %s.'
                       % ('APLICADO' if APL else 'de la simulacion'))
            log.append('!' * 70)
    hay_ko_esc = bool(eo.get('ko_pares')) or any(
        r.get('status') == 'KO' for r in rp['ejes'])
    if RECETA is None and hay_ko_esc:
        t_esc = time.perf_counter()
        filas_esc = escenarios_comparativos(
            ejes_trs, MODO, p_frac, p_trans, ESC, GAPC, PITCH, MPITCH,
            SOLAPE_MIN, int(MAXP), 10, RUG, TOLE, TOLR, rp, p_hincas=None)
        log.append('ESCENARIOS COMPARATIVOS (resueltos de verdad, NO '
                   'aplicados; ratio off en los casos):')
        for f in filas_esc:
            etq = 'CUMPLE' if f['kos'] == 0 else 'KOs %d' % f['kos']
            rat = (f['D'] / f['T']) if f['T'] > 1e-9 else 0.0
            log.append('  %-7s EXTREMO %.2f / RESCATE %.2f (pasadas %d)'
                       ' -> %-7s | tierras %.2f/%.2f%s | anclas %d '
                       '(max %.2f) | dZmax %.2f'
                       % (f['nombre'], f['ext'], f['resc'], f['pas'],
                          etq, f['D'], f['T'],
                          (' (D/T %.2f)' % rat) if f['T'] > 1e-9 else '',
                          f['anc_n'], f['anc_max'], f['dzmax']))
        if any(f['kos'] > filas_esc[0]['kos'] for f in filas_esc[1:]):
            log.append('  NOTA: algun caso sale peor que REAL; el motor '
                       'es iterativo (no monotono con mas libertad).')
        ok_f = [f for f in filas_esc if f['kos'] == 0]
        if ok_f:
            mejor_f = min(ok_f, key=lambda f: (f['D'] + f['T']))
            log.append('  -> cumple con menos tierras: %s (EXTREMO %.2f '
                       '/ RESCATE %.2f)'
                       % (mejor_f['nombre'], mejor_f['ext'],
                          mejor_f['resc']))
        else:
            log.append('  -> ningun escenario cumple del todo: ver '
                       'AUTOPSIA / IMPLANTACION.')
        T['Escenarios'] = time.perf_counter() - t_esc
    recs = eo.get('recos') or []
    if recs:
        log.append('QUE TOCAR (prioridad P1 MAX_PASADAS_EO -> P2 TOL_RESCATE -> '
                   'P3 TOL_EXTREMOS -> IMPLANTACION; estimacion estatica, '
                   'verificar en dry-run):')
    if RINF.get('activo'):
        def _fr(r):
            if r < 0:
                return 'n/a'
            if r == float('inf') or r > 900:
                return 'inf'
            return '%.2f' % r
        log.append('  OBJETIVO DE TIERRAS D/T = %.2f +- %.2f -> logrado %s '
                   '%s [%d optimizaciones]'
                   % (RINF['objetivo'], RINF['tol'], _fr(RINF['logrado']),
                      '(EN BANDA)' if RINF['en_banda'] else
                      '!! ' + RINF['nota'], RINF['iteraciones']))
        log.append('    intentos corte/relleno -> ratio: ' + ' | '.join(
            '%d/%d -> %s' % (a, b, _fr(r))
            for a, b, r, _, _ in RINF['historial']))
        if not RINF['en_banda'] and RINF.get('logrado', -1.0) >= 0 \
                and RINF['logrado'] != float('inf'):
            log.append('    -> acepta el %.2f logrado o pon RATIO=0 '
                       '(tierras totales: %.2f m en puntos).'
                       % (RINF['logrado'],
                          RINF.get('D', 0.0) + RINF.get('T', 0.0)))
    if tot.get('resc'):
        log.append('  Ejes RESCATADOS (condiciones ampliadas): %d'
                   % tot['resc'])
    if eo['activa']:
        log.append('  Pares EO: %s'
                   % ('todos cumplen' if not eo['ko_pares'] else
                      '%d NO resueltos (ver bloque FASE EO)'
                      % len(eo['ko_pares'])))
    if APL:
        log.append('  Extremos escritos: %d | Re-anclados a terreno: %d'
                   % (n_escritos, n_reanclados))
        log.append('  Rebuild "%s": %s' % (SUP_TR if SUP_TR else '-',
                                           rebuild_txt))
        log.append('  ' + audit_txt)
    else:
        log.append('  SIMULACION (APLICAR=False): NO se ha modificado nada.')
        log.append('  Pendientes de escribir si aplicas: %d extremos '
                   'corregidos + %d re-anclajes a terreno'
                   % (len(planes), len(reset)))
    log.append('')
    log.append('==== RESUMEN DE TIEMPOS ====')
    for k in ('Lectura FLs', 'Geometria', 'Terreno (MDT)', 'Agrupacion ejes',
              'Optimizacion', 'Escenarios', 'Escritura', 'Rebuild',
              'Auditoria Z'):
        if k in T:
            log.append('  {:<27}{:>7.2f} s'.format(k, T[k]))
    log.append('  {:<27}{:>7.2f} s'.format('TOTAL',
                                           time.perf_counter() - t00))
    try:
        import os
        try:
            from Autodesk.AutoCAD.ApplicationServices import \
                Application as _App
            carpeta = os.path.dirname(
                _App.DocumentManager.MdiActiveDocument.Name)
        except Exception:
            carpeta = ''
        if not carpeta or not os.path.isdir(carpeta):
            carpeta = os.environ.get('TEMP', '.')
        ruta_log = os.path.join(
            carpeta, '3_CorreccionPendientes_log_%s_%d.txt'
            % (time.strftime('%Y%m%d_%H%M%S'), os.getpid()))
        fh = open(ruta_log, 'w', encoding='utf-8')
        fh.write('\n'.join(log))
        fh.close()
        log.append('')
        log.append('LOG GUARDADO EN: ' + ruta_log)
    except Exception as ex:
        log.append('(no se pudo guardar el log a fichero: '
                   + str(ex)[:80] + ')')
    return '\n'.join(log)


OUT = run()
# ----------------------------------------
LOG = Watch(n3_CorreccionPendientes_v24)
