# Dynamo graph FeatureLines_AjustarCotasNorteSur_3.dyn (Dynamo 2.19.4.6671)
# author: Lynka / Juande
# Ajusta cotas Norte/Sur de feature lines (de 2 vertices) y reconstruye una TinSurface.

# note: USO
# 1) En Civil 3D, selecciona con el raton las Feature Lines que
#    quieras modificar (clic / ventana, antes de pulsar Run).
# 2) En este grafico, ajusta:
#      delta_norte (m)    -> +sube / -baja el PI mas al Norte
#      delta_sur   (m)    -> +sube / -baja el PI mas al Sur
#      nombre superficie  -> TinSurface que se reconstruye al final
#                             (dejar vacio = no reconstruir).
# 3) Pulsa Run. El log saldra en el Watch.
# NOTAS
# - FL horizontales E-W (|dY| < 1 cm) se omiten con aviso.
# - FL con mas de 2 PIs: solo se mueven los PIs extremos (idx 0
#   e idx N-1). Aviso en log.
# - Alternativa al pickfirst: cablea un selector (Civil 3D Toolkit,
#   Camber, etc.) al puerto IN[0] del nodo Python.
delta_norte_m = DoubleInput(0)  # graph input
delta_sur_m = DoubleInput(0.5)  # graph input
nombre_superficie = StringInput("")  # graph input
featureLines_AjustarCotasNorteSur = Python(IN[1]=delta_norte_m, IN[2]=delta_sur_m, IN[3]=nombre_superficie)  # CPython3; unwired: IN[0]
# ---------- featureLines_AjustarCotasNorteSur.python (425 lines) ----------
# -*- coding: utf-8 -*-
# =============================================================================
# FeatureLines_AjustarCotasNorteSur.dyn   (v2)
# Civil 3D 2024 / Dynamo 2.19.x / CPython3
#
# Para cada FeatureLine seleccionada:
#   - Identifica el PI de coordenada Y mayor (Norte = "Punto 1")
#   - Identifica el PI de coordenada Y menor (Sur   = "Punto 2")
#   - Aplica deltas relativos de elevacion (positivos suben, negativos bajan)
# Despues reconstruye la TinSurface indicada por nombre (solo si hubo cambios).
#
# Cambios v2:
#   - API correcta: GetPoints(FeatureLinePointType.PIPoint) y
#     SetPointElevation(int, double). En v1 use GetPointAtPI/GetElevationAtPI
#     que NO existen en C3D 2024.
#   - Introspeccion en la primera FL: el log lista los metodos relevantes,
#     asi cualquier renombrado futuro se detecta de inmediato.
#   - Rebuild solo si hubo al menos 1 OK.
#   - Enumeracion segura de Point3dCollection (no se asume indexer).
#
# Reglas:
#   - FL de 2 vertices; si hay mas, solo se mueven extremos (aviso en log).
#   - Si |Y_norte - Y_sur| < EPS_Y_M (1 cm), FL horizontal E-W -> no se toca.
#   - delta_norte y delta_sur son globales (mismos para todas).
#   - Reconstruye solo la superficie cuyo nombre se pasa por IN[3].
#
# Inputs:
#   IN[0] : list[FeatureLine wrappers]   OPCIONAL (vacio -> pickfirst).
#   IN[1] : double   delta_norte  (m, +sube / -baja).
#   IN[2] : double   delta_sur    (m, +sube / -baja).
#   IN[3] : string   nombre_superficie   (vacio = no reconstruir).
#
# Output:
#   OUT : string  log multilinea para conectar a un Watch.
# =============================================================================

import clr
import traceback

clr.AddReference('AcMgd')
clr.AddReference('AcCoreMgd')
clr.AddReference('AcDbMgd')
clr.AddReference('AecBaseMgd')
clr.AddReference('AeccDbMgd')

from Autodesk.AutoCAD.ApplicationServices import Application as AcadApp
from Autodesk.AutoCAD.DatabaseServices import OpenMode, ObjectId
from Autodesk.AutoCAD.EditorInput import PromptStatus
from Autodesk.Civil.ApplicationServices import CivilApplication
from Autodesk.Civil.DatabaseServices import FeatureLine, TinSurface

# FeatureLinePointType vive en Autodesk.Civil (namespace base), NO en
# Autodesk.Civil.DatabaseServices. En v2 lo importe del sitio equivocado y
# fallaba el modulo entero antes de procesar nada.
# Importacion robusta con fallbacks por si Autodesk lo mueve de namespace
# en futuras versiones.
FeatureLinePointType = None
_import_log = []
try:
    from Autodesk.Civil import FeatureLinePointType as _FLPT  # ubicacion correcta C3D 2024
    FeatureLinePointType = _FLPT
    _import_log.append("FeatureLinePointType: Autodesk.Civil OK")
except ImportError as ex1:
    _import_log.append("Autodesk.Civil: {}".format(str(ex1)[:80]))
    try:
        from Autodesk.Civil.DatabaseServices import FeatureLinePointType as _FLPT2
        FeatureLinePointType = _FLPT2
        _import_log.append("FeatureLinePointType: Autodesk.Civil.DatabaseServices OK (fallback)")
    except ImportError as ex2:
        _import_log.append("Autodesk.Civil.DatabaseServices: {}".format(str(ex2)[:80]))


def resolve_pi_point_enum(log):
    """Devuelve el valor del enum 'PIPoint' aunque el namespace haya cambiado.
    Estrategia:
      1) Si FeatureLinePointType esta cargado, devuelve .PIPoint
      2) Si no, escanea ensamblados de Autodesk.Civil* via reflection
         buscando un Enum llamado 'FeatureLinePointType'.
    Devuelve None si no encuentra nada (en ese caso, el script no puede
    procesar y abortara con mensaje claro).
    """
    if FeatureLinePointType is not None:
        try:
            return FeatureLinePointType.PIPoint
        except AttributeError as ex:
            log.append("WARN: FeatureLinePointType cargado pero sin .PIPoint: {}".format(ex))

    # Fallback por reflexion
    try:
        import System
        for asm in System.AppDomain.CurrentDomain.GetAssemblies():
            try:
                aname = asm.GetName().Name
            except Exception:
                continue
            if 'Civil' not in aname:
                continue
            try:
                types = asm.GetTypes()
            except Exception:
                continue
            for t in types:
                if t.Name == 'FeatureLinePointType' and t.IsEnum:
                    try:
                        val = System.Enum.Parse(t, 'PIPoint')
                        log.append("Reflection: FeatureLinePointType.PIPoint encontrado en {} ({})".format(
                            aname, t.FullName))
                        return val
                    except Exception as ex_p:
                        log.append("Reflection: t={} pero Parse fallo: {}".format(
                            t.FullName, str(ex_p)[:80]))
    except Exception as ex:
        log.append("Reflection scan fallo: {}".format(str(ex)[:120]))
    return None


EPS_Y_M = 0.01  # 1 cm: umbral para considerar FL "horizontal Este-Oeste"

# Flag de modulo: True tras volcar la introspeccion una sola vez.
_DIAG_DONE = False


def diag_featureline_api(fl, log):
    """Vuelca al log los metodos / propiedades relevantes de la primera FL,
    para detectar de inmediato cambios de API entre versiones de C3D."""
    global _DIAG_DONE
    if _DIAG_DONE:
        return
    _DIAG_DONE = True
    try:
        names = [m for m in dir(fl) if not m.startswith('_')]
        kw = ('point', 'elev', 'pi', 'vertex')
        rel = sorted({m for m in names if any(k in m.lower() for k in kw)})
        log.append("DIAG API FeatureLine (relevante):")
        for i in range(0, len(rel), 4):
            log.append("    " + " | ".join(rel[i:i+4]))
    except Exception as ex:
        log.append("DIAG FAIL: {}".format(str(ex)[:120]))


def enum_to_list(col):
    """Convierte una coleccion .NET (Point3dCollection, etc.) en lista Python
    usando GetEnumerator (los indexers no siempre funcionan en pythonnet)."""
    out = []
    en = col.GetEnumerator()
    try:
        while en.MoveNext():
            out.append(en.Current)
    finally:
        disp = getattr(en, 'Dispose', None)
        if disp is not None:
            try:
                disp()
            except Exception:
                pass
    return out


def get_object_id(wrapper):
    """Devuelve ObjectId a partir de un wrapper Dynamo (Civil3DToolkit /
    Civil DynamoNodes) o de un ObjectId puro.
    Patron reutilizado de los .dyn anteriores del proyecto.
    """
    if wrapper is None:
        return None
    if isinstance(wrapper, ObjectId):
        return wrapper
    # Civil 3D Toolkit / DynamoNodes: InternalDBObject expone .ObjectId
    try:
        dbo = getattr(wrapper, 'InternalDBObject', None)
        if dbo is not None:
            return dbo.ObjectId
    except Exception:
        pass
    # Camber / otros wrappers: InternalObjectId directo
    for attr in ('InternalObjectId', 'ObjectId', 'InternalObjectID'):
        try:
            oid = getattr(wrapper, attr, None)
            if oid is not None:
                return oid
        except Exception:
            pass
    return None


def collect_feature_line_ids(in0, ed, log):
    """Construye lista de ObjectId a procesar.
    Si in0 trae wrappers/ids, los traduce. Si esta vacio, usa pickfirst
    (Editor.SelectImplied) para que el usuario haya seleccionado con el
    raton en Civil 3D antes de pulsar Run.
    """
    items = in0
    if items is None:
        items = []
    if not isinstance(items, list):
        items = [items]

    ids = []
    if items:
        for i, w in enumerate(items):
            oid = get_object_id(w)
            if oid is None or oid.IsNull:
                log.append("WARN: IN[0][{}] no se ha resuelto a ObjectId, se omite ({}).".format(
                    i, type(w).__name__))
                continue
            ids.append(oid)
        return ids

    # Fallback: pickfirst en Civil 3D
    log.append("IN[0] vacio -> uso seleccion previa (pickfirst) en Civil 3D.")
    res = ed.SelectImplied()
    if res.Status != PromptStatus.OK or res.Value is None:
        log.append("ERROR: no hay seleccion previa. Antes de pulsar Run, "
                   "selecciona las Feature Lines en Civil 3D (clic con el "
                   "raton). Alternativa: cablea un nodo selector al puerto "
                   "IN[0].")
        return []
    for so in res.Value:
        ids.append(so.ObjectId)
    log.append("Pickfirst: {} objeto(s) seleccionado(s) en Civil 3D.".format(len(ids)))
    return ids


def find_tin_surface_id(cdoc, tr, name, log):
    """Busca una TinSurface por nombre exacto. Devuelve ObjectId o None.
    Se enumera con GetEnumerator (las colecciones .NET no admiten indexer).
    """
    if not name:
        return None
    surf_ids = cdoc.GetSurfaceIds()
    en = surf_ids.GetEnumerator()
    found = None
    try:
        while en.MoveNext():
            sid = en.Current
            try:
                s_obj = tr.GetObject(sid, OpenMode.ForRead)
                if isinstance(s_obj, TinSurface) and s_obj.Name == name:
                    found = sid
                    break
            except Exception as ex_s:
                log.append("WARN enumerando superficies: {}".format(str(ex_s)[:120]))
    finally:
        try:
            en.Dispose()
        except Exception:
            pass
    return found


def run():
    # ---- Inputs ----
    in0       = IN[0] if len(IN) > 0 else None
    delta_n_in = IN[1] if len(IN) > 1 else 0.0
    delta_s_in = IN[2] if len(IN) > 2 else 0.0
    surf_in    = IN[3] if len(IN) > 3 else ""

    try:
        delta_norte = float(delta_n_in)
    except Exception:
        return "ERROR: IN[1] (delta_norte) no es numerico: {!r}".format(delta_n_in)
    try:
        delta_sur = float(delta_s_in)
    except Exception:
        return "ERROR: IN[2] (delta_sur) no es numerico: {!r}".format(delta_s_in)
    surf_name = (str(surf_in) if surf_in is not None else "").strip()

    log = []
    log.append("=" * 74)
    log.append("FeatureLines_AjustarCotasNorteSur (v3)")
    for line in _import_log:
        log.append("  IMPORT: " + line)
    log.append("delta_norte    = {:+.4f} m".format(delta_norte))
    log.append("delta_sur      = {:+.4f} m".format(delta_sur))
    log.append("superficie     = '{}'".format(surf_name))
    log.append("eps_horizontal = {} m".format(EPS_Y_M))
    log.append("-" * 74)

    # Resolver enum (con fallback por reflexion)
    pi_enum = resolve_pi_point_enum(log)
    if pi_enum is None:
        log.append("ERROR: no se pudo resolver FeatureLinePointType.PIPoint. "
                   "Imposible leer los PIs. Aborto.")
        return "\n".join(log)

    doc = AcadApp.DocumentManager.MdiActiveDocument
    if doc is None:
        log.append("ERROR: no hay documento activo en Civil 3D.")
        return "\n".join(log)
    db = doc.Database
    ed = doc.Editor

    fl_ids = collect_feature_line_ids(in0, ed, log)
    if not fl_ids:
        log.append("Sin feature lines para procesar. Fin.")
        return "\n".join(log)
    log.append("Candidatas a procesar: {}".format(len(fl_ids)))

    n_ok = 0
    n_skipped_horizontal = 0
    n_errors = 0

    dlock = doc.LockDocument()
    try:
        tr = db.TransactionManager.StartTransaction()
        try:
            # ---- 1) Modificar cada FL ----
            for oid in fl_ids:
                handle_str = "<?>"
                try:
                    ent = tr.GetObject(oid, OpenMode.ForRead)
                    if not isinstance(ent, FeatureLine):
                        log.append("SKIP: handle={} no es FeatureLine (es {}).".format(
                            oid.Handle.ToString(), type(ent).__name__))
                        # No incrementa errores: filtra ruido del pickfirst.
                        continue

                    fl = ent
                    handle_str = oid.Handle.ToString()

                    # Introspeccion una unica vez (en la primera FL valida).
                    diag_featureline_api(fl, log)

                    # PIs reales de la feature line (Point3d con X,Y,Z=elev)
                    pi_col = fl.GetPoints(pi_enum)
                    pis = enum_to_list(pi_col)
                    n_pts = len(pis)

                    if n_pts < 2:
                        log.append("SKIP: FL handle={} tiene {} PIs (<2).".format(
                            handle_str, n_pts))
                        n_errors += 1
                        continue
                    if n_pts > 2:
                        log.append("WARN: FL handle={} tiene {} PIs (>2). "
                                   "Solo se modifican idx 0 y idx {}.".format(
                                       handle_str, n_pts, n_pts - 1))

                    idx_a = 0
                    idx_b = n_pts - 1
                    p_a = pis[idx_a]
                    p_b = pis[idx_b]
                    elev_a = p_a.Z
                    elev_b = p_b.Z

                    dy = abs(p_a.Y - p_b.Y)
                    if dy < EPS_Y_M:
                        log.append(
                            "SKIP horizontal: FL handle={} |dY|={:.4f}m < {}m  "
                            "P0=({:.3f},{:.3f}) P{}=({:.3f},{:.3f})".format(
                                handle_str, dy, EPS_Y_M,
                                p_a.X, p_a.Y, idx_b, p_b.X, p_b.Y))
                        n_skipped_horizontal += 1
                        continue

                    # Norte = Y mayor; Sur = Y menor
                    if p_a.Y > p_b.Y:
                        idx_norte, coord_norte, elev_norte_old = idx_a, p_a, elev_a
                        idx_sur,   coord_sur,   elev_sur_old   = idx_b, p_b, elev_b
                    else:
                        idx_norte, coord_norte, elev_norte_old = idx_b, p_b, elev_b
                        idx_sur,   coord_sur,   elev_sur_old   = idx_a, p_a, elev_a

                    elev_norte_new = elev_norte_old + delta_norte
                    elev_sur_new   = elev_sur_old   + delta_sur

                    fl_w = tr.GetObject(oid, OpenMode.ForWrite)
                    fl_w.SetPointElevation(idx_norte, float(elev_norte_new))
                    fl_w.SetPointElevation(idx_sur,   float(elev_sur_new))

                    log.append(
                        "OK   handle={} | N idx={} XY=({:.3f},{:.3f}) "
                        "Z {:.4f} -> {:.4f}  | S idx={} XY=({:.3f},{:.3f}) "
                        "Z {:.4f} -> {:.4f}".format(
                            handle_str,
                            idx_norte, coord_norte.X, coord_norte.Y,
                            elev_norte_old, elev_norte_new,
                            idx_sur, coord_sur.X, coord_sur.Y,
                            elev_sur_old, elev_sur_new))
                    n_ok += 1

                except Exception as ex_item:
                    log.append("ERROR FL handle={}: {}".format(
                        handle_str, str(ex_item)[:160]))
                    n_errors += 1

            # ---- 2) Reconstruir TinSurface indicada ----
            log.append("-" * 74)
            if not surf_name:
                log.append("Sin nombre de superficie -> no se reconstruye.")
            elif n_ok == 0:
                log.append("0 feature lines modificadas -> no se reconstruye "
                           "la superficie '{}'.".format(surf_name))
            else:
                cdoc = CivilApplication.ActiveDocument
                surf_id = find_tin_surface_id(cdoc, tr, surf_name, log)
                if surf_id is None:
                    log.append("ERROR: TinSurface '{}' no encontrada.".format(surf_name))
                else:
                    try:
                        s_w = tr.GetObject(surf_id, OpenMode.ForWrite)
                        s_w.Rebuild()
                        log.append("OK Rebuild de TinSurface '{}' (handle={}).".format(
                            surf_name, surf_id.Handle.ToString()))
                    except Exception as ex_r:
                        log.append("ERROR Rebuild '{}': {}".format(
                            surf_name, str(ex_r)[:160]))

            tr.Commit()
        finally:
            tr.Dispose()
    finally:
        dlock.Dispose()

    log.append("-" * 74)
    log.append("RESUMEN: ok={} | skip_horizontal={} | errores={}".format(
        n_ok, n_skipped_horizontal, n_errors))
    log.append("=" * 74)
    return "\n".join(log)


try:
    OUT = run()
except Exception as ex:
    OUT = "FATAL: {}\n{}".format(str(ex), traceback.format_exc())
# ----------------------------------------
log = Watch(featureLines_AjustarCotasNorteSur)
