# Dynamo graph 0_DP_RecorteMDT_v01.dyn "0_DP_RecorteMDT_v03" (Dynamo 2.19.4.6671)
# Recorte del MDT por contornos + determinado offset. Inputs: Contornos y MDT original.

mdt_original_nombre = StringInput("MDT_CASARES_III_CROPPED")
capa_de_zonas_contornos = StringInput("_contornos")
nombre_nueva_superficie = StringInput("MDT_PruebaCaso")
margen_extra_filtrado_m = DoubleInput(1)
anclar_contorno_original_s_n = StringInput("S")
paso_muestreo_borde_m = DoubleInput(1)
offset_borde_hacia_fuera_m = DoubleInput(1)
cfg_fase = StringInput("0")
config_sombra = Python(IN[0]=cfg_fase)  # CPython3
# ---------- config_sombra.python (66 lines) ----------
# -*- coding: utf-8 -*-
# NODO CONFIG (modo sombra: valida y muestra la config, pero
# los parametros del script siguen viniendo de los inputs de siempre)
import os
import sys
import importlib

# Localizador de pipeline.py sin rutas fijas. Orden:
#   1) instalado con instalar.bat (site-packages del Python de Dynamo)
#   2) variable de entorno PIPELINE_HOME
#   3) carpeta del proyecto (hasta 3 niveles sobre el DWG activo)
def _cargar_pipeline():
    probadas = []
    try:
        import pipeline as _m
        importlib.reload(_m)
        return _m, "pipeline.py: importado desde " + str(
            getattr(_m, "__file__", "?"))
    except ImportError:
        probadas.append("import directo (site-packages de Dynamo)")
    candidatas = []
    ph = os.environ.get("PIPELINE_HOME", "")
    if ph:
        candidatas.append(ph)
    try:
        import clr
        clr.AddReference("AcMgd")
        from Autodesk.AutoCAD.ApplicationServices import (
            Application as _A)
        _doc = _A.DocumentManager.MdiActiveDocument
        if _doc is not None:
            _c = os.path.dirname(os.path.abspath(str(_doc.Name)))
            for _ in range(3):
                candidatas.append(_c)
                _p = os.path.dirname(_c)
                if _p == _c:
                    break
                _c = _p
    except Exception as ex:
        probadas.append("DWG activo no disponible: " + str(ex)[:80])
    for _r in candidatas:
        probadas.append(_r)
        if _r and os.path.exists(os.path.join(_r, "pipeline.py")):
            if _r not in sys.path:
                sys.path.insert(0, _r)
            import pipeline as _m
            importlib.reload(_m)
            return _m, "pipeline.py: cargado desde " + _r
    log = ["KO: no se encontro pipeline.py. Rutas probadas:"]
    log += ["  - " + p for p in probadas]
    log.append("Solucion: doble clic en instalar.bat, o copia pipeline.py "
               "a la carpeta del proyecto (junto a config_proyecto.xlsx), "
               "o define la variable de entorno PIPELINE_HOME.")
    return None, "\n".join(log)


pipeline, _msg_carga = _cargar_pipeline()

if pipeline is None:
    OUT = [False, _msg_carga, "", ""]
else:
    OUT = pipeline.nodo_config(str(IN[0]))
    try:
        OUT[1] = _msg_carga + "\n" + OUT[1]
    except Exception:
        pass
# ----------------------------------------
cfg_superficie_mdt = Python(IN[0]=config_sombra)  # CPython3
# ---------- cfg_superficie_mdt.python (21 lines) ----------
# -*- coding: utf-8 -*-
# CONFIG: parametro 'superficie_mdt' desde config (indice 4).
# Si la config es KO, BLOQUEA este parametro e incrusta la causa
# (las lineas KO/AVISO del log de config) en el propio error.
res = IN[0]
if ((not isinstance(res, list)) or len(res) <= 4
        or res[0] is not True):
    detalle = "el nodo de config no devolvio datos"
    try:
        lineas = str(res[1]).splitlines()
        malas = [l.strip() for l in lineas
                 if "KO" in l or "AVISO" in l]
        if malas:
            detalle = " | ".join(malas[-4:])
        elif lineas:
            detalle = " | ".join(
                l.strip() for l in lineas[-3:])
    except Exception:
        pass
    raise Exception("CONFIG KO -> " + detalle[:400])
OUT = res[4]
# ----------------------------------------
cfg_capa_contornos = Python(IN[0]=config_sombra)  # CPython3
# ---------- cfg_capa_contornos.python (21 lines) ----------
# -*- coding: utf-8 -*-
# CONFIG: parametro 'capa_contornos' desde config (indice 5).
# Si la config es KO, BLOQUEA este parametro e incrusta la causa
# (las lineas KO/AVISO del log de config) en el propio error.
res = IN[0]
if ((not isinstance(res, list)) or len(res) <= 5
        or res[0] is not True):
    detalle = "el nodo de config no devolvio datos"
    try:
        lineas = str(res[1]).splitlines()
        malas = [l.strip() for l in lineas
                 if "KO" in l or "AVISO" in l]
        if malas:
            detalle = " | ".join(malas[-4:])
        elif lineas:
            detalle = " | ".join(
                l.strip() for l in lineas[-3:])
    except Exception:
        pass
    raise Exception("CONFIG KO -> " + detalle[:400])
OUT = res[5]
# ----------------------------------------
cfg_superficie_salida = Python(IN[0]=config_sombra)  # CPython3
# ---------- cfg_superficie_salida.python (21 lines) ----------
# -*- coding: utf-8 -*-
# CONFIG: parametro 'superficie_salida' desde config (indice 6).
# Si la config es KO, BLOQUEA este parametro e incrusta la causa
# (las lineas KO/AVISO del log de config) en el propio error.
res = IN[0]
if ((not isinstance(res, list)) or len(res) <= 6
        or res[0] is not True):
    detalle = "el nodo de config no devolvio datos"
    try:
        lineas = str(res[1]).splitlines()
        malas = [l.strip() for l in lineas
                 if "KO" in l or "AVISO" in l]
        if malas:
            detalle = " | ".join(malas[-4:])
        elif lineas:
            detalle = " | ".join(
                l.strip() for l in lineas[-3:])
    except Exception:
        pass
    raise Exception("CONFIG KO -> " + detalle[:400])
OUT = res[6]
# ----------------------------------------
cfg_margen_extra_filtrado_m = Python(IN[0]=config_sombra)  # CPython3
# ---------- cfg_margen_extra_filtrado_m.python (21 lines) ----------
# -*- coding: utf-8 -*-
# CONFIG: parametro 'margen_extra_filtrado_m' desde config (indice 7).
# Si la config es KO, BLOQUEA este parametro e incrusta la causa
# (las lineas KO/AVISO del log de config) en el propio error.
res = IN[0]
if ((not isinstance(res, list)) or len(res) <= 7
        or res[0] is not True):
    detalle = "el nodo de config no devolvio datos"
    try:
        lineas = str(res[1]).splitlines()
        malas = [l.strip() for l in lineas
                 if "KO" in l or "AVISO" in l]
        if malas:
            detalle = " | ".join(malas[-4:])
        elif lineas:
            detalle = " | ".join(
                l.strip() for l in lineas[-3:])
    except Exception:
        pass
    raise Exception("CONFIG KO -> " + detalle[:400])
OUT = res[7]
# ----------------------------------------
aplicar_cambios_n_s = StringInput("S")  # graph input
cfg_anclar_contorno_original = Python(IN[0]=config_sombra)  # CPython3
# ---------- cfg_anclar_contorno_original.python (21 lines) ----------
# -*- coding: utf-8 -*-
# CONFIG: parametro 'anclar_contorno_original' desde config (indice 8).
# Si la config es KO, BLOQUEA este parametro e incrusta la causa
# (las lineas KO/AVISO del log de config) en el propio error.
res = IN[0]
if ((not isinstance(res, list)) or len(res) <= 8
        or res[0] is not True):
    detalle = "el nodo de config no devolvio datos"
    try:
        lineas = str(res[1]).splitlines()
        malas = [l.strip() for l in lineas
                 if "KO" in l or "AVISO" in l]
        if malas:
            detalle = " | ".join(malas[-4:])
        elif lineas:
            detalle = " | ".join(
                l.strip() for l in lineas[-3:])
    except Exception:
        pass
    raise Exception("CONFIG KO -> " + detalle[:400])
OUT = res[8]
# ----------------------------------------
cfg_paso_muestreo_borde_m = Python(IN[0]=config_sombra)  # CPython3
# ---------- cfg_paso_muestreo_borde_m.python (21 lines) ----------
# -*- coding: utf-8 -*-
# CONFIG: parametro 'paso_muestreo_borde_m' desde config (indice 9).
# Si la config es KO, BLOQUEA este parametro e incrusta la causa
# (las lineas KO/AVISO del log de config) en el propio error.
res = IN[0]
if ((not isinstance(res, list)) or len(res) <= 9
        or res[0] is not True):
    detalle = "el nodo de config no devolvio datos"
    try:
        lineas = str(res[1]).splitlines()
        malas = [l.strip() for l in lineas
                 if "KO" in l or "AVISO" in l]
        if malas:
            detalle = " | ".join(malas[-4:])
        elif lineas:
            detalle = " | ".join(
                l.strip() for l in lineas[-3:])
    except Exception:
        pass
    raise Exception("CONFIG KO -> " + detalle[:400])
OUT = res[9]
# ----------------------------------------
cfg_offset_borde_m = Python(IN[0]=config_sombra)  # CPython3
# ---------- cfg_offset_borde_m.python (21 lines) ----------
# -*- coding: utf-8 -*-
# CONFIG: parametro 'offset_borde_m' desde config (indice 10).
# Si la config es KO, BLOQUEA este parametro e incrusta la causa
# (las lineas KO/AVISO del log de config) en el propio error.
res = IN[0]
if ((not isinstance(res, list)) or len(res) <= 10
        or res[0] is not True):
    detalle = "el nodo de config no devolvio datos"
    try:
        lineas = str(res[1]).splitlines()
        malas = [l.strip() for l in lineas
                 if "KO" in l or "AVISO" in l]
        if malas:
            detalle = " | ".join(malas[-4:])
        elif lineas:
            detalle = " | ".join(
                l.strip() for l in lineas[-3:])
    except Exception:
        pass
    raise Exception("CONFIG KO -> " + detalle[:400])
OUT = res[10]
# ----------------------------------------
normalizar_true_convierte_false = BoolSelector(true)  # "NORMALIZAR (True=convierte, False=solo informa)"; graph input
normalizar_geometria_line_pl2d = Python(IN[0]=cfg_capa_contornos, IN[1]=normalizar_true_convierte_false)  # "NORMALIZAR geometria (LINE/PL2D/PL3D -> LWPOLYLINE)"; CPython3
# ---------- normalizar_geometria_line_pl2d.python (368 lines) ----------
# -*- coding: utf-8 -*-
# =============================================================================
# NORMALIZAR GEOMETRIA v01  -  nodo previo comun a los scripts del pipeline
# =============================================================================
# Los scripts leen contornos, ejes y trackers como LWPOLYLINE. En la practica
# esas capas llegan con LINE sueltas (layouts, DXF), POLYLINE 2D antiguas o
# POLYLINE 3D. Este nodo las normaliza ANTES de que corra el script:
#
#   - LINE      : se encadenan por extremos (tolerancia de empalme TOL_EMPALME)
#                 y cada cadena pasa a ser UNA LWPOLYLINE. Si la cadena cierra
#                 sobre si misma (hueco <= TOL_CIERRE) se marca Closed.
#                 Una LINE aislada -> LWPOLYLINE de 2 vertices.
#   - POLYLINE2D / POLYLINE3D : se reescriben como LWPOLYLINE plana (Z ignorada),
#                 conservando el flag Closed.
#   - LWPOLYLINE: no se toca.
#
# Los originales NO se borran: se mueven a la capa '<capa>_ORIG' (se crea si
# no existe y se deja apagada). Es reversible: mover de vuelta y borrar las
# LWPOLYLINE nuevas.
#
# ENTRADAS (numero variable): IN[0..n-2] nombres de capa (str; vacios se
#   ignoran; tambien acepta listas de str). El ULTIMO input IN[n-1] es
#   APLICAR: True convierte; False solo informa (dry-run).
# SALIDA: OUT = [log_str, n_convertidas]. Conectar OUT como barrera al primer
#   nodo de trabajo del script para forzar que esto corra antes.
# =============================================================================
import math
import time
import traceback

import clr
clr.AddReference('AcMgd')
clr.AddReference('AcCoreMgd')
clr.AddReference('AcDbMgd')

from Autodesk.AutoCAD.ApplicationServices import Application
from Autodesk.AutoCAD.DatabaseServices import (
    OpenMode, Polyline, Polyline2d, Polyline3d, Line,
    SymbolUtilityServices, LayerTableRecord, ObjectId)
from Autodesk.AutoCAD.Geometry import Point2d

TOL_EMPALME = 0.05   # m: dos extremos a menos de esto se consideran unidos
TOL_CIERRE = 0.50    # m: regla del proyecto para contornos visualmente cerrados

# [DYNAMO-DAG] todo dentro de run(): nunca SystemExit a nivel de modulo
def run():
    # ------------------------------ entradas -----------------------------------
    _ins = list(IN)
    if not _ins:
        return ["NORMALIZAR: sin entradas", 0]
    _ap = _ins[-1]
    if isinstance(_ap, str):
        APLICAR = _ap.strip().upper() in ("S", "SI", "TRUE", "1", "V")
    else:
        APLICAR = bool(_ap)
    capas = []
    for v in _ins[:-1]:
        if v is None:
            continue
        if isinstance(v, (list, tuple)):
            for x in v:
                if x is not None and str(x).strip():
                    capas.append(str(x).strip())
        elif str(v).strip():
            capas.append(str(v).strip())
    # dedup conservando orden
    _vist = set()
    capas = [c for c in capas if not (c in _vist or _vist.add(c))]

    L = []


    def w(s=""):
        L.append(str(s))


    t_ini = time.perf_counter()
    w("=" * 72)
    w(" NORMALIZAR GEOMETRIA v01  -  {}".format(
        "APLICAR (convierte)" if APLICAR else "DRY-RUN (solo informa)"))
    w("=" * 72)
    w("capas: {}".format(", ".join(capas) if capas else "(ninguna)"))
    w("tolerancias: empalme {:.2f} m, cierre {:.2f} m".format(TOL_EMPALME, TOL_CIERRE))

    if not capas:
        w("Nada que hacer.")
        w("")
        w("==== RESUMEN DE TIEMPOS ====")
        w("{:<27}{:>7.2f} s".format("TOTAL", time.perf_counter() - t_ini))
        return ["\n".join(L), 0]


    def _key(p):
        """Celda de rejilla para agrupar extremos con tolerancia."""
        return (int(math.floor(p[0] / TOL_EMPALME)),
                int(math.floor(p[1] / TOL_EMPALME)))


    def _cerca(a, b):
        return math.hypot(a[0] - b[0], a[1] - b[1]) <= TOL_EMPALME


    def encadenar(segs):
        """segs: lista de (p_ini, p_fin) 2D. Devuelve lista de (pts, cerrada).
        Recorre cada segmento una sola vez; en bifurcaciones toma el primer
        vecino libre (suficiente para contornos y ejes; los nudos raros se
        reportan como cadenas abiertas y el usuario los ve en el log)."""
        n = len(segs)
        usado = [False] * n
        idx = {}
        for i, (a, b) in enumerate(segs):
            for p in (a, b):
                k = _key(p)
                for dx in (-1, 0, 1):
                    for dy in (-1, 0, 1):
                        idx.setdefault((k[0] + dx, k[1] + dy), []).append(i)
        # dedup listas
        for k in idx:
            vist = set()
            idx[k] = [i for i in idx[k] if not (i in vist or vist.add(i))]

        def vecino_libre(p, excluir):
            for j in idx.get(_key(p), []):
                if usado[j] or j == excluir:
                    continue
                a, b = segs[j]
                if _cerca(p, a):
                    return j, b
                if _cerca(p, b):
                    return j, a
            return None, None

        cadenas = []
        for i in range(n):
            if usado[i]:
                continue
            usado[i] = True
            a, b = segs[i]
            pts = [a, b]
            # extender por el final
            cur = b
            last = i
            while True:
                j, nxt = vecino_libre(cur, last)
                if j is None:
                    break
                usado[j] = True
                pts.append(nxt)
                cur = nxt
                last = j
                if _cerca(cur, pts[0]) and len(pts) > 3:
                    break
            # extender por el principio (si no cerro)
            if not _cerca(pts[-1], pts[0]):
                cur = pts[0]
                last = i
                while True:
                    j, nxt = vecino_libre(cur, last)
                    if j is None:
                        break
                    usado[j] = True
                    pts.insert(0, nxt)
                    cur = nxt
                    last = j
                    if _cerca(pts[0], pts[-1]) and len(pts) > 3:
                        break
            cerrada = False
            if len(pts) >= 4 and math.hypot(pts[0][0] - pts[-1][0],
                                            pts[0][1] - pts[-1][1]) <= TOL_CIERRE:
                cerrada = True
                # si el ultimo punto duplica al primero, quitarlo
                if _cerca(pts[0], pts[-1]):
                    pts = pts[:-1]
            cadenas.append((pts, cerrada))
        return cadenas


    def pts_polyline2d(ent, tr):
        pts = []
        try:
            for vid in ent:
                v = tr.GetObject(vid, OpenMode.ForRead)
                p = v.Position
                pts.append((p.X, p.Y))
        except Exception:
            pts = []
        return pts


    def pts_polyline3d(ent, tr):
        pts = []
        try:
            for vid in ent:
                v = tr.GetObject(vid, OpenMode.ForRead)
                p = v.Position
                pts.append((p.X, p.Y))
        except Exception:
            pts = []
        return pts


    adoc = Application.DocumentManager.MdiActiveDocument
    db = adoc.Database
    n_total_conv = 0
    tiempos = []

    dlock = adoc.LockDocument()
    try:
        tr = db.TransactionManager.StartTransaction()
        try:
            ms_id = SymbolUtilityServices.GetBlockModelSpaceId(db)
            ms = tr.GetObject(ms_id, OpenMode.ForWrite if APLICAR else OpenMode.ForRead)
            lt = tr.GetObject(db.LayerTableId, OpenMode.ForRead)

            # ---- inventario por capa -----------------------------------------
            t0 = time.perf_counter()
            por_capa = {c: {"lw": 0, "line": [], "p2d": [], "p3d": [], "otros": {}}
                        for c in capas}
            for oid in ms:
                try:
                    ent = tr.GetObject(oid, OpenMode.ForRead)
                except Exception:
                    continue
                lay = ent.Layer
                if lay not in por_capa:
                    continue
                d = por_capa[lay]
                if isinstance(ent, Polyline):
                    d["lw"] += 1
                elif isinstance(ent, Line):
                    d["line"].append(oid)
                elif isinstance(ent, Polyline2d):
                    d["p2d"].append(oid)
                elif isinstance(ent, Polyline3d):
                    d["p3d"].append(oid)
                else:
                    try:
                        tn = ent.GetType().Name
                    except Exception:
                        tn = type(ent).__name__
                    d["otros"][tn] = d["otros"].get(tn, 0) + 1
            tiempos.append(("inventario", time.perf_counter() - t0))

            w("")
            w("{:<28}{:>6}{:>7}{:>7}{:>7}  otros".format(
                "capa", "LWPL", "LINE", "PL2D", "PL3D"))
            w("-" * 72)
            for c in capas:
                d = por_capa[c]
                otros = ", ".join("{} x {}".format(v, k) for k, v in
                                  sorted(d["otros"].items())) or "-"
                existe = lt.Has(c)
                w("{:<28}{:>6}{:>7}{:>7}{:>7}  {}{}".format(
                    c[:28], d["lw"], len(d["line"]), len(d["p2d"]),
                    len(d["p3d"]), otros, "" if existe else "   !! CAPA NO EXISTE"))

            # ---- conversion ---------------------------------------------------
            t0 = time.perf_counter()
            for c in capas:
                d = por_capa[c]
                pendientes = len(d["line"]) + len(d["p2d"]) + len(d["p3d"])
                if pendientes == 0:
                    continue
                w("")
                w("[{}]".format(c))

                nuevas = []   # (pts, cerrada, origen)
                # LINE -> cadenas
                if d["line"]:
                    segs = []
                    for oid in d["line"]:
                        ent = tr.GetObject(oid, OpenMode.ForRead)
                        a = ent.StartPoint
                        b = ent.EndPoint
                        segs.append(((a.X, a.Y), (b.X, b.Y)))
                    cadenas = encadenar(segs)
                    n_cer = sum(1 for _, z in cadenas if z)
                    w("  LINE: {} segmentos -> {} cadenas ({} cerradas, {} abiertas)"
                      .format(len(segs), len(cadenas), n_cer, len(cadenas) - n_cer))
                    for pts, cerrada in cadenas:
                        nuevas.append((pts, cerrada, "LINE"))
                for oid in d["p2d"]:
                    ent = tr.GetObject(oid, OpenMode.ForRead)
                    pts = pts_polyline2d(ent, tr)
                    if len(pts) >= 2:
                        nuevas.append((pts, bool(ent.Closed), "PL2D"))
                    else:
                        w("  PL2D handle {}: sin vertices legibles, se deja".format(ent.Handle))
                for oid in d["p3d"]:
                    ent = tr.GetObject(oid, OpenMode.ForRead)
                    pts = pts_polyline3d(ent, tr)
                    if len(pts) >= 2:
                        nuevas.append((pts, bool(ent.Closed), "PL3D"))
                    else:
                        w("  PL3D handle {}: sin vertices legibles, se deja".format(ent.Handle))

                for pts, cerrada, origen in nuevas:
                    w("  {} -> LWPOLYLINE {} vertices{}".format(
                        origen, len(pts), " (cerrada)" if cerrada else ""))

                if not APLICAR:
                    w("  dry-run: {} LWPOLYLINE se crearian; {} originales irian a '{}_ORIG'"
                      .format(len(nuevas), pendientes, c))
                    continue

                # capa destino de la geometria original
                capa_orig = c + "_ORIG"
                if lt.Has(capa_orig):
                    id_orig = lt.get_Item(capa_orig)
                else:
                    lt.UpgradeOpen()
                    ltr = LayerTableRecord()
                    ltr.Name = capa_orig
                    ltr.IsOff = True
                    id_orig = lt.Add(ltr)
                    tr.AddNewlyCreatedDBObject(ltr, True)
                    lt.DowngradeOpen()
                    w("  capa '{}' creada (apagada)".format(capa_orig))
                id_capa = lt.get_Item(c)

                n_new = 0
                for pts, cerrada, origen in nuevas:
                    pl = Polyline()
                    for i, (x, y) in enumerate(pts):
                        pl.AddVertexAt(i, Point2d(x, y), 0.0, 0.0, 0.0)
                    pl.Closed = cerrada
                    pl.LayerId = id_capa
                    ms.AppendEntity(pl)
                    tr.AddNewlyCreatedDBObject(pl, True)
                    n_new += 1
                n_mov = 0
                for oid in d["line"] + d["p2d"] + d["p3d"]:
                    try:
                        ent = tr.GetObject(oid, OpenMode.ForWrite)
                        ent.LayerId = id_orig
                        n_mov += 1
                    except Exception as ex:
                        w("  KO moviendo handle: {}".format(str(ex)[:80]))
                w("  creadas {} LWPOLYLINE; {} originales movidas a '{}'".format(
                    n_new, n_mov, capa_orig))
                n_total_conv += n_new
            tiempos.append(("conversion", time.perf_counter() - t0))

            if APLICAR:
                tr.Commit()
        finally:
            tr.Dispose()
    except Exception:
        w("")
        w("!!!!!! EXCEPCION NO CONTROLADA")
        for linea in traceback.format_exc().split("\n"):
            w("  " + linea)
    finally:
        dlock.Dispose()

    w("")
    w("RESULTADO: {} LWPOLYLINE {}".format(
        n_total_conv, "creadas" if APLICAR else "se crearian (dry-run)"))
    w("")
    w("==== RESUMEN DE TIEMPOS ====")
    for et, sg in tiempos:
        w("{:<27}{:>7.2f} s".format(et, sg))
    w("{:<27}{:>7.2f} s".format("TOTAL", time.perf_counter() - t_ini))

    return ["\n".join(L), n_total_conv]


OUT = run()
# ----------------------------------------
recorte_mdt_por_zonas_v07_halo = Python(IN[0]=cfg_superficie_mdt, IN[1]=cfg_capa_contornos, IN[2]=cfg_superficie_salida, IN[3]=cfg_margen_extra_filtrado_m, IN[4]=aplicar_cambios_n_s, IN[5]=cfg_anclar_contorno_original, IN[6]=cfg_paso_muestreo_borde_m, IN[7]=cfg_offset_borde_m, IN[8]=normalizar_geometria_line_pl2d)  # "Recorte MDT por zonas v07 (halo + cierre virtual)"; CPython3
# ---------- recorte_mdt_por_zonas_v07_halo.python (577 lines) ----------
# IN[8]: BARRERA de sincronizacion del nodo NORMALIZAR (contenido ignorado).
# -*- coding: utf-8 -*-
# =============================================================================
# 0_RecorteMDT_v07.dyn  -  Nodo Python
# Civil 3D 2024 / Dynamo / CPython3
#
# QUE CAMBIA EN v07 (respecto a v06): CIERRE VIRTUAL de contornos.
#   En produccion aparecen contornos "cerrados a la vista" pero con
#   Closed=No y un mini-hueco entre ultimo y primer vertice (caso real:
#   5 de 10 zonas ignoradas en MDT_Recortado_Casares III). v07 los acepta
#   si el hueco es <= TOL_CIERRE (0.5 m), cerrandolos virtualmente y
#   avisando en el log (handle + hueco). El offset se calcula sobre un
#   CLON CERRADO EN MEMORIA construido desde los vertices, uniforme para
#   todas las zonas (y se hace Dispose del clon). Huecos mayores siguen
#   ignorandose, ahora informando del tamanyo del hueco.
#
# QUE CAMBIA EN v06 (respecto a v05): RECORTE CON HALO (contorno + offset).
#
#   CAUSA RAIZ que corrige: en v05 la superficie recortada terminaba
#   EXACTAMENTE en la linea de contorno. Consultar cota SOBRE el borde de un
#   TIN es fragil: en tramos rectos cae dentro, pero en las esquinas convexas
#   el punto queda fuera por micras y FindElevationAtXY /
#   AssignElevationsFromSurface fallan EN SILENCIO -> puntos a Z=0 en las
#   FLs de contorno del Script 2 -> vertices a cota 0 en la superficie de
#   trackers -> "embudos" -> volumenes fantasma de hasta ~250 m en Script 4.
#
#   SOLUCION (propuesta de Juande): recortar por el contorno DESFASADO
#   'OFFSET_BORDE' m HACIA FUERA (defecto 1.0). Asi la linea de contorno
#   original queda 1 m DENTRO de los datos en todo su recorrido, y cualquier
#   consulta sobre ella (esquinas incluidas) es una consulta interior que no
#   puede fallar por redondeo. Arregla el problema en el productor para
#   todos los consumidores (Script 2, replanteo, futuros).
#
#   Detalles v06:
#   - Offset hacia fuera con GetOffsetCurves(+/-d) eligiendo el de MAYOR
#     area (tecnica del Script 5, invertida). Curvas en memoria: se leen y
#     se hace Dispose, NO se anyaden al dibujo.
#   - El boundary se pasa como Point3dCollection del contorno DESFASADO con
#     COTA REAL del MDT original en cada punto (leccion aprendida: el corte
#     exacto inyecta la Z de esos puntos en el TIN; inyectamos verdad, no 0).
#     Si un punto no tiene cota (borde del MDT del cliente), hereda la del
#     vecino bueno mas cercano y se cuenta en el log.
#   - Ancla ADEMAS la linea de contorno ORIGINAL (vertices + muestreo cada
#     'paso' m) con cota real: es la linea que consultaran los scripts de
#     aguas abajo y queda clavada a datos verdaderos.
#   - El margen de filtrado de vertices se auto-ajusta a >= OFFSET + margen
#     pedido, para que haya datos del MDT hasta la nueva linea de corte.
#   - Volumenes del Script 4: SIN CAMBIO (cada volumen sigue recortado por
#     el contorno ORIGINAL; el halo queda fuera de la interseccion).
#
# Entradas:
#   IN[0] : str    nombre del MDT original (del cliente)
#   IN[1] : str    capa de zonas (polilineas cerradas)
#   IN[2] : str    nombre de la superficie nueva
#   IN[3] : float  margen extra de filtrado en metros (defecto 1.0)
#   IN[4] : str    aplicar cambios: "N" = dry-run (defecto), "S" = crear
#   IN[5] : str    muestrear/anclar contorno original con cota real: "S"/"N"
#   IN[6] : float  paso de muestreo del borde en metros (defecto 5.0)
#   IN[7] : float  OFFSET_BORDE hacia fuera en metros (defecto 1.0)
#
# Salida:
#   OUT   : str    log
# =============================================================================

import clr
import math
import time
import traceback

clr.AddReference('AcMgd')
clr.AddReference('AcCoreMgd')
clr.AddReference('AcDbMgd')
clr.AddReference('AecBaseMgd')
clr.AddReference('AeccDbMgd')

from Autodesk.AutoCAD.ApplicationServices import Application as AcadApp
from Autodesk.AutoCAD.DatabaseServices import (
    OpenMode, Polyline, SymbolUtilityServices
)
from Autodesk.AutoCAD.Geometry import Point2d, Point3d, Point3dCollection
from Autodesk.Civil import SurfaceBoundaryType
from Autodesk.Civil.ApplicationServices import CivilApplication
from Autodesk.Civil.DatabaseServices import TinSurface

# --------------------------------------------------------------------------- #
# Inputs
# --------------------------------------------------------------------------- #
mdt_name    = str(IN[0])
zones_layer = str(IN[1])
out_name    = str(IN[2])
margin_in   = float(IN[3]) if (len(IN) > 3 and IN[3] is not None) else 1.0
apply_raw   = str(IN[4]).strip().upper() if (len(IN) > 4 and IN[4] is not None) else "N"
do_apply    = apply_raw in ("S", "SI", "Y", "YES", "1", "TRUE")
samp_raw    = str(IN[5]).strip().upper() if (len(IN) > 5 and IN[5] is not None) else "S"
do_sample   = samp_raw in ("S", "SI", "Y", "YES", "1", "TRUE")
samp_step   = float(IN[6]) if (len(IN) > 6 and IN[6] is not None) else 5.0
if samp_step <= 0.1:
    samp_step = 0.1
offset_b    = float(IN[7]) if (len(IN) > 7 and IN[7] is not None) else 1.0
if offset_b < 0.0:
    offset_b = 0.0

# margen total de filtrado: datos hasta la linea de corte (offset) + margen
margin = offset_b + max(margin_in, 1.0)

# hueco maximo (m) entre ultimo y primer vertice para cerrar virtualmente
TOL_CIERRE = 0.50

log = []
def w(s):
    log.append(str(s))

_t0 = time.perf_counter()
_tiempos = []
def _fase(etq, t_ini):
    _tiempos.append((etq, time.perf_counter() - t_ini))

# --------------------------------------------------------------------------- #
# Geometria pura
# --------------------------------------------------------------------------- #
def pip(px, py, poly):
    inside = False
    n = len(poly)
    if n < 3:
        return False
    j = n - 1
    for i in range(n):
        xi, yi = poly[i]
        xj, yj = poly[j]
        if ((yi > py) != (yj > py)) and (px < (xj - xi) * (py - yi) / (yj - yi) + xi):
            inside = not inside
        j = i
    return inside

def dist_pt_seg(px, py, ax, ay, bx, by):
    dx = bx - ax
    dy = by - ay
    if dx == 0.0 and dy == 0.0:
        return math.hypot(px - ax, py - ay)
    t = ((px - ax) * dx + (py - ay) * dy) / (dx * dx + dy * dy)
    if t < 0.0:
        t = 0.0
    elif t > 1.0:
        t = 1.0
    return math.hypot(px - (ax + t * dx), py - (ay + t * dy))

def min_dist_poly(px, py, poly):
    n = len(poly)
    best = 1e18
    j = n - 1
    for i in range(n):
        d = dist_pt_seg(px, py, poly[j][0], poly[j][1], poly[i][0], poly[i][1])
        if d < best:
            best = d
        j = i
    return best

def in_zone(px, py, poly, bbox, marg):
    if px < bbox[0] or px > bbox[2] or py < bbox[1] or py > bbox[3]:
        return False
    if pip(px, py, poly):
        return True
    return min_dist_poly(px, py, poly) <= marg

def ring_subdividido(pts_xy, paso):
    """Anillo ORDENADO: vertices originales + subdivisiones cada 'paso' m.
    pts_xy abierto (sin repetir el primero). Incluye siempre cada vertice
    (t=0 de cada segmento) -> las esquinas quedan exactas."""
    ring = []
    n = len(pts_xy)
    for i in range(n):
        ax, ay = pts_xy[i]
        bx, by = pts_xy[(i + 1) % n]
        seg = math.hypot(bx - ax, by - ay)
        nsub = max(1, int(seg / paso))
        for s in range(nsub):
            t = float(s) / float(nsub)
            ring.append((ax + t * (bx - ax), ay + t * (by - ay)))
    return ring

# --------------------------------------------------------------------------- #
# Offset hacia fuera (tecnica Script 5, invertida: MAYOR area)
# --------------------------------------------------------------------------- #
def leer_polyline_xy(pl, paso):
    """Vertices XY de una Polyline en orden. Si tiene bulges, muestrea por
    distancia (orden garantizado)."""
    nv = pl.NumberOfVertices
    tiene_bulge = False
    for i in range(nv):
        try:
            if abs(pl.GetBulgeAt(i)) > 1e-9:
                tiene_bulge = True
                break
        except Exception:
            break
    if not tiene_bulge:
        pts = []
        for i in range(nv):
            p2 = pl.GetPoint2dAt(i)
            pts.append((p2.X, p2.Y))
        if len(pts) > 1 and abs(pts[0][0] - pts[-1][0]) < 1e-9 and abs(pts[0][1] - pts[-1][1]) < 1e-9:
            pts.pop()
        return pts
    # con arcos: muestreo por distancia
    pts = []
    try:
        L = float(pl.Length)
        n = max(8, int(L / max(paso, 0.5)))
        for k in range(n):
            p = pl.GetPointAtDist(min(k * L / n, L - 1e-6))
            pts.append((p.X, p.Y))
    except Exception:
        pass
    return pts

def clon_cerrado(pts_xy):
    """Polyline CERRADA en memoria (no residente en BD) desde vertices XY.
    Sirve para GetOffsetCurves con independencia del flag Closed y de los
    mini-huecos de la polilinea original. El llamador debe hacer Dispose."""
    pl = Polyline()
    for i, (x, y) in enumerate(pts_xy):
        pl.AddVertexAt(i, Point2d(x, y), 0.0, 0.0, 0.0)
    pl.Closed = True
    return pl


def offset_hacia_fuera(pl, dist, paso, log, etiqueta):
    """Devuelve la lista XY (abierta) del contorno desfasado 'dist' m hacia
    FUERA, o None si falla. Prueba +dist y -dist y elige la de MAYOR area.
    Las curvas del offset son objetos en memoria: se leen y se Dispose."""
    if dist <= 0.0:
        return None
    try:
        area_orig = abs(float(pl.Area))
    except Exception:
        area_orig = None
    best_pts = None
    best_area = -1.0
    for sgn in (1.0, -1.0):
        col = None
        try:
            col = pl.GetOffsetCurves(sgn * dist)
        except Exception as ex_of:
            w("  {} offset {}{:.2f} fallo: {}".format(
                etiqueta, "+" if sgn > 0 else "-", dist, str(ex_of)[:90]))
            continue
        try:
            for obj in col:
                try:
                    if isinstance(obj, Polyline):
                        a = None
                        try:
                            a = abs(float(obj.Area))
                        except Exception:
                            a = None
                        pts = leer_polyline_xy(obj, paso)
                        if a is None and len(pts) >= 3:
                            s = 0.0
                            m = len(pts)
                            for i in range(m):
                                x1, y1 = pts[i]
                                x2, y2 = pts[(i + 1) % m]
                                s += x1 * y2 - x2 * y1
                            a = abs(s) * 0.5
                        if a is not None and a > best_area and len(pts) >= 3:
                            best_area = a
                            best_pts = pts
                finally:
                    try:
                        obj.Dispose()
                    except Exception:
                        pass
        finally:
            try:
                col.Dispose()
            except Exception:
                pass
    if best_pts is None:
        return None
    if area_orig is not None and best_area <= area_orig:
        w("  {} AVISO: ningun offset AUMENTA el area (orig {:.1f}, mejor {:.1f})".format(
            etiqueta, area_orig, best_area))
        return None
    return best_pts

# --------------------------------------------------------------------------- #
# Documento
# --------------------------------------------------------------------------- #
adoc = AcadApp.DocumentManager.MdiActiveDocument
db = adoc.Database
civdoc = CivilApplication.ActiveDocument

w("=== RECORTE MDT POR ZONAS v06 (halo = contorno + offset) ===")
w("MDT:          '" + mdt_name + "'")
w("zonas:        capa '" + zones_layer + "'")
w("nueva:        '" + out_name + "'")
w("OFFSET borde: %.2f m (corte por el contorno desfasado hacia fuera)" % offset_b)
w("margen filtrado total: %.2f m (offset + margen extra %.2f)" % (margin, max(margin_in, 1.0)))
w("modo:         " + ("APLICAR (escribe en el DWG)" if do_apply else "DRY-RUN (solo lectura)"))
w("")

dlock = adoc.LockDocument() if do_apply else None
tr = db.TransactionManager.StartTransaction()
try:
    # ---- 1) localizar el MDT ------------------------------------------------
    t = time.perf_counter()
    sids = civdoc.GetSurfaceIds()
    src = None
    available = []
    for i in range(sids.Count):
        o = tr.GetObject(sids[i], OpenMode.ForRead)
        available.append(o.Name)
        if o.Name == mdt_name:
            src = o

    if src is None:
        w("ERROR: no existe la superficie '" + mdt_name + "'. Superficies:")
        for nm in available:
            w("   " + nm)
        raise Exception("Superficie MDT '{}' no encontrada (lista arriba).".format(mdt_name))
    if not isinstance(src, TinSurface):
        w("AVISO: '" + mdt_name + "' no es TinSurface; continuo con cautela.")

    def cota_src(x, y):
        try:
            return float(src.FindElevationAtXY(x, y))
        except Exception:
            return None

    # ---- 2) zonas: polilineas cerradas de la capa ---------------------------
    ms_id = SymbolUtilityServices.GetBlockModelSpaceId(db)
    ms = tr.GetObject(ms_id, OpenMode.ForRead)
    zonas = []            # (pts_orig_xy, bbox_ampliada, pts_offset_xy)
    n_abiertas = 0
    n_offset_ko = 0
    zi = 0
    for oid in ms:
        ent = tr.GetObject(oid, OpenMode.ForRead)
        if not isinstance(ent, Polyline):
            continue
        if ent.Layer != zones_layer:
            continue
        if ent.NumberOfVertices < 3:
            continue
        pts = leer_polyline_xy(ent, samp_step)
        if len(pts) < 3:
            continue
        # clasificacion de cierre sobre los EXTREMOS CRUDOS de la entidad
        p0 = ent.GetPoint2dAt(0)
        pn = ent.GetPoint2dAt(ent.NumberOfVertices - 1)
        hueco = math.hypot(pn.X - p0.X, pn.Y - p0.Y)
        if ent.Closed or hueco <= 1e-6:
            pass  # cerrada de verdad
        elif hueco <= TOL_CIERRE:
            w("  aviso: handle {} cerrada VIRTUALMENTE (hueco {:.3f} m)".format(
                ent.Handle, hueco))
        else:
            n_abiertas += 1
            w("  aviso: polilinea ABIERTA ignorada (handle {}, hueco {:.3f} m > {:.2f})".format(
                ent.Handle, hueco, TOL_CIERRE))
            continue
        zi += 1
        etiqueta = "zona {:02d}".format(zi)
        pts_off = None
        if offset_b > 0:
            clon = None
            try:
                clon = clon_cerrado(pts)
                pts_off = offset_hacia_fuera(clon, offset_b, samp_step, w, etiqueta)
            except Exception as ex_cl:
                w("  {} clon/offset fallo: {}".format(etiqueta, str(ex_cl)[:90]))
            finally:
                if clon is not None:
                    try:
                        clon.Dispose()
                    except Exception:
                        pass
        if offset_b > 0 and pts_off is None:
            n_offset_ko += 1
            w("  {} SIN offset valido -> usara el contorno ORIGINAL como corte".format(etiqueta))
        xs = [p[0] for p in pts]
        ys = [p[1] for p in pts]
        bbox = (min(xs) - margin, min(ys) - margin, max(xs) + margin, max(ys) + margin)
        zonas.append((pts, bbox, pts_off))

    w("zonas cerradas: {} | abiertas ignoradas: {} | offsets KO: {}".format(
        len(zonas), n_abiertas, n_offset_ko))
    if not zonas:
        raise Exception("La capa '{}' no tiene polilineas cerradas validas.".format(zones_layer))
    _fase("Zonas + offsets", t)

    # ---- 3) filtrar vertices del MDT (buffer = offset + margen) -------------
    t = time.perf_counter()
    verts = src.Vertices
    total = 0
    kept = 0
    kept_pts = Point3dCollection()
    for v in verts:
        total += 1
        loc = v.Location
        x = loc.X
        y = loc.Y
        for (poly, bbox, _off) in zonas:
            if in_zone(x, y, poly, bbox, margin):
                kept += 1
                if do_apply:
                    kept_pts.Add(Point3d(x, y, loc.Z))
                break
    dropped = total - kept
    pct = (100.0 * dropped / total) if total else 0.0
    w("")
    w("vertices MDT total:          " + str(total))
    w("dentro de zonas (+%.2f m):   %d" % (margin, kept))
    w("descartados (ahorro):        %d  (%.1f%%)" % (dropped, pct))
    _fase("Filtrado vertices", t)

    # ---- 4) anclar el contorno ORIGINAL con cota real -----------------------
    # (la linea que consultaran los scripts de aguas abajo)
    t = time.perf_counter()
    n_anc = 0
    n_anc_ko = 0
    if do_sample:
        for (poly, _bb, _off) in zonas:
            for (px, py) in ring_subdividido(poly, samp_step):
                z = cota_src(px, py)
                if z is None:
                    n_anc_ko += 1
                    continue
                n_anc += 1
                if do_apply:
                    kept_pts.Add(Point3d(px, py, z))
        w("anclaje contorno original (paso %.1f m): %d puntos con cota, %d sin cota"
          % (samp_step, n_anc, n_anc_ko))
    else:
        w("anclaje contorno original: NO solicitado (IN[5]='N').")
    _fase("Anclaje contorno", t)

    # ---- 5) preparar boundaries (linea offset con cota real) ----------------
    t = time.perf_counter()
    boundaries_pc = []     # (etiqueta, lista [(x,y,z)])
    tot_b = 0
    tot_b_heredada = 0
    for k, (poly, _bb, poff) in enumerate(zonas):
        linea = poff if poff is not None else poly
        ring = ring_subdividido(linea, samp_step)
        vals = []
        for (px, py) in ring:
            vals.append((px, py, cota_src(px, py)))
        # rellenar huecos heredando el vecino bueno mas cercano (anillo)
        buenos = [i for i in range(len(vals)) if vals[i][2] is not None]
        if not buenos:
            w("  zona {:02d}: SIN COTA en toda la linea de corte -> boundary OMITIDO".format(k + 1))
            continue
        m = len(vals)
        fill = []
        for i in range(m):
            x, y, z = vals[i]
            if z is None:
                dmin = None
                for j in buenos:
                    dd = min(abs(i - j), m - abs(i - j))
                    if dmin is None or dd < dmin:
                        dmin = dd
                        z = vals[j][2]
                tot_b_heredada += 1
            fill.append((x, y, z))
        tot_b += m
        boundaries_pc.append(("zona {:02d}".format(k + 1), fill))
    w("boundaries preparados: {} | puntos: {} (cota heredada en {})".format(
        len(boundaries_pc), tot_b, tot_b_heredada))
    _fase("Preparar boundaries", t)

    if not do_apply:
        w("")
        w("DRY-RUN: no se ha creado nada. Plan al aplicar:")
        w("  1) borrar '{}' previa si existe".format(out_name))
        w("  2) crear TIN con {} vertices MDT + {} anclas de contorno".format(kept, n_anc))
        w("  3) {} boundaries por la LINEA OFFSET (+{:.2f} m) con cota real".format(
            len(boundaries_pc), offset_b))
        w("Si el recuento encaja, pon IN[4]='S' y re-ejecuta.")
        tr.Commit()
    else:
        # ---- 6) borrar previa + crear ---------------------------------------
        t = time.perf_counter()
        for i in range(sids.Count):
            o = tr.GetObject(sids[i], OpenMode.ForRead)
            if o.Name == out_name:
                o.UpgradeOpen()
                o.Erase()
                w("superficie previa '{}' borrada (re-ejecucion).".format(out_name))
                break
        new_id = None
        try:
            new_id = TinSurface.Create(db, out_name)
        except Exception as e1:
            try:
                new_id = TinSurface.Create(out_name, src.StyleId)
            except Exception as e2:
                w("ERROR creando TinSurface: " + str(e1)[:90] + " | " + str(e2)[:90])
                raise
        new_surf = tr.GetObject(new_id, OpenMode.ForWrite)

        try:
            new_surf.AddVertices(kept_pts)
            w("vertices anyadidos (AddVertices): " + str(kept_pts.Count))
        except Exception as ex:
            w("ERROR AddVertices: " + str(ex)[:160])
            raise
        _fase("Crear superficie", t)

        # ---- 7) boundaries: linea OFFSET, 1 Outer + resto Show, cota real ---
        t = time.perf_counter()
        bdef = new_surf.BoundariesDefinition
        n_out = 0
        n_show = 0
        n_bko = 0
        first = True
        for (etq, fill) in boundaries_pc:
            pc = Point3dCollection()
            for (x, y, z) in fill:
                pc.Add(Point3d(x, y, z))
            if (fill[0][0], fill[0][1]) != (fill[-1][0], fill[-1][1]):
                pc.Add(Point3d(fill[0][0], fill[0][1], fill[0][2]))
            btype = SurfaceBoundaryType.Outer if first else SurfaceBoundaryType.Show
            try:
                bdef.AddBoundaries(pc, 1.0, btype, True)
                if first:
                    n_out += 1
                else:
                    n_show += 1
            except Exception as ex_bn:
                n_bko += 1
                w("  boundary {} fallo: {}".format(etq, str(ex_bn)[:120]))
            first = False
        w("boundaries: {} Outer + {} Show ({} KO)".format(n_out, n_show, n_bko))

        try:
            new_surf.Rebuild()
        except Exception as ex_rb:
            w("AVISO Rebuild final: " + str(ex_rb)[:100])
        try:
            w("")
            w("superficie '{}' creada. vertices: {}".format(out_name, new_surf.Vertices.Count))
        except Exception as ex:
            w("superficie creada; recuento final ilegible: " + str(ex)[:80])
        _fase("Boundaries + rebuild", t)

        tr.Commit()
        w("HECHO. MDT del cliente intacto. La linea de contorno original queda")
        w("%.2f m DENTRO de los datos: consultas sobre ella ya no pueden fallar." % offset_b)

except Exception as ex:
    w("")
    w("ERROR general: " + str(ex)[:200])
    w(traceback.format_exc()[:800])
    try:
        tr.Abort()
    except Exception:
        pass
finally:
    try:
        tr.Dispose()
    except Exception:
        pass
    if dlock is not None:
        try:
            dlock.Dispose()
        except Exception:
            pass

w("")
w("==== RESUMEN DE TIEMPOS ====")
for (etq, seg) in _tiempos:
    w("{:<27}{:>7.2f} s".format(etq, seg))
w("{:<27}{:>7.2f} s".format("TOTAL", time.perf_counter() - _t0))

OUT = "\n".join(log)
# ----------------------------------------
log = Watch(recorte_mdt_por_zonas_v07_halo)  # graph output
extraer_log = Python(IN[0]=config_sombra)  # CPython3; graph output
# ---------- extraer_log.python (3 lines) ----------
# -*- coding: utf-8 -*-
# Extrae el log (indice 1) de la salida CONFIG para el Watch
OUT = IN[0][1] if IN[0] is not None else "(sin salida CONFIG)"
# ----------------------------------------
CONFIG_LOG = Watch(extraer_log)
cfg_resultados_vacio = StringInput("")
cfg_ok = BoolSelector(true)
cfg_auditoria_z = StringInput("N/A")
CIERRE = Python(IN[0]=cfg_fase, IN[1]=recorte_mdt_por_zonas_v07_halo, IN[2]=cfg_resultados_vacio, IN[3]=aplicar_cambios_n_s, IN[4]=cfg_ok, IN[5]=cfg_auditoria_z, IN[6]=recorte_mdt_por_zonas_v07_halo)  # CPython3
# ---------- CIERRE.python (79 lines) ----------
# -*- coding: utf-8 -*-
# NODO CIERRE: escribe estado_pipeline.json y el log en Logs/
import os
import sys
import importlib

# Localizador de pipeline.py sin rutas fijas. Orden:
#   1) instalado con instalar.bat (site-packages del Python de Dynamo)
#   2) variable de entorno PIPELINE_HOME
#   3) carpeta del proyecto (hasta 3 niveles sobre el DWG activo)
def _cargar_pipeline():
    probadas = []
    try:
        import pipeline as _m
        importlib.reload(_m)
        return _m, "pipeline.py: importado desde " + str(
            getattr(_m, "__file__", "?"))
    except ImportError:
        probadas.append("import directo (site-packages de Dynamo)")
    candidatas = []
    ph = os.environ.get("PIPELINE_HOME", "")
    if ph:
        candidatas.append(ph)
    try:
        import clr
        clr.AddReference("AcMgd")
        from Autodesk.AutoCAD.ApplicationServices import (
            Application as _A)
        _doc = _A.DocumentManager.MdiActiveDocument
        if _doc is not None:
            _c = os.path.dirname(os.path.abspath(str(_doc.Name)))
            for _ in range(3):
                candidatas.append(_c)
                _p = os.path.dirname(_c)
                if _p == _c:
                    break
                _c = _p
    except Exception as ex:
        probadas.append("DWG activo no disponible: " + str(ex)[:80])
    for _r in candidatas:
        probadas.append(_r)
        if _r and os.path.exists(os.path.join(_r, "pipeline.py")):
            if _r not in sys.path:
                sys.path.insert(0, _r)
            import pipeline as _m
            importlib.reload(_m)
            return _m, "pipeline.py: cargado desde " + _r
    log = ["KO: no se encontro pipeline.py. Rutas probadas:"]
    log += ["  - " + p for p in probadas]
    log.append("Solucion: doble clic en instalar.bat, o copia pipeline.py "
               "a la carpeta del proyecto (junto a config_proyecto.xlsx), "
               "o define la variable de entorno PIPELINE_HOME.")
    return None, "\n".join(log)


pipeline, _msg_carga = _cargar_pipeline()

if pipeline is None:
    OUT = [False, _msg_carga + "\n"
           + (str(IN[1]) if IN[1] is not None else "")]
else:
    def _abool(v):
        if isinstance(v, str):
            return v.strip().upper() in ("S", "SI", "TRUE", "1", "V")
        return bool(v)

    fase = str(IN[0])
    log_script = IN[1] if IN[1] is not None else ""
    resultados = IN[2]
    aplicado = _abool(IN[3]) if IN[3] is not None else False
    ok_script = _abool(IN[4]) if IN[4] is not None else True
    auditoria = str(IN[5]) if IN[5] is not None else "N/A"
    # IN[6]: barrera de sincronizacion (ignorada)

    OUT = pipeline.nodo_cierre(fase, log_script,
                               resultados=resultados,
                               aplicado=aplicado,
                               ok=ok_script,
                               auditoria_z=auditoria)
# ----------------------------------------
extraer_log_cierre = Python(IN[0]=CIERRE)  # CPython3; graph output; same code as extraer_log
CIERRE_LOG = Watch(extraer_log_cierre)
extraer_log_normalizar = Python(IN[0]=normalizar_geometria_line_pl2d)  # CPython3
# ---------- extraer_log_normalizar.python (2 lines) ----------
# Extrae el log (indice 0) de la salida del normalizador para el Watch
OUT = IN[0][0] if IN[0] is not None else "(sin salida)"
# ----------------------------------------
NORMALIZAR_LOG = Watch(extraer_log_normalizar)
