# Dynamo graph 1_DP_Slope_Analysis_Unificado_v01.dyn "1_DP_Slope_Analysis_Unificado_v04" (Dynamo 2.19.4.6671)
# Análisis de pendientes de una superficie (Original/Trackers) en ambos sentidos. Inputs: Contornos, líneas de rotura y MDT.

mdt_nombre_de_la_superficie = StringInput("Trackers_Proyecto")
capa_de_contorno = StringInput("_contornos offset")
capa_de_ejes_trackers_mesas = StringInput("_Lineas rotura")
tipo_trackers_mesas = StringInput("Trackers")
pendiente_maxima_admisible = DoubleInput(4)
pendiente_de_aviso = DoubleInput(3)
nombre_de_la_nueva_superficie = StringInput("Slope_Analysis_Trackers_NS")
opcion_puntos_1_centroide_2 = DoubleInput(2)  # "Opcion puntos (1=centroide, 2=extremos) [solo axial]"
pitch_minimo_m_solo_entre_filas = DoubleInput(4)
pitch_maximo_m_solo_entre_filas = DoubleInput(15)
iteraciones_de_subdivision_solo = DoubleInput(2)  # "Iteraciones de subdivision [solo entre-filas]"
cfg_fase = StringInput("1")
orientacion_ns_eo = StringInput("NS")  # graph input
cfg_objetivo_terreno_trackers = StringInput("TERRENO")  # graph input
cfg_variante_base_orient = Python(IN[0]=cfg_fase, IN[1]=orientacion_ns_eo, IN[2]=cfg_objetivo_terreno_trackers)  # "CFG variante (base+orient+objetivo)"; CPython3
# ---------- cfg_variante_base_orient.python (9 lines) ----------
# -*- coding: utf-8 -*-
# Compone la subfase: base + orientacion + objetivo
# ("1"+"NS"+TERRENO -> "1NS"; "1"+"NS"+TRACKERS -> "1NST")
base = str(IN[0]).strip()
ori = str(IN[1]).strip().upper() if IN[1] is not None else ""
obj = str(IN[2]).strip().upper() if IN[2] is not None else "TERRENO"
suf = "NS" if "NS" in ori else ("EO" if "EO" in ori else "")
t = "T" if obj.startswith("TRACK") else ""
OUT = base + suf + t
# ----------------------------------------
config_sombra = Python(IN[0]=cfg_variante_base_orient)  # CPython3
# ---------- config_sombra.python (66 lines) ----------
# -*- coding: utf-8 -*-
# NODO CONFIG (modo sombra: valida y muestra la config, pero
# los parametros del script siguen viniendo de los inputs de siempre)
import os
import sys
import importlib

# Localizador de pipeline.py sin rutas fijas. Orden:
#   1) instalado con instalar.bat (site-packages del Python de Dynamo)
#   2) variable de entorno PIPELINE_HOME
#   3) carpeta del proyecto (hasta 3 niveles sobre el DWG activo)
def _cargar_pipeline():
    probadas = []
    try:
        import pipeline as _m
        importlib.reload(_m)
        return _m, "pipeline.py: importado desde " + str(
            getattr(_m, "__file__", "?"))
    except ImportError:
        probadas.append("import directo (site-packages de Dynamo)")
    candidatas = []
    ph = os.environ.get("PIPELINE_HOME", "")
    if ph:
        candidatas.append(ph)
    try:
        import clr
        clr.AddReference("AcMgd")
        from Autodesk.AutoCAD.ApplicationServices import (
            Application as _A)
        _doc = _A.DocumentManager.MdiActiveDocument
        if _doc is not None:
            _c = os.path.dirname(os.path.abspath(str(_doc.Name)))
            for _ in range(3):
                candidatas.append(_c)
                _p = os.path.dirname(_c)
                if _p == _c:
                    break
                _c = _p
    except Exception as ex:
        probadas.append("DWG activo no disponible: " + str(ex)[:80])
    for _r in candidatas:
        probadas.append(_r)
        if _r and os.path.exists(os.path.join(_r, "pipeline.py")):
            if _r not in sys.path:
                sys.path.insert(0, _r)
            import pipeline as _m
            importlib.reload(_m)
            return _m, "pipeline.py: cargado desde " + _r
    log = ["KO: no se encontro pipeline.py. Rutas probadas:"]
    log += ["  - " + p for p in probadas]
    log.append("Solucion: doble clic en instalar.bat, o copia pipeline.py "
               "a la carpeta del proyecto (junto a config_proyecto.xlsx), "
               "o define la variable de entorno PIPELINE_HOME.")
    return None, "\n".join(log)


pipeline, _msg_carga = _cargar_pipeline()

if pipeline is None:
    OUT = [False, _msg_carga, "", ""]
else:
    OUT = pipeline.nodo_config(str(IN[0]))
    try:
        OUT[1] = _msg_carga + "\n" + OUT[1]
    except Exception:
        pass
# ----------------------------------------
cfg_superficie_analisis = Python(IN[0]=config_sombra)  # CPython3
# ---------- cfg_superficie_analisis.python (21 lines) ----------
# -*- coding: utf-8 -*-
# CONFIG: parametro 'superficie_analisis' desde config (indice 4).
# Si la config es KO, BLOQUEA este parametro e incrusta la causa
# (las lineas KO/AVISO del log de config) en el propio error.
res = IN[0]
if ((not isinstance(res, list)) or len(res) <= 4
        or res[0] is not True):
    detalle = "el nodo de config no devolvio datos"
    try:
        lineas = str(res[1]).splitlines()
        malas = [l.strip() for l in lineas
                 if "KO" in l or "AVISO" in l]
        if malas:
            detalle = " | ".join(malas[-4:])
        elif lineas:
            detalle = " | ".join(
                l.strip() for l in lineas[-3:])
    except Exception:
        pass
    raise Exception("CONFIG KO -> " + detalle[:400])
OUT = res[4]
# ----------------------------------------
cfg_capa_contorno = Python(IN[0]=config_sombra)  # CPython3
# ---------- cfg_capa_contorno.python (21 lines) ----------
# -*- coding: utf-8 -*-
# CONFIG: parametro 'capa_contorno' desde config (indice 5).
# Si la config es KO, BLOQUEA este parametro e incrusta la causa
# (las lineas KO/AVISO del log de config) en el propio error.
res = IN[0]
if ((not isinstance(res, list)) or len(res) <= 5
        or res[0] is not True):
    detalle = "el nodo de config no devolvio datos"
    try:
        lineas = str(res[1]).splitlines()
        malas = [l.strip() for l in lineas
                 if "KO" in l or "AVISO" in l]
        if malas:
            detalle = " | ".join(malas[-4:])
        elif lineas:
            detalle = " | ".join(
                l.strip() for l in lineas[-3:])
    except Exception:
        pass
    raise Exception("CONFIG KO -> " + detalle[:400])
OUT = res[5]
# ----------------------------------------
cfg_capa_ejes = Python(IN[0]=config_sombra)  # CPython3
# ---------- cfg_capa_ejes.python (21 lines) ----------
# -*- coding: utf-8 -*-
# CONFIG: parametro 'capa_ejes' desde config (indice 6).
# Si la config es KO, BLOQUEA este parametro e incrusta la causa
# (las lineas KO/AVISO del log de config) en el propio error.
res = IN[0]
if ((not isinstance(res, list)) or len(res) <= 6
        or res[0] is not True):
    detalle = "el nodo de config no devolvio datos"
    try:
        lineas = str(res[1]).splitlines()
        malas = [l.strip() for l in lineas
                 if "KO" in l or "AVISO" in l]
        if malas:
            detalle = " | ".join(malas[-4:])
        elif lineas:
            detalle = " | ".join(
                l.strip() for l in lineas[-3:])
    except Exception:
        pass
    raise Exception("CONFIG KO -> " + detalle[:400])
OUT = res[6]
# ----------------------------------------
cfg_tipo = Python(IN[0]=config_sombra)  # CPython3
# ---------- cfg_tipo.python (21 lines) ----------
# -*- coding: utf-8 -*-
# CONFIG: parametro 'tipo' desde config (indice 7).
# Si la config es KO, BLOQUEA este parametro e incrusta la causa
# (las lineas KO/AVISO del log de config) en el propio error.
res = IN[0]
if ((not isinstance(res, list)) or len(res) <= 7
        or res[0] is not True):
    detalle = "el nodo de config no devolvio datos"
    try:
        lineas = str(res[1]).splitlines()
        malas = [l.strip() for l in lineas
                 if "KO" in l or "AVISO" in l]
        if malas:
            detalle = " | ".join(malas[-4:])
        elif lineas:
            detalle = " | ".join(
                l.strip() for l in lineas[-3:])
    except Exception:
        pass
    raise Exception("CONFIG KO -> " + detalle[:400])
OUT = res[7]
# ----------------------------------------
cfg_pendiente_max_pct = Python(IN[0]=config_sombra)  # CPython3
# ---------- cfg_pendiente_max_pct.python (21 lines) ----------
# -*- coding: utf-8 -*-
# CONFIG: parametro 'pendiente_max_pct' desde config (indice 8).
# Si la config es KO, BLOQUEA este parametro e incrusta la causa
# (las lineas KO/AVISO del log de config) en el propio error.
res = IN[0]
if ((not isinstance(res, list)) or len(res) <= 8
        or res[0] is not True):
    detalle = "el nodo de config no devolvio datos"
    try:
        lineas = str(res[1]).splitlines()
        malas = [l.strip() for l in lineas
                 if "KO" in l or "AVISO" in l]
        if malas:
            detalle = " | ".join(malas[-4:])
        elif lineas:
            detalle = " | ".join(
                l.strip() for l in lineas[-3:])
    except Exception:
        pass
    raise Exception("CONFIG KO -> " + detalle[:400])
OUT = res[8]
# ----------------------------------------
cfg_pendiente_aviso_pct = Python(IN[0]=config_sombra)  # CPython3
# ---------- cfg_pendiente_aviso_pct.python (21 lines) ----------
# -*- coding: utf-8 -*-
# CONFIG: parametro 'pendiente_aviso_pct' desde config (indice 9).
# Si la config es KO, BLOQUEA este parametro e incrusta la causa
# (las lineas KO/AVISO del log de config) en el propio error.
res = IN[0]
if ((not isinstance(res, list)) or len(res) <= 9
        or res[0] is not True):
    detalle = "el nodo de config no devolvio datos"
    try:
        lineas = str(res[1]).splitlines()
        malas = [l.strip() for l in lineas
                 if "KO" in l or "AVISO" in l]
        if malas:
            detalle = " | ".join(malas[-4:])
        elif lineas:
            detalle = " | ".join(
                l.strip() for l in lineas[-3:])
    except Exception:
        pass
    raise Exception("CONFIG KO -> " + detalle[:400])
OUT = res[9]
# ----------------------------------------
cfg_superficie_salida = Python(IN[0]=config_sombra)  # CPython3
# ---------- cfg_superficie_salida.python (21 lines) ----------
# -*- coding: utf-8 -*-
# CONFIG: parametro 'superficie_salida' desde config (indice 10).
# Si la config es KO, BLOQUEA este parametro e incrusta la causa
# (las lineas KO/AVISO del log de config) en el propio error.
res = IN[0]
if ((not isinstance(res, list)) or len(res) <= 10
        or res[0] is not True):
    detalle = "el nodo de config no devolvio datos"
    try:
        lineas = str(res[1]).splitlines()
        malas = [l.strip() for l in lineas
                 if "KO" in l or "AVISO" in l]
        if malas:
            detalle = " | ".join(malas[-4:])
        elif lineas:
            detalle = " | ".join(
                l.strip() for l in lineas[-3:])
    except Exception:
        pass
    raise Exception("CONFIG KO -> " + detalle[:400])
OUT = res[10]
# ----------------------------------------
cfg_opcion_puntos = Python(IN[0]=config_sombra)  # CPython3
# ---------- cfg_opcion_puntos.python (21 lines) ----------
# -*- coding: utf-8 -*-
# CONFIG: parametro 'opcion_puntos' desde config (indice 11).
# Si la config es KO, BLOQUEA este parametro e incrusta la causa
# (las lineas KO/AVISO del log de config) en el propio error.
res = IN[0]
if ((not isinstance(res, list)) or len(res) <= 11
        or res[0] is not True):
    detalle = "el nodo de config no devolvio datos"
    try:
        lineas = str(res[1]).splitlines()
        malas = [l.strip() for l in lineas
                 if "KO" in l or "AVISO" in l]
        if malas:
            detalle = " | ".join(malas[-4:])
        elif lineas:
            detalle = " | ".join(
                l.strip() for l in lineas[-3:])
    except Exception:
        pass
    raise Exception("CONFIG KO -> " + detalle[:400])
OUT = res[11]
# ----------------------------------------
cfg_pitch_min_m = Python(IN[0]=config_sombra)  # CPython3
# ---------- cfg_pitch_min_m.python (21 lines) ----------
# -*- coding: utf-8 -*-
# CONFIG: parametro 'pitch_min_m' desde config (indice 12).
# Si la config es KO, BLOQUEA este parametro e incrusta la causa
# (las lineas KO/AVISO del log de config) en el propio error.
res = IN[0]
if ((not isinstance(res, list)) or len(res) <= 12
        or res[0] is not True):
    detalle = "el nodo de config no devolvio datos"
    try:
        lineas = str(res[1]).splitlines()
        malas = [l.strip() for l in lineas
                 if "KO" in l or "AVISO" in l]
        if malas:
            detalle = " | ".join(malas[-4:])
        elif lineas:
            detalle = " | ".join(
                l.strip() for l in lineas[-3:])
    except Exception:
        pass
    raise Exception("CONFIG KO -> " + detalle[:400])
OUT = res[12]
# ----------------------------------------
cfg_pitch_max_m = Python(IN[0]=config_sombra)  # CPython3
# ---------- cfg_pitch_max_m.python (21 lines) ----------
# -*- coding: utf-8 -*-
# CONFIG: parametro 'pitch_max_m' desde config (indice 13).
# Si la config es KO, BLOQUEA este parametro e incrusta la causa
# (las lineas KO/AVISO del log de config) en el propio error.
res = IN[0]
if ((not isinstance(res, list)) or len(res) <= 13
        or res[0] is not True):
    detalle = "el nodo de config no devolvio datos"
    try:
        lineas = str(res[1]).splitlines()
        malas = [l.strip() for l in lineas
                 if "KO" in l or "AVISO" in l]
        if malas:
            detalle = " | ".join(malas[-4:])
        elif lineas:
            detalle = " | ".join(
                l.strip() for l in lineas[-3:])
    except Exception:
        pass
    raise Exception("CONFIG KO -> " + detalle[:400])
OUT = res[13]
# ----------------------------------------
cfg_iteraciones_subdivision = Python(IN[0]=config_sombra)  # CPython3
# ---------- cfg_iteraciones_subdivision.python (21 lines) ----------
# -*- coding: utf-8 -*-
# CONFIG: parametro 'iteraciones_subdivision' desde config (indice 14).
# Si la config es KO, BLOQUEA este parametro e incrusta la causa
# (las lineas KO/AVISO del log de config) en el propio error.
res = IN[0]
if ((not isinstance(res, list)) or len(res) <= 14
        or res[0] is not True):
    detalle = "el nodo de config no devolvio datos"
    try:
        lineas = str(res[1]).splitlines()
        malas = [l.strip() for l in lineas
                 if "KO" in l or "AVISO" in l]
        if malas:
            detalle = " | ".join(malas[-4:])
        elif lineas:
            detalle = " | ".join(
                l.strip() for l in lineas[-3:])
    except Exception:
        pass
    raise Exception("CONFIG KO -> " + detalle[:400])
OUT = res[14]
# ----------------------------------------
normalizar_true_convierte_false = BoolSelector(true)  # "NORMALIZAR (True=convierte, False=solo informa)"; graph input
normalizar_geometria_line_pl2d = Python(IN[0]=cfg_capa_contorno, IN[1]=cfg_capa_ejes, IN[2]=normalizar_true_convierte_false)  # "NORMALIZAR geometria (LINE/PL2D/PL3D -> LWPOLYLINE)"; CPython3
# ---------- normalizar_geometria_line_pl2d.python (368 lines) ----------
# -*- coding: utf-8 -*-
# =============================================================================
# NORMALIZAR GEOMETRIA v01  -  nodo previo comun a los scripts del pipeline
# =============================================================================
# Los scripts leen contornos, ejes y trackers como LWPOLYLINE. En la practica
# esas capas llegan con LINE sueltas (layouts, DXF), POLYLINE 2D antiguas o
# POLYLINE 3D. Este nodo las normaliza ANTES de que corra el script:
#
#   - LINE      : se encadenan por extremos (tolerancia de empalme TOL_EMPALME)
#                 y cada cadena pasa a ser UNA LWPOLYLINE. Si la cadena cierra
#                 sobre si misma (hueco <= TOL_CIERRE) se marca Closed.
#                 Una LINE aislada -> LWPOLYLINE de 2 vertices.
#   - POLYLINE2D / POLYLINE3D : se reescriben como LWPOLYLINE plana (Z ignorada),
#                 conservando el flag Closed.
#   - LWPOLYLINE: no se toca.
#
# Los originales NO se borran: se mueven a la capa '<capa>_ORIG' (se crea si
# no existe y se deja apagada). Es reversible: mover de vuelta y borrar las
# LWPOLYLINE nuevas.
#
# ENTRADAS (numero variable): IN[0..n-2] nombres de capa (str; vacios se
#   ignoran; tambien acepta listas de str). El ULTIMO input IN[n-1] es
#   APLICAR: True convierte; False solo informa (dry-run).
# SALIDA: OUT = [log_str, n_convertidas]. Conectar OUT como barrera al primer
#   nodo de trabajo del script para forzar que esto corra antes.
# =============================================================================
import math
import time
import traceback

import clr
clr.AddReference('AcMgd')
clr.AddReference('AcCoreMgd')
clr.AddReference('AcDbMgd')

from Autodesk.AutoCAD.ApplicationServices import Application
from Autodesk.AutoCAD.DatabaseServices import (
    OpenMode, Polyline, Polyline2d, Polyline3d, Line,
    SymbolUtilityServices, LayerTableRecord, ObjectId)
from Autodesk.AutoCAD.Geometry import Point2d

TOL_EMPALME = 0.05   # m: dos extremos a menos de esto se consideran unidos
TOL_CIERRE = 0.50    # m: regla del proyecto para contornos visualmente cerrados

# [DYNAMO-DAG] todo dentro de run(): nunca SystemExit a nivel de modulo
def run():
    # ------------------------------ entradas -----------------------------------
    _ins = list(IN)
    if not _ins:
        return ["NORMALIZAR: sin entradas", 0]
    _ap = _ins[-1]
    if isinstance(_ap, str):
        APLICAR = _ap.strip().upper() in ("S", "SI", "TRUE", "1", "V")
    else:
        APLICAR = bool(_ap)
    capas = []
    for v in _ins[:-1]:
        if v is None:
            continue
        if isinstance(v, (list, tuple)):
            for x in v:
                if x is not None and str(x).strip():
                    capas.append(str(x).strip())
        elif str(v).strip():
            capas.append(str(v).strip())
    # dedup conservando orden
    _vist = set()
    capas = [c for c in capas if not (c in _vist or _vist.add(c))]

    L = []


    def w(s=""):
        L.append(str(s))


    t_ini = time.perf_counter()
    w("=" * 72)
    w(" NORMALIZAR GEOMETRIA v01  -  {}".format(
        "APLICAR (convierte)" if APLICAR else "DRY-RUN (solo informa)"))
    w("=" * 72)
    w("capas: {}".format(", ".join(capas) if capas else "(ninguna)"))
    w("tolerancias: empalme {:.2f} m, cierre {:.2f} m".format(TOL_EMPALME, TOL_CIERRE))

    if not capas:
        w("Nada que hacer.")
        w("")
        w("==== RESUMEN DE TIEMPOS ====")
        w("{:<27}{:>7.2f} s".format("TOTAL", time.perf_counter() - t_ini))
        return ["\n".join(L), 0]


    def _key(p):
        """Celda de rejilla para agrupar extremos con tolerancia."""
        return (int(math.floor(p[0] / TOL_EMPALME)),
                int(math.floor(p[1] / TOL_EMPALME)))


    def _cerca(a, b):
        return math.hypot(a[0] - b[0], a[1] - b[1]) <= TOL_EMPALME


    def encadenar(segs):
        """segs: lista de (p_ini, p_fin) 2D. Devuelve lista de (pts, cerrada).
        Recorre cada segmento una sola vez; en bifurcaciones toma el primer
        vecino libre (suficiente para contornos y ejes; los nudos raros se
        reportan como cadenas abiertas y el usuario los ve en el log)."""
        n = len(segs)
        usado = [False] * n
        idx = {}
        for i, (a, b) in enumerate(segs):
            for p in (a, b):
                k = _key(p)
                for dx in (-1, 0, 1):
                    for dy in (-1, 0, 1):
                        idx.setdefault((k[0] + dx, k[1] + dy), []).append(i)
        # dedup listas
        for k in idx:
            vist = set()
            idx[k] = [i for i in idx[k] if not (i in vist or vist.add(i))]

        def vecino_libre(p, excluir):
            for j in idx.get(_key(p), []):
                if usado[j] or j == excluir:
                    continue
                a, b = segs[j]
                if _cerca(p, a):
                    return j, b
                if _cerca(p, b):
                    return j, a
            return None, None

        cadenas = []
        for i in range(n):
            if usado[i]:
                continue
            usado[i] = True
            a, b = segs[i]
            pts = [a, b]
            # extender por el final
            cur = b
            last = i
            while True:
                j, nxt = vecino_libre(cur, last)
                if j is None:
                    break
                usado[j] = True
                pts.append(nxt)
                cur = nxt
                last = j
                if _cerca(cur, pts[0]) and len(pts) > 3:
                    break
            # extender por el principio (si no cerro)
            if not _cerca(pts[-1], pts[0]):
                cur = pts[0]
                last = i
                while True:
                    j, nxt = vecino_libre(cur, last)
                    if j is None:
                        break
                    usado[j] = True
                    pts.insert(0, nxt)
                    cur = nxt
                    last = j
                    if _cerca(pts[0], pts[-1]) and len(pts) > 3:
                        break
            cerrada = False
            if len(pts) >= 4 and math.hypot(pts[0][0] - pts[-1][0],
                                            pts[0][1] - pts[-1][1]) <= TOL_CIERRE:
                cerrada = True
                # si el ultimo punto duplica al primero, quitarlo
                if _cerca(pts[0], pts[-1]):
                    pts = pts[:-1]
            cadenas.append((pts, cerrada))
        return cadenas


    def pts_polyline2d(ent, tr):
        pts = []
        try:
            for vid in ent:
                v = tr.GetObject(vid, OpenMode.ForRead)
                p = v.Position
                pts.append((p.X, p.Y))
        except Exception:
            pts = []
        return pts


    def pts_polyline3d(ent, tr):
        pts = []
        try:
            for vid in ent:
                v = tr.GetObject(vid, OpenMode.ForRead)
                p = v.Position
                pts.append((p.X, p.Y))
        except Exception:
            pts = []
        return pts


    adoc = Application.DocumentManager.MdiActiveDocument
    db = adoc.Database
    n_total_conv = 0
    tiempos = []

    dlock = adoc.LockDocument()
    try:
        tr = db.TransactionManager.StartTransaction()
        try:
            ms_id = SymbolUtilityServices.GetBlockModelSpaceId(db)
            ms = tr.GetObject(ms_id, OpenMode.ForWrite if APLICAR else OpenMode.ForRead)
            lt = tr.GetObject(db.LayerTableId, OpenMode.ForRead)

            # ---- inventario por capa -----------------------------------------
            t0 = time.perf_counter()
            por_capa = {c: {"lw": 0, "line": [], "p2d": [], "p3d": [], "otros": {}}
                        for c in capas}
            for oid in ms:
                try:
                    ent = tr.GetObject(oid, OpenMode.ForRead)
                except Exception:
                    continue
                lay = ent.Layer
                if lay not in por_capa:
                    continue
                d = por_capa[lay]
                if isinstance(ent, Polyline):
                    d["lw"] += 1
                elif isinstance(ent, Line):
                    d["line"].append(oid)
                elif isinstance(ent, Polyline2d):
                    d["p2d"].append(oid)
                elif isinstance(ent, Polyline3d):
                    d["p3d"].append(oid)
                else:
                    try:
                        tn = ent.GetType().Name
                    except Exception:
                        tn = type(ent).__name__
                    d["otros"][tn] = d["otros"].get(tn, 0) + 1
            tiempos.append(("inventario", time.perf_counter() - t0))

            w("")
            w("{:<28}{:>6}{:>7}{:>7}{:>7}  otros".format(
                "capa", "LWPL", "LINE", "PL2D", "PL3D"))
            w("-" * 72)
            for c in capas:
                d = por_capa[c]
                otros = ", ".join("{} x {}".format(v, k) for k, v in
                                  sorted(d["otros"].items())) or "-"
                existe = lt.Has(c)
                w("{:<28}{:>6}{:>7}{:>7}{:>7}  {}{}".format(
                    c[:28], d["lw"], len(d["line"]), len(d["p2d"]),
                    len(d["p3d"]), otros, "" if existe else "   !! CAPA NO EXISTE"))

            # ---- conversion ---------------------------------------------------
            t0 = time.perf_counter()
            for c in capas:
                d = por_capa[c]
                pendientes = len(d["line"]) + len(d["p2d"]) + len(d["p3d"])
                if pendientes == 0:
                    continue
                w("")
                w("[{}]".format(c))

                nuevas = []   # (pts, cerrada, origen)
                # LINE -> cadenas
                if d["line"]:
                    segs = []
                    for oid in d["line"]:
                        ent = tr.GetObject(oid, OpenMode.ForRead)
                        a = ent.StartPoint
                        b = ent.EndPoint
                        segs.append(((a.X, a.Y), (b.X, b.Y)))
                    cadenas = encadenar(segs)
                    n_cer = sum(1 for _, z in cadenas if z)
                    w("  LINE: {} segmentos -> {} cadenas ({} cerradas, {} abiertas)"
                      .format(len(segs), len(cadenas), n_cer, len(cadenas) - n_cer))
                    for pts, cerrada in cadenas:
                        nuevas.append((pts, cerrada, "LINE"))
                for oid in d["p2d"]:
                    ent = tr.GetObject(oid, OpenMode.ForRead)
                    pts = pts_polyline2d(ent, tr)
                    if len(pts) >= 2:
                        nuevas.append((pts, bool(ent.Closed), "PL2D"))
                    else:
                        w("  PL2D handle {}: sin vertices legibles, se deja".format(ent.Handle))
                for oid in d["p3d"]:
                    ent = tr.GetObject(oid, OpenMode.ForRead)
                    pts = pts_polyline3d(ent, tr)
                    if len(pts) >= 2:
                        nuevas.append((pts, bool(ent.Closed), "PL3D"))
                    else:
                        w("  PL3D handle {}: sin vertices legibles, se deja".format(ent.Handle))

                for pts, cerrada, origen in nuevas:
                    w("  {} -> LWPOLYLINE {} vertices{}".format(
                        origen, len(pts), " (cerrada)" if cerrada else ""))

                if not APLICAR:
                    w("  dry-run: {} LWPOLYLINE se crearian; {} originales irian a '{}_ORIG'"
                      .format(len(nuevas), pendientes, c))
                    continue

                # capa destino de la geometria original
                capa_orig = c + "_ORIG"
                if lt.Has(capa_orig):
                    id_orig = lt.get_Item(capa_orig)
                else:
                    lt.UpgradeOpen()
                    ltr = LayerTableRecord()
                    ltr.Name = capa_orig
                    ltr.IsOff = True
                    id_orig = lt.Add(ltr)
                    tr.AddNewlyCreatedDBObject(ltr, True)
                    lt.DowngradeOpen()
                    w("  capa '{}' creada (apagada)".format(capa_orig))
                id_capa = lt.get_Item(c)

                n_new = 0
                for pts, cerrada, origen in nuevas:
                    pl = Polyline()
                    for i, (x, y) in enumerate(pts):
                        pl.AddVertexAt(i, Point2d(x, y), 0.0, 0.0, 0.0)
                    pl.Closed = cerrada
                    pl.LayerId = id_capa
                    ms.AppendEntity(pl)
                    tr.AddNewlyCreatedDBObject(pl, True)
                    n_new += 1
                n_mov = 0
                for oid in d["line"] + d["p2d"] + d["p3d"]:
                    try:
                        ent = tr.GetObject(oid, OpenMode.ForWrite)
                        ent.LayerId = id_orig
                        n_mov += 1
                    except Exception as ex:
                        w("  KO moviendo handle: {}".format(str(ex)[:80]))
                w("  creadas {} LWPOLYLINE; {} originales movidas a '{}'".format(
                    n_new, n_mov, capa_orig))
                n_total_conv += n_new
            tiempos.append(("conversion", time.perf_counter() - t0))

            if APLICAR:
                tr.Commit()
        finally:
            tr.Dispose()
    except Exception:
        w("")
        w("!!!!!! EXCEPCION NO CONTROLADA")
        for linea in traceback.format_exc().split("\n"):
            w("  " + linea)
    finally:
        dlock.Dispose()

    w("")
    w("RESULTADO: {} LWPOLYLINE {}".format(
        n_total_conv, "creadas" if APLICAR else "se crearian (dry-run)"))
    w("")
    w("==== RESUMEN DE TIEMPOS ====")
    for et, sg in tiempos:
        w("{:<27}{:>7.2f} s".format(et, sg))
    w("{:<27}{:>7.2f} s".format("TOTAL", time.perf_counter() - t_ini))

    return ["\n".join(L), n_total_conv]


OUT = run()
# ----------------------------------------
slope_analysis_unificado_python = Python(IN[0]=cfg_superficie_analisis, IN[1]=cfg_capa_contorno, IN[2]=cfg_capa_ejes, IN[3]=cfg_tipo, IN[4]=orientacion_ns_eo, IN[5]=cfg_pendiente_max_pct, IN[6]=cfg_pendiente_aviso_pct, IN[7]=cfg_superficie_salida, IN[8]=cfg_opcion_puntos, IN[9]=cfg_pitch_min_m, IN[10]=cfg_pitch_max_m, IN[11]=cfg_iteraciones_subdivision, IN[12]=normalizar_geometria_line_pl2d)  # CPython3
# ---------- slope_analysis_unificado_python.python (647 lines) ----------
# IN[12]: BARRERA de sincronizacion del nodo NORMALIZAR (contenido ignorado).
# -*- coding: utf-8 -*-
# =============================================================================
# 1_Slope_Analysis_Unificado.dyn  -  Nodo Python principal  (v1)
# Civil 3D 2024 / Dynamo 2.19 / CPython3
#
# Unifica los dos analisis de pendientes (NS y EO) y los generaliza a
# Trackers y Mesas. Hay 2 algoritmos y 4 casos:
#
#   AXIAL (a lo largo del eje)  -> Trackers+NS  y  Mesas+EO
#   CROSS (entre filas/vecino)  -> Trackers+EO  y  Mesas+NS
#
# Regla: eje_estructura = "NS" si Trackers, "EO" si Mesas.
#        mode = "axial" si Orientacion == eje_estructura, si no "cross".
#
# Normalizacion de extremos: Trackers A=Norte (mayor Y); Mesas A=Oeste (menor X).
# CROSS:  Trackers -> vecino al ESTE (+X), solape en Y, proyeccion horizontal.
#         Mesas    -> vecino al SUR  (-Y), solape en X, proyeccion vertical.
#
# AXIAL replica el script NS actual (estilo+rangos en la misma transaccion,
#   sin max triangle length, usa Opcion puntos 1/2).
# CROSS replica el script EO actual (2a transaccion aislada para estilo+rangos,
#   MaximumTriangleLength = pitch_max*1.5, usa pitch_min/max e iteraciones).
#
# Entradas (puertos IN[0..11]):
#   IN[0]  : str    nombre de la superficie a muestrear (MDT / definitiva)
#   IN[1]  : str    capa del contorno (polilineas cerradas)
#   IN[2]  : str    capa de los ejes (trackers o mesas, polilineas de 2 vert.)
#   IN[3]  : str    Tipo: "Trackers" o "Mesas"
#   IN[4]  : str    Orientacion medida: "NS" o "EO"
#   IN[5]  : float  pendiente maxima admisible (%)  -> umbral rojo
#   IN[6]  : float  pendiente de aviso (%)          -> umbral amarillo
#   IN[7]  : str    nombre de la nueva superficie TIN de resultado
#   IN[8]  : int    [solo AXIAL] opcion puntos (1=centroide, 2=extremos)
#   IN[9]  : float  [solo CROSS] pitch minimo (m)
#   IN[10] : float  [solo CROSS] pitch maximo (m)
#   IN[11] : int    [solo CROSS] iteraciones de subdivision (n -> 2^n+1 puntos)
#
# Salida:
#   OUT : str  log del analisis + desglose de tiempos
# =============================================================================

import clr
import math
import time
import traceback

clr.AddReference('AcMgd')
clr.AddReference('AcCoreMgd')
clr.AddReference('AcDbMgd')
clr.AddReference('AecBaseMgd')
clr.AddReference('AeccDbMgd')

from Autodesk.AutoCAD.ApplicationServices import Application as AcadApp
from Autodesk.AutoCAD.DatabaseServices import (
    OpenMode, Polyline, Line, SymbolUtilityServices
)
from Autodesk.AutoCAD.Geometry import Point2d, Point3d, Point3dCollection
from Autodesk.Civil import SurfaceBoundaryType
from Autodesk.Civil.ApplicationServices import CivilApplication
from Autodesk.Civil.DatabaseServices import (
    TinSurface, SurfaceAnalysisElevationData, SurfaceSlopeLabel
)

import System
from System import Array
from Autodesk.AutoCAD.Colors import Color as AcadColor


def pip(px, py, poly):
    """Ray-casting point-in-polygon (poly = lista de (x,y), sin necesidad de cerrar)."""
    inside = False
    n = len(poly)
    if n < 3:
        return False
    j = n - 1
    for i in range(n):
        xi, yi = poly[i]
        xj, yj = poly[j]
        if ((yi > py) != (yj > py)) and \
           (px < (xj - xi) * (py - yi) / ((yj - yi) if (yj - yi) != 0 else 1e-12) + xi):
            inside = not inside
        j = i
    return inside


def build_color_ranges(z_min, z_max, warn, mx):
    """Rangos verde/amarillo/rojo dinamicos segun datos reales y umbrales.
    El verde absorbe los extremos que caen dentro; solo se crean colas
    amarillo/rojo si hay datos que las alcancen. Devuelve [(mn,mx,color),...]."""
    green = AcadColor.FromRgb(80, 200, 80)
    yellow = AcadColor.FromRgb(240, 220, 60)
    red = AcadColor.FromRgb(220, 50, 50)

    ranges = []
    # lado negativo
    if z_min < -mx:
        ranges.append((z_min, -mx, red))
        ranges.append((-mx, -warn, yellow))
        green_lo = -warn
    elif z_min < -warn:
        ranges.append((z_min, -warn, yellow))
        green_lo = -warn
    else:
        green_lo = z_min

    # lado positivo
    pos_tail = []
    if z_max > mx:
        green_hi = warn
        pos_tail.append((warn, mx, yellow))
        pos_tail.append((mx, z_max, red))
    elif z_max > warn:
        green_hi = warn
        pos_tail.append((warn, z_max, yellow))
    else:
        green_hi = z_max

    if green_lo >= green_hi:
        green_hi = green_lo + 0.001
    ranges.append((green_lo, green_hi, green))
    ranges.extend(pos_tail)
    return ranges


def assign_style_and_ranges(surf, cdoc, z_min, z_max, warn, mx, log):
    """Asigna estilo 'elevaciones' y aplica los rangos de color a una superficie
    ya abierta ForWrite. Usado por AXIAL (en tr1) y por CROSS (en tr2)."""
    # estilo
    try:
        ss = cdoc.Styles.SurfaceStyles
        style_set = False
        for name_try in ["elevaciones", "Elevaciones", "ELEVACIONES"]:
            try:
                surf.StyleId = ss.get_Item(name_try)
                style_set = True
                log.append("Estilo '{}' asignado.".format(name_try))
                break
            except:
                continue
        if not style_set:
            log.append("AVISO: estilo 'elevaciones' no encontrado. Asignalo a mano.")
    except Exception as ex_sty:
        log.append("AVISO estilo: {}".format(ex_sty))

    # rangos de color
    try:
        ranges = build_color_ranges(z_min, z_max, warn, mx)
        data_arr = [SurfaceAnalysisElevationData(mn, mxv, col)
                    for (mn, mxv, col) in ranges]
        surf.Analysis.SetElevationData(Array[SurfaceAnalysisElevationData](data_arr))
        log.append("{} rangos de color aplicados ({:.2f} a {:.2f}).".format(
            len(ranges), z_min, z_max))
    except Exception as ex_an:
        log.append("AVISO analisis: {}".format(ex_an))


def run():
    log = []
    T = {}
    T["start"] = time.perf_counter()

    # --------------------------------------------------------------------- #
    # Inputs (lectura tolerante)
    # --------------------------------------------------------------------- #
    def _s(i, default=""):
        try:
            return str(IN[i]) if (len(IN) > i and IN[i] is not None) else default
        except:
            return default

    def _f(i, default):
        try:
            return float(IN[i]) if (len(IN) > i and IN[i] is not None) else default
        except:
            return default

    mdt_name = _s(0)
    contour_layer = _s(1)
    axis_layer = _s(2)
    tipo_raw = _s(3, "Trackers")
    orient_raw = _s(4, "NS")
    max_slope_pct = _f(5, 4.0)
    warn_slope_pct = _f(6, 3.0)
    out_surf_name = _s(7, "Slope_Analysis")
    opt_pts = int(_f(8, 2.0))
    pitch_min = _f(9, 4.0)
    pitch_max = _f(10, 15.0)
    n_iter = int(_f(11, 2.0))

    tipo = tipo_raw.strip().upper()
    orient = orient_raw.strip().upper()

    if tipo in ("TRACKER", "TRACKERS", "SEGUIDOR", "SEGUIDORES"):
        tipo = "TRACKERS"
    elif tipo in ("MESA", "MESAS", "FIJA", "FIJAS"):
        tipo = "MESAS"
    if tipo not in ("TRACKERS", "MESAS"):
        raise Exception("Tipo invalido '{}'. Usa 'Trackers' o 'Mesas'.".format(tipo_raw))
    if orient not in ("NS", "EO"):
        raise Exception("Orientacion invalida '{}'. Usa 'NS' o 'EO'.".format(orient_raw))
    if opt_pts not in (1, 2):
        opt_pts = 1

    axis_orient = "NS" if tipo == "TRACKERS" else "EO"   # eje de la estructura
    axis_vertical = (axis_orient == "NS")                # Trackers vertical / Mesas horizontal
    mode = "axial" if orient == axis_orient else "cross"

    tipo_lbl = "Trackers" if tipo == "TRACKERS" else "Mesas"
    log.append("=== SLOPE ANALYSIS UNIFICADO (v1) ===")
    log.append("Tipo: {}   Orientacion medida: {}   Eje estructura: {}".format(
        tipo_lbl, orient, axis_orient))
    log.append("Caso: {} {}  ->  algoritmo '{}'".format(
        tipo_lbl, orient,
        "a lo largo del eje" if mode == "axial" else "entre filas"))
    log.append("Superficie muestreada: {}".format(mdt_name))
    if mode == "axial":
        log.append("(Opcion puntos = {}  |  pitch/iteraciones IGNORADOS en este caso)".format(opt_pts))
    else:
        log.append("(pitch=[{}, {}] m, iteraciones={}  |  Opcion puntos IGNORADA en este caso)".format(
            pitch_min, pitch_max, n_iter))

    doc = AcadApp.DocumentManager.MdiActiveDocument
    db = doc.Database
    cdoc = CivilApplication.ActiveDocument

    surf_points = []     # Point3d con Z = pendiente(%)
    label_pairs = []     # [(Point2d_A, Point2d_B), ...]
    z_min_surf = 0.0
    z_max_surf = 0.0
    n_ok = n_warn = n_ko = 0
    n_err = 0

    # --------------------------------------------------------------------- #
    # FASE 1: lectura, calculo, superficie, (axial: estilo+rangos), etiquetas
    # --------------------------------------------------------------------- #
    dlock = doc.LockDocument()
    try:
        tr = db.TransactionManager.StartTransaction()
        try:

            # 1. Localizar la superficie por nombre
            mdt_surf = None
            mdt_surf_id = None
            for sid in cdoc.GetSurfaceIds():
                s = tr.GetObject(sid, OpenMode.ForRead)
                if s.Name == mdt_name:
                    mdt_surf = s
                    mdt_surf_id = sid
                    break
            if mdt_surf is None:
                raise Exception("No se ha encontrado la superficie '{}'. "
                                "Comprueba el nombre / data shortcut.".format(mdt_name))

            # 2. Recorrer ModelSpace -> contornos + ejes normalizados
            ms_id = SymbolUtilityServices.GetBlockModelSpaceId(db)
            btr = tr.GetObject(ms_id, OpenMode.ForRead)

            contours = []
            axes = []
            # v02: los ejes pueden ser LWPOLYLINE (primer y ultimo vertice) o
            # LINE (StartPoint/EndPoint). Los contornos siguen siendo solo
            # polilineas cerradas. Se lleva censo por capa/tipo para que, si
            # no aparece nada, el log diga que hay en realidad en esa capa.
            censo = {}
            n_ejes_pl = 0
            n_ejes_ln = 0
            for oid in btr:
                obj = tr.GetObject(oid, OpenMode.ForRead)
                es_pl = isinstance(obj, Polyline)
                es_ln = isinstance(obj, Line)
                lay = obj.Layer
                if lay == contour_layer or lay == axis_layer:
                    try:
                        tipo_obj = obj.GetType().Name
                    except Exception:
                        tipo_obj = type(obj).__name__
                    clave = (lay, tipo_obj)
                    censo[clave] = censo.get(clave, 0) + 1
                if not (es_pl or es_ln):
                    continue
                p1 = None
                p2 = None
                if es_pl:
                    nv = obj.NumberOfVertices
                    if lay == contour_layer and nv >= 3:
                        pts = []
                        for i in range(nv):
                            p = obj.GetPoint2dAt(i)
                            pts.append((p.X, p.Y))
                        contours.append(pts)
                        continue
                    if lay == axis_layer and nv >= 2:
                        p1 = obj.GetPoint2dAt(0)
                        p2 = obj.GetPoint2dAt(nv - 1)
                        n_ejes_pl += 1
                elif lay == axis_layer:
                    p1 = obj.StartPoint
                    p2 = obj.EndPoint
                    n_ejes_ln += 1
                if p1 is not None and p2 is not None:
                    if axis_vertical:
                        # A = Norte (mayor Y)
                        if p1.Y >= p2.Y:
                            ax, ay, bx, by = p1.X, p1.Y, p2.X, p2.Y
                        else:
                            ax, ay, bx, by = p2.X, p2.Y, p1.X, p1.Y
                    else:
                        # A = Oeste (menor X)
                        if p1.X <= p2.X:
                            ax, ay, bx, by = p1.X, p1.Y, p2.X, p2.Y
                        else:
                            ax, ay, bx, by = p2.X, p2.Y, p1.X, p1.Y
                    axes.append({
                        "ax": ax, "ay": ay, "bx": bx, "by": by,
                        "xmid": (ax + bx) / 2.0, "ymid": (ay + by) / 2.0,
                        "xmin": min(ax, bx), "xmax": max(ax, bx),
                        "ymin": min(ay, by), "ymax": max(ay, by),
                    })

            def _censo_txt(capa):
                filas = ["{} x {}".format(v, k[1]) for k, v in censo.items()
                         if k[0] == capa]
                return ", ".join(sorted(filas)) if filas else "ningun objeto"

            if not contours:
                raise Exception(
                    "No hay polilineas (LWPOLYLINE, >=3 vertices) en la capa "
                    "de contorno '{}'. En esa capa hay: {}."
                    .format(contour_layer, _censo_txt(contour_layer)))
            if not axes:
                raise Exception(
                    "No hay ejes (LWPOLYLINE o LINE) en la capa de ejes '{}'. "
                    "En esa capa hay: {}. Comprueba nombre exacto de capa, "
                    "que no esten en un bloque/XREF, y el tipo de objeto."
                    .format(axis_layer, _censo_txt(axis_layer)))

            log.append("Contornos encontrados: {}".format(len(contours)))
            log.append("Ejes encontrados:      {}  (polilineas {}, lineas {})"
                       .format(len(axes), n_ejes_pl, n_ejes_ln))
            T["read"] = time.perf_counter()

            # 3. Filtro: ambos extremos dentro de algun contorno
            inside_axes = []
            n_out = 0
            for a in axes:
                inA = any(pip(a["ax"], a["ay"], c) for c in contours)
                inB = any(pip(a["bx"], a["by"], c) for c in contours)
                if inA and inB:
                    inside_axes.append(a)
                else:
                    n_out += 1
            if not inside_axes:
                raise Exception("Ningun eje con ambos extremos dentro del contorno.")
            log.append("Ejes dentro del contorno: {}".format(len(inside_axes)))
            log.append("Ejes fuera del contorno:  {}".format(n_out))
            T["filter"] = time.perf_counter()

            # 4. Calculo de pendientes segun modo
            if mode == "axial":
                # pendiente entre los dos extremos de cada eje
                for a in inside_axes:
                    xa, ya, xb, yb = a["ax"], a["ay"], a["bx"], a["by"]
                    try:
                        za = mdt_surf.FindElevationAtXY(xa, ya)
                        zb = mdt_surf.FindElevationAtXY(xb, yb)
                    except:
                        n_err += 1
                        continue
                    dx = xb - xa
                    dy = yb - ya
                    L = math.sqrt(dx * dx + dy * dy)
                    if L < 1e-6:
                        n_err += 1
                        continue
                    slope_pct = (zb - za) / L * 100.0
                    if abs(slope_pct) > max_slope_pct:
                        n_ko += 1
                    elif abs(slope_pct) > warn_slope_pct:
                        n_warn += 1
                    else:
                        n_ok += 1
                    if opt_pts == 2:
                        surf_points.append(Point3d(xa, ya, slope_pct))
                        surf_points.append(Point3d(xb, yb, slope_pct))
                    else:
                        xm = (xa + xb) / 2.0
                        ym = (ya + yb) / 2.0
                        surf_points.append(Point3d(xm, ym, slope_pct))
                    label_pairs.append((Point2d(xa, ya), Point2d(xb, yb)))

            else:
                # entre filas: emparejar con vecino perpendicular y densificar
                if pitch_max <= 0 or pitch_min < 0 or pitch_min >= pitch_max:
                    raise Exception("Pitch invalido: min={}, max={}. Debe cumplir 0<=min<max.".format(
                        pitch_min, pitch_max))

                neighbor_dir = "Este" if axis_vertical else "Sur"

                def find_neighbor(Tn, pool):
                    cands = []
                    for U in pool:
                        if U is Tn:
                            continue
                        if axis_vertical:
                            d = U["xmid"] - Tn["xmid"]            # vecino al Este (+X)
                            if d <= 1e-6 or d < pitch_min or d > pitch_max:
                                continue
                            if min(Tn["ymax"], U["ymax"]) <= max(Tn["ymin"], U["ymin"]):
                                continue                          # sin solape en Y
                        else:
                            d = Tn["ymid"] - U["ymid"]            # vecino al Sur (-Y)
                            if d <= 1e-6 or d < pitch_min or d > pitch_max:
                                continue
                            if min(Tn["xmax"], U["xmax"]) <= max(Tn["xmin"], U["xmin"]):
                                continue                          # sin solape en X
                        cands.append((d, U))
                    if not cands:
                        return None
                    cands.sort(key=lambda c: c[0])                # mas cercano dentro del rango
                    return cands[0][1]

                n_pts = (1 << max(0, n_iter)) + 1                 # 2^n + 1
                if n_pts < 2:
                    n_pts = 2
                denom = float(n_pts - 1)
                t_params = [i / denom for i in range(n_pts)]

                pairs = []
                n_no_neighbor = 0
                for Tn in inside_axes:
                    Nn = find_neighbor(Tn, inside_axes)
                    if Nn is None:
                        n_no_neighbor += 1
                        continue
                    pairs.append((Tn, Nn))
                if not pairs:
                    raise Exception("Ningun eje tiene vecino al {}. Revisa pitch/geometria.".format(
                        neighbor_dir))

                for Tn, Nn in pairs:
                    Tax, Tay, Tbx, Tby = Tn["ax"], Tn["ay"], Tn["bx"], Tn["by"]
                    Nax, Nay, Nbx, Nby = Nn["ax"], Nn["ay"], Nn["bx"], Nn["by"]
                    for tp in t_params:
                        px = Tax + tp * (Tbx - Tax)
                        py = Tay + tp * (Tby - Tay)
                        if axis_vertical:
                            # proyeccion horizontal: misma py, hallar nx sobre la recta de N
                            if abs(Nay - Nby) < 1e-9:
                                n_err += 1
                                continue
                            t_n = (Nay - py) / (Nay - Nby)
                            nx = Nax + t_n * (Nbx - Nax)
                            ny = py
                        else:
                            # proyeccion vertical: misma px, hallar ny sobre la recta de N
                            if abs(Nax - Nbx) < 1e-9:
                                n_err += 1
                                continue
                            t_n = (Nax - px) / (Nax - Nbx)
                            ny = Nay + t_n * (Nby - Nay)
                            nx = px
                        dx = nx - px
                        dy = ny - py
                        L = math.sqrt(dx * dx + dy * dy)
                        if L < 1e-6:
                            n_err += 1
                            continue
                        try:
                            zT = mdt_surf.FindElevationAtXY(px, py)
                            zN = mdt_surf.FindElevationAtXY(nx, ny)
                        except:
                            n_err += 1
                            continue
                        slope_pct = (zN - zT) / L * 100.0
                        if abs(slope_pct) > max_slope_pct:
                            n_ko += 1
                        elif abs(slope_pct) > warn_slope_pct:
                            n_warn += 1
                        else:
                            n_ok += 1
                        surf_points.append(Point3d(px, py, slope_pct))
                        surf_points.append(Point3d(nx, ny, slope_pct))
                        label_pairs.append((Point2d(px, py), Point2d(nx, ny)))

                log.append("Parejas analizadas:     {}".format(len(pairs)))
                log.append("Ejes sin vecino al {}: {}".format(neighbor_dir, n_no_neighbor))

            if not surf_points:
                raise Exception("No se han podido calcular pendientes (sin puntos validos).")

            z_min_surf = min(p.Z for p in surf_points)
            z_max_surf = max(p.Z for p in surf_points)
            T["calc"] = time.perf_counter()

            # 5. Crear superficie TIN (borrando la previa por nombre)
            existing_id = None
            for sid in cdoc.GetSurfaceIds():
                s = tr.GetObject(sid, OpenMode.ForRead)
                if s.Name == out_surf_name:
                    existing_id = sid
                    break
            if existing_id is not None:
                tr.GetObject(existing_id, OpenMode.ForWrite).Erase()
                log.append("Superficie previa '{}' borrada.".format(out_surf_name))

            new_surf_id = TinSurface.Create(db, out_surf_name)
            new_surf = tr.GetObject(new_surf_id, OpenMode.ForWrite)
            for p in surf_points:
                new_surf.AddVertex(p)

            # 6. Contornos: el primero como Outer, los demas como Show
            firstb = True
            for c in contours:
                pc = Point3dCollection()
                for (x, y) in c:
                    pc.Add(Point3d(x, y, 0.0))
                if (c[0][0], c[0][1]) != (c[-1][0], c[-1][1]):
                    pc.Add(Point3d(c[0][0], c[0][1], 0.0))
                btype = SurfaceBoundaryType.Outer if firstb else SurfaceBoundaryType.Show
                new_surf.BoundariesDefinition.AddBoundaries(pc, 1.0, btype, True)
                firstb = False

            # 6b. (solo CROSS) longitud maxima de triangulo -> corta puentes
            if mode == "cross":
                max_tri = pitch_max * 1.5
                try:
                    bops = new_surf.BuildOptions
                    bops.UseMaximumTriangleLength = True
                    bops.MaximumTriangleLength = max_tri
                    log.append("Max triangle side aplicado: {:.2f} m".format(max_tri))
                except Exception as ex_bo:
                    log.append("AVISO: max triangle side no aplicado por API ({}). "
                               "Configuralo a mano (= {:.2f} m).".format(ex_bo, max_tri))

            # 7. (solo AXIAL) estilo + rangos en ESTA misma transaccion
            if mode == "axial":
                assign_style_and_ranges(new_surf, cdoc, z_min_surf, z_max_surf,
                                        warn_slope_pct, max_slope_pct, log)
            T["surface"] = time.perf_counter()

            # 8. Etiquetas de pendiente "Two points" sobre el MDT muestreado
            #    Firma C3D 2024: SurfaceSlopeLabel.Create(surfaceId, P2d, P2d, styleId)
            slope_style_id = None
            try:
                lss = cdoc.Styles.LabelStyles.SurfaceLabelStyles.SlopeLabelStyles
                for stid in lss:
                    slope_style_id = stid
                    break
            except Exception as ex_ss:
                log.append("AVISO: no se pudo leer SlopeLabelStyles: {}".format(ex_ss))

            n_labels = 0
            n_label_err = 0
            first_err = None
            for pA, pB in label_pairs:
                try:
                    if slope_style_id is not None:
                        SurfaceSlopeLabel.Create(mdt_surf_id, pA, pB, slope_style_id)
                    else:
                        SurfaceSlopeLabel.Create(mdt_surf_id, pA, pB)
                    n_labels += 1
                except Exception as ex_lb:
                    n_label_err += 1
                    if first_err is None:
                        first_err = str(ex_lb)
            log.append("Etiquetas de pendiente creadas: {}".format(n_labels))
            if n_label_err > 0:
                log.append("Etiquetas con error: {} (primer error: {})".format(n_label_err, first_err))
            T["labels"] = time.perf_counter()

            tr.Commit()
        finally:
            tr.Dispose()
    finally:
        dlock.Dispose()

    # --------------------------------------------------------------------- #
    # FASE 2 (solo CROSS): estilo + rangos en transaccion aislada.
    # Si falla, la superficie/contornos/etiquetas siguen intactos.
    # --------------------------------------------------------------------- #
    if mode == "cross":
        dlock2 = doc.LockDocument()
        try:
            tr2 = db.TransactionManager.StartTransaction()
            try:
                target = None
                for sid in cdoc.GetSurfaceIds():
                    s = tr2.GetObject(sid, OpenMode.ForRead)
                    if s.Name == out_surf_name:
                        target = tr2.GetObject(sid, OpenMode.ForWrite)
                        break
                if target is None:
                    log.append("AVISO: superficie no localizada para estilo/analisis (fase 2).")
                else:
                    assign_style_and_ranges(target, cdoc, z_min_surf, z_max_surf,
                                            warn_slope_pct, max_slope_pct, log)
                tr2.Commit()
            finally:
                tr2.Dispose()
        finally:
            dlock2.Dispose()
        T["style2"] = time.perf_counter()

    # --------------------------------------------------------------------- #
    # Resumen
    # --------------------------------------------------------------------- #
    log.append("")
    log.append("=== RESUMEN ===")
    log.append("Puntos clasificados (dentro):    {}".format(n_ok + n_warn + n_ko))
    log.append("  Verde   (|p| <= {} %):         {}".format(warn_slope_pct, n_ok))
    log.append("  Amarillo({} - {} %):           {}".format(warn_slope_pct, max_slope_pct, n_warn))
    log.append("  Rojo    (|p| > {} %):          {}".format(max_slope_pct, n_ko))
    log.append("Puntos con error de muestreo:    {}".format(n_err))
    log.append("Rango pendiente:                 {:.2f} % a {:.2f} %".format(z_min_surf, z_max_surf))
    log.append("Superficie creada:               {}".format(out_surf_name))

    # --------------------------------------------------------------------- #
    # Tiempos
    # --------------------------------------------------------------------- #
    T["end"] = time.perf_counter()

    def tl(lbl, k1, k2):
        if k1 in T and k2 in T:
            log.append("  {:<27}{:>7.2f} s".format(lbl, T[k2] - T[k1]))

    log.append("")
    log.append("=== TIEMPOS ===")
    tl("Lectura geometria:", "start", "read")
    tl("Filtrado contorno:", "read", "filter")
    tl("Calculo pendientes:", "filter", "calc")
    tl("Creacion superficie:", "calc", "surface")
    if mode == "axial":
        tl("Etiquetas:", "surface", "labels")
    else:
        tl("Etiquetas:", "surface", "labels")
        tl("Estilo + rangos (fase 2):", "labels", "style2")
    log.append("  " + "-" * 34)
    log.append("  {:<27}{:>7.2f} s".format("TOTAL:", T["end"] - T["start"]))

    return "\n".join(log)


try:
    OUT = run()
except Exception as ex:
    OUT = "ERROR:\n" + str(ex) + "\n\n" + traceback.format_exc()
# ----------------------------------------
LOG = Watch(slope_analysis_unificado_python)  # graph output
extraer_log = Python(IN[0]=config_sombra)  # CPython3; graph output
# ---------- extraer_log.python (3 lines) ----------
# -*- coding: utf-8 -*-
# Extrae el log (indice 1) de la salida CONFIG para el Watch
OUT = IN[0][1] if IN[0] is not None else "(sin salida CONFIG)"
# ----------------------------------------
CONFIG_LOG = Watch(extraer_log)
cfg_resultados_vacio = StringInput("")
cfg_ok = BoolSelector(true)
cfg_auditoria_z = StringInput("N/A")
CIERRE = Python(IN[0]=cfg_variante_base_orient, IN[1]=slope_analysis_unificado_python, IN[2]=cfg_resultados_vacio, IN[3]=cfg_ok, IN[4]=cfg_ok, IN[5]=cfg_auditoria_z, IN[6]=slope_analysis_unificado_python)  # CPython3
# ---------- CIERRE.python (79 lines) ----------
# -*- coding: utf-8 -*-
# NODO CIERRE: escribe estado_pipeline.json y el log en Logs/
import os
import sys
import importlib

# Localizador de pipeline.py sin rutas fijas. Orden:
#   1) instalado con instalar.bat (site-packages del Python de Dynamo)
#   2) variable de entorno PIPELINE_HOME
#   3) carpeta del proyecto (hasta 3 niveles sobre el DWG activo)
def _cargar_pipeline():
    probadas = []
    try:
        import pipeline as _m
        importlib.reload(_m)
        return _m, "pipeline.py: importado desde " + str(
            getattr(_m, "__file__", "?"))
    except ImportError:
        probadas.append("import directo (site-packages de Dynamo)")
    candidatas = []
    ph = os.environ.get("PIPELINE_HOME", "")
    if ph:
        candidatas.append(ph)
    try:
        import clr
        clr.AddReference("AcMgd")
        from Autodesk.AutoCAD.ApplicationServices import (
            Application as _A)
        _doc = _A.DocumentManager.MdiActiveDocument
        if _doc is not None:
            _c = os.path.dirname(os.path.abspath(str(_doc.Name)))
            for _ in range(3):
                candidatas.append(_c)
                _p = os.path.dirname(_c)
                if _p == _c:
                    break
                _c = _p
    except Exception as ex:
        probadas.append("DWG activo no disponible: " + str(ex)[:80])
    for _r in candidatas:
        probadas.append(_r)
        if _r and os.path.exists(os.path.join(_r, "pipeline.py")):
            if _r not in sys.path:
                sys.path.insert(0, _r)
            import pipeline as _m
            importlib.reload(_m)
            return _m, "pipeline.py: cargado desde " + _r
    log = ["KO: no se encontro pipeline.py. Rutas probadas:"]
    log += ["  - " + p for p in probadas]
    log.append("Solucion: doble clic en instalar.bat, o copia pipeline.py "
               "a la carpeta del proyecto (junto a config_proyecto.xlsx), "
               "o define la variable de entorno PIPELINE_HOME.")
    return None, "\n".join(log)


pipeline, _msg_carga = _cargar_pipeline()

if pipeline is None:
    OUT = [False, _msg_carga + "\n"
           + (str(IN[1]) if IN[1] is not None else "")]
else:
    def _abool(v):
        if isinstance(v, str):
            return v.strip().upper() in ("S", "SI", "TRUE", "1", "V")
        return bool(v)

    fase = str(IN[0])
    log_script = IN[1] if IN[1] is not None else ""
    resultados = IN[2]
    aplicado = _abool(IN[3]) if IN[3] is not None else False
    ok_script = _abool(IN[4]) if IN[4] is not None else True
    auditoria = str(IN[5]) if IN[5] is not None else "N/A"
    # IN[6]: barrera de sincronizacion (ignorada)

    OUT = pipeline.nodo_cierre(fase, log_script,
                               resultados=resultados,
                               aplicado=aplicado,
                               ok=ok_script,
                               auditoria_z=auditoria)
# ----------------------------------------
extraer_log_cierre = Python(IN[0]=CIERRE)  # CPython3; graph output; same code as extraer_log
CIERRE_LOG = Watch(extraer_log_cierre)
extraer_log_normalizar = Python(IN[0]=normalizar_geometria_line_pl2d)  # CPython3
# ---------- extraer_log_normalizar.python (2 lines) ----------
# Extrae el log (indice 0) de la salida del normalizador para el Watch
OUT = IN[0][0] if IN[0] is not None else "(sin salida)"
# ----------------------------------------
NORMALIZAR_LOG = Watch(extraer_log_normalizar)
