# Dynamo graph 4_DP_SuperficiesVolumen_MdT_v01.dyn "4_DP_SuperficiesVolumen_MdT_v03" (Dynamo 2.19.4.6671)
# Tablas de volúmenes por contornos con su rugosidad. Inputs: Contornos, Trackers y MDT.

superficie_base_trackers = StringInput("TrackersCaso")
superficie_comparacion_mdt = StringInput("MDT_PruebaCaso")  # "Superficie comparacion (MDT original)"
rugosidad_mm = DoubleInput(100)
prefijo_nombre_volumen = StringInput("Volumen_MDT")
capa_de_contornos = StringInput("_contornos")
cfg_fase = StringInput("4")
config_sombra = Python(IN[0]=cfg_fase)  # CPython3
# ---------- config_sombra.python (66 lines) ----------
# -*- coding: utf-8 -*-
# NODO CONFIG (modo sombra: valida y muestra la config, pero
# los parametros del script siguen viniendo de los inputs de siempre)
import os
import sys
import importlib

# Localizador de pipeline.py sin rutas fijas. Orden:
#   1) instalado con instalar.bat (site-packages del Python de Dynamo)
#   2) variable de entorno PIPELINE_HOME
#   3) carpeta del proyecto (hasta 3 niveles sobre el DWG activo)
def _cargar_pipeline():
    probadas = []
    try:
        import pipeline as _m
        importlib.reload(_m)
        return _m, "pipeline.py: importado desde " + str(
            getattr(_m, "__file__", "?"))
    except ImportError:
        probadas.append("import directo (site-packages de Dynamo)")
    candidatas = []
    ph = os.environ.get("PIPELINE_HOME", "")
    if ph:
        candidatas.append(ph)
    try:
        import clr
        clr.AddReference("AcMgd")
        from Autodesk.AutoCAD.ApplicationServices import (
            Application as _A)
        _doc = _A.DocumentManager.MdiActiveDocument
        if _doc is not None:
            _c = os.path.dirname(os.path.abspath(str(_doc.Name)))
            for _ in range(3):
                candidatas.append(_c)
                _p = os.path.dirname(_c)
                if _p == _c:
                    break
                _c = _p
    except Exception as ex:
        probadas.append("DWG activo no disponible: " + str(ex)[:80])
    for _r in candidatas:
        probadas.append(_r)
        if _r and os.path.exists(os.path.join(_r, "pipeline.py")):
            if _r not in sys.path:
                sys.path.insert(0, _r)
            import pipeline as _m
            importlib.reload(_m)
            return _m, "pipeline.py: cargado desde " + _r
    log = ["KO: no se encontro pipeline.py. Rutas probadas:"]
    log += ["  - " + p for p in probadas]
    log.append("Solucion: doble clic en instalar.bat, o copia pipeline.py "
               "a la carpeta del proyecto (junto a config_proyecto.xlsx), "
               "o define la variable de entorno PIPELINE_HOME.")
    return None, "\n".join(log)


pipeline, _msg_carga = _cargar_pipeline()

if pipeline is None:
    OUT = [False, _msg_carga, "", ""]
else:
    OUT = pipeline.nodo_config(str(IN[0]))
    try:
        OUT[1] = _msg_carga + "\n" + OUT[1]
    except Exception:
        pass
# ----------------------------------------
cfg_superficie_trackers = Python(IN[0]=config_sombra)  # CPython3
# ---------- cfg_superficie_trackers.python (21 lines) ----------
# -*- coding: utf-8 -*-
# CONFIG: parametro 'superficie_trackers' desde config (indice 4).
# Si la config es KO, BLOQUEA este parametro e incrusta la causa
# (las lineas KO/AVISO del log de config) en el propio error.
res = IN[0]
if ((not isinstance(res, list)) or len(res) <= 4
        or res[0] is not True):
    detalle = "el nodo de config no devolvio datos"
    try:
        lineas = str(res[1]).splitlines()
        malas = [l.strip() for l in lineas
                 if "KO" in l or "AVISO" in l]
        if malas:
            detalle = " | ".join(malas[-4:])
        elif lineas:
            detalle = " | ".join(
                l.strip() for l in lineas[-3:])
    except Exception:
        pass
    raise Exception("CONFIG KO -> " + detalle[:400])
OUT = res[4]
# ----------------------------------------
cfg_superficie_mdt = Python(IN[0]=config_sombra)  # CPython3
# ---------- cfg_superficie_mdt.python (21 lines) ----------
# -*- coding: utf-8 -*-
# CONFIG: parametro 'superficie_mdt' desde config (indice 5).
# Si la config es KO, BLOQUEA este parametro e incrusta la causa
# (las lineas KO/AVISO del log de config) en el propio error.
res = IN[0]
if ((not isinstance(res, list)) or len(res) <= 5
        or res[0] is not True):
    detalle = "el nodo de config no devolvio datos"
    try:
        lineas = str(res[1]).splitlines()
        malas = [l.strip() for l in lineas
                 if "KO" in l or "AVISO" in l]
        if malas:
            detalle = " | ".join(malas[-4:])
        elif lineas:
            detalle = " | ".join(
                l.strip() for l in lineas[-3:])
    except Exception:
        pass
    raise Exception("CONFIG KO -> " + detalle[:400])
OUT = res[5]
# ----------------------------------------
cfg_rugosidad_mm = Python(IN[0]=config_sombra)  # CPython3
# ---------- cfg_rugosidad_mm.python (21 lines) ----------
# -*- coding: utf-8 -*-
# CONFIG: parametro 'rugosidad_mm' desde config (indice 6).
# Si la config es KO, BLOQUEA este parametro e incrusta la causa
# (las lineas KO/AVISO del log de config) en el propio error.
res = IN[0]
if ((not isinstance(res, list)) or len(res) <= 6
        or res[0] is not True):
    detalle = "el nodo de config no devolvio datos"
    try:
        lineas = str(res[1]).splitlines()
        malas = [l.strip() for l in lineas
                 if "KO" in l or "AVISO" in l]
        if malas:
            detalle = " | ".join(malas[-4:])
        elif lineas:
            detalle = " | ".join(
                l.strip() for l in lineas[-3:])
    except Exception:
        pass
    raise Exception("CONFIG KO -> " + detalle[:400])
OUT = res[6]
# ----------------------------------------
cfg_prefijo_volumen = Python(IN[0]=config_sombra)  # CPython3
# ---------- cfg_prefijo_volumen.python (21 lines) ----------
# -*- coding: utf-8 -*-
# CONFIG: parametro 'prefijo_volumen' desde config (indice 7).
# Si la config es KO, BLOQUEA este parametro e incrusta la causa
# (las lineas KO/AVISO del log de config) en el propio error.
res = IN[0]
if ((not isinstance(res, list)) or len(res) <= 7
        or res[0] is not True):
    detalle = "el nodo de config no devolvio datos"
    try:
        lineas = str(res[1]).splitlines()
        malas = [l.strip() for l in lineas
                 if "KO" in l or "AVISO" in l]
        if malas:
            detalle = " | ".join(malas[-4:])
        elif lineas:
            detalle = " | ".join(
                l.strip() for l in lineas[-3:])
    except Exception:
        pass
    raise Exception("CONFIG KO -> " + detalle[:400])
OUT = res[7]
# ----------------------------------------
cfg_capa_contornos = Python(IN[0]=config_sombra)  # CPython3
# ---------- cfg_capa_contornos.python (21 lines) ----------
# -*- coding: utf-8 -*-
# CONFIG: parametro 'capa_contornos' desde config (indice 8).
# Si la config es KO, BLOQUEA este parametro e incrusta la causa
# (las lineas KO/AVISO del log de config) en el propio error.
res = IN[0]
if ((not isinstance(res, list)) or len(res) <= 8
        or res[0] is not True):
    detalle = "el nodo de config no devolvio datos"
    try:
        lineas = str(res[1]).splitlines()
        malas = [l.strip() for l in lineas
                 if "KO" in l or "AVISO" in l]
        if malas:
            detalle = " | ".join(malas[-4:])
        elif lineas:
            detalle = " | ".join(
                l.strip() for l in lineas[-3:])
    except Exception:
        pass
    raise Exception("CONFIG KO -> " + detalle[:400])
OUT = res[8]
# ----------------------------------------
normalizar_true_convierte_false = BoolSelector(true)  # "NORMALIZAR (True=convierte, False=solo informa)"; graph input
normalizar_geometria_line_pl2d = Python(IN[0]=cfg_capa_contornos, IN[1]=normalizar_true_convierte_false)  # "NORMALIZAR geometria (LINE/PL2D/PL3D -> LWPOLYLINE)"; CPython3
# ---------- normalizar_geometria_line_pl2d.python (368 lines) ----------
# -*- coding: utf-8 -*-
# =============================================================================
# NORMALIZAR GEOMETRIA v01  -  nodo previo comun a los scripts del pipeline
# =============================================================================
# Los scripts leen contornos, ejes y trackers como LWPOLYLINE. En la practica
# esas capas llegan con LINE sueltas (layouts, DXF), POLYLINE 2D antiguas o
# POLYLINE 3D. Este nodo las normaliza ANTES de que corra el script:
#
#   - LINE      : se encadenan por extremos (tolerancia de empalme TOL_EMPALME)
#                 y cada cadena pasa a ser UNA LWPOLYLINE. Si la cadena cierra
#                 sobre si misma (hueco <= TOL_CIERRE) se marca Closed.
#                 Una LINE aislada -> LWPOLYLINE de 2 vertices.
#   - POLYLINE2D / POLYLINE3D : se reescriben como LWPOLYLINE plana (Z ignorada),
#                 conservando el flag Closed.
#   - LWPOLYLINE: no se toca.
#
# Los originales NO se borran: se mueven a la capa '<capa>_ORIG' (se crea si
# no existe y se deja apagada). Es reversible: mover de vuelta y borrar las
# LWPOLYLINE nuevas.
#
# ENTRADAS (numero variable): IN[0..n-2] nombres de capa (str; vacios se
#   ignoran; tambien acepta listas de str). El ULTIMO input IN[n-1] es
#   APLICAR: True convierte; False solo informa (dry-run).
# SALIDA: OUT = [log_str, n_convertidas]. Conectar OUT como barrera al primer
#   nodo de trabajo del script para forzar que esto corra antes.
# =============================================================================
import math
import time
import traceback

import clr
clr.AddReference('AcMgd')
clr.AddReference('AcCoreMgd')
clr.AddReference('AcDbMgd')

from Autodesk.AutoCAD.ApplicationServices import Application
from Autodesk.AutoCAD.DatabaseServices import (
    OpenMode, Polyline, Polyline2d, Polyline3d, Line,
    SymbolUtilityServices, LayerTableRecord, ObjectId)
from Autodesk.AutoCAD.Geometry import Point2d

TOL_EMPALME = 0.05   # m: dos extremos a menos de esto se consideran unidos
TOL_CIERRE = 0.50    # m: regla del proyecto para contornos visualmente cerrados

# [DYNAMO-DAG] todo dentro de run(): nunca SystemExit a nivel de modulo
def run():
    # ------------------------------ entradas -----------------------------------
    _ins = list(IN)
    if not _ins:
        return ["NORMALIZAR: sin entradas", 0]
    _ap = _ins[-1]
    if isinstance(_ap, str):
        APLICAR = _ap.strip().upper() in ("S", "SI", "TRUE", "1", "V")
    else:
        APLICAR = bool(_ap)
    capas = []
    for v in _ins[:-1]:
        if v is None:
            continue
        if isinstance(v, (list, tuple)):
            for x in v:
                if x is not None and str(x).strip():
                    capas.append(str(x).strip())
        elif str(v).strip():
            capas.append(str(v).strip())
    # dedup conservando orden
    _vist = set()
    capas = [c for c in capas if not (c in _vist or _vist.add(c))]

    L = []


    def w(s=""):
        L.append(str(s))


    t_ini = time.perf_counter()
    w("=" * 72)
    w(" NORMALIZAR GEOMETRIA v01  -  {}".format(
        "APLICAR (convierte)" if APLICAR else "DRY-RUN (solo informa)"))
    w("=" * 72)
    w("capas: {}".format(", ".join(capas) if capas else "(ninguna)"))
    w("tolerancias: empalme {:.2f} m, cierre {:.2f} m".format(TOL_EMPALME, TOL_CIERRE))

    if not capas:
        w("Nada que hacer.")
        w("")
        w("==== RESUMEN DE TIEMPOS ====")
        w("{:<27}{:>7.2f} s".format("TOTAL", time.perf_counter() - t_ini))
        return ["\n".join(L), 0]


    def _key(p):
        """Celda de rejilla para agrupar extremos con tolerancia."""
        return (int(math.floor(p[0] / TOL_EMPALME)),
                int(math.floor(p[1] / TOL_EMPALME)))


    def _cerca(a, b):
        return math.hypot(a[0] - b[0], a[1] - b[1]) <= TOL_EMPALME


    def encadenar(segs):
        """segs: lista de (p_ini, p_fin) 2D. Devuelve lista de (pts, cerrada).
        Recorre cada segmento una sola vez; en bifurcaciones toma el primer
        vecino libre (suficiente para contornos y ejes; los nudos raros se
        reportan como cadenas abiertas y el usuario los ve en el log)."""
        n = len(segs)
        usado = [False] * n
        idx = {}
        for i, (a, b) in enumerate(segs):
            for p in (a, b):
                k = _key(p)
                for dx in (-1, 0, 1):
                    for dy in (-1, 0, 1):
                        idx.setdefault((k[0] + dx, k[1] + dy), []).append(i)
        # dedup listas
        for k in idx:
            vist = set()
            idx[k] = [i for i in idx[k] if not (i in vist or vist.add(i))]

        def vecino_libre(p, excluir):
            for j in idx.get(_key(p), []):
                if usado[j] or j == excluir:
                    continue
                a, b = segs[j]
                if _cerca(p, a):
                    return j, b
                if _cerca(p, b):
                    return j, a
            return None, None

        cadenas = []
        for i in range(n):
            if usado[i]:
                continue
            usado[i] = True
            a, b = segs[i]
            pts = [a, b]
            # extender por el final
            cur = b
            last = i
            while True:
                j, nxt = vecino_libre(cur, last)
                if j is None:
                    break
                usado[j] = True
                pts.append(nxt)
                cur = nxt
                last = j
                if _cerca(cur, pts[0]) and len(pts) > 3:
                    break
            # extender por el principio (si no cerro)
            if not _cerca(pts[-1], pts[0]):
                cur = pts[0]
                last = i
                while True:
                    j, nxt = vecino_libre(cur, last)
                    if j is None:
                        break
                    usado[j] = True
                    pts.insert(0, nxt)
                    cur = nxt
                    last = j
                    if _cerca(pts[0], pts[-1]) and len(pts) > 3:
                        break
            cerrada = False
            if len(pts) >= 4 and math.hypot(pts[0][0] - pts[-1][0],
                                            pts[0][1] - pts[-1][1]) <= TOL_CIERRE:
                cerrada = True
                # si el ultimo punto duplica al primero, quitarlo
                if _cerca(pts[0], pts[-1]):
                    pts = pts[:-1]
            cadenas.append((pts, cerrada))
        return cadenas


    def pts_polyline2d(ent, tr):
        pts = []
        try:
            for vid in ent:
                v = tr.GetObject(vid, OpenMode.ForRead)
                p = v.Position
                pts.append((p.X, p.Y))
        except Exception:
            pts = []
        return pts


    def pts_polyline3d(ent, tr):
        pts = []
        try:
            for vid in ent:
                v = tr.GetObject(vid, OpenMode.ForRead)
                p = v.Position
                pts.append((p.X, p.Y))
        except Exception:
            pts = []
        return pts


    adoc = Application.DocumentManager.MdiActiveDocument
    db = adoc.Database
    n_total_conv = 0
    tiempos = []

    dlock = adoc.LockDocument()
    try:
        tr = db.TransactionManager.StartTransaction()
        try:
            ms_id = SymbolUtilityServices.GetBlockModelSpaceId(db)
            ms = tr.GetObject(ms_id, OpenMode.ForWrite if APLICAR else OpenMode.ForRead)
            lt = tr.GetObject(db.LayerTableId, OpenMode.ForRead)

            # ---- inventario por capa -----------------------------------------
            t0 = time.perf_counter()
            por_capa = {c: {"lw": 0, "line": [], "p2d": [], "p3d": [], "otros": {}}
                        for c in capas}
            for oid in ms:
                try:
                    ent = tr.GetObject(oid, OpenMode.ForRead)
                except Exception:
                    continue
                lay = ent.Layer
                if lay not in por_capa:
                    continue
                d = por_capa[lay]
                if isinstance(ent, Polyline):
                    d["lw"] += 1
                elif isinstance(ent, Line):
                    d["line"].append(oid)
                elif isinstance(ent, Polyline2d):
                    d["p2d"].append(oid)
                elif isinstance(ent, Polyline3d):
                    d["p3d"].append(oid)
                else:
                    try:
                        tn = ent.GetType().Name
                    except Exception:
                        tn = type(ent).__name__
                    d["otros"][tn] = d["otros"].get(tn, 0) + 1
            tiempos.append(("inventario", time.perf_counter() - t0))

            w("")
            w("{:<28}{:>6}{:>7}{:>7}{:>7}  otros".format(
                "capa", "LWPL", "LINE", "PL2D", "PL3D"))
            w("-" * 72)
            for c in capas:
                d = por_capa[c]
                otros = ", ".join("{} x {}".format(v, k) for k, v in
                                  sorted(d["otros"].items())) or "-"
                existe = lt.Has(c)
                w("{:<28}{:>6}{:>7}{:>7}{:>7}  {}{}".format(
                    c[:28], d["lw"], len(d["line"]), len(d["p2d"]),
                    len(d["p3d"]), otros, "" if existe else "   !! CAPA NO EXISTE"))

            # ---- conversion ---------------------------------------------------
            t0 = time.perf_counter()
            for c in capas:
                d = por_capa[c]
                pendientes = len(d["line"]) + len(d["p2d"]) + len(d["p3d"])
                if pendientes == 0:
                    continue
                w("")
                w("[{}]".format(c))

                nuevas = []   # (pts, cerrada, origen)
                # LINE -> cadenas
                if d["line"]:
                    segs = []
                    for oid in d["line"]:
                        ent = tr.GetObject(oid, OpenMode.ForRead)
                        a = ent.StartPoint
                        b = ent.EndPoint
                        segs.append(((a.X, a.Y), (b.X, b.Y)))
                    cadenas = encadenar(segs)
                    n_cer = sum(1 for _, z in cadenas if z)
                    w("  LINE: {} segmentos -> {} cadenas ({} cerradas, {} abiertas)"
                      .format(len(segs), len(cadenas), n_cer, len(cadenas) - n_cer))
                    for pts, cerrada in cadenas:
                        nuevas.append((pts, cerrada, "LINE"))
                for oid in d["p2d"]:
                    ent = tr.GetObject(oid, OpenMode.ForRead)
                    pts = pts_polyline2d(ent, tr)
                    if len(pts) >= 2:
                        nuevas.append((pts, bool(ent.Closed), "PL2D"))
                    else:
                        w("  PL2D handle {}: sin vertices legibles, se deja".format(ent.Handle))
                for oid in d["p3d"]:
                    ent = tr.GetObject(oid, OpenMode.ForRead)
                    pts = pts_polyline3d(ent, tr)
                    if len(pts) >= 2:
                        nuevas.append((pts, bool(ent.Closed), "PL3D"))
                    else:
                        w("  PL3D handle {}: sin vertices legibles, se deja".format(ent.Handle))

                for pts, cerrada, origen in nuevas:
                    w("  {} -> LWPOLYLINE {} vertices{}".format(
                        origen, len(pts), " (cerrada)" if cerrada else ""))

                if not APLICAR:
                    w("  dry-run: {} LWPOLYLINE se crearian; {} originales irian a '{}_ORIG'"
                      .format(len(nuevas), pendientes, c))
                    continue

                # capa destino de la geometria original
                capa_orig = c + "_ORIG"
                if lt.Has(capa_orig):
                    id_orig = lt.get_Item(capa_orig)
                else:
                    lt.UpgradeOpen()
                    ltr = LayerTableRecord()
                    ltr.Name = capa_orig
                    ltr.IsOff = True
                    id_orig = lt.Add(ltr)
                    tr.AddNewlyCreatedDBObject(ltr, True)
                    lt.DowngradeOpen()
                    w("  capa '{}' creada (apagada)".format(capa_orig))
                id_capa = lt.get_Item(c)

                n_new = 0
                for pts, cerrada, origen in nuevas:
                    pl = Polyline()
                    for i, (x, y) in enumerate(pts):
                        pl.AddVertexAt(i, Point2d(x, y), 0.0, 0.0, 0.0)
                    pl.Closed = cerrada
                    pl.LayerId = id_capa
                    ms.AppendEntity(pl)
                    tr.AddNewlyCreatedDBObject(pl, True)
                    n_new += 1
                n_mov = 0
                for oid in d["line"] + d["p2d"] + d["p3d"]:
                    try:
                        ent = tr.GetObject(oid, OpenMode.ForWrite)
                        ent.LayerId = id_orig
                        n_mov += 1
                    except Exception as ex:
                        w("  KO moviendo handle: {}".format(str(ex)[:80]))
                w("  creadas {} LWPOLYLINE; {} originales movidas a '{}'".format(
                    n_new, n_mov, capa_orig))
                n_total_conv += n_new
            tiempos.append(("conversion", time.perf_counter() - t0))

            if APLICAR:
                tr.Commit()
        finally:
            tr.Dispose()
    except Exception:
        w("")
        w("!!!!!! EXCEPCION NO CONTROLADA")
        for linea in traceback.format_exc().split("\n"):
            w("  " + linea)
    finally:
        dlock.Dispose()

    w("")
    w("RESULTADO: {} LWPOLYLINE {}".format(
        n_total_conv, "creadas" if APLICAR else "se crearian (dry-run)"))
    w("")
    w("==== RESUMEN DE TIEMPOS ====")
    for et, sg in tiempos:
        w("{:<27}{:>7.2f} s".format(et, sg))
    w("{:<27}{:>7.2f} s".format("TOTAL", time.perf_counter() - t_ini))

    return ["\n".join(L), n_total_conv]


OUT = run()
# ----------------------------------------
volumen_MDT = Python(IN[0]=cfg_superficie_trackers, IN[1]=cfg_superficie_mdt, IN[2]=cfg_rugosidad_mm, IN[3]=cfg_prefijo_volumen, IN[4]=cfg_capa_contornos, IN[5]=normalizar_geometria_line_pl2d)  # CPython3
# ---------- volumen_MDT.python (333 lines) ----------
# IN[5]: BARRERA de sincronizacion del nodo NORMALIZAR (contenido ignorado).
# -*- coding: utf-8 -*-
# =============================================================================
# Volumen_MDT.dyn  -  Nodo 1: superficies de volumen por zona  (VERSION FINAL v2)
# Civil 3D 2024 / Dynamo / CPython3
#
# Por cada contorno cerrado en la capa indicada crea una TIN Volume Surface
# (base = trackers, comparacion = MDT) con analisis de elevaciones, y deja la
# informacion para que el nodo 2 genere su tabla de leyenda.
#
# Caracteristicas:
#   - Re-ejecutable: borra los volumenes previos con el mismo prefijo.
#   - Un unico barrido de superficies (base + comparacion + a-borrar).
#   - Logging de avisos por zona (sin 'except: pass' silenciosos) [LOG-DISCIPLINA].
#   - Modo APLICAR (dry-run): con False no escribe nada, solo informa.
#   - Calcula un punto de PICADO interior GARANTIZADO por zona (no el
#     centroide, que en zonas concavas se sale). El nodo 2 lo usa para
#     seleccionar la superficie al crear la tabla. NOTA C3D 2024:
#     ADDSURFACELEGENDTABLE NO respeta la preseleccion por nombre
#     (sssetfirst/ssget) -> hay que seleccionar PICANDO.
#
# RENDIMIENTO: el coste dominante es TinVolumeSurface.Create contra el MDT.
# Para acelerar con MDT grande, pasar en IN[1] el MDT recortado a la huella
# (p.ej. '<MDT>_CROPPED'). No requiere tocar codigo.
#
# IN[0] : str    superficie base (trackers)
# IN[1] : str    superficie comparacion (MDT; usar version recortada)
# IN[2] : float  rugosidad en mm
# IN[3] : str    prefijo del nombre volumen (ej: Volumen_MDT)
# IN[4] : str    nombre de la capa de contornos
#
# OUT   : [log_lista, [(nombre, px, py, table_x, table_y), ...], APLICAR, t0, bbox]
# =============================================================================

# --- INTERRUPTOR DE SIMULACION ---------------------------------------------
# True  = ejecuta de verdad (borra y crea superficies)
# False = simulacion: NO escribe nada, solo informa zonas y tablas previstas
APLICAR = True
# ---------------------------------------------------------------------------

import clr
import traceback
import time

clr.AddReference('AcMgd')
clr.AddReference('AcCoreMgd')
clr.AddReference('AcDbMgd')
clr.AddReference('AecBaseMgd')
clr.AddReference('AeccDbMgd')

from Autodesk.AutoCAD.ApplicationServices import Application as AcadApp
from Autodesk.AutoCAD.DatabaseServices import (
    OpenMode, ObjectId, Polyline, SymbolUtilityServices
)
from Autodesk.AutoCAD.Geometry import Point3d, Point3dCollection
from Autodesk.Civil.ApplicationServices import CivilApplication
from Autodesk.Civil.DatabaseServices import (
    TinVolumeSurface, SurfaceAnalysisElevationData
)
from Autodesk.Civil import SurfaceBoundaryType
from Autodesk.AutoCAD.Colors import Color as AcadColor

import System
from System import Array


def interior_point(poly):
    """Punto garantizado DENTRO del poligono (poly = [(x,y),...], abierto).
    Metodo scanline: a varias alturas, intersecta con los bordes, empareja
    en tramos interiores y devuelve el punto medio del tramo MAS ancho
    (bien adentro, lejos de bordes). Cae dentro incluso en zonas concavas
    donde el centroide se saldria. Fallback: centroide."""
    n = len(poly)
    if n < 3:
        return (sum(p[0] for p in poly) / n, sum(p[1] for p in poly) / n)
    ys = [p[1] for p in poly]
    ymin = min(ys); ymax = max(ys); h = ymax - ymin
    best = None  # (ancho, x, y)
    for frac in (0.5, 0.45, 0.55, 0.4, 0.6, 0.35, 0.65):
        yc = ymin + frac * h
        xs = []
        for i in range(n):
            x1, y1 = poly[i]
            x2, y2 = poly[(i + 1) % n]
            if (y1 <= yc < y2) or (y2 <= yc < y1):
                t = (yc - y1) / (y2 - y1)
                xs.append(x1 + t * (x2 - x1))
        xs.sort()
        k = 0
        while k + 1 < len(xs):
            w = xs[k + 1] - xs[k]
            if best is None or w > best[0]:
                best = (w, 0.5 * (xs[k] + xs[k + 1]), yc)
            k += 2
    if best is not None:
        return (best[1], best[2])
    return (sum(p[0] for p in poly) / n, sum(p[1] for p in poly) / n)

base_surf_name = str(IN[0])
comp_surf_name = str(IN[1])
rugosidad_mm   = float(IN[2])
prefix         = str(IN[3])
contour_layer  = str(IN[4])
rugosidad_m    = rugosidad_mm / 1000.0

_t0  = time.time()
bbox = None

log = []
log.append("=== Volumen MDT v32 (split) - Crea volumenes ===")
log.append("MODO: {}".format("APLICAR (escribe)" if APLICAR else "SIMULACION (no escribe)"))
log.append("Base: {} | Comp: {} | Capa: {}".format(
    base_surf_name, comp_surf_name, contour_layer))
log.append("")

table_rows = []   # [(zone_name, table_x, table_y), ...] para el nodo de tablas

try:
    doc  = AcadApp.DocumentManager.MdiActiveDocument
    db   = doc.Database
    cdoc = CivilApplication.ActiveDocument

    contours = []
    created_info = []   # nombres de las zonas efectivamente creadas

    green = AcadColor.FromRgb(80, 200, 80)
    red   = AcadColor.FromRgb(220, 50, 50)

    dlock = doc.LockDocument()
    try:
        base_id = None
        comp_id = None
        style_picking_id = None
        vol_prefix = prefix + "_Zona"
        to_erase = []

        tr0 = db.TransactionManager.StartTransaction()
        try:
            # ---- UNA sola pasada: base, comp y volumenes previos ----
            for sid in cdoc.GetSurfaceIds():
                try:
                    s = tr0.GetObject(sid, OpenMode.ForRead)
                    sn = s.Name
                except Exception as ex_n:
                    log.append("  aviso: superficie ilegible: {}".format(str(ex_n)[:80]))
                    continue
                if sn == base_surf_name:
                    base_id = sid
                elif sn == comp_surf_name:
                    comp_id = sid
                if sn.startswith(vol_prefix):
                    to_erase.append(sid)

            if base_id is None:
                raise Exception("Base '{}' no encontrada.".format(base_surf_name))
            if comp_id is None:
                raise Exception("Comp '{}' no encontrada.".format(comp_surf_name))

            # ---- Leer contornos ----
            ms_id = SymbolUtilityServices.GetBlockModelSpaceId(db)
            btr = tr0.GetObject(ms_id, OpenMode.ForRead)
            for oid in btr:
                obj = tr0.GetObject(oid, OpenMode.ForRead)
                if not isinstance(obj, Polyline):
                    continue
                if obj.Layer != contour_layer:
                    continue
                n = obj.NumberOfVertices
                if n < 3:
                    continue
                pts = []
                for i in range(n):
                    p = obj.GetPoint2dAt(i)
                    pts.append((p.X, p.Y))
                contours.append(pts)

            if not contours:
                raise Exception("Sin contornos en '{}'.".format(contour_layer))
            contours.sort(key=lambda c: min(p[0] for p in c))
            log.append("Contornos encontrados: {}".format(len(contours)))

            # ---- Estilo full-coverage para que el comando de tabla seleccione ----
            ss = cdoc.Styles.SurfaceStyles
            for tv in ["analisis de pendientes",
                       "Analisis de pendientes",
                       "Analisis de Pendientes",
                       "ANALISIS DE PENDIENTES",
                       "Contours 1m and 5m (Background)",
                       "Standard",
                       "Triangles"]:
                try:
                    style_picking_id = ss.get_Item(tv)
                    log.append("Estilo (full-coverage): '{}'".format(tv))
                    break
                except:
                    continue
            if style_picking_id is None:
                for sid_s in ss:
                    try:
                        s_obj = tr0.GetObject(sid_s, OpenMode.ForRead)
                        nm = s_obj.Name
                        if nm and not nm.startswith("_No"):
                            style_picking_id = sid_s
                            log.append("Estilo (fallback): '{}'".format(nm))
                            break
                    except:
                        continue

            # ---- Borrar volumenes previos (solo si APLICAR) ----
            if APLICAR:
                n_erased = 0
                for sid in to_erase:
                    try:
                        tr0.GetObject(sid, OpenMode.ForWrite).Erase()
                        n_erased += 1
                    except Exception as ex_e:
                        log.append("  aviso: no se pudo borrar previo: {}".format(str(ex_e)[:80]))
                log.append("Volumenes previos borrados: {}".format(n_erased))
            else:
                log.append("SIMULACION: borraria {} volumenes previos.".format(len(to_erase)))

            tr0.Commit()
        finally:
            tr0.Dispose()

        # ---- Geometria para colocar las tablas (igual layout que v31) ----
        all_min_x = min(x for pts in contours for x, y in pts)
        all_min_y = min(y for pts in contours for x, y in pts)
        all_max_x = max(x for pts in contours for x, y in pts)
        all_max_y = max(y for pts in contours for x, y in pts)
        bbox = (all_min_x, all_min_y, all_max_x, all_max_y)
        width = all_max_x - all_min_x
        margin_x = max(width * 0.2, 100.0)
        table_x = all_max_x + margin_x
        table_spacing = 40.0

        # ============================================================== #
        # FASE 1: Crear volumenes (o simular)
        # ============================================================== #
        if APLICAR:
            tr = db.TransactionManager.StartTransaction()
            try:
                for i, pts in enumerate(contours):
                    zone_name = "{}_Zona{:02d}".format(prefix, i + 1)
                    try:
                        vol_id = TinVolumeSurface.Create(zone_name, base_id, comp_id)
                        vol_surf = tr.GetObject(vol_id, OpenMode.ForWrite)

                        if style_picking_id is not None:
                            vol_surf.StyleId = style_picking_id

                        pc = Point3dCollection()
                        for (x, y) in pts:
                            pc.Add(Point3d(x, y, 0.0))
                        if (pts[0][0], pts[0][1]) != (pts[-1][0], pts[-1][1]):
                            pc.Add(Point3d(pts[0][0], pts[0][1], 0.0))
                        vol_surf.BoundariesDefinition.AddBoundaries(
                            pc, 1.0, SurfaceBoundaryType.Outer, True)

                        # min/max elevacion (diferencia) para las bandas de analisis
                        min_e = -50.0; max_e = 50.0
                        try:
                            gp = vol_surf.GetGeneralProperties()
                            gt = clr.GetClrType(type(gp))
                            for p in gt.GetProperties():
                                pn = p.Name.lower()
                                if "min" in pn and "elev" in pn:
                                    min_e = p.GetValue(gp)
                                elif "max" in pn and "elev" in pn:
                                    max_e = p.GetValue(gp)
                        except Exception as ex_gp:
                            log.append("    {} aviso props: {}".format(zone_name, str(ex_gp)[:100]))

                        try:
                            d1 = SurfaceAnalysisElevationData(min_e, -rugosidad_m, green)
                            d2 = SurfaceAnalysisElevationData(rugosidad_m, max_e, red)
                            vol_surf.Analysis.SetElevationData(
                                Array[SurfaceAnalysisElevationData]([d1, d2]))
                        except Exception as ex_an:
                            log.append("    {} aviso analisis: {}".format(zone_name, str(ex_an)[:100]))

                        try:
                            vp = vol_surf.GetVolumeProperties()
                            r = (vp.UnadjustedCutVolume / vp.UnadjustedFillVolume
                                 if vp.UnadjustedFillVolume > 0 else 0)
                            log.append("  {}: Corte {:.0f}  Relleno {:.0f}  ratio {:.2f}".format(
                                zone_name, vp.UnadjustedCutVolume, vp.UnadjustedFillVolume, r))
                        except Exception as ex_vp:
                            log.append("    {} aviso volumen: {}".format(zone_name, str(ex_vp)[:100]))

                        created_info.append(zone_name)
                    except Exception as ex_v:
                        log.append("  ERROR creando {}: {}".format(zone_name, str(ex_v)[:160]))

                tr.Commit()
            finally:
                tr.Dispose()
            log.append("")
            log.append("{} volumenes creados de {} contornos.".format(
                len(created_info), len(contours)))
        else:
            for i, pts in enumerate(contours):
                created_info.append("{}_Zona{:02d}".format(prefix, i + 1))
            log.append("")
            log.append("SIMULACION: crearia {} volumenes: {}".format(
                len(created_info), ", ".join(created_info)))

        # ---- Tablas: solo para zonas REALMENTE creadas ----
        # Punto de picado = interior garantizado de la zona (NO el centroide).
        # zone_name "..._Zona{n:02d}" -> indice n-1 en contours (mismo orden).
        for zone_name in created_info:
            try:
                zi = int(zone_name.split("Zona")[-1]) - 1
            except Exception:
                zi = 0
            pts = contours[zi]
            px, py = interior_point(pts)
            ty = all_max_y - zi * table_spacing
            table_rows.append((zone_name, px, py, table_x, ty))
            log.append("  tabla {} : pick interior ({:.2f}, {:.2f}) -> tabla ({:.1f}, {:.1f})".format(
                zone_name, px, py, table_x, ty))

    finally:
        dlock.Dispose()

    log.append("")
    log.append("=== Volumenes OK, pasando al nodo de tablas ===")
    OUT = [log, table_rows, APLICAR, _t0, bbox]

except Exception as ex:
    log.append("ERROR: {}".format(ex))
    log.append(traceback.format_exc())
    OUT = [log, [], APLICAR, _t0, bbox]
# ----------------------------------------
tablas_de_leyenda = Python(IN[0]=volumen_MDT)  # CPython3
# ---------- tablas_de_leyenda.python (150 lines) ----------
# -*- coding: utf-8 -*-
# =============================================================================
# Volumen_MDT.dyn  -  Nodo 2: tablas de leyenda de volumen  (VERSION FINAL v4)
# Civil 3D 2024 / Dynamo / CPython3
#
# Recibe del nodo 1:
#   IN[0] = [log, [(nombre, px, py, table_x, table_y), ...], APLICAR, t0, bbox]
#
# POR QUE ESTA VERSION (corrige "[SKIP] en todas las zonas"):
#   La version anterior comprobaba con ssget si habia superficie en el punto,
#   filtrando por el tipo "AECC_TIN_VOLUME_SURFACE". Ese filtro NO casa con las
#   superficies de volumen en este Civil 3D -> ssget devolvia nil siempre ->
#   todas las zonas se saltaban -> 0 tablas.
#
#   Solucion: se ELIMINA la comprobacion ssget y se vuelve al PICADO DIRECTO
#   por coordenada (el metodo que creo las 9 tablas en su dia), anadiendo lo
#   que si ayuda y no depende de ssget:
#     - ZOOM a la zona + REGEN antes de picar (superficies dibujadas y en vista;
#       el picado por coordenada necesita el punto en pantalla).
#     - Envios cortos (cada SendStringToExecute < ~120 chars) -> sin truncado.
#     - ZOOM Extents al final para que se vean las tablas creadas.
#   El punto de picado interior (calculado por el nodo 1) ya acierta en las 9
#   zonas. Tras crear las tablas, restaura el estilo 'elevaciones'.
#
#   NOTA C3D 2024: ADDSURFACELEGENDTABLE no respeta la preseleccion -> se pica.
#
# Al final, anade al log el TIEMPO total de ejecucion del grafo.
# APLICAR=False -> dry-run: NO envia nada; vuelca al log todas las lineas.
# =============================================================================

import clr
import traceback
import time

clr.AddReference('AcMgd')
clr.AddReference('AcCoreMgd')
clr.AddReference('AcDbMgd')

from Autodesk.AutoCAD.ApplicationServices import Application as AcadApp


def _get(seq, i, default):
    try:
        return seq[i]
    except Exception:
        return default


_in = IN[0]
if isinstance(_in, (list, tuple)):
    log_prev   = _get(_in, 0, [])
    table_info = _get(_in, 1, [])
    aplicar    = _get(_in, 2, True)
    t0         = _get(_in, 3, None)
    bbox       = _get(_in, 4, None)
else:
    log_prev, table_info, aplicar, t0, bbox = ["(entrada inesperada al nodo de tablas)"], [], True, None, None

log = list(log_prev)
log.append("")
log.append("=== Nodo 2: tablas de leyenda (picado directo, sin ssget) ===")


def lq(s):
    return s.replace("\\", "\\\\").replace('"', '\\"')


def fn(v):
    return "{:.4f}".format(float(v))


# Restaura el estilo 'elevaciones' de una superficie por nombre (definir 1 vez)
DEF_VT = ('(defun _vt (nm / d) (setq d (vla-get-surfaces (vla-get-civildocument '
          '(vla-get-application (vla-get-activedocument (vlax-get-acad-object)))))) '
          '(vl-catch-all-apply (function (lambda () '
          '(vla-put-style (vla-item d nm) "elevaciones")))))')

try:
    if not table_info:
        log.append("Sin tablas que crear.")
    else:
        doc = AcadApp.DocumentManager.MdiActiveDocument

        sends = []   # cada elemento = una cadena para un SendStringToExecute

        # 1) Zoom a la zona de los contornos + regen (para que el picado acierte)
        if bbox:
            minx, miny, maxx, maxy = bbox
            m = max((maxx - minx), (maxy - miny)) * 0.15 + 5.0
            sends.append("_.ZOOM\n_W\n{},{}\n{},{}\n".format(
                fn(minx - m), fn(miny - m), fn(maxx + m), fn(maxy + m)))
        sends.append("_.REGEN\n")

        # 2) Una tabla por zona: PICADO directo (texto de comando, lo que funciona)
        names = []
        for row in table_info:
            if len(row) < 5:
                log.append("  AVISO: fila sin punto de picado, salto: {}".format(row))
                continue
            name, px, py, tx, ty = row[0], row[1], row[2], row[3], row[4]
            names.append(name)
            sends.append(
                "_.ADDSURFACELEGENDTABLE\n"
                "{},{}\n"   # pick: selecciona la superficie de volumen
                "E\n"       # tipo Elevation
                "D\n"       # Dynamic
                "{},{}\n".format(fn(px), fn(py), fn(tx), fn(ty)))
            log.append("  {} : pick ({:.2f}, {:.2f}) -> tabla ({:.1f}, {:.1f})".format(
                name, px, py, tx, ty))

        # 3) Restaurar estilo 'elevaciones' (despues de crear todas las tablas)
        sends.append("(vl-load-com)\n")
        sends.append(DEF_VT + "\n")
        for name in names:
            sends.append('(_vt "{}")\n'.format(lq(name)))

        # 4) Zoom extents al final para que se vean las tablas
        sends.append("_.ZOOM\n_E\n")

        max_len = max(len(s) for s in sends)
        log.append("  (envios: {} | mas largo: {} chars)".format(len(sends), max_len))

        if aplicar:
            for s in sends:
                doc.SendStringToExecute(s, True, False, False)
            log.append("")
            log.append(">>> {} tablas enviadas por picado directo en {} llamadas cortas.".format(
                len(names), len(sends)))
            log.append(">>> Al terminar, AutoCAD hara ZOOM Extents: las tablas estaran a la derecha de las zonas.")
        else:
            log.append("")
            log.append("SIMULACION: NO se ha enviado nada. Lineas que se enviarian:")
            log.append("-" * 60)
            for s in sends:
                log.append(repr(s))
            log.append("-" * 60)

    if t0 is not None:
        log.append("")
        log.append("Tiempo de ejecucion (grafo Dynamo): {:.1f} s".format(time.time() - t0))
        log.append("(NO incluye el dibujado de tablas: AutoCAD lo ejecuta despues, al quedar libre)")

    OUT = "\n".join(log)

except Exception as ex:
    log.append("ERROR: {}".format(ex))
    log.append(traceback.format_exc())
    if t0 is not None:
        log.append("Tiempo de ejecucion (grafo Dynamo): {:.1f} s".format(time.time() - t0))
    OUT = "\n".join(log)
# ----------------------------------------
log = Watch(tablas_de_leyenda)  # graph output
extraer_log = Python(IN[0]=config_sombra)  # CPython3; graph output
# ---------- extraer_log.python (3 lines) ----------
# -*- coding: utf-8 -*-
# Extrae el log (indice 1) de la salida CONFIG para el Watch
OUT = IN[0][1] if IN[0] is not None else "(sin salida CONFIG)"
# ----------------------------------------
CONFIG_LOG = Watch(extraer_log)
cfg_resultados_vacio = StringInput("")
cfg_ok = BoolSelector(true)
cfg_auditoria_z = StringInput("N/A")
CIERRE = Python(IN[0]=cfg_fase, IN[1]=volumen_MDT, IN[2]=cfg_resultados_vacio, IN[3]=cfg_ok, IN[4]=cfg_ok, IN[5]=cfg_auditoria_z, IN[6]=volumen_MDT)  # CPython3
# ---------- CIERRE.python (79 lines) ----------
# -*- coding: utf-8 -*-
# NODO CIERRE: escribe estado_pipeline.json y el log en Logs/
import os
import sys
import importlib

# Localizador de pipeline.py sin rutas fijas. Orden:
#   1) instalado con instalar.bat (site-packages del Python de Dynamo)
#   2) variable de entorno PIPELINE_HOME
#   3) carpeta del proyecto (hasta 3 niveles sobre el DWG activo)
def _cargar_pipeline():
    probadas = []
    try:
        import pipeline as _m
        importlib.reload(_m)
        return _m, "pipeline.py: importado desde " + str(
            getattr(_m, "__file__", "?"))
    except ImportError:
        probadas.append("import directo (site-packages de Dynamo)")
    candidatas = []
    ph = os.environ.get("PIPELINE_HOME", "")
    if ph:
        candidatas.append(ph)
    try:
        import clr
        clr.AddReference("AcMgd")
        from Autodesk.AutoCAD.ApplicationServices import (
            Application as _A)
        _doc = _A.DocumentManager.MdiActiveDocument
        if _doc is not None:
            _c = os.path.dirname(os.path.abspath(str(_doc.Name)))
            for _ in range(3):
                candidatas.append(_c)
                _p = os.path.dirname(_c)
                if _p == _c:
                    break
                _c = _p
    except Exception as ex:
        probadas.append("DWG activo no disponible: " + str(ex)[:80])
    for _r in candidatas:
        probadas.append(_r)
        if _r and os.path.exists(os.path.join(_r, "pipeline.py")):
            if _r not in sys.path:
                sys.path.insert(0, _r)
            import pipeline as _m
            importlib.reload(_m)
            return _m, "pipeline.py: cargado desde " + _r
    log = ["KO: no se encontro pipeline.py. Rutas probadas:"]
    log += ["  - " + p for p in probadas]
    log.append("Solucion: doble clic en instalar.bat, o copia pipeline.py "
               "a la carpeta del proyecto (junto a config_proyecto.xlsx), "
               "o define la variable de entorno PIPELINE_HOME.")
    return None, "\n".join(log)


pipeline, _msg_carga = _cargar_pipeline()

if pipeline is None:
    OUT = [False, _msg_carga + "\n"
           + (str(IN[1]) if IN[1] is not None else "")]
else:
    def _abool(v):
        if isinstance(v, str):
            return v.strip().upper() in ("S", "SI", "TRUE", "1", "V")
        return bool(v)

    fase = str(IN[0])
    log_script = IN[1] if IN[1] is not None else ""
    resultados = IN[2]
    aplicado = _abool(IN[3]) if IN[3] is not None else False
    ok_script = _abool(IN[4]) if IN[4] is not None else True
    auditoria = str(IN[5]) if IN[5] is not None else "N/A"
    # IN[6]: barrera de sincronizacion (ignorada)

    OUT = pipeline.nodo_cierre(fase, log_script,
                               resultados=resultados,
                               aplicado=aplicado,
                               ok=ok_script,
                               auditoria_z=auditoria)
# ----------------------------------------
extraer_log_cierre = Python(IN[0]=CIERRE)  # CPython3; graph output; same code as extraer_log
CIERRE_LOG = Watch(extraer_log_cierre)
extraer_log_normalizar = Python(IN[0]=normalizar_geometria_line_pl2d)  # CPython3
# ---------- extraer_log_normalizar.python (2 lines) ----------
# Extrae el log (indice 0) de la salida del normalizador para el Watch
OUT = IN[0][0] if IN[0] is not None else "(sin salida)"
# ----------------------------------------
NORMALIZAR_LOG = Watch(extraer_log_normalizar)
