# Dynamo graph 5_DP_Superficies_Zonas_Manchas_v01.dyn "5_DP_Superficies_Zonas_Manchas_v03" (Dynamo 2.19.4.6671)
# Superficies de desmonte y terraplen por contornos y obtención MDT_Modificado. Inputs: Contornos, Trackers y MDT.

superficie_trackers_general = StringInput("Trackers_Proyecto")
superficie_mdt_original = StringInput("MDT_REC_2")
capa_de_contornos = StringInput("_contornos")
cfg_fase = StringInput("5")
config_sombra = Python(IN[0]=cfg_fase)  # CPython3
# ---------- config_sombra.python (66 lines) ----------
# -*- coding: utf-8 -*-
# NODO CONFIG (modo sombra: valida y muestra la config, pero
# los parametros del script siguen viniendo de los inputs de siempre)
import os
import sys
import importlib

# Localizador de pipeline.py sin rutas fijas. Orden:
#   1) instalado con instalar.bat (site-packages del Python de Dynamo)
#   2) variable de entorno PIPELINE_HOME
#   3) carpeta del proyecto (hasta 3 niveles sobre el DWG activo)
def _cargar_pipeline():
    probadas = []
    try:
        import pipeline as _m
        importlib.reload(_m)
        return _m, "pipeline.py: importado desde " + str(
            getattr(_m, "__file__", "?"))
    except ImportError:
        probadas.append("import directo (site-packages de Dynamo)")
    candidatas = []
    ph = os.environ.get("PIPELINE_HOME", "")
    if ph:
        candidatas.append(ph)
    try:
        import clr
        clr.AddReference("AcMgd")
        from Autodesk.AutoCAD.ApplicationServices import (
            Application as _A)
        _doc = _A.DocumentManager.MdiActiveDocument
        if _doc is not None:
            _c = os.path.dirname(os.path.abspath(str(_doc.Name)))
            for _ in range(3):
                candidatas.append(_c)
                _p = os.path.dirname(_c)
                if _p == _c:
                    break
                _c = _p
    except Exception as ex:
        probadas.append("DWG activo no disponible: " + str(ex)[:80])
    for _r in candidatas:
        probadas.append(_r)
        if _r and os.path.exists(os.path.join(_r, "pipeline.py")):
            if _r not in sys.path:
                sys.path.insert(0, _r)
            import pipeline as _m
            importlib.reload(_m)
            return _m, "pipeline.py: cargado desde " + _r
    log = ["KO: no se encontro pipeline.py. Rutas probadas:"]
    log += ["  - " + p for p in probadas]
    log.append("Solucion: doble clic en instalar.bat, o copia pipeline.py "
               "a la carpeta del proyecto (junto a config_proyecto.xlsx), "
               "o define la variable de entorno PIPELINE_HOME.")
    return None, "\n".join(log)


pipeline, _msg_carga = _cargar_pipeline()

if pipeline is None:
    OUT = [False, _msg_carga, "", ""]
else:
    OUT = pipeline.nodo_config(str(IN[0]))
    try:
        OUT[1] = _msg_carga + "\n" + OUT[1]
    except Exception:
        pass
# ----------------------------------------
cfg_superficie_trackers = Python(IN[0]=config_sombra)  # CPython3
# ---------- cfg_superficie_trackers.python (21 lines) ----------
# -*- coding: utf-8 -*-
# CONFIG: parametro 'superficie_trackers' desde config (indice 4).
# Si la config es KO, BLOQUEA este parametro e incrusta la causa
# (las lineas KO/AVISO del log de config) en el propio error.
res = IN[0]
if ((not isinstance(res, list)) or len(res) <= 4
        or res[0] is not True):
    detalle = "el nodo de config no devolvio datos"
    try:
        lineas = str(res[1]).splitlines()
        malas = [l.strip() for l in lineas
                 if "KO" in l or "AVISO" in l]
        if malas:
            detalle = " | ".join(malas[-4:])
        elif lineas:
            detalle = " | ".join(
                l.strip() for l in lineas[-3:])
    except Exception:
        pass
    raise Exception("CONFIG KO -> " + detalle[:400])
OUT = res[4]
# ----------------------------------------
cfg_superficie_mdt = Python(IN[0]=config_sombra)  # CPython3
# ---------- cfg_superficie_mdt.python (21 lines) ----------
# -*- coding: utf-8 -*-
# CONFIG: parametro 'superficie_mdt' desde config (indice 5).
# Si la config es KO, BLOQUEA este parametro e incrusta la causa
# (las lineas KO/AVISO del log de config) en el propio error.
res = IN[0]
if ((not isinstance(res, list)) or len(res) <= 5
        or res[0] is not True):
    detalle = "el nodo de config no devolvio datos"
    try:
        lineas = str(res[1]).splitlines()
        malas = [l.strip() for l in lineas
                 if "KO" in l or "AVISO" in l]
        if malas:
            detalle = " | ".join(malas[-4:])
        elif lineas:
            detalle = " | ".join(
                l.strip() for l in lineas[-3:])
    except Exception:
        pass
    raise Exception("CONFIG KO -> " + detalle[:400])
OUT = res[5]
# ----------------------------------------
cfg_capa_contornos = Python(IN[0]=config_sombra)  # CPython3
# ---------- cfg_capa_contornos.python (21 lines) ----------
# -*- coding: utf-8 -*-
# CONFIG: parametro 'capa_contornos' desde config (indice 6).
# Si la config es KO, BLOQUEA este parametro e incrusta la causa
# (las lineas KO/AVISO del log de config) en el propio error.
res = IN[0]
if ((not isinstance(res, list)) or len(res) <= 6
        or res[0] is not True):
    detalle = "el nodo de config no devolvio datos"
    try:
        lineas = str(res[1]).splitlines()
        malas = [l.strip() for l in lineas
                 if "KO" in l or "AVISO" in l]
        if malas:
            detalle = " | ".join(malas[-4:])
        elif lineas:
            detalle = " | ".join(
                l.strip() for l in lineas[-3:])
    except Exception:
        pass
    raise Exception("CONFIG KO -> " + detalle[:400])
OUT = res[6]
# ----------------------------------------
cfg_superficie_combinada = Python(IN[0]=config_sombra)  # CPython3
# ---------- cfg_superficie_combinada.python (21 lines) ----------
# -*- coding: utf-8 -*-
# CONFIG: parametro 'superficie_combinada' desde config (indice 7).
# Si la config es KO, BLOQUEA este parametro e incrusta la causa
# (las lineas KO/AVISO del log de config) en el propio error.
res = IN[0]
if ((not isinstance(res, list)) or len(res) <= 7
        or res[0] is not True):
    detalle = "el nodo de config no devolvio datos"
    try:
        lineas = str(res[1]).splitlines()
        malas = [l.strip() for l in lineas
                 if "KO" in l or "AVISO" in l]
        if malas:
            detalle = " | ".join(malas[-4:])
        elif lineas:
            detalle = " | ".join(
                l.strip() for l in lineas[-3:])
    except Exception:
        pass
    raise Exception("CONFIG KO -> " + detalle[:400])
OUT = res[7]
# ----------------------------------------
cfg_offset_manchas_m = Python(IN[0]=config_sombra)  # CPython3
# ---------- cfg_offset_manchas_m.python (21 lines) ----------
# -*- coding: utf-8 -*-
# CONFIG: parametro 'offset_manchas_m' desde config (indice 8).
# Si la config es KO, BLOQUEA este parametro e incrusta la causa
# (las lineas KO/AVISO del log de config) en el propio error.
res = IN[0]
if ((not isinstance(res, list)) or len(res) <= 8
        or res[0] is not True):
    detalle = "el nodo de config no devolvio datos"
    try:
        lineas = str(res[1]).splitlines()
        malas = [l.strip() for l in lineas
                 if "KO" in l or "AVISO" in l]
        if malas:
            detalle = " | ".join(malas[-4:])
        elif lineas:
            detalle = " | ".join(
                l.strip() for l in lineas[-3:])
    except Exception:
        pass
    raise Exception("CONFIG KO -> " + detalle[:400])
OUT = res[8]
# ----------------------------------------
cfg_filtro_manchas_pct = Python(IN[0]=config_sombra)  # CPython3
# ---------- cfg_filtro_manchas_pct.python (21 lines) ----------
# -*- coding: utf-8 -*-
# CONFIG: parametro 'filtro_manchas_pct' desde config (indice 9).
# Si la config es KO, BLOQUEA este parametro e incrusta la causa
# (las lineas KO/AVISO del log de config) en el propio error.
res = IN[0]
if ((not isinstance(res, list)) or len(res) <= 9
        or res[0] is not True):
    detalle = "el nodo de config no devolvio datos"
    try:
        lineas = str(res[1]).splitlines()
        malas = [l.strip() for l in lineas
                 if "KO" in l or "AVISO" in l]
        if malas:
            detalle = " | ".join(malas[-4:])
        elif lineas:
            detalle = " | ".join(
                l.strip() for l in lineas[-3:])
    except Exception:
        pass
    raise Exception("CONFIG KO -> " + detalle[:400])
OUT = res[9]
# ----------------------------------------
cfg_pegar_mdt_base = Python(IN[0]=config_sombra)  # CPython3
# ---------- cfg_pegar_mdt_base.python (21 lines) ----------
# -*- coding: utf-8 -*-
# CONFIG: parametro 'pegar_mdt_base' desde config (indice 10).
# Si la config es KO, BLOQUEA este parametro e incrusta la causa
# (las lineas KO/AVISO del log de config) en el propio error.
res = IN[0]
if ((not isinstance(res, list)) or len(res) <= 10
        or res[0] is not True):
    detalle = "el nodo de config no devolvio datos"
    try:
        lineas = str(res[1]).splitlines()
        malas = [l.strip() for l in lineas
                 if "KO" in l or "AVISO" in l]
        if malas:
            detalle = " | ".join(malas[-4:])
        elif lineas:
            detalle = " | ".join(
                l.strip() for l in lineas[-3:])
    except Exception:
        pass
    raise Exception("CONFIG KO -> " + detalle[:400])
OUT = res[10]
# ----------------------------------------
cfg_intentos_offset = Python(IN[0]=config_sombra)  # CPython3
# ---------- cfg_intentos_offset.python (21 lines) ----------
# -*- coding: utf-8 -*-
# CONFIG: parametro 'intentos_offset' desde config (indice 11).
# Si la config es KO, BLOQUEA este parametro e incrusta la causa
# (las lineas KO/AVISO del log de config) en el propio error.
res = IN[0]
if ((not isinstance(res, list)) or len(res) <= 11
        or res[0] is not True):
    detalle = "el nodo de config no devolvio datos"
    try:
        lineas = str(res[1]).splitlines()
        malas = [l.strip() for l in lineas
                 if "KO" in l or "AVISO" in l]
        if malas:
            detalle = " | ".join(malas[-4:])
        elif lineas:
            detalle = " | ".join(
                l.strip() for l in lineas[-3:])
    except Exception:
        pass
    raise Exception("CONFIG KO -> " + detalle[:400])
OUT = res[11]
# ----------------------------------------
cfg_paso_offset_m = Python(IN[0]=config_sombra)  # CPython3
# ---------- cfg_paso_offset_m.python (21 lines) ----------
# -*- coding: utf-8 -*-
# CONFIG: parametro 'paso_offset_m' desde config (indice 12).
# Si la config es KO, BLOQUEA este parametro e incrusta la causa
# (las lineas KO/AVISO del log de config) en el propio error.
res = IN[0]
if ((not isinstance(res, list)) or len(res) <= 12
        or res[0] is not True):
    detalle = "el nodo de config no devolvio datos"
    try:
        lineas = str(res[1]).splitlines()
        malas = [l.strip() for l in lineas
                 if "KO" in l or "AVISO" in l]
        if malas:
            detalle = " | ".join(malas[-4:])
        elif lineas:
            detalle = " | ".join(
                l.strip() for l in lineas[-3:])
    except Exception:
        pass
    raise Exception("CONFIG KO -> " + detalle[:400])
OUT = res[12]
# ----------------------------------------
normalizar_true_convierte_false = BoolSelector(true)  # "NORMALIZAR (True=convierte, False=solo informa)"; graph input
normalizar_geometria_line_pl2d = Python(IN[0]=cfg_capa_contornos, IN[1]=normalizar_true_convierte_false)  # "NORMALIZAR geometria (LINE/PL2D/PL3D -> LWPOLYLINE)"; CPython3
# ---------- normalizar_geometria_line_pl2d.python (368 lines) ----------
# -*- coding: utf-8 -*-
# =============================================================================
# NORMALIZAR GEOMETRIA v01  -  nodo previo comun a los scripts del pipeline
# =============================================================================
# Los scripts leen contornos, ejes y trackers como LWPOLYLINE. En la practica
# esas capas llegan con LINE sueltas (layouts, DXF), POLYLINE 2D antiguas o
# POLYLINE 3D. Este nodo las normaliza ANTES de que corra el script:
#
#   - LINE      : se encadenan por extremos (tolerancia de empalme TOL_EMPALME)
#                 y cada cadena pasa a ser UNA LWPOLYLINE. Si la cadena cierra
#                 sobre si misma (hueco <= TOL_CIERRE) se marca Closed.
#                 Una LINE aislada -> LWPOLYLINE de 2 vertices.
#   - POLYLINE2D / POLYLINE3D : se reescriben como LWPOLYLINE plana (Z ignorada),
#                 conservando el flag Closed.
#   - LWPOLYLINE: no se toca.
#
# Los originales NO se borran: se mueven a la capa '<capa>_ORIG' (se crea si
# no existe y se deja apagada). Es reversible: mover de vuelta y borrar las
# LWPOLYLINE nuevas.
#
# ENTRADAS (numero variable): IN[0..n-2] nombres de capa (str; vacios se
#   ignoran; tambien acepta listas de str). El ULTIMO input IN[n-1] es
#   APLICAR: True convierte; False solo informa (dry-run).
# SALIDA: OUT = [log_str, n_convertidas]. Conectar OUT como barrera al primer
#   nodo de trabajo del script para forzar que esto corra antes.
# =============================================================================
import math
import time
import traceback

import clr
clr.AddReference('AcMgd')
clr.AddReference('AcCoreMgd')
clr.AddReference('AcDbMgd')

from Autodesk.AutoCAD.ApplicationServices import Application
from Autodesk.AutoCAD.DatabaseServices import (
    OpenMode, Polyline, Polyline2d, Polyline3d, Line,
    SymbolUtilityServices, LayerTableRecord, ObjectId)
from Autodesk.AutoCAD.Geometry import Point2d

TOL_EMPALME = 0.05   # m: dos extremos a menos de esto se consideran unidos
TOL_CIERRE = 0.50    # m: regla del proyecto para contornos visualmente cerrados

# [DYNAMO-DAG] todo dentro de run(): nunca SystemExit a nivel de modulo
def run():
    # ------------------------------ entradas -----------------------------------
    _ins = list(IN)
    if not _ins:
        return ["NORMALIZAR: sin entradas", 0]
    _ap = _ins[-1]
    if isinstance(_ap, str):
        APLICAR = _ap.strip().upper() in ("S", "SI", "TRUE", "1", "V")
    else:
        APLICAR = bool(_ap)
    capas = []
    for v in _ins[:-1]:
        if v is None:
            continue
        if isinstance(v, (list, tuple)):
            for x in v:
                if x is not None and str(x).strip():
                    capas.append(str(x).strip())
        elif str(v).strip():
            capas.append(str(v).strip())
    # dedup conservando orden
    _vist = set()
    capas = [c for c in capas if not (c in _vist or _vist.add(c))]

    L = []


    def w(s=""):
        L.append(str(s))


    t_ini = time.perf_counter()
    w("=" * 72)
    w(" NORMALIZAR GEOMETRIA v01  -  {}".format(
        "APLICAR (convierte)" if APLICAR else "DRY-RUN (solo informa)"))
    w("=" * 72)
    w("capas: {}".format(", ".join(capas) if capas else "(ninguna)"))
    w("tolerancias: empalme {:.2f} m, cierre {:.2f} m".format(TOL_EMPALME, TOL_CIERRE))

    if not capas:
        w("Nada que hacer.")
        w("")
        w("==== RESUMEN DE TIEMPOS ====")
        w("{:<27}{:>7.2f} s".format("TOTAL", time.perf_counter() - t_ini))
        return ["\n".join(L), 0]


    def _key(p):
        """Celda de rejilla para agrupar extremos con tolerancia."""
        return (int(math.floor(p[0] / TOL_EMPALME)),
                int(math.floor(p[1] / TOL_EMPALME)))


    def _cerca(a, b):
        return math.hypot(a[0] - b[0], a[1] - b[1]) <= TOL_EMPALME


    def encadenar(segs):
        """segs: lista de (p_ini, p_fin) 2D. Devuelve lista de (pts, cerrada).
        Recorre cada segmento una sola vez; en bifurcaciones toma el primer
        vecino libre (suficiente para contornos y ejes; los nudos raros se
        reportan como cadenas abiertas y el usuario los ve en el log)."""
        n = len(segs)
        usado = [False] * n
        idx = {}
        for i, (a, b) in enumerate(segs):
            for p in (a, b):
                k = _key(p)
                for dx in (-1, 0, 1):
                    for dy in (-1, 0, 1):
                        idx.setdefault((k[0] + dx, k[1] + dy), []).append(i)
        # dedup listas
        for k in idx:
            vist = set()
            idx[k] = [i for i in idx[k] if not (i in vist or vist.add(i))]

        def vecino_libre(p, excluir):
            for j in idx.get(_key(p), []):
                if usado[j] or j == excluir:
                    continue
                a, b = segs[j]
                if _cerca(p, a):
                    return j, b
                if _cerca(p, b):
                    return j, a
            return None, None

        cadenas = []
        for i in range(n):
            if usado[i]:
                continue
            usado[i] = True
            a, b = segs[i]
            pts = [a, b]
            # extender por el final
            cur = b
            last = i
            while True:
                j, nxt = vecino_libre(cur, last)
                if j is None:
                    break
                usado[j] = True
                pts.append(nxt)
                cur = nxt
                last = j
                if _cerca(cur, pts[0]) and len(pts) > 3:
                    break
            # extender por el principio (si no cerro)
            if not _cerca(pts[-1], pts[0]):
                cur = pts[0]
                last = i
                while True:
                    j, nxt = vecino_libre(cur, last)
                    if j is None:
                        break
                    usado[j] = True
                    pts.insert(0, nxt)
                    cur = nxt
                    last = j
                    if _cerca(pts[0], pts[-1]) and len(pts) > 3:
                        break
            cerrada = False
            if len(pts) >= 4 and math.hypot(pts[0][0] - pts[-1][0],
                                            pts[0][1] - pts[-1][1]) <= TOL_CIERRE:
                cerrada = True
                # si el ultimo punto duplica al primero, quitarlo
                if _cerca(pts[0], pts[-1]):
                    pts = pts[:-1]
            cadenas.append((pts, cerrada))
        return cadenas


    def pts_polyline2d(ent, tr):
        pts = []
        try:
            for vid in ent:
                v = tr.GetObject(vid, OpenMode.ForRead)
                p = v.Position
                pts.append((p.X, p.Y))
        except Exception:
            pts = []
        return pts


    def pts_polyline3d(ent, tr):
        pts = []
        try:
            for vid in ent:
                v = tr.GetObject(vid, OpenMode.ForRead)
                p = v.Position
                pts.append((p.X, p.Y))
        except Exception:
            pts = []
        return pts


    adoc = Application.DocumentManager.MdiActiveDocument
    db = adoc.Database
    n_total_conv = 0
    tiempos = []

    dlock = adoc.LockDocument()
    try:
        tr = db.TransactionManager.StartTransaction()
        try:
            ms_id = SymbolUtilityServices.GetBlockModelSpaceId(db)
            ms = tr.GetObject(ms_id, OpenMode.ForWrite if APLICAR else OpenMode.ForRead)
            lt = tr.GetObject(db.LayerTableId, OpenMode.ForRead)

            # ---- inventario por capa -----------------------------------------
            t0 = time.perf_counter()
            por_capa = {c: {"lw": 0, "line": [], "p2d": [], "p3d": [], "otros": {}}
                        for c in capas}
            for oid in ms:
                try:
                    ent = tr.GetObject(oid, OpenMode.ForRead)
                except Exception:
                    continue
                lay = ent.Layer
                if lay not in por_capa:
                    continue
                d = por_capa[lay]
                if isinstance(ent, Polyline):
                    d["lw"] += 1
                elif isinstance(ent, Line):
                    d["line"].append(oid)
                elif isinstance(ent, Polyline2d):
                    d["p2d"].append(oid)
                elif isinstance(ent, Polyline3d):
                    d["p3d"].append(oid)
                else:
                    try:
                        tn = ent.GetType().Name
                    except Exception:
                        tn = type(ent).__name__
                    d["otros"][tn] = d["otros"].get(tn, 0) + 1
            tiempos.append(("inventario", time.perf_counter() - t0))

            w("")
            w("{:<28}{:>6}{:>7}{:>7}{:>7}  otros".format(
                "capa", "LWPL", "LINE", "PL2D", "PL3D"))
            w("-" * 72)
            for c in capas:
                d = por_capa[c]
                otros = ", ".join("{} x {}".format(v, k) for k, v in
                                  sorted(d["otros"].items())) or "-"
                existe = lt.Has(c)
                w("{:<28}{:>6}{:>7}{:>7}{:>7}  {}{}".format(
                    c[:28], d["lw"], len(d["line"]), len(d["p2d"]),
                    len(d["p3d"]), otros, "" if existe else "   !! CAPA NO EXISTE"))

            # ---- conversion ---------------------------------------------------
            t0 = time.perf_counter()
            for c in capas:
                d = por_capa[c]
                pendientes = len(d["line"]) + len(d["p2d"]) + len(d["p3d"])
                if pendientes == 0:
                    continue
                w("")
                w("[{}]".format(c))

                nuevas = []   # (pts, cerrada, origen)
                # LINE -> cadenas
                if d["line"]:
                    segs = []
                    for oid in d["line"]:
                        ent = tr.GetObject(oid, OpenMode.ForRead)
                        a = ent.StartPoint
                        b = ent.EndPoint
                        segs.append(((a.X, a.Y), (b.X, b.Y)))
                    cadenas = encadenar(segs)
                    n_cer = sum(1 for _, z in cadenas if z)
                    w("  LINE: {} segmentos -> {} cadenas ({} cerradas, {} abiertas)"
                      .format(len(segs), len(cadenas), n_cer, len(cadenas) - n_cer))
                    for pts, cerrada in cadenas:
                        nuevas.append((pts, cerrada, "LINE"))
                for oid in d["p2d"]:
                    ent = tr.GetObject(oid, OpenMode.ForRead)
                    pts = pts_polyline2d(ent, tr)
                    if len(pts) >= 2:
                        nuevas.append((pts, bool(ent.Closed), "PL2D"))
                    else:
                        w("  PL2D handle {}: sin vertices legibles, se deja".format(ent.Handle))
                for oid in d["p3d"]:
                    ent = tr.GetObject(oid, OpenMode.ForRead)
                    pts = pts_polyline3d(ent, tr)
                    if len(pts) >= 2:
                        nuevas.append((pts, bool(ent.Closed), "PL3D"))
                    else:
                        w("  PL3D handle {}: sin vertices legibles, se deja".format(ent.Handle))

                for pts, cerrada, origen in nuevas:
                    w("  {} -> LWPOLYLINE {} vertices{}".format(
                        origen, len(pts), " (cerrada)" if cerrada else ""))

                if not APLICAR:
                    w("  dry-run: {} LWPOLYLINE se crearian; {} originales irian a '{}_ORIG'"
                      .format(len(nuevas), pendientes, c))
                    continue

                # capa destino de la geometria original
                capa_orig = c + "_ORIG"
                if lt.Has(capa_orig):
                    id_orig = lt.get_Item(capa_orig)
                else:
                    lt.UpgradeOpen()
                    ltr = LayerTableRecord()
                    ltr.Name = capa_orig
                    ltr.IsOff = True
                    id_orig = lt.Add(ltr)
                    tr.AddNewlyCreatedDBObject(ltr, True)
                    lt.DowngradeOpen()
                    w("  capa '{}' creada (apagada)".format(capa_orig))
                id_capa = lt.get_Item(c)

                n_new = 0
                for pts, cerrada, origen in nuevas:
                    pl = Polyline()
                    for i, (x, y) in enumerate(pts):
                        pl.AddVertexAt(i, Point2d(x, y), 0.0, 0.0, 0.0)
                    pl.Closed = cerrada
                    pl.LayerId = id_capa
                    ms.AppendEntity(pl)
                    tr.AddNewlyCreatedDBObject(pl, True)
                    n_new += 1
                n_mov = 0
                for oid in d["line"] + d["p2d"] + d["p3d"]:
                    try:
                        ent = tr.GetObject(oid, OpenMode.ForWrite)
                        ent.LayerId = id_orig
                        n_mov += 1
                    except Exception as ex:
                        w("  KO moviendo handle: {}".format(str(ex)[:80]))
                w("  creadas {} LWPOLYLINE; {} originales movidas a '{}'".format(
                    n_new, n_mov, capa_orig))
                n_total_conv += n_new
            tiempos.append(("conversion", time.perf_counter() - t0))

            if APLICAR:
                tr.Commit()
        finally:
            tr.Dispose()
    except Exception:
        w("")
        w("!!!!!! EXCEPCION NO CONTROLADA")
        for linea in traceback.format_exc().split("\n"):
            w("  " + linea)
    finally:
        dlock.Dispose()

    w("")
    w("RESULTADO: {} LWPOLYLINE {}".format(
        n_total_conv, "creadas" if APLICAR else "se crearian (dry-run)"))
    w("")
    w("==== RESUMEN DE TIEMPOS ====")
    for et, sg in tiempos:
        w("{:<27}{:>7.2f} s".format(et, sg))
    w("{:<27}{:>7.2f} s".format("TOTAL", time.perf_counter() - t_ini))

    return ["\n".join(L), n_total_conv]


OUT = run()
# ----------------------------------------
superficies_Zonas = Python(IN[0]=cfg_superficie_trackers, IN[1]=cfg_superficie_mdt, IN[2]=cfg_capa_contornos, IN[3]=cfg_superficie_combinada, IN[4]=cfg_offset_manchas_m, IN[5]=cfg_filtro_manchas_pct, IN[6]=cfg_pegar_mdt_base, IN[7]=cfg_intentos_offset, IN[8]=cfg_paso_offset_m, IN[9]=normalizar_geometria_line_pl2d)  # CPython3
# ---------- superficies_Zonas.python (1705 lines) ----------
# IN[9]: BARRERA de sincronizacion del nodo NORMALIZAR (contenido ignorado).
# -*- coding: utf-8 -*-
# =============================================================================
# Superficies_Zonas.dyn  v4.16
# Civil 3D 2024 / Dynamo / CPython3
#
# Por cada contorno cerrado en la capa indicada (ordenado por min_x asc,
# igual que Volumen_MDT.dyn para mantener la misma numeracion de zonas):
#
#   FASE 1 (por zona):
#     - Trackers_ZonaXX  : TinSurface vacia -> Paste(<tracker_surf>) ->
#                          Outer Boundary = contorno de la zona
#     - Desmonte_ZonaXX  : TinSurface vacia -> Paste(Trackers_ZonaXX)
#                          -> Raise(+min del intervalo positivo del Volumen)
#     - Terraplen_ZonaXX : TinSurface vacia -> Paste(Trackers_ZonaXX)
#                          -> Raise(max del intervalo negativo)   (baja)
#
#   FASE 2 (por zona): MANCHAS + LIMPIEZA + OFFSET + BOUNDARIES
#     Para Desmonte y Terraplen:
#       a) Crear TinVolumeSurface temporal __tmp_vol_<tipo>_ZonaXX con
#          Base=<tipo>_ZonaXX, Comparison=MDT.
#       b) ExtractContoursAt(0.0) -> polylines en ModelSpace donde las dos
#          superficies se cruzan (las "manchas").
#       c) Mover esas polylines a la capa:
#            _Contornos_desmonte_ZonaXX  (color rojo, index 1)
#            _Contornos_terraplen_ZonaXX (color verde, index 3)
#          Crear la capa si no existe.
#       c1b) FILTRO de area: eliminar las manchas con area menor que
#           IN[5]% del area media de su superficie. Son astillas pegadas
#           al contorno cero (desmonte ~ terraplen ~ MDT), con efecto
#           despreciable en el MDT modificado y causa principal de
#           boundaries ilegales y fallos de paste.
#       c2) Limpiar esas polylines (weed de vertices casi duplicados +
#           cerrar las abiertas) y desfasarlas hacia DENTRO un valor
#           configurable (IN[4]); si el offset colapsa la mancha, se
#           reintenta en cascada con x0.5, x0.2 y x0.1 del valor, para
#           que las manchas estrechas tambien queden separadas (las
#           aristas coincidentes son las que disparan el fallo de paste);
#           borrar las originales y dejar las
#           limpias/desfasadas en su capa. Regenera geometria limpia y
#           separa aristas para mitigar el "Error performing edit" al
#           pegar en la combinada (FASE 4).
#       d) Anyadir las polylines DESFASADAS como boundary de <tipo>_ZonaXX:
#          la mayor como Outer, el resto como Show.
#       e) Borrar la TinVolumeSurface temporal.
#
#   FASE 4 (global): agrupaciones + MDT MODIFICADO
#     Jerarquia: zona -> agrupacion -> definitiva.
#       1) Desmonte_Total  = paste de todos los Desmonte_ZonaXX
#       2) Terraplen_Total = paste de todos los Terraplen_ZonaXX
#       3) Combinada (IN[3]) = [MDT (IN[1]) si IN[6]=S] + Desmonte_Total
#          + Terraplen_Total -> el resultado es el MDT MODIFICADO.
#     Cada pegado va en su propia transaccion; los que fallan se
#     reintentan tras un Rebuild y, si siguen fallando, la ANTILOTERIA
#     desfasa las manchas de ESA superficie de zona el paso IN[8] (m) por
#     intento (acumulativo, max IN[7] intentos), la recrea y repega.
#     Las agrupaciones empiezan VACIAS (sin MDT base), asi que los
#     pegados zona->agrupacion pueden fallar mas; se cubren con
#     reintento + ANTILOTERIA y con RONDAS adicionales sobre los fallos
#     definitivos (el estado del destino cambia entre rondas y eso
#     rebaraja el bug). JERARQUIA ESTRICTA: la combinada SOLO se crea si
#     las dos agrupaciones quedan completas; si no, se aborta listando
#     las zonas pendientes (sin pegados directos ni fallback).
#     Estilo _No Display. Las previas se borran en FASE 0.
#
# Las 3 superficies Trackers/Desmonte/Terraplen se crean con estilo
# '_No Display'. El MDT se pide como input para la comparacion de volumen
# y para validacion (typo-check).
#
# Re-ejecutable: superficies y capas previas con los prefijos del script
# se borran (o vacian) antes de recrearse.
#
# NOTA: Carpetas del Prospector (Zona01, ...) se crean a mano.
#
# IN[0] : str   nombre superficie de trackers general
# IN[1] : str   nombre superficie MDT original
# IN[2] : str   nombre capa de contornos de zonas
# IN[3] : str   nombre de la combinada FINAL (MDT modificado), que se
#               monta como [MDT] + Desmonte_Total + Terraplen_Total
# IN[4] : str   offset de las manchas en metros (limpieza + separacion)
# IN[5] : str   filtro de area: eliminar manchas con area < este % del
#               area MEDIA de las manchas de su superficie (0 = off)
# IN[6] : str   S/N pegar el MDT como base de la combinada (S = la
#               combinada es el MDT MODIFICADO; N = solo union manchas)
# IN[7] : str   antiloteria: numero max de intentos de rescate por
#               superficie cuyo pegado falla (0 = desactivada)
# IN[8] : str   antiloteria: offset EXTRA en metros aplicado en cada
#               intento, ACUMULATIVO (p.ej. 0.02 -> +0.02, +0.04, +0.06)
# =============================================================================

import clr
import time
import traceback

# --- cronometro ---
_T_START = time.perf_counter()
_t_last  = _T_START
_T_PHASES = {}

def _fmt_hms(secs):
    secs = float(secs)
    if secs < 0:
        secs = 0.0
    m, s = divmod(secs, 60.0)
    h, m = divmod(m, 60.0)
    if h >= 1:
        return "{:d}h {:02d}m {:04.1f}s".format(int(h), int(m), s)
    if m >= 1:
        return "{:d}m {:04.1f}s".format(int(m), s)
    return "{:.2f}s".format(s)

def _tlog(label, log):
    """Anyade al log el tiempo de la fase (desde la marca anterior) y el
    acumulado total; actualiza la marca."""
    global _t_last
    now = time.perf_counter()
    _T_PHASES[label] = now - _t_last
    log.append("  [tiempo] {}: {}  (acumulado {})".format(
        label, _fmt_hms(now - _t_last), _fmt_hms(now - _T_START)))
    _t_last = now

clr.AddReference('AcMgd')
clr.AddReference('AcCoreMgd')
clr.AddReference('AcDbMgd')
clr.AddReference('AecBaseMgd')
clr.AddReference('AeccDbMgd')

from Autodesk.AutoCAD.ApplicationServices import Application as AcadApp
from Autodesk.AutoCAD.DatabaseServices import (
    OpenMode, Polyline, SymbolUtilityServices,
    LayerTable, LayerTableRecord, ObjectIdCollection
)
from Autodesk.AutoCAD.Geometry import Point2d, Point3d, Point3dCollection
from Autodesk.AutoCAD.Colors import Color as AcadColor, ColorMethod
from Autodesk.Civil.ApplicationServices import CivilApplication
from Autodesk.Civil.DatabaseServices import (
    TinSurface, TinVolumeSurface
)
# ITerrainSurface puede no estar expuesto en el modulo raiz en algunas
# versiones; lo importamos aparte de forma tolerante.
try:
    from Autodesk.Civil.DatabaseServices import ITerrainSurface
    _HAS_ITERRAINSURFACE = True
except Exception:
    ITerrainSurface = None
    _HAS_ITERRAINSURFACE = False

from Autodesk.Civil import SurfaceBoundaryType

# Reflection para invocar metodos de interfaz explicita (pythonnet no
# expone ExtractContoursAt directamente en TinVolumeSurface porque la
# interfaz ITerrainSurface esta implementada explicitamente).
from System import Array, Double, Object
from System.Reflection import BindingFlags

VOLUME_PREFIX    = "Volumen_MDT"    # Volumen_MDT_ZonaXX
TMP_VOL_PREFIX   = "__tmp_vol_"     # para volumenes temporales de manchas
DES_LAYER_FMT    = "_Contornos_desmonte_Zona{:02d}"
TER_LAYER_FMT    = "_Contornos_terraplen_Zona{:02d}"
DES_COLOR_INDEX  = 1   # rojo
TER_COLOR_INDEX  = 3   # verde
OFFSET_DIST      = 0.10   # valor por defecto si IN[4] no es valido (m)
WEED_TOL         = 0.001  # 1 mm: tolerancia weed (quita vert. duplicados)
ANTILOT_STEP     = 0.05   # paso antiloteria por defecto si IN[8] no es valido (m)
DES_TOTAL_NAME   = "Desmonte_Total"    # agrupacion de todos los Desmonte_ZonaXX
TER_TOTAL_NAME   = "Terraplen_Total"   # agrupacion de todos los Terraplen_ZonaXX

tracker_surf_name = str(IN[0])
mdt_surf_name     = str(IN[1])
contour_layer     = str(IN[2])
try:
    combined_name = str(IN[3]).strip()
except Exception:
    combined_name = ""
try:
    offset_dist = float(str(IN[4]).strip().replace(",", "."))
    if offset_dist < 0:
        offset_dist = OFFSET_DIST
except Exception:
    offset_dist = OFFSET_DIST
try:
    filtro_pct = float(str(IN[5]).strip().replace(",", "."))
    if filtro_pct < 0:
        filtro_pct = 0.0
except Exception:
    filtro_pct = 5.0
try:
    _v6 = str(IN[6]).strip().upper()
except Exception:
    _v6 = ""
# Por defecto SI: solo un NO explicito desactiva la base MDT.
pegar_mdt = _v6 not in ("N", "NO", "FALSE", "0")
try:
    antilot_max = int(float(str(IN[7]).strip().replace(",", ".")))
    if antilot_max < 0:
        antilot_max = 0
except Exception:
    antilot_max = 3
try:
    antilot_paso = float(str(IN[8]).strip().replace(",", "."))
    if antilot_paso <= 0:
        antilot_paso = ANTILOT_STEP
except Exception:
    antilot_paso = ANTILOT_STEP

log = []
log.append("=== Superficies_Zonas v4.16 ===")
log.append("Inicio: {}".format(time.strftime("%Y-%m-%d %H:%M:%S")))
log.append("Tracker surf : {}".format(tracker_surf_name))
log.append("MDT surf     : {}".format(mdt_surf_name))
log.append("Contour layer: {}".format(contour_layer))
log.append("Superf. comb.: {}".format(combined_name))
log.append("Offset (m)   : {}  (cascada x1, x0.5, x0.2, x0.1)".format(offset_dist))
log.append("Filtro area  : manchas < {}% del area media se eliminan (0 = off)".format(filtro_pct))
log.append("MDT base     : {}  [IN[6]='{}']".format(
    "SI (la combinada sera el MDT MODIFICADO)" if pegar_mdt
    else "NO (solo union de manchas)", _v6))
log.append("Antiloteria  : {} intento(s) max, +{} m de offset por intento".format(
    antilot_max, antilot_paso))
log.append("")


def find_style_id(cdoc, candidates):
    ss = cdoc.Styles.SurfaceStyles
    for nm in candidates:
        try:
            return ss.get_Item(nm)
        except:
            continue
    return None


def extract_contours_at_iface(surface, elevation):
    """Invoca ITerrainSurface.ExtractContoursAt(double) via reflection.
    pythonnet no expone el metodo directamente en TinVolumeSurface porque
    la interfaz esta implementada explicitamente. Cuatro estrategias en
    orden de preferencia:
      1) Llamada directa (por si el runtime ya lo expone).
      2) Reflection sobre el tipo ITerrainSurface (si esta importado).
      3) Reflection sobre el tipo concreto, buscando por nombre exacto
         o nombre calificado 'Autodesk.Civil.DatabaseServices.ITerrainSurface.ExtractContoursAt'.
      4) Igual que 3 pero filtrando por 'termina en .ExtractContoursAt'
         y con parametro (double), captura cualquier nombre calificado
         aunque el namespace haya cambiado.
    Devuelve un ObjectIdCollection.
    """
    from System import Type as NetType
    double_elev = float(elevation)

    # Estrategia 1: directo
    try:
        return surface.ExtractContoursAt(double_elev)
    except Exception:
        pass

    args = Array[Object]([Double(double_elev)])
    type_arr_double = Array[NetType]([clr.GetClrType(Double)])

    # Estrategia 2: invocar a traves de ITerrainSurface (si esta importado)
    if _HAS_ITERRAINSURFACE and ITerrainSurface is not None:
        try:
            iface_type = clr.GetClrType(ITerrainSurface)
            m = iface_type.GetMethod("ExtractContoursAt", type_arr_double)
            if m is not None:
                return m.Invoke(surface, args)
        except Exception:
            pass

    # Estrategia 3 y 4: enumerar metodos del tipo concreto
    try:
        t = surface.GetType()
        flags = (BindingFlags.Instance |
                 BindingFlags.Public |
                 BindingFlags.NonPublic |
                 BindingFlags.FlattenHierarchy)
        double_clr = clr.GetClrType(Double)
        candidates = []
        for m in t.GetMethods(flags):
            name = m.Name
            # 'ExtractContoursAt' o cualquier nombre que acabe en '.ExtractContoursAt'
            if name == "ExtractContoursAt" or name.endswith(".ExtractContoursAt"):
                ps = m.GetParameters()
                if len(ps) == 1 and ps[0].ParameterType == double_clr:
                    candidates.append(m)
        # Probar todas las candidatas, priorizando la calificada (explicita)
        candidates.sort(key=lambda mm: 0 if "." in mm.Name else 1)
        for m in candidates:
            try:
                return m.Invoke(surface, args)
            except Exception:
                continue
    except Exception:
        pass

    # Estrategia 5: InternalExtractContoursAt(Double)
    # En Civil 3D 2024, los metodos publicos del guide son wrappers de
    # Internal* que si estan visibles en el tipo concreto. Confirmado por
    # diagnostico previo: 'InternalExtractContoursAt(Double)' existe.
    try:
        t = surface.GetType()
        flags = (BindingFlags.Instance |
                 BindingFlags.Public |
                 BindingFlags.NonPublic |
                 BindingFlags.FlattenHierarchy)
        double_clr = clr.GetClrType(Double)
        for m in t.GetMethods(flags):
            if m.Name == "InternalExtractContoursAt":
                ps = m.GetParameters()
                if len(ps) == 1 and ps[0].ParameterType == double_clr:
                    return m.Invoke(surface, args)
    except Exception:
        pass

    raise Exception("ExtractContoursAt no accesible ni por reflection.")


def get_deltas_from_volume(vol_surf):
    """Lee los intervalos de analisis del TinVolumeSurface y devuelve:
         (raise_d, raise_t)
       Criterio (borde mas cercano a 0 en ambos casos):
         - Desmonte  = intervalo POSITIVO (min>=0). Cojo su MIN.
                       Desmonte.RaiseSurface(+min)  -> sube.
         - Terraplen = intervalo NEGATIVO (max<=0). Cojo su MAX.
                       Terraplen.RaiseSurface(max)  (max <=0) -> baja.
       None si no hay intervalo de ese signo.
    """
    try:
        data = vol_surf.Analysis.GetElevationData()
    except Exception:
        return None, None
    if data is None:
        return None, None
    raise_d = None
    raise_t = None
    eps = 1e-6
    for d in data:
        try:
            mn = float(d.MinimumElevation)
            mx = float(d.MaximumElevation)
        except Exception:
            continue
        if mn >= -eps:
            cand = mn
            if raise_d is None or cand < raise_d:
                raise_d = cand
        if mx <= eps:
            cand = mx
            if raise_t is None or cand > raise_t:
                raise_t = cand
    return raise_d, raise_t



    """Ver docstring v3.1: devuelve (raise_d, raise_t) con borde mas cercano a 0."""
    try:
        data = vol_surf.Analysis.GetElevationData()
    except Exception:
        return None, None
    if data is None:
        return None, None
    raise_d = None
    raise_t = None
    eps = 1e-6
    for d in data:
        try:
            mn = float(d.MinimumElevation)
            mx = float(d.MaximumElevation)
        except Exception:
            continue
        if mn >= -eps:
            cand = mn
            if raise_d is None or cand < raise_d:
                raise_d = cand
        if mx <= eps:
            cand = mx
            if raise_t is None or cand > raise_t:
                raise_t = cand
    return raise_d, raise_t


def ensure_layer(tr, db, layer_name, color_index):
    """Crea la capa si no existe; si existe, fuerza su color. Devuelve
    el ObjectId del LayerTableRecord."""
    lt = tr.GetObject(db.LayerTableId, OpenMode.ForRead)
    if lt.Has(layer_name):
        ltr_id = lt.get_Item(layer_name)
        ltr = tr.GetObject(ltr_id, OpenMode.ForWrite)
    else:
        lt.UpgradeOpen()
        ltr = LayerTableRecord()
        ltr.Name = layer_name
        ltr_id = lt.Add(ltr)
        tr.AddNewlyCreatedDBObject(ltr, True)
    try:
        ltr.Color = AcadColor.FromColorIndex(ColorMethod.ByAci, color_index)
    except Exception as ex:
        # Fallback a RGB si FromColorIndex falla por algun motivo
        rgb_map = {1: (255, 0, 0), 3: (0, 255, 0)}
        r, g, b = rgb_map.get(color_index, (255, 255, 255))
        try:
            ltr.Color = AcadColor.FromRgb(r, g, b)
        except:
            pass
    return ltr_id


def erase_polylines_in_layer(tr, db, layer_name):
    """Borra todas las Polylines del ModelSpace que esten en la capa dada."""
    ms_id = SymbolUtilityServices.GetBlockModelSpaceId(db)
    btr = tr.GetObject(ms_id, OpenMode.ForRead)
    to_erase = []
    for oid in btr:
        try:
            obj = tr.GetObject(oid, OpenMode.ForRead)
        except:
            continue
        if isinstance(obj, Polyline) and obj.Layer == layer_name:
            to_erase.append(oid)
    for oid in to_erase:
        try:
            o = tr.GetObject(oid, OpenMode.ForWrite)
            o.Erase()
        except:
            pass
    return len(to_erase)


def extract_stain_boundaries(tr, db, cdoc, base_surf_id, base_surf_name,
                             mdt_surf_id, tmp_vol_name,
                             target_layer_name, log):
    """Crea un TinVolumeSurface temporal, extrae contornos a 0, los mueve
    a la capa target_layer_name y devuelve la lista de ObjectIds de esas
    polylines (ordenadas por longitud descendente, para que la mayor sea
    el Outer boundary). Borra la volume surface al terminar.

    Puede devolver lista vacia si la volume surface no cruza el cero
    (desmonte o terraplen irrelevante en esa zona)."""
    # 1) Crear volumen temporal
    vol_id = None
    try:
        vol_id = TinVolumeSurface.Create(
            tmp_vol_name, base_surf_id, mdt_surf_id)
    except Exception as ex:
        log.append("    ERROR creando volumen temporal '{}': {}".format(
            tmp_vol_name, ex))
        return []

    # 2) Extraer contornos a elevacion 0
    contour_ids_coll = ObjectIdCollection()
    try:
        vol_surf = tr.GetObject(vol_id, OpenMode.ForRead)
        # Invocar via reflection (ExtractContoursAt esta en ITerrainSurface
        # con implementacion explicita, no accesible directamente en
        # TinVolumeSurface desde pythonnet).
        contour_ids_coll = extract_contours_at_iface(vol_surf, 0.0)
    except Exception as ex:
        log.append("    ERROR ExtractContoursAt(0) en '{}': {}".format(
            base_surf_name, ex))
        # Diagnostico: listar los metodos del tipo que contengan "Contour"
        # o "Extract" (solo la primera vez, controlado con flag global).
        global _DIAG_DONE
        try:
            _DIAG_DONE
        except NameError:
            _DIAG_DONE = False
        if not _DIAG_DONE:
            _DIAG_DONE = True
            try:
                from System.Reflection import BindingFlags as BF
                t = vol_surf.GetType()
                log.append("    [diag] Tipo: {}".format(t.FullName))
                flags = (BF.Instance | BF.Public | BF.NonPublic |
                         BF.FlattenHierarchy)
                found = []
                for m in t.GetMethods(flags):
                    nm = m.Name
                    if "Contour" in nm or "Extract" in nm:
                        ps = m.GetParameters()
                        sig = ", ".join([p.ParameterType.Name for p in ps])
                        found.append("{}({})".format(nm, sig))
                log.append("    [diag] Metodos Extract*/Contour*:")
                for s in sorted(set(found))[:15]:
                    log.append("      {}".format(s))
            except Exception as ex2:
                log.append("    [diag] Error en diagnostico: {}".format(ex2))
        try:
            tr.GetObject(vol_id, OpenMode.ForWrite).Erase()
        except:
            pass
        return []

    # 3) Mover polylines a la capa destino + recoger IDs + longitudes
    polys_info = []   # (oid, length)
    for cid in contour_ids_coll:
        try:
            pl = tr.GetObject(cid, OpenMode.ForWrite)
            if not isinstance(pl, Polyline):
                continue
            pl.Layer = target_layer_name
            polys_info.append((cid, float(pl.Length)))
        except Exception as ex:
            log.append("    AVISO moviendo polyline a capa: {}".format(ex))

    # 4) Borrar volumen temporal
    try:
        tr.GetObject(vol_id, OpenMode.ForWrite).Erase()
    except Exception as ex:
        log.append("    AVISO borrando volumen temporal: {}".format(ex))

    # 5) Ordenar por longitud descendente (el mayor -> Outer)
    polys_info.sort(key=lambda x: x[1], reverse=True)
    return [oid for (oid, _) in polys_info]


def add_boundaries_from_polylines(tr, surf, poly_ids, log):
    """Anyade cada polyline como boundary de surf. La primera Outer,
    el resto Show. Anyade al log el recuento."""
    if not poly_ids:
        return 0
    added = 0
    for idx, pid in enumerate(poly_ids):
        try:
            pl = tr.GetObject(pid, OpenMode.ForRead)
            if not isinstance(pl, Polyline):
                continue
            # Point3dCollection con los vertices de la polyline
            pc = Point3dCollection()
            n = pl.NumberOfVertices
            for i in range(n):
                p3 = pl.GetPoint3dAt(i)
                pc.Add(Point3d(p3.X, p3.Y, 0.0))
            # Cerrar si no lo esta
            first = pl.GetPoint3dAt(0)
            last  = pl.GetPoint3dAt(n - 1)
            if (first.X, first.Y) != (last.X, last.Y):
                pc.Add(Point3d(first.X, first.Y, 0.0))
            btype = SurfaceBoundaryType.Outer if idx == 0 else SurfaceBoundaryType.Show
            surf.BoundariesDefinition.AddBoundaries(pc, 1.0, btype, True)
            added += 1
        except Exception as ex:
            log.append("    AVISO anyadiendo boundary #{}: {}".format(idx, ex))
    return added


def iter_dbcollection(coll):
    """Materializa una coleccion .NET (p.ej. DBObjectCollection) en una
    lista Python. Usa GetEnumerator (patron robusto en pythonnet) con
    fallback a indexacion por entero."""
    items = []
    if coll is None:
        return items
    try:
        e = coll.GetEnumerator()
        while e.MoveNext():
            items.append(e.Current)
        return items
    except Exception:
        pass
    try:
        cnt = coll.Count
        for i in range(cnt):
            items.append(coll[i])
    except Exception:
        pass
    return items


def weed_points(pts, tol):
    """Elimina vertices consecutivos a menos de 'tol' del anterior
    (quita duplicados / micro-segmentos). Devuelve la lista filtrada."""
    if not pts:
        return pts
    out = [pts[0]]
    t2 = tol * tol
    for p in pts[1:]:
        lx, ly = out[-1]
        if (p[0] - lx) ** 2 + (p[1] - ly) ** 2 >= t2:
            out.append(p)
    return out


def offset_polyline_inward(tr, db, btr, pl_id, offset_dist, log):
    """Desfasa la polilinea CERRADA pl_id 'offset_dist' hacia dentro.
    Genera el offset a +offset_dist y a -offset_dist y se queda con el de
    MENOR area (el interior). Anyade la(s) curva(s) al ModelSpace en la
    misma capa (color ByLayer) y BORRA la original.
    Devuelve la lista de ObjectId creados, o [] si el offset falla o si
    ninguna opcion reduce el area (en ese caso NO borra la original).
    No escribe en el log por cada fallo (lo resume offset_manchas)."""
    if not offset_dist or offset_dist <= 0:
        return []
    try:
        pl = tr.GetObject(pl_id, OpenMode.ForRead)
    except Exception:
        return []
    if not isinstance(pl, Polyline):
        return []
    layer_name = pl.Layer
    try:
        area_orig = abs(float(pl.Area))
    except Exception:
        area_orig = None
    best = None
    for d_off in (offset_dist, -offset_dist):
        try:
            curves = pl.GetOffsetCurves(d_off)
        except Exception:
            curves = None
        cur_list = iter_dbcollection(curves)
        if not cur_list:
            continue
        total = 0.0
        for c in cur_list:
            try:
                total += abs(float(c.Area))
            except Exception:
                pass
        if best is None or total < best[0]:
            if best is not None:
                for c in best[1]:
                    try:
                        c.Dispose()
                    except Exception:
                        pass
            best = (total, cur_list)
        else:
            for c in cur_list:
                try:
                    c.Dispose()
                except Exception:
                    pass
    if best is None:
        return []
    if best[0] < 1e-9 or (area_orig is not None and best[0] >= area_orig - 1e-9):
        for c in best[1]:
            try:
                c.Dispose()
            except Exception:
                pass
        return []
    new_ids = []
    for c in best[1]:
        try:
            btr.AppendEntity(c)
            tr.AddNewlyCreatedDBObject(c, True)
            c.Layer = layer_name
            try:
                c.ColorIndex = 256
            except Exception:
                pass
            new_ids.append(c.ObjectId)
        except Exception:
            pass
    if new_ids:
        try:
            tr.GetObject(pl_id, OpenMode.ForWrite).Erase()
        except Exception:
            pass
    return new_ids


def clean_and_offset_mancha(tr, db, btr, pl_id, offset_dist, weed_tol, log):
    """Limpia la mancha y la desfasa hacia dentro. Pasos:
      1) lee vertices, quita el de cierre si duplica el primero,
      2) weed de vertices casi duplicados (tol = weed_tol),
      3) crea una polilinea NUEVA, limpia y CERRADA (cierra las abiertas),
      4) borra la original y desfasa la limpia 'offset_dist' hacia dentro.
    Devuelve (ids, modo) con modo en:
      'offset'     -> desfasada con el valor completo de IN[4],
      'offset_red' -> el valor completo colapsaba; desfasada con un valor
                      REDUCIDO de la cascada (x0.5, x0.2, x0.1 de IN[4]),
      'weed'       -> ningun offset de la cascada funciono; se usa la
                      version solo-limpia (sin separar),
      'drop'       -> degenerada (<3 vertices tras limpiar); se descarta.
    La cascada garantiza que las manchas estrechas tambien queden
    SEPARADAS (aunque sea poco), evitando aristas coincidentes
    desmonte/terraplen que disparan el fallo de paste en FASE 4.
    El weed + regenerado equivale a OVERKILL: quita duplicados y
    micro-segmentos, principal causa del 'Error performing edit' al pegar."""
    try:
        pl = tr.GetObject(pl_id, OpenMode.ForRead)
    except Exception:
        return [], 'drop'
    if not isinstance(pl, Polyline):
        return [], 'drop'
    layer_name = pl.Layer
    try:
        elev = float(pl.Elevation)
    except Exception:
        elev = 0.0
    try:
        nv = pl.NumberOfVertices
        pts = []
        for i in range(nv):
            p = pl.GetPoint2dAt(i)
            pts.append((p.X, p.Y))
    except Exception:
        return [], 'drop'
    if len(pts) >= 2 and abs(pts[0][0] - pts[-1][0]) < 1e-9 \
            and abs(pts[0][1] - pts[-1][1]) < 1e-9:
        pts = pts[:-1]
    pts = weed_points(pts, weed_tol)
    if len(pts) >= 2 and (pts[0][0] - pts[-1][0]) ** 2 \
            + (pts[0][1] - pts[-1][1]) ** 2 < weed_tol * weed_tol:
        pts = pts[:-1]
    if len(pts) < 3:
        try:
            tr.GetObject(pl_id, OpenMode.ForWrite).Erase()
        except Exception:
            pass
        return [], 'drop'
    clean_pl = Polyline()
    for i, (x, y) in enumerate(pts):
        clean_pl.AddVertexAt(i, Point2d(x, y), 0.0, 0.0, 0.0)
    btr.AppendEntity(clean_pl)
    tr.AddNewlyCreatedDBObject(clean_pl, True)
    clean_pl.Closed = True
    try:
        clean_pl.Elevation = elev
    except Exception:
        pass
    clean_pl.Layer = layer_name
    try:
        clean_pl.ColorIndex = 256
    except Exception:
        pass
    clean_id = clean_pl.ObjectId
    try:
        tr.GetObject(pl_id, OpenMode.ForWrite).Erase()
    except Exception:
        pass
    for fac in (1.0, 0.5, 0.2, 0.1):
        d_try = offset_dist * fac
        if d_try <= 0:
            break
        new_ids = offset_polyline_inward(tr, db, btr, clean_id, d_try, log)
        if new_ids:
            return new_ids, ('offset' if fac >= 0.999 else 'offset_red')
    return [clean_id], 'weed'


def offset_manchas(tr, db, pids, offset_dist, weed_tol, filtro_pct, log):
    """Filtra por area, limpia y desfasa cada polilinea de 'pids'.
    1) FILTRO: si filtro_pct > 0, BORRA las manchas con area menor que
       filtro_pct% del area MEDIA de las manchas de esta superficie.
       Son astillas junto al contorno cero, con efecto despreciable en
       el MDT modificado y principal fuente de geometria degenerada.
    2) LIMPIEZA + OFFSET en cascada (ver clean_and_offset_mancha).
    Devuelve (ids_ordenados_por_longitud_desc, stats) con stats:
      n_off, n_red, n_weed, n_drop, n_small, area_drop, area_tot,
      area_kept_orig (area original de manchas conservadas) y
      area_kept_fin (area tras el offset; mide la reduccion real).
    Solo registra el resumen; el detalle por mancha NO va al log."""
    try:
        btr = tr.GetObject(
            SymbolUtilityServices.GetBlockModelSpaceId(db), OpenMode.ForWrite)
    except Exception:
        btr = None
    stats = {'n_off': 0, 'n_red': 0, 'n_weed': 0, 'n_drop': 0,
             'n_small': 0, 'area_drop': 0.0, 'area_tot': 0.0,
             'area_kept_orig': 0.0, 'area_kept_fin': 0.0}
    areas = {}
    for pid in pids:
        a = 0.0
        try:
            o = tr.GetObject(pid, OpenMode.ForRead)
            a = abs(float(o.Area))
        except Exception:
            a = 0.0
        areas[pid] = a
        stats['area_tot'] += a
    umbral = 0.0
    if filtro_pct > 0 and len(pids) > 0:
        media = stats['area_tot'] / float(len(pids))
        umbral = media * filtro_pct / 100.0
    result = []
    if btr is not None:
        for pid in pids:
            if umbral > 0.0 and areas.get(pid, 0.0) < umbral:
                try:
                    tr.GetObject(pid, OpenMode.ForWrite).Erase()
                except Exception:
                    pass
                stats['n_small'] += 1
                stats['area_drop'] += areas.get(pid, 0.0)
                continue
            stats['area_kept_orig'] += areas.get(pid, 0.0)
            ids, modo = clean_and_offset_mancha(
                tr, db, btr, pid, offset_dist, weed_tol, log)
            if modo == 'offset':
                result.extend(ids)
                stats['n_off'] += 1
            elif modo == 'offset_red':
                result.extend(ids)
                stats['n_red'] += 1
            elif modo == 'weed':
                result.extend(ids)
                stats['n_weed'] += 1
            else:
                stats['n_drop'] += 1
    info = []
    for oid in result:
        try:
            o = tr.GetObject(oid, OpenMode.ForRead)
            info.append((oid, float(o.Length)))
            try:
                stats['area_kept_fin'] += abs(float(o.Area))
            except Exception:
                pass
        except Exception:
            info.append((oid, 0.0))
    info.sort(key=lambda x: x[1], reverse=True)
    return [oid for (oid, _) in info], stats


def antilot_offset_capa(tr, db, layer_name, paso, log):
    """ANTILOTERIA paso a: desfasa 'paso' m hacia DENTRO todas las
    polylines de mancha de la capa dada (borra la original al desfasar;
    si una no puede desfasarse, se conserva tal cual). Devuelve
    (ids_ordenados_por_longitud_desc, n_desfasadas, n_total,
    area_total_m2 de las polylines resultantes)."""
    ms_id = SymbolUtilityServices.GetBlockModelSpaceId(db)
    btr = tr.GetObject(ms_id, OpenMode.ForWrite)
    pids = []
    for oid in btr:
        try:
            obj = tr.GetObject(oid, OpenMode.ForRead)
        except Exception:
            continue
        if isinstance(obj, Polyline) and obj.Layer == layer_name:
            pids.append(oid)
    result = []
    n_off = 0
    for pid in pids:
        new_ids = offset_polyline_inward(tr, db, btr, pid, paso, log)
        if new_ids:
            result.extend(new_ids)
            n_off += 1
        else:
            result.append(pid)
    info = []
    area_total = 0.0
    for oid in result:
        try:
            o = tr.GetObject(oid, OpenMode.ForRead)
            info.append((oid, float(o.Length)))
            try:
                area_total += abs(float(o.Area))
            except Exception:
                pass
        except Exception:
            info.append((oid, 0.0))
    info.sort(key=lambda x: x[1], reverse=True)
    return [oid for (oid, _) in info], n_off, len(pids), area_total


def antilot_recrear_superficie(tr, db, sname, old_id, trk_id, delta,
                               style_id, poly_ids, log):
    """ANTILOTERIA paso b: borra la superficie 'sname' y la recrea con el
    MISMO procedimiento de FASE 1 (paste Trackers de su zona + raise) y
    boundaries desde poly_ids (mayor = Outer, resto = Show). Devuelve el
    nuevo ObjectId, o None si algo falla."""
    try:
        try:
            tr.GetObject(old_id, OpenMode.ForWrite).Erase()
        except Exception as ex_e:
            log.append("    AVISO borrando {}: {}".format(
                sname, str(ex_e)[:80]))
        new_id = TinSurface.Create(db, sname)
        surf = tr.GetObject(new_id, OpenMode.ForWrite)
        if style_id is not None:
            surf.StyleId = style_id
        surf.PasteSurface(trk_id)
        if delta is not None:
            surf.RaiseSurface(float(delta))
        added = add_boundaries_from_polylines(tr, surf, poly_ids, log)
        log.append("    {} recreada con {} boundaries".format(sname, added))
        return new_id
    except Exception as ex_r:
        log.append("    ERROR recreando {}: {}".format(
            sname, str(ex_r)[:120]))
        return None




def pegar_grupo(db, target_id, target_name, items, antilot_max, antilot_paso,
                deltas_zona, trk_ids, des_ids, ter_ids, no_display_id,
                area_fin_surf, extra_acum, log):
    """Pega una lista de superficies en target_id (una transaccion por
    pegado), con reintento tras Rebuild y rescate ANTILOTERIA solo para
    items de zona (zn/tipo definidos). items = [(src_id, sname, zn,
    tipo)], zn=None para fuentes no-zona (MDT, agrupaciones). Actualiza
    area_fin_surf[sname] con el area real de las manchas tras cada
    rescate y extra_acum[sname] con el offset extra acumulado.
    Devuelve (n_pegadas, n_fallos_def, n_rescatadas,
    fallos_def) con fallos_def = [(sname, zn, tipo)]."""
    n_pasted = 0
    fallidos = []
    for src_id, sname, p_zn, p_tipo in items:
        if src_id is None:
            continue
        tr_p = db.TransactionManager.StartTransaction()
        ok = False
        try:
            cs = tr_p.GetObject(target_id, OpenMode.ForWrite)
            cs.PasteSurface(src_id)
            tr_p.Commit()
            ok = True
        except Exception as ex_p:
            log.append("    AVISO pegando {} en {}: {} (se reintentara)".format(
                sname, target_name, str(ex_p)[:110]))
        finally:
            tr_p.Dispose()
        if ok:
            n_pasted += 1
            log.append("    + {}".format(sname))
        else:
            fallidos.append((src_id, sname, p_zn, p_tipo))

    n_fail = 0
    rescatadas = 0
    fallidos2 = []
    if fallidos:
        tr_r0 = db.TransactionManager.StartTransaction()
        try:
            try:
                tr_r0.GetObject(target_id, OpenMode.ForWrite).Rebuild()
            except Exception:
                pass
            tr_r0.Commit()
        finally:
            tr_r0.Dispose()
        log.append("  Reintentando {} pegado(s) fallido(s) en {} tras Rebuild...".format(
            len(fallidos), target_name))
        for src_id, sname, p_zn, p_tipo in fallidos:
            tr_p2 = db.TransactionManager.StartTransaction()
            ok2 = False
            try:
                cs2 = tr_p2.GetObject(target_id, OpenMode.ForWrite)
                cs2.PasteSurface(src_id)
                tr_p2.Commit()
                ok2 = True
            except Exception as ex_p2:
                log.append("    AVISO reintento {}: {}".format(
                    sname, str(ex_p2)[:110]))
            finally:
                tr_p2.Dispose()
            if ok2:
                n_pasted += 1
                log.append("    + {} (reintento OK)".format(sname))
            else:
                fallidos2.append((src_id, sname, p_zn, p_tipo))

    fallos_def = []
    for src_id, sname, p_zn, p_tipo in fallidos2:
        rescatada = False
        if p_zn is not None and p_tipo in ("D", "T") and antilot_max > 0:
            cur_id = src_id
            dz = deltas_zona.get(p_zn, (None, None))
            delta = dz[0] if p_tipo == "D" else dz[1]
            capa = (DES_LAYER_FMT.format(p_zn) if p_tipo == "D"
                    else TER_LAYER_FMT.format(p_zn))
            trk_id_z = trk_ids.get(p_zn)
            if trk_id_z is None:
                log.append("  AVISO antiloteria {}: sin Trackers_Zona{:02d}, no se puede recrear.".format(
                    sname, p_zn))
            else:
                for intento in range(1, antilot_max + 1):
                    tr_a = db.TransactionManager.StartTransaction()
                    new_id = None
                    area_capa = 0.0
                    try:
                        poly_ids, n_off_a, n_tot_a, area_capa = antilot_offset_capa(
                            tr_a, db, capa, antilot_paso, log)
                        extra_acum[sname] = extra_acum.get(sname, 0.0) + antilot_paso
                        log.append("  Antiloteria {} intento {}: offset extra +{:.2f} m acumulado ({} de {} manchas desfasadas)".format(
                            sname, intento, extra_acum[sname],
                            n_off_a, n_tot_a))
                        if poly_ids:
                            new_id = antilot_recrear_superficie(
                                tr_a, db, sname, cur_id, trk_id_z, delta,
                                no_display_id, poly_ids, log)
                        else:
                            log.append("    AVISO antiloteria {}: sin manchas en capa '{}'.".format(
                                sname, capa))
                        if new_id is not None:
                            tr_a.Commit()
                    except Exception as ex_a:
                        log.append("    ERROR antiloteria {}: {}".format(
                            sname, str(ex_a)[:120]))
                        new_id = None
                    finally:
                        tr_a.Dispose()
                    if new_id is None:
                        break
                    cur_id = new_id
                    if p_tipo == "D":
                        des_ids[p_zn] = new_id
                    else:
                        ter_ids[p_zn] = new_id
                    if area_capa > 0:
                        ant_a = area_fin_surf.get(sname, 0.0)
                        area_fin_surf[sname] = area_capa
                        log.append("    area manchas {} tras rescate: {:.0f} m2 (antes {:.0f} m2)".format(
                            sname, area_capa, ant_a))
                    tr_p3 = db.TransactionManager.StartTransaction()
                    ok3 = False
                    try:
                        cs3 = tr_p3.GetObject(target_id, OpenMode.ForWrite)
                        cs3.PasteSurface(new_id)
                        tr_p3.Commit()
                        ok3 = True
                    except Exception as ex_p3:
                        log.append("    AVISO pegando {} (antiloteria intento {}): {}".format(
                            sname, intento, str(ex_p3)[:100]))
                    finally:
                        tr_p3.Dispose()
                    if ok3:
                        n_pasted += 1
                        rescatadas += 1
                        rescatada = True
                        log.append("    + {} (antiloteria intento {} OK)".format(
                            sname, intento))
                        break
        if not rescatada:
            n_fail += 1
            fallos_def.append((sname, p_zn, p_tipo))
    if fallidos2 and antilot_max > 0:
        log.append("  Antiloteria en {}: {} rescatada(s) de {}.".format(
            target_name, rescatadas, len(fallidos2)))
    log.append("  Superficies pegadas en '{}': {} (fallos definitivos: {})".format(
        target_name, n_pasted, n_fail))
    return n_pasted, n_fail, rescatadas, fallos_def



def pegar_grupo_rondas(db, target_id, target_name, items, rondas_max,
                       antilot_max, antilot_paso, deltas_zona, trk_ids,
                       des_ids, ter_ids, no_display_id, area_fin_surf,
                       extra_acum, log):
    """Ejecuta pegar_grupo por RONDAS: los fallos definitivos de una
    ronda se reintentan en la siguiente tras Rebuild del destino. El
    estado del destino cambia con cada pegado nuevo y eso rebaraja la
    coincidencia que dispara el bug (evidencia r11: zonas que agotaron
    la antiloteria contra su agrupacion incompleta pegaron a la primera
    contra un destino mas completo). Para al completar, al agotar
    rondas_max o si una ronda no consigue ningun pegado. Devuelve
    (n_pegadas, n_rescatadas, pendientes) con pendientes =
    [(sname, zn, tipo)]."""
    base_ids = {}
    pend = []
    for it in items:
        if it[0] is None:
            continue
        base_ids[it[1]] = it[0]
        pend.append(it)
    total_p = 0
    total_r = 0
    ronda = 0
    fallos = []
    while pend and ronda < rondas_max:
        ronda += 1
        if ronda > 1:
            tr_rb = db.TransactionManager.StartTransaction()
            try:
                try:
                    tr_rb.GetObject(target_id, OpenMode.ForWrite).Rebuild()
                except Exception:
                    pass
                tr_rb.Commit()
            finally:
                tr_rb.Dispose()
            log.append("  -- Ronda {} en '{}': {} pendiente(s) --".format(
                ronda, target_name, len(pend)))
        n_p, _nf, n_r, fallos = pegar_grupo(
            db, target_id, target_name, pend,
            antilot_max, antilot_paso, deltas_zona, trk_ids,
            des_ids, ter_ids, no_display_id, area_fin_surf,
            extra_acum, log)
        total_p += n_p
        total_r += n_r
        pend2 = []
        for (snf, znf, tpf) in fallos:
            if znf is not None and tpf == "D":
                sid_f = des_ids.get(znf)
            elif znf is not None and tpf == "T":
                sid_f = ter_ids.get(znf)
            else:
                sid_f = base_ids.get(snf)
            if sid_f is not None:
                pend2.append((sid_f, snf, znf, tpf))
        pend = pend2
        if n_p == 0:
            break
    return total_p, total_r, fallos


try:
    doc  = AcadApp.DocumentManager.MdiActiveDocument
    db   = doc.Database
    cdoc = CivilApplication.ActiveDocument

    dlock = doc.LockDocument()
    try:
        tracker_surf_id = None
        mdt_surf_id     = None
        no_display_id   = None
        contours        = []
        vol_by_zone     = {}
        created_names   = []
        errors_count    = 0
        manchas_offset      = 0
        manchas_offset_red  = 0
        manchas_conservadas = 0
        manchas_drop        = 0
        manchas_small       = 0
        area_filtrada       = 0.0
        area_manchas_tot    = 0.0
        area_off_orig       = 0.0
        area_off_fin        = 0.0
        boundaries_ok_tot   = 0
        boundaries_fail_tot = 0
        pegadas_ok          = 0
        pegadas_fail        = 0
        antilot_rescatadas  = 0
        area_fin_surf       = {}
        extra_acum          = {}

        # ===================================================== #
        # FASE 0: Localizar superficies, estilo y contornos
        # ===================================================== #
        tr0 = db.TransactionManager.StartTransaction()
        try:
            for sid in cdoc.GetSurfaceIds():
                s = tr0.GetObject(sid, OpenMode.ForRead)
                try:
                    sn = s.Name
                except:
                    continue
                if sn == tracker_surf_name:
                    tracker_surf_id = sid
                elif sn == mdt_surf_name:
                    mdt_surf_id = sid
                else:
                    prefix = VOLUME_PREFIX + "_Zona"
                    if sn.startswith(prefix):
                        tail = sn[len(prefix):]
                        if len(tail) >= 2 and tail[:2].isdigit():
                            zn = int(tail[:2])
                            vol_by_zone[zn] = sid

            if tracker_surf_id is None:
                raise Exception("Superficie de trackers '{}' no encontrada.".format(
                    tracker_surf_name))
            if mdt_surf_id is None:
                raise Exception("Superficie MDT '{}' no encontrada.".format(
                    mdt_surf_name))

            log.append("Superficies de volumen detectadas: {}".format(
                len(vol_by_zone)))

            no_display_id = find_style_id(cdoc, [
                "_No Display", "_no display", "_NO DISPLAY",
                "_Sin Display", "_Sin Visualizacion",
            ])
            if no_display_id is None:
                log.append("AVISO: estilo '_No Display' no encontrado.")
            else:
                log.append("Estilo de superficie: '_No Display' OK.")

            ms_id = SymbolUtilityServices.GetBlockModelSpaceId(db)
            btr = tr0.GetObject(ms_id, OpenMode.ForRead)
            for oid in btr:
                obj = tr0.GetObject(oid, OpenMode.ForRead)
                if not isinstance(obj, Polyline):
                    continue
                if obj.Layer != contour_layer:
                    continue
                n = obj.NumberOfVertices
                if n < 3:
                    continue
                pts = []
                for i in range(n):
                    p = obj.GetPoint2dAt(i)
                    pts.append((p.X, p.Y))
                contours.append(pts)

            if not contours:
                raise Exception("Sin contornos cerrados en '{}'.".format(
                    contour_layer))
            contours.sort(key=lambda c: min(p[0] for p in c))
            log.append("Contornos encontrados: {}".format(len(contours)))

            # Borrar en orden de dependencia: PRIMERO la combinada
            # (IN[3]), DESPUES las agrupaciones Desmonte_Total /
            # Terraplen_Total y por ultimo (mas abajo) las superficies
            # por zona: cada nivel referencia por Paste al inferior y
            # debe borrarse antes que sus fuentes.
            borrar_orden = []
            if combined_name:
                borrar_orden.append(combined_name)
            borrar_orden.extend([DES_TOTAL_NAME, TER_TOTAL_NAME])
            for nombre_b in borrar_orden:
                prev_b = []
                for sid in cdoc.GetSurfaceIds():
                    try:
                        sc = tr0.GetObject(sid, OpenMode.ForRead)
                        if sc.Name == nombre_b:
                            prev_b.append(sid)
                    except Exception:
                        pass
                for sid in prev_b:
                    try:
                        tr0.GetObject(sid, OpenMode.ForWrite).Erase()
                    except Exception:
                        pass
                if prev_b:
                    log.append("Superficie previa '{}' borrada.".format(nombre_b))

            # Limpieza de ejecuciones previas:
            # - Superficies Trackers_Zona*, Desmonte_Zona*, Terraplen_Zona*
            # - Superficies temporales __tmp_vol_*
            prefixes = ("Trackers_Zona", "Desmonte_Zona",
                        "Terraplen_Zona", TMP_VOL_PREFIX)
            to_erase = []
            for sid in cdoc.GetSurfaceIds():
                s = tr0.GetObject(sid, OpenMode.ForRead)
                try:
                    sn = s.Name
                except:
                    continue
                if sn.startswith(prefixes):
                    to_erase.append(sid)
            for sid in to_erase:
                tr0.GetObject(sid, OpenMode.ForWrite).Erase()
            if to_erase:
                log.append("Superficies previas borradas: {}".format(len(to_erase)))

            tr0.Commit()
        finally:
            tr0.Dispose()
        _tlog("FASE 0 - localizar superficies/contornos y limpiar", log)

        # ===================================================== #
        # FASE 1: Crear superficies por zona (+ raise/lower)
        # ===================================================== #
        tr = db.TransactionManager.StartTransaction()
        trk_ids = {}   # zn -> ObjectId Trackers_ZonaXX
        des_ids = {}   # zn -> ObjectId Desmonte_ZonaXX
        ter_ids = {}   # zn -> ObjectId Terraplen_ZonaXX
        deltas_zona = {}  # zn -> (raise_desmonte, raise_terraplen)
        try:
            for i, pts in enumerate(contours):
                zn = i + 1
                trk_name = "Trackers_Zona{:02d}".format(zn)
                des_name = "Desmonte_Zona{:02d}".format(zn)
                ter_name = "Terraplen_Zona{:02d}".format(zn)

                log.append("")
                log.append(">>> Zona {:02d}".format(zn))

                raise_d, raise_t = None, None
                vol_id = vol_by_zone.get(zn)
                if vol_id is None:
                    log.append("  AVISO: sin Volumen_MDT_Zona{:02d}.".format(zn))
                else:
                    try:
                        vol_surf = tr.GetObject(vol_id, OpenMode.ForRead)
                        raise_d, raise_t = get_deltas_from_volume(vol_surf)
                        if raise_d is not None:
                            log.append("  Delta desmonte : {:+.3f} m".format(raise_d))
                        else:
                            log.append("  AVISO: sin intervalo de desmonte.")
                        if raise_t is not None:
                            log.append("  Delta terraplen: {:+.3f} m".format(raise_t))
                        else:
                            log.append("  AVISO: sin intervalo de terraplen.")
                    except Exception as ex_v:
                        log.append("  ERROR leyendo volumen: {}".format(ex_v))

                deltas_zona[zn] = (raise_d, raise_t)

                pc = Point3dCollection()
                for (x, y) in pts:
                    pc.Add(Point3d(x, y, 0.0))
                if (pts[0][0], pts[0][1]) != (pts[-1][0], pts[-1][1]):
                    pc.Add(Point3d(pts[0][0], pts[0][1], 0.0))

                # ---- 1) Trackers_ZonaXX ----
                trk_id = None
                try:
                    trk_id = TinSurface.Create(db, trk_name)
                    trk_surf = tr.GetObject(trk_id, OpenMode.ForWrite)
                    if no_display_id is not None:
                        trk_surf.StyleId = no_display_id
                    trk_surf.PasteSurface(tracker_surf_id)
                    trk_surf.BoundariesDefinition.AddBoundaries(
                        pc, 1.0, SurfaceBoundaryType.Outer, True)
                    log.append("  OK {}".format(trk_name))
                    created_names.append(trk_name)
                    trk_ids[zn] = trk_id
                except Exception as ex_t:
                    log.append("  ERROR {}: {}".format(trk_name, ex_t))
                    errors_count += 1
                    continue

                # ---- 2) Desmonte_ZonaXX ----
                try:
                    des_id = TinSurface.Create(db, des_name)
                    des_surf = tr.GetObject(des_id, OpenMode.ForWrite)
                    if no_display_id is not None:
                        des_surf.StyleId = no_display_id
                    des_surf.PasteSurface(trk_id)
                    if raise_d is not None:
                        des_surf.RaiseSurface(float(raise_d))
                        log.append("  OK {}  (raise {:+.3f})".format(
                            des_name, raise_d))
                    else:
                        log.append("  OK {}  (sin raise)".format(des_name))
                    created_names.append(des_name)
                    des_ids[zn] = des_id
                except Exception as ex_d:
                    log.append("  ERROR {}: {}".format(des_name, ex_d))
                    errors_count += 1

                # ---- 3) Terraplen_ZonaXX ----
                try:
                    ter_id = TinSurface.Create(db, ter_name)
                    ter_surf = tr.GetObject(ter_id, OpenMode.ForWrite)
                    if no_display_id is not None:
                        ter_surf.StyleId = no_display_id
                    ter_surf.PasteSurface(trk_id)
                    if raise_t is not None:
                        ter_surf.RaiseSurface(float(raise_t))
                        log.append("  OK {}  (raise {:+.3f})".format(
                            ter_name, raise_t))
                    else:
                        log.append("  OK {}  (sin raise)".format(ter_name))
                    created_names.append(ter_name)
                    ter_ids[zn] = ter_id
                except Exception as ex_r:
                    log.append("  ERROR {}: {}".format(ter_name, ex_r))
                    errors_count += 1

            tr.Commit()
        finally:
            tr.Dispose()
        _tlog("FASE 1 - crear superficies por zona", log)

        # ===================================================== #
        # FASE 2: Manchas (extraer contornos) + boundaries
        # ===================================================== #
        # Transaccion nueva: las superficies ya estan commiteadas y
        # ExtractContoursAt crea polylines en ModelSpace.
        log.append("")
        log.append("--- FASE 2: manchas + limpieza + offset + boundaries ---")

        tr2 = db.TransactionManager.StartTransaction()
        try:
            for zn in sorted(set(list(des_ids.keys()) + list(ter_ids.keys()))):
                log.append("")
                log.append(">>> Zona {:02d} (manchas)".format(zn))

                # ---- Desmonte ----
                des_id = des_ids.get(zn)
                if des_id is not None:
                    des_layer = DES_LAYER_FMT.format(zn)
                    des_name_short = "Desmonte_Zona{:02d}".format(zn)
                    try:
                        ensure_layer(tr2, db, des_layer, DES_COLOR_INDEX)
                        n_old = erase_polylines_in_layer(tr2, db, des_layer)
                        if n_old:
                            log.append("  Capa '{}': {} polylines previas borradas".format(
                                des_layer, n_old))
                        tmp_name = "{}des_{:02d}".format(TMP_VOL_PREFIX, zn)
                        pids = extract_stain_boundaries(
                            tr2, db, cdoc, des_id, des_name_short,
                            mdt_surf_id, tmp_name, des_layer, log)
                        log.append("  {} -> {} polyline(s) de mancha".format(
                            des_name_short, len(pids)))
                        # Limpieza (weed + cerrar) + offset hacia dentro
                        # (valor IN[4]) ANTES de usar como boundary: regenera
                        # geometria limpia y separa aristas; mitiga el
                        # "Error performing edit" al pegar en la combinada.
                        off_pids, st_m = offset_manchas(
                            tr2, db, pids, offset_dist, WEED_TOL,
                            filtro_pct, log)
                        manchas_offset += st_m['n_off'] + st_m['n_red']
                        manchas_offset_red += st_m['n_red']
                        manchas_conservadas += st_m['n_weed']
                        manchas_drop += st_m['n_drop']
                        manchas_small += st_m['n_small']
                        area_filtrada += st_m['area_drop']
                        area_manchas_tot += st_m['area_tot']
                        area_off_orig += st_m['area_kept_orig']
                        area_off_fin += st_m['area_kept_fin']
                        area_fin_surf[des_name_short] = st_m['area_kept_fin']
                        pct_f = 0.0
                        if st_m['area_tot'] > 0:
                            pct_f = 100.0 * st_m['area_drop'] / st_m['area_tot']
                        log.append("  {} -> filtro: {} peq. ({:.1f}% area); limpieza: {} offset, {} offset-red, {} weed, {} drop".format(
                            des_name_short, st_m['n_small'], pct_f, st_m['n_off'],
                            st_m['n_red'], st_m['n_weed'], st_m['n_drop']))
                        red_o = 0.0
                        if st_m['area_kept_orig'] > 0:
                            red_o = 100.0 * (st_m['area_kept_orig'] - st_m['area_kept_fin']) / st_m['area_kept_orig']
                        log.append("  {} -> area manchas: {:.0f} m2 -> {:.0f} m2 (reduccion por offset: {:.2f}%)".format(
                            des_name_short, st_m['area_kept_orig'], st_m['area_kept_fin'], red_o))
                        if off_pids:
                            des_surf = tr2.GetObject(des_id, OpenMode.ForWrite)
                            added = add_boundaries_from_polylines(tr2, des_surf, off_pids, log)
                            boundaries_ok_tot += added
                            boundaries_fail_tot += max(0, len(off_pids) - added)
                            log.append("  {}: {} boundaries anyadidas".format(
                                des_name_short, added))
                    except Exception as ex_d2:
                        log.append("  ERROR manchas desmonte Zona{:02d}: {}".format(
                            zn, ex_d2))
                        errors_count += 1

                # ---- Terraplen ----
                ter_id = ter_ids.get(zn)
                if ter_id is not None:
                    ter_layer = TER_LAYER_FMT.format(zn)
                    ter_name_short = "Terraplen_Zona{:02d}".format(zn)
                    try:
                        ensure_layer(tr2, db, ter_layer, TER_COLOR_INDEX)
                        n_old = erase_polylines_in_layer(tr2, db, ter_layer)
                        if n_old:
                            log.append("  Capa '{}': {} polylines previas borradas".format(
                                ter_layer, n_old))
                        tmp_name = "{}ter_{:02d}".format(TMP_VOL_PREFIX, zn)
                        pids = extract_stain_boundaries(
                            tr2, db, cdoc, ter_id, ter_name_short,
                            mdt_surf_id, tmp_name, ter_layer, log)
                        log.append("  {} -> {} polyline(s) de mancha".format(
                            ter_name_short, len(pids)))
                        # Limpieza (weed + cerrar) + offset hacia dentro
                        # (valor IN[4]) ANTES de usar como boundary: regenera
                        # geometria limpia y separa aristas; mitiga el
                        # "Error performing edit" al pegar en la combinada.
                        off_pids, st_m = offset_manchas(
                            tr2, db, pids, offset_dist, WEED_TOL,
                            filtro_pct, log)
                        manchas_offset += st_m['n_off'] + st_m['n_red']
                        manchas_offset_red += st_m['n_red']
                        manchas_conservadas += st_m['n_weed']
                        manchas_drop += st_m['n_drop']
                        manchas_small += st_m['n_small']
                        area_filtrada += st_m['area_drop']
                        area_manchas_tot += st_m['area_tot']
                        area_off_orig += st_m['area_kept_orig']
                        area_off_fin += st_m['area_kept_fin']
                        area_fin_surf[ter_name_short] = st_m['area_kept_fin']
                        pct_f = 0.0
                        if st_m['area_tot'] > 0:
                            pct_f = 100.0 * st_m['area_drop'] / st_m['area_tot']
                        log.append("  {} -> filtro: {} peq. ({:.1f}% area); limpieza: {} offset, {} offset-red, {} weed, {} drop".format(
                            ter_name_short, st_m['n_small'], pct_f, st_m['n_off'],
                            st_m['n_red'], st_m['n_weed'], st_m['n_drop']))
                        red_o = 0.0
                        if st_m['area_kept_orig'] > 0:
                            red_o = 100.0 * (st_m['area_kept_orig'] - st_m['area_kept_fin']) / st_m['area_kept_orig']
                        log.append("  {} -> area manchas: {:.0f} m2 -> {:.0f} m2 (reduccion por offset: {:.2f}%)".format(
                            ter_name_short, st_m['area_kept_orig'], st_m['area_kept_fin'], red_o))
                        if off_pids:
                            ter_surf = tr2.GetObject(ter_id, OpenMode.ForWrite)
                            added = add_boundaries_from_polylines(tr2, ter_surf, off_pids, log)
                            boundaries_ok_tot += added
                            boundaries_fail_tot += max(0, len(off_pids) - added)
                            log.append("  {}: {} boundaries anyadidas".format(
                                ter_name_short, added))
                    except Exception as ex_t2:
                        log.append("  ERROR manchas terraplen Zona{:02d}: {}".format(
                            zn, ex_t2))
                        errors_count += 1

            tr2.Commit()
        finally:
            tr2.Dispose()
        _tlog("FASE 2 - manchas + limpieza + offset + boundaries", log)

        # ===================================================== #
        # FASE 3: Cambiar estilo de Volumen_MDT_ZonaXX a 'elevaciones'
        # ===================================================== #
        log.append("")
        log.append("--- FASE 3: estilo de Volumen_MDT ---")
        tr3 = db.TransactionManager.StartTransaction()
        try:
            # Buscar el estilo (prioridad al nombre exacto 'elevaciones')
            vol_style_id = find_style_id(cdoc, [
                "elevaciones",
                "Elevaciones",
                "ELEVACIONES",
                "Elevation Banding 2D",
                "Elevation Banding 3D",
            ])
            if vol_style_id is None:
                log.append("  AVISO: estilo 'elevaciones' no encontrado. "
                           "Se deja el estilo actual de cada volumen.")
            else:
                log.append("  Estilo 'elevaciones' localizado.")
                n_updated = 0
                for zn, vid in sorted(vol_by_zone.items()):
                    vname = "Volumen_MDT_Zona{:02d}".format(zn)
                    try:
                        vsurf = tr3.GetObject(vid, OpenMode.ForWrite)
                        vsurf.StyleId = vol_style_id
                        log.append("  OK {} -> estilo 'elevaciones'".format(vname))
                        n_updated += 1
                    except Exception as ex_s:
                        log.append("  ERROR {} al aplicar estilo: {}".format(
                            vname, ex_s))
                        errors_count += 1
                log.append("  Volumenes actualizados: {} de {}".format(
                    n_updated, len(vol_by_zone)))
            tr3.Commit()
        finally:
            tr3.Dispose()
        _tlog("FASE 3 - estilo Volumen_MDT", log)

        # ===================================================== #
        # FASE 4: Agrupaciones Desmonte_Total / Terraplen_Total + combinada
        # ===================================================== #
        # Jerarquia: zona -> agrupacion -> definitiva.
        #   1) Desmonte_Total  = paste de todos los Desmonte_ZonaXX
        #   2) Terraplen_Total = paste de todos los Terraplen_ZonaXX
        #   3) Combinada (IN[3]) = [MDT si IN[6]=S] + Desmonte_Total +
        #      Terraplen_Total -> MDT MODIFICADO.
        # JERARQUIA ESTRICTA: la combinada se construye SOLO con las dos
        # agrupaciones (+MDT). Las agrupaciones empiezan VACIAS (sin MDT
        # base) y los pegados zona->agrupacion fallan mas; se cubren con
        # reintento + ANTILOTERIA y con RONDAS adicionales (el estado del
        # destino cambia entre rondas y rebaraja el bug). Si tras las
        # rondas una agrupacion queda incompleta, NO se crea la combinada
        # (mejor fallo claro que jerarquia rota) y se listan las zonas
        # pendientes para subir IN[7] o re-ejecutar.
        log.append("")
        log.append("--- FASE 4: agrupaciones + superficie combinada ---")
        log.append("  Jerarquia: zona -> {} / {} -> '{}'".format(
            DES_TOTAL_NAME, TER_TOTAL_NAME, combined_name))
        log.append("  Modo  : {}".format(
            "MDT base + manchas (MDT MODIFICADO)" if pegar_mdt
            else "solo union de manchas"))
        if not combined_name:
            log.append("  AVISO: IN[3] vacio; se omite la superficie combinada.")
        else:
            def _crear_superficie(nombre):
                sid_new = None
                tr_cx = db.TransactionManager.StartTransaction()
                try:
                    try:
                        sid_new = TinSurface.Create(db, nombre)
                        sx = tr_cx.GetObject(sid_new, OpenMode.ForWrite)
                        if no_display_id is not None:
                            sx.StyleId = no_display_id
                        tr_cx.Commit()
                    except Exception as ex_cx:
                        log.append("  ERROR creando superficie '{}': {}".format(
                            nombre, str(ex_cx)[:140]))
                        sid_new = None
                finally:
                    tr_cx.Dispose()
                return sid_new

            def _rebuild_surf(sid_r, nombre):
                tr_rx = db.TransactionManager.StartTransaction()
                try:
                    try:
                        tr_rx.GetObject(sid_r, OpenMode.ForWrite).Rebuild()
                        log.append("  Rebuild de '{}' OK.".format(nombre))
                    except Exception as ex_rx:
                        log.append("  AVISO Rebuild '{}': {}".format(
                            nombre, str(ex_rx)[:110]))
                    tr_rx.Commit()
                finally:
                    tr_rx.Dispose()

            zonas_orden = sorted(set(list(des_ids.keys()) + list(ter_ids.keys())))
            RONDAS_MAX = 3   # rondas de pegado por agrupacion

            # 1) Agrupacion Desmonte_Total (debe quedar COMPLETA)
            log.append("  >> Agrupacion '{}'".format(DES_TOTAL_NAME))
            des_total_id = _crear_superficie(DES_TOTAL_NAME)
            pend_des = []
            if des_total_id is not None:
                items_des = [(des_ids.get(zn), "Desmonte_Zona{:02d}".format(zn), zn, "D")
                             for zn in zonas_orden if des_ids.get(zn) is not None]
                n_p, n_r, pend_des = pegar_grupo_rondas(
                    db, des_total_id, DES_TOTAL_NAME, items_des, RONDAS_MAX,
                    antilot_max, antilot_paso, deltas_zona, trk_ids,
                    des_ids, ter_ids, no_display_id, area_fin_surf,
                    extra_acum, log)
                pegadas_ok += n_p
                antilot_rescatadas += n_r
                _rebuild_surf(des_total_id, DES_TOTAL_NAME)

            # 2) Agrupacion Terraplen_Total (debe quedar COMPLETA)
            log.append("  >> Agrupacion '{}'".format(TER_TOTAL_NAME))
            ter_total_id = _crear_superficie(TER_TOTAL_NAME)
            pend_ter = []
            if ter_total_id is not None:
                items_ter = [(ter_ids.get(zn), "Terraplen_Zona{:02d}".format(zn), zn, "T")
                             for zn in zonas_orden if ter_ids.get(zn) is not None]
                n_p, n_r, pend_ter = pegar_grupo_rondas(
                    db, ter_total_id, TER_TOTAL_NAME, items_ter, RONDAS_MAX,
                    antilot_max, antilot_paso, deltas_zona, trk_ids,
                    des_ids, ter_ids, no_display_id, area_fin_surf,
                    extra_acum, log)
                pegadas_ok += n_p
                antilot_rescatadas += n_r
                _rebuild_surf(ter_total_id, TER_TOTAL_NAME)

            # 3) Combinada SOLO si ambas agrupaciones estan completas
            faltan = [s for (s, _z, _t) in (pend_des + pend_ter)]
            if des_total_id is None or ter_total_id is None or faltan:
                errors_count += max(len(faltan), 1)
                pegadas_fail += len(faltan)
                log.append("  ERROR: jerarquia estricta: agrupacion(es) incompleta(s); NO se crea '{}'.".format(
                    combined_name))
                if faltan:
                    log.append("  Zonas que no entraron en su agrupacion: {}".format(
                        ", ".join(faltan)))
                log.append("  Sugerencia: sube intentos de antiloteria (IN[7]) o re-ejecuta el script.")
            else:
                log.append("  >> Combinada '{}'".format(combined_name))
                comb_id = _crear_superficie(combined_name)
                if comb_id is not None:
                    items_comb = []
                    if pegar_mdt:
                        if mdt_surf_id is None:
                            log.append("  AVISO: MDT '{}' no encontrado; combinada sin base.".format(
                                mdt_surf_name))
                        else:
                            items_comb.append((mdt_surf_id,
                                               "{} (MDT base)".format(mdt_surf_name),
                                               None, None))
                    items_comb.append((des_total_id, DES_TOTAL_NAME, None, None))
                    items_comb.append((ter_total_id, TER_TOTAL_NAME, None, None))
                    n_p, _nr, pend_comb = pegar_grupo_rondas(
                        db, comb_id, combined_name, items_comb, 2,
                        0, antilot_paso, deltas_zona, trk_ids,
                        des_ids, ter_ids, no_display_id, area_fin_surf,
                        extra_acum, log)
                    pegadas_ok += n_p
                    for (s_c, _zc, _tc) in pend_comb:
                        log.append("  ERROR: '{}' no pego en la combinada; re-ejecuta o pega manualmente.".format(s_c))
                        pegadas_fail += 1
                        errors_count += 1
                    _rebuild_surf(comb_id, combined_name)
        _tlog("FASE 4 - agrupaciones + superficie combinada", log)

        # ===================================================== #
        # Resumen
        # ===================================================== #
        log.append("")
        log.append("=" * 50)
        n_zones = len(contours)
        expected = n_zones * 3
        log.append("RESUMEN")
        log.append("  Zonas procesadas : {}".format(n_zones))
        log.append("  Superficies OK   : {} de {}".format(
            len(created_names), expected))
        log.append("  ERRORES          : {}".format(errors_count))
        log.append("  Manchas: {} offset ({} con offset reducido), {} weed (sin separar), {} descartadas".format(
            manchas_offset, manchas_offset_red, manchas_conservadas, manchas_drop))
        pct_filtro_g = 0.0
        if area_manchas_tot > 0:
            pct_filtro_g = 100.0 * area_filtrada / area_manchas_tot
        log.append("  Filtro de area : {} manchas pequenyas eliminadas ({:.2f}% del area total de manchas)".format(
            manchas_small, pct_filtro_g))
        red_off_g = 0.0
        if area_off_orig > 0:
            red_off_g = 100.0 * (area_off_orig - area_off_fin) / area_off_orig
        log.append("  Offset manchas (FASE 2): area {:.0f} m2 -> {:.0f} m2 (reduccion: {:.2f}%)".format(
            area_off_orig, area_off_fin, red_off_g))
        area_real_fin = 0.0
        for _v_a in area_fin_surf.values():
            area_real_fin += _v_a
        if antilot_rescatadas > 0 and area_off_orig > 0 and area_real_fin > 0:
            red_real_g = 100.0 * (area_off_orig - area_real_fin) / area_off_orig
            log.append("  Area REAL final (post-rescates): {:.0f} m2 (reduccion total: {:.2f}%)".format(
                area_real_fin, red_real_g))
        log.append("  Antiloteria    : {} superficie(s) rescatada(s)".format(
            antilot_rescatadas))
        log.append("  Tiempo total     : {}".format(
            _fmt_hms(time.perf_counter() - _T_START)))
        log.append("")
        log.append("SIGUIENTE PASO (manual): en Prospector > Surfaces")
        log.append("crear una carpeta por zona (Zona01, Zona02, ...) y")
        log.append("arrastrar Trackers_ZonaXX, Desmonte_ZonaXX,")
        log.append("Terraplen_ZonaXX y Volumen_MDT_ZonaXX a cada una.")

    finally:
        dlock.Dispose()

    OUT = "\n".join(log)

except Exception as ex:
    log.append("")
    log.append("[tiempo] ABORTADO tras {}".format(_fmt_hms(time.perf_counter() - _T_START)))
    log.append("ERROR FATAL: {}".format(ex))
    log.append(traceback.format_exc())
    OUT = "\n".join(log)
# ----------------------------------------
watch = Watch(superficies_Zonas)
superficie_combinada = StringInput("MDT_Modificado")
offset_manchas_m = StringInput("0.10")
filtro_manchas_area_media = StringInput("10")
pegar_mdt_base_en_combinada_s_n = StringInput("S")
intentos_offset_0_off = StringInput("3")
paso_offset_m = StringInput("0.05")
extraer_log = Python(IN[0]=config_sombra)  # CPython3; graph output
# ---------- extraer_log.python (3 lines) ----------
# -*- coding: utf-8 -*-
# Extrae el log (indice 1) de la salida CONFIG para el Watch
OUT = IN[0][1] if IN[0] is not None else "(sin salida CONFIG)"
# ----------------------------------------
CONFIG_LOG = Watch(extraer_log)
cfg_resultados_vacio = StringInput("")
cfg_ok = BoolSelector(true)
cfg_auditoria_z = StringInput("N/A")
CIERRE = Python(IN[0]=cfg_fase, IN[1]=superficies_Zonas, IN[2]=cfg_resultados_vacio, IN[3]=cfg_ok, IN[4]=cfg_ok, IN[5]=cfg_auditoria_z, IN[6]=superficies_Zonas)  # CPython3
# ---------- CIERRE.python (79 lines) ----------
# -*- coding: utf-8 -*-
# NODO CIERRE: escribe estado_pipeline.json y el log en Logs/
import os
import sys
import importlib

# Localizador de pipeline.py sin rutas fijas. Orden:
#   1) instalado con instalar.bat (site-packages del Python de Dynamo)
#   2) variable de entorno PIPELINE_HOME
#   3) carpeta del proyecto (hasta 3 niveles sobre el DWG activo)
def _cargar_pipeline():
    probadas = []
    try:
        import pipeline as _m
        importlib.reload(_m)
        return _m, "pipeline.py: importado desde " + str(
            getattr(_m, "__file__", "?"))
    except ImportError:
        probadas.append("import directo (site-packages de Dynamo)")
    candidatas = []
    ph = os.environ.get("PIPELINE_HOME", "")
    if ph:
        candidatas.append(ph)
    try:
        import clr
        clr.AddReference("AcMgd")
        from Autodesk.AutoCAD.ApplicationServices import (
            Application as _A)
        _doc = _A.DocumentManager.MdiActiveDocument
        if _doc is not None:
            _c = os.path.dirname(os.path.abspath(str(_doc.Name)))
            for _ in range(3):
                candidatas.append(_c)
                _p = os.path.dirname(_c)
                if _p == _c:
                    break
                _c = _p
    except Exception as ex:
        probadas.append("DWG activo no disponible: " + str(ex)[:80])
    for _r in candidatas:
        probadas.append(_r)
        if _r and os.path.exists(os.path.join(_r, "pipeline.py")):
            if _r not in sys.path:
                sys.path.insert(0, _r)
            import pipeline as _m
            importlib.reload(_m)
            return _m, "pipeline.py: cargado desde " + _r
    log = ["KO: no se encontro pipeline.py. Rutas probadas:"]
    log += ["  - " + p for p in probadas]
    log.append("Solucion: doble clic en instalar.bat, o copia pipeline.py "
               "a la carpeta del proyecto (junto a config_proyecto.xlsx), "
               "o define la variable de entorno PIPELINE_HOME.")
    return None, "\n".join(log)


pipeline, _msg_carga = _cargar_pipeline()

if pipeline is None:
    OUT = [False, _msg_carga + "\n"
           + (str(IN[1]) if IN[1] is not None else "")]
else:
    def _abool(v):
        if isinstance(v, str):
            return v.strip().upper() in ("S", "SI", "TRUE", "1", "V")
        return bool(v)

    fase = str(IN[0])
    log_script = IN[1] if IN[1] is not None else ""
    resultados = IN[2]
    aplicado = _abool(IN[3]) if IN[3] is not None else False
    ok_script = _abool(IN[4]) if IN[4] is not None else True
    auditoria = str(IN[5]) if IN[5] is not None else "N/A"
    # IN[6]: barrera de sincronizacion (ignorada)

    OUT = pipeline.nodo_cierre(fase, log_script,
                               resultados=resultados,
                               aplicado=aplicado,
                               ok=ok_script,
                               auditoria_z=auditoria)
# ----------------------------------------
extraer_log_cierre = Python(IN[0]=CIERRE)  # CPython3; graph output; same code as extraer_log
CIERRE_LOG = Watch(extraer_log_cierre)
extraer_log_normalizar = Python(IN[0]=normalizar_geometria_line_pl2d)  # CPython3
# ---------- extraer_log_normalizar.python (2 lines) ----------
# Extrae el log (indice 0) de la salida del normalizador para el Watch
OUT = IN[0][0] if IN[0] is not None else "(sin salida)"
# ----------------------------------------
NORMALIZAR_LOG = Watch(extraer_log_normalizar)
