# Dynamo graph 6_DP_TablasExcel_v01.dyn "6_DP_TablasExcel_v06" (Dynamo 2.19.4.6671)
# Convertir tablas a formato Excel. Cuando se ejecute es necesario seleccionar las tablas. Inputs: Cualquier tabla CAD.

nombres_de_hojas_coma_opcional = StringInput("")
filtro_dxf_de_tablas = StringInput("AECC_*TABLE*,ACAD_TABLE")
fase = StringInput("6")
config_sombra = Python(IN[0]=fase)  # CPython3
# ---------- config_sombra.python (65 lines) ----------
# -*- coding: utf-8 -*-
# NODO CONFIG (modo sombra: valida y muestra la config; los parametros
# de este script vienen de los nodos CFG cableados a su salida)
import os
import sys
import importlib

# ---------------------------------------------------------------------------
# Localizador del modulo pipeline.py. Sin rutas escritas: prueba, en orden,
#   1) ya importable (instalado con instalar.bat en el Python de Dynamo)
#   2) variable de entorno PIPELINE_HOME (carpeta que contiene pipeline.py)
#   3) carpeta del proyecto: subiendo hasta 3 niveles desde el DWG activo
#      (el mismo criterio con el que se localiza config_proyecto.xlsx)
# Si ninguna funciona, OUT es un KO legible con las rutas probadas.
# ---------------------------------------------------------------------------
def _cargar_pipeline():
    probadas = []
    try:
        import pipeline as _m
        importlib.reload(_m)
        return _m, "pipeline.py: importado desde " + str(getattr(_m, "__file__", "?"))
    except ImportError:
        probadas.append("import directo (site-packages de Dynamo)")
    candidatas = []
    ph = os.environ.get("PIPELINE_HOME", "")
    if ph:
        candidatas.append(ph)
    try:
        import clr
        clr.AddReference("AcMgd")
        from Autodesk.AutoCAD.ApplicationServices import Application as _A
        _doc = _A.DocumentManager.MdiActiveDocument
        if _doc is not None:
            _c = os.path.dirname(os.path.abspath(str(_doc.Name)))
            for _ in range(3):
                candidatas.append(_c)
                _p = os.path.dirname(_c)
                if _p == _c:
                    break
                _c = _p
    except Exception as ex:
        probadas.append("DWG activo no disponible: " + str(ex)[:80])
    for _r in candidatas:
        probadas.append(_r)
        if _r and os.path.exists(os.path.join(_r, "pipeline.py")):
            if _r not in sys.path:
                sys.path.insert(0, _r)
            import pipeline as _m
            importlib.reload(_m)
            return _m, "pipeline.py: cargado desde " + _r
    log = ["KO: no se encontro pipeline.py. Rutas probadas:"]
    log += ["  - " + p for p in probadas]
    log.append("Solucion: doble clic en instalar.bat, o copia pipeline.py a la")
    log.append("carpeta del proyecto (junto a config_proyecto.xlsx), o define")
    log.append("la variable de entorno PIPELINE_HOME con su carpeta.")
    return None, "\n".join(log)


pipeline, _msg_carga = _cargar_pipeline()
if pipeline is None:
    OUT = [False, _msg_carga, "", ""]
else:
    FASE = "6"
    OUT = pipeline.nodo_config(FASE)
    OUT[1] = _msg_carga + "\n" + OUT[1]
# ----------------------------------------
cfg_hojas_nombres = Python(IN[0]=config_sombra)  # CPython3
# ---------- cfg_hojas_nombres.python (21 lines) ----------
# -*- coding: utf-8 -*-
# CFG parametro 'hojas_nombres' desde config (indice 4).
# Si la config es KO, BLOQUEA este parametro e incrusta la causa
# (las lineas KO/AVISO del log de config) en el propio error.
res = IN[0]
if ((not isinstance(res, list)) or len(res) <= 4
        or res[0] is not True):
    detalle = "el nodo de config no devolvio datos"
    try:
        lineas = str(res[1]).splitlines()
        malas = [l.strip() for l in lineas
                 if "KO" in l or "AVISO" in l]
        if malas:
            detalle = " | ".join(malas[-4:])
        elif lineas:
            detalle = " | ".join(
                l.strip() for l in lineas[-3:])
    except Exception:
        pass
    raise Exception("CONFIG KO -> " + detalle[:400])
OUT = res[4]
# ----------------------------------------
cfg_filtro_dxf = Python(IN[0]=config_sombra)  # CPython3
# ---------- cfg_filtro_dxf.python (21 lines) ----------
# -*- coding: utf-8 -*-
# CFG parametro 'filtro_dxf' desde config (indice 5).
# Si la config es KO, BLOQUEA este parametro e incrusta la causa
# (las lineas KO/AVISO del log de config) en el propio error.
res = IN[0]
if ((not isinstance(res, list)) or len(res) <= 5
        or res[0] is not True):
    detalle = "el nodo de config no devolvio datos"
    try:
        lineas = str(res[1]).splitlines()
        malas = [l.strip() for l in lineas
                 if "KO" in l or "AVISO" in l]
        if malas:
            detalle = " | ".join(malas[-4:])
        elif lineas:
            detalle = " | ".join(
                l.strip() for l in lineas[-3:])
    except Exception:
        pass
    raise Exception("CONFIG KO -> " + detalle[:400])
OUT = res[5]
# ----------------------------------------
tablas_excel = Python(IN[0]=cfg_hojas_nombres, IN[1]=cfg_filtro_dxf)  # CPython3
# ---------- tablas_excel.python (618 lines) ----------
# -*- coding: utf-8 -*-
# =============================================================================
# 6_TablasExcel.dyn - Exporta tablas seleccionadas de Civil 3D a Excel (v06)
# Civil 3D 2024 / Dynamo 2.19 / CPython3 (pythonnet 2.5)
#
# BASADO EN 0_DIAG_Tablas (2026-07): las AECC_LEGEND_TABLE no exponen API de
# celdas ([API-KO] LegendTable sin Rows/Columns/Cells). Via verificada:
# Explode EN MEMORIA (no destructivo) -> las Line forman la rejilla (bordes
# de filas/columnas) y los MText son el contenido -> asignacion geometrica
# de cada texto a su celda. Maneja columnas sin texto (p.ej. 'Color'=Hatch).
#
# ENTRADAS:
#   IN[0] = nombres de hojas separados por coma (opcional, "" = automatico).
#           Se asignan en ORDEN VISUAL: arriba->abajo, izquierda->derecha.
#   IN[1] = filtro DXF de seleccion (defecto "AECC_*TABLE*,ACAD_TABLE")
#
# SALIDA: Tablas_<dwg>_<timestamp>.xlsx junto al DWG.
#   - Una hoja por tabla (todo como TEXTO, decision de proyecto).
#   - Hoja 'Resumen' al final con FORMULAS VIVAS:
#       titulo  -> ='Hoja'!A1
#       sumas   -> =IFERROR(SUM('Hoja'!D3:D9),"") con numeros reales
#     (SUMPRODUCT(--()) convierte texto numerico a numero al recalcular)
#
# v06: motor Excel openpyxl embebido; sin dependencia de pipeline.py.
# USO: Run -> clic en AutoCAD -> seleccionar tablas -> Enter.
# =============================================================================

import clr
import os
import time
import traceback

clr.AddReference('AcMgd')
clr.AddReference('AcCoreMgd')
clr.AddReference('AcDbMgd')
try:
    clr.AddReference('AeccDbMgd')
except Exception:
    pass

from System import Array
from Autodesk.AutoCAD.ApplicationServices import Application as AcadApp
from Autodesk.AutoCAD.EditorInput import (PromptSelectionOptions,
                                          PromptStatus, SelectionFilter)
from Autodesk.AutoCAD.DatabaseServices import (OpenMode, DBObjectCollection,
                                               TypedValue)

L = []


def log(s):
    L.append(str(s))


NOMBRES_IN = str(IN[0] or "").strip()
FILTRO_IN  = str(IN[1] or "").strip() or "AECC_*TABLE*,ACAD_TABLE"

TOL_LINEA  = 0.001   # para decidir si una Line es vertical u horizontal
TOL_CLUST  = 0.05    # para fusionar bordes de rejilla casi identicos


# ------------------------------ geometria -----------------------------------

def texto_de(o):
    tn = type(o).__name__
    try:
        if tn == 'DBText':
            return (o.Position.X, o.Position.Y, str(o.TextString))
        if tn == 'MText':
            try:
                s = o.Text
            except Exception:
                s = o.Contents
            return (o.Location.X, o.Location.Y, str(s))
    except Exception:
        return None
    return None


def extraer_tabla(ent):
    """Explode en memoria 2 niveles. Devuelve (xs_col, ys_fila_desc,
    textos[(x,y,s)], avisos[])."""
    avisos = []
    creados = []
    xs_v, ys_h, textos = [], [], []
    try:
        objs = DBObjectCollection()
        ent.Explode(objs)
        pool = []
        en = objs.GetEnumerator()
        while en.MoveNext():
            pool.append(en.Current)
        creados.extend(pool)
        extra = []
        for o in pool:
            tn = type(o).__name__
            if 'Block' in tn or 'Table' in tn:
                try:
                    o2 = DBObjectCollection()
                    o.Explode(o2)
                    e2 = o2.GetEnumerator()
                    while e2.MoveNext():
                        extra.append(e2.Current)
                except Exception as ex:
                    avisos.append("nivel2 KO en {}: {}".format(
                        tn, str(ex)[:60]))
        creados.extend(extra)
        for o in pool + extra:
            tn = type(o).__name__
            if tn == 'Line':
                try:
                    p1, p2 = o.StartPoint, o.EndPoint
                    if abs(p1.X - p2.X) < TOL_LINEA:
                        xs_v.append(p1.X)
                    elif abs(p1.Y - p2.Y) < TOL_LINEA:
                        ys_h.append(p1.Y)
                except Exception as ex:
                    avisos.append("Line KO: " + str(ex)[:60])
            else:
                t = texto_de(o)
                if t is not None:
                    textos.append(t)
    except Exception as ex:
        avisos.append("[KO] Explode: " + str(ex)[:150])
    finally:
        for o in creados:
            try:
                o.Dispose()
            except Exception:
                pass
    return (agrupa(xs_v), agrupa(ys_h, desc=True), textos, avisos)


def agrupa(vals, desc=False):
    """Fusiona valores casi identicos (tolerancia TOL_CLUST) y ordena."""
    if not vals:
        return []
    vals = sorted(vals)
    grupos = [[vals[0]]]
    for v in vals[1:]:
        if v - grupos[-1][-1] <= TOL_CLUST:
            grupos[-1].append(v)
        else:
            grupos.append([v])
    bordes = [sum(g) / len(g) for g in grupos]
    return sorted(bordes, reverse=desc)


def idx_col(x, xs):
    for j in range(len(xs) - 1):
        if xs[j] <= x <= xs[j + 1]:
            return j
    return None


def idx_fila(y, ys_desc):
    for i in range(len(ys_desc) - 1):
        if ys_desc[i] >= y >= ys_desc[i + 1]:
            return i
    return None


def montar_matriz(xs, ys, textos, avisos):
    """Matriz filas x columnas por asignacion geometrica a la rejilla."""
    ncol = max(0, len(xs) - 1)
    nfil = max(0, len(ys) - 1)
    if ncol < 1 or nfil < 1:
        avisos.append("rejilla insuficiente ({} col, {} fil): fallback"
                      " por agrupamiento de textos".format(ncol, nfil))
        return montar_matriz_fallback(textos, avisos)
    M = [["" for _ in range(ncol)] for _ in range(nfil)]
    fuera = 0
    for x, y, s in textos:
        i, j = idx_fila(y, ys), idx_col(x, xs)
        if i is None or j is None:
            fuera += 1
            continue
        M[i][j] = (M[i][j] + " " + s).strip() if M[i][j] else s
    if fuera:
        avisos.append("{} textos fuera de rejilla (ignorados)".format(fuera))
    return M


def montar_matriz_fallback(textos, avisos):
    """Sin rejilla: filas por Y agrupada, columnas por orden X. Menos fiable
    (columnas vacias se pierden); se avisa en el log."""
    if not textos:
        return []
    ys = agrupa([t[1] for t in textos], desc=True)
    filas = {}
    for x, y, s in textos:
        i = min(range(len(ys)), key=lambda k: abs(ys[k] - y))
        filas.setdefault(i, []).append((x, s))
    M = []
    for i in sorted(filas):
        M.append([s for x, s in sorted(filas[i])])
    ancho = max(len(f) for f in M)
    for f in M:
        f.extend([""] * (ancho - len(f)))
    avisos.append("fallback aplicado: revisar alineacion de columnas")
    return M


def separa_titulo(M):
    """Si la 1a fila tiene un unico texto -> es el titulo."""
    if M and sum(1 for c in M[0] if c) == 1:
        titulo = next(c for c in M[0] if c)
        return titulo, M[1:]
    return "", M


# ------------------------------ excel ----------------------------------------

INVALIDOS = set('[]:*?/\\')


def hoja_nombre(nm, usados):
    s = "".join(c for c in nm if c not in INVALIDOS).strip() or "TABLA"
    s = s[:31]
    base, j = s, 2
    while s.upper() in usados:
        suf = "_" + str(j)
        s = base[:31 - len(suf)] + suf
        j += 1
    usados.add(s.upper())
    return s


def ref_hoja(nombre):
    return "'" + nombre.replace("'", "''") + "'"


def run():
    t0 = time.perf_counter()
    log("=== Script 6: Tablas de Civil 3D -> Excel (v01) ===")
    log("filtro DXF: " + FILTRO_IN)
    if NOMBRES_IN:
        log("nombres de hoja manuales: " + NOMBRES_IN)
    log("")

    doc = AcadApp.DocumentManager.MdiActiveDocument
    ed = doc.Editor
    db = doc.Database

    # ---- 1) seleccion con filtro, ANTES de LockDocument ----
    log(">> Cambia a AutoCAD y selecciona las tablas...")
    opts = PromptSelectionOptions()
    opts.MessageForAdding = "\nSelecciona las tablas a exportar"
    try:
        filtro = SelectionFilter(
            Array[TypedValue]([TypedValue(0, FILTRO_IN)]))
        psr = ed.GetSelection(opts, filtro)
    except Exception as ex:
        log("[KO] GetSelection: " + str(ex)[:200])
        return
    t_sel = time.perf_counter()
    if psr.Status != PromptStatus.OK:
        log("Seleccion cancelada o sin tablas (status: {}).".format(
            psr.Status))
        return
    ids = list(psr.Value.GetObjectIds())
    log("Tablas seleccionadas (tras filtro): {}".format(len(ids)))
    log("")

    # ---- 2) extraccion bajo lock + transaccion (solo lectura) ----
    tablas = []   # dicts: titulo, M, anchor(x,y), display, handle
    dlock = doc.LockDocument()
    try:
        tr = db.TransactionManager.StartTransaction()
        try:
            for k, oid in enumerate(ids):
                try:
                    ent = tr.GetObject(oid, OpenMode.ForRead)
                except Exception as ex:
                    log("[{}] [KO] GetObject: {}".format(k, str(ex)[:120]))
                    continue
                disp = ""
                try:
                    disp = str(ent.DisplayName or "")
                except Exception as ex:
                    log("[{}] DisplayName no legible: {}".format(
                        k, str(ex)[:60]))
                xs, ys, textos, avisos = extraer_tabla(ent)
                M = montar_matriz(xs, ys, textos, avisos)
                titulo, cuerpo = separa_titulo(M)
                if not cuerpo:
                    log("[{}] handle {}: SIN CONTENIDO legible, se salta"
                        .format(k, ent.Handle))
                    for a in avisos:
                        log("    aviso: " + a)
                    continue
                ax = min((t[0] for t in textos), default=0.0)
                ay = max((t[1] for t in textos), default=0.0)
                tablas.append({"titulo": titulo, "M": cuerpo,
                               "x": ax, "y": ay, "disp": disp,
                               "handle": str(ent.Handle)})
                log("[{}] handle {}: {} filas x {} col | titulo '{}'"
                    " | DisplayName '{}'".format(
                        k, ent.Handle, len(cuerpo),
                        len(cuerpo[0]) if cuerpo else 0,
                        titulo[:30], disp[:30]))
                for a in avisos:
                    log("    aviso: " + a)
            tr.Commit()
        finally:
            tr.Dispose()
    finally:
        dlock.Dispose()
    t_ext = time.perf_counter()

    if not tablas:
        log("")
        log("Sin tablas legibles: no se genera Excel.")
        return

    # ---- 3) orden visual: arriba->abajo, izquierda->derecha ----
    tablas.sort(key=lambda t: (-round(t["y"], 2), round(t["x"], 2)))

    # ---- 4) nombres de hoja ----
    manuales = [s.strip() for s in NOMBRES_IN.split(",") if s.strip()] \
        if NOMBRES_IN else []
    if manuales and len(manuales) != len(tablas):
        log("")
        log("AVISO: {} nombres para {} tablas; se asignan en orden y el"
            " resto automatico.".format(len(manuales), len(tablas)))
    usados = set()
    disps = [t["disp"] for t in tablas]
    disp_utiles = (all(disps) and len(set(disps)) == len(disps))
    for i, t in enumerate(tablas):
        if i < len(manuales):
            base = manuales[i]
        elif disp_utiles:
            base = t["disp"]
        else:
            base = (t["titulo"] or "Tabla") + "_" + str(i + 1).zfill(2)
        t["hoja"] = hoja_nombre(base, usados)
    if not manuales:
        log("nombres de hoja automaticos ({}).".format(
            "DisplayName" if disp_utiles else "titulo+correlativo"))

    # ---- 5) escribir excel ----
    log("")
    try:
        # Motor Excel embebido sobre openpyxl (v06). Misma interfaz que el
        # antiguo XLibro/XHoja para no tocar el bloque de escritura.
        # El Script 6 NO depende de pipeline.py.
        import openpyxl as _ox
        from openpyxl.styles import (Font as _Font, PatternFill as _Fill,
                                     Border as _Border, Side as _Side,
                                     Alignment as _Al)
        from openpyxl.utils import get_column_letter as _gcl
        log("motor Excel: openpyxl " + str(getattr(_ox, "__version__", "?")))

        class _XHoja(object):
            def __init__(self, ws):
                self.ws = ws

            def escribir(self, fila, col, valor, fill=None, font=None,
                         borde=False, centro=False, numfmt=None):
                c = self.ws.cell(row=fila, column=col)
                if valor is not None:
                    c.value = valor
                if fill:
                    c.fill = _Fill("solid", fgColor=fill)
                if font:
                    c.font = _Font(bold=bool(font.get("bold", False)),
                                   color=font.get("color"))
                if borde:
                    s = _Side(style="thin")
                    c.border = _Border(left=s, right=s, top=s, bottom=s)
                if centro:
                    c.alignment = _Al(horizontal="center",
                                      vertical="center", wrap_text=True)
                if numfmt:
                    c.number_format = numfmt

            def combinar(self, r1, c1, r2, c2):
                self.ws.merge_cells(start_row=r1, start_column=c1,
                                    end_row=r2, end_column=c2)

            def ancho(self, col, w):
                self.ws.column_dimensions[_gcl(col)].width = w

        class _XLibro(object):
            def __init__(self):
                self.wb = _ox.Workbook()
                self.wb.remove(self.wb.active)

            def nueva(self, nombre):
                return _XHoja(self.wb.create_sheet(nombre))

            def guardar(self, ruta):
                self.wb.save(ruta)

        class _lk(object):
            XLibro = _XLibro
            _x_col = staticmethod(_gcl)

        F_NEGRITA = {"bold": True}
        F_BLANCA = {"bold": True, "color": "FFFFFF"}
        C_GRIS, C_VERDE, C_ROJO = "D9D9D9", "00B050", "C00000"
        lb = _lk.XLibro()

        def _num(x):
            s = str(x).strip().replace(" ", "")
            if s.count(",") == 1 and s.count(".") == 0:
                s = s.replace(",", ".")
            try:
                f = float(s)
            except Exception:
                return None
            if "." not in s and "e" not in s.lower():
                return int(f)
            return f

        for t in tablas:
            M = t["M"]
            ncol = len(M[0])
            hx = lb.nueva(t["hoja"])
            hx.escribir(1, 1, (t["titulo"] or t["hoja"]), fill=C_GRIS,
                        font=F_NEGRITA, borde=True, centro=True)
            for ci in range(2, ncol + 1):
                hx.escribir(1, ci, None, fill=C_GRIS, borde=True)
            hx.combinar(1, 1, 1, ncol)
            cabx = [str(x).strip().lower() for x in M[0]]
            i_min = (cabx.index("minimum elevation")
                     if "minimum elevation" in cabx else None)
            i_max = (cabx.index("maximum elevation")
                     if "maximum elevation" in cabx else None)
            i_col = cabx.index("color") if "color" in cabx else None
            n_d = n_t = 0
            for fi, fila in enumerate(M, start=2):
                for ci, v in enumerate(fila, start=1):
                    nv = _num(v) if fi > 2 else None
                    hx.escribir(fi, ci,
                                nv if nv is not None else str(v),
                                borde=True, centro=True,
                                numfmt=("0.00" if isinstance(nv, float)
                                        else None),
                                fill=C_GRIS if fi == 2 else None,
                                font=F_NEGRITA if fi == 2 else None)
                if (fi > 2 and i_col is not None
                        and i_min is not None and i_max is not None):
                    try:
                        vmin = float(str(fila[i_min])
                                     .replace(",", "."))
                        vmax = float(str(fila[i_max])
                                     .replace(",", "."))
                    except Exception:
                        vmin = None
                    if vmin is not None:
                        if vmax <= 0:
                            hx.escribir(fi, i_col + 1, "Terraplen",
                                        fill=C_VERDE, font=F_BLANCA,
                                        borde=True, centro=True)
                            n_t += 1
                        elif vmin >= 0:
                            hx.escribir(fi, i_col + 1, "Desmonte",
                                        fill=C_ROJO, font=F_BLANCA,
                                        borde=True, centro=True)
                            n_d += 1
            for ci in range(1, ncol + 1):
                ancho = max([len(str(f[ci - 1]))
                             for f in M] + [8]) + 4
                hx.ancho(ci, min(ancho, 28))
            t["nfilas"] = len(M) - 1      # filas de datos
            t["cab"] = [str(x).strip() for x in M[0]]
            log("hoja '{}': {} filas de datos x {} col".format(
                t["hoja"], t["nfilas"], ncol))
            if n_d or n_t:
                log("  color: {} desmonte (rojo) / {} terraplen "
                    "(verde)".format(n_d, n_t))

        # ---- hoja Resumen con formulas vivas ----
        ref_cab = tablas[0]["cab"]
        cab_low = [(x or "").strip().lower() for x in ref_cab]
        es_elev = ("minimum elevation" in cab_low
                   and "maximum elevation" in cab_low
                   and "volumen" in cab_low)
        hr = lb.nueva("Resumen")
        if es_elev:
            CAB = ["Hoja", "Titulo", "Suma Area", "Suma desmonte",
                   "Suma terraplen", "Ratio D/T"]
            metas = ["hoja", "titulo", "suma:area", "desm", "terr",
                     "ratio"]
        else:
            CAB = ["Hoja", "Titulo", "Filas"]
            metas = ["hoja", "titulo", "filas"]
            for j, x in enumerate(ref_cab):
                hl = (x or "").strip().lower()
                if hl == "color":
                    continue
                CAB.append("Suma " + (x or "Col" + str(j + 1)))
                metas.append("suma:" + hl)
        hr.escribir(1, 1, "Resumen de tablas", fill=C_GRIS,
                    font=F_NEGRITA, borde=True, centro=True)
        for ci in range(2, len(CAB) + 1):
            hr.escribir(1, ci, None, fill=C_GRIS, borde=True)
        hr.combinar(1, 1, 1, len(CAB))
        for ci, txt in enumerate(CAB, start=1):
            hr.escribir(2, ci, txt, fill=C_GRIS, font=F_NEGRITA,
                        borde=True, centro=True)
        for fi, t in enumerate(tablas, start=3):
            rh = ref_hoja(t["hoja"])
            n = t["nfilas"]
            fin = 2 + n
            cabt = [x.lower() for x in t["cab"]]

            def _col(nom):
                return (_lk._x_col(cabt.index(nom) + 1)
                        if nom in cabt else None)

            vals = [t["hoja"], "={}!A1".format(rh)]
            for tag in metas[2:]:
                if tag == "filas":
                    vals.append(n)
                elif tag in ("desm", "terr"):
                    cmin = _col("minimum elevation")
                    cmax = _col("maximum elevation")
                    cvol = _col("volumen")
                    if n > 0 and cmin and cmax and cvol:
                        cs, op = ((cmin, ">=") if tag == "desm"
                                  else (cmax, "<="))
                        vals.append(
                            '=IFERROR(SUMPRODUCT(({0}!{1}3:{1}{3}'
                            '{4}0)*({0}!{2}3:{2}{3})),"")'
                            .format(rh, cs, cvol, fin, op))
                    else:
                        vals.append("")
                elif tag == "ratio":
                    cd = _lk._x_col(len(vals) - 1)
                    ct = _lk._x_col(len(vals))
                    vals.append('=IFERROR({0}{2}/{1}{2},"")'
                                .format(cd, ct, fi))
                else:
                    nom = tag.split(":", 1)[1]
                    col = _col(nom)
                    if n > 0 and col:
                        vals.append(
                            '=IFERROR(SUM({0}!{1}3:{1}{2}),"")'
                            .format(rh, col, fin))
                    else:
                        vals.append("")
            for ci, v in enumerate(vals, start=1):
                hr.escribir(fi, ci, v, borde=True, centro=True,
                            numfmt=("0.00" if isinstance(v, str)
                                    and v.startswith("=IFERROR(SUM")
                                    else None))
        fi_tot = 3 + len(tablas)
        pos_desm = (metas.index("desm") + 1 if "desm" in metas
                    else None)
        for ci, tag in enumerate(metas, start=1):
            letra = _lk._x_col(ci)
            v_tot = None
            if tag == "titulo":
                v_tot = "TOTAL"
            elif tag in ("desm", "terr") or tag == "suma:area":
                v_tot = "=SUM({0}3:{0}{1})".format(letra, fi_tot - 1)
            elif tag == "ratio" and pos_desm:
                v_tot = ('=IFERROR({0}{2}/{1}{2},"")'
                         .format(_lk._x_col(pos_desm),
                                 _lk._x_col(pos_desm + 1), fi_tot))
            hr.escribir(fi_tot, ci, v_tot, fill=C_GRIS,
                        font=F_NEGRITA, borde=True, centro=True,
                        numfmt=("0.00" if tag != "titulo" and v_tot
                                else None))
        for ci in range(1, len(CAB) + 1):
            hr.ancho(ci, 16)
        hr.ancho(1, 24)
        hr.ancho(2, 24)
        log("hoja 'Resumen': {} filas + TOTAL, formulas vivas"
            .format(len(tablas)))
        if es_elev:
            log("  desglose desmonte/terraplen + Ratio D/T por tabla "
                "y global (numeros reales, sin coercion)")

        # ---- guardar junto al DWG ----
        try:
            ruta_dwg = str(db.Filename)
        except Exception:
            ruta_dwg = str(doc.Name)
        dwg_dir = os.path.dirname(ruta_dwg)
        dwg_base = os.path.splitext(os.path.basename(ruta_dwg))[0]
        if not os.path.isdir(dwg_dir):
            dwg_dir = os.environ.get("TEMP", ".")
            log("AVISO: DWG sin ruta valida, se guarda en " + dwg_dir)
        ts = time.strftime("%Y%m%d_%H%M")
        ruta = os.path.join(dwg_dir,
                            "Tablas_" + dwg_base + "_" + ts + ".xlsx")
        try:
            lb.guardar(ruta)
            log("")
            log("Excel generado: " + ruta)
        except Exception as ex:
            log("")
            log("[KO] no se pudo guardar el Excel (abierto? OneDrive"
                " bloqueado?): " + str(ex)[:160])
    except Exception as ex:
        log("[KO] generacion Excel: " + str(ex)[:160])
        log(traceback.format_exc()[:600])
    t_xls = time.perf_counter()

    log("")
    log("==== RESUMEN DE TIEMPOS ====")
    log("{:<27}{:>7.2f} s".format("seleccion", t_sel - t0))
    log("{:<27}{:>7.2f} s".format("extraccion", t_ext - t_sel))
    log("{:<27}{:>7.2f} s".format("excel", t_xls - t_ext))
    log("{:<27}{:>7.2f} s".format("TOTAL", t_xls - t0))
    log("=== FIN ===")


try:
    run()
except Exception:
    log("[KO] excepcion no controlada:")
    log(traceback.format_exc()[:1200])

OUT = "\n".join(L)
# ----------------------------------------
log = Watch(tablas_excel)
config_log_extraer = Python(IN[0]=config_sombra)  # CPython3; graph output
# ---------- config_log_extraer.python (3 lines) ----------
# -*- coding: utf-8 -*-
# Extrae el log (indice 1) de la salida CONFIG/CIERRE para el Watch
OUT = IN[0][1] if IN[0] is not None else "(sin salida CONFIG/CIERRE)"
# ----------------------------------------
CONFIG_LOG = Watch(config_log_extraer)
resultados_vacio = StringInput("")
ok = BoolSelector(true)
auditoria_z = StringInput("N/A")
CIERRE = Python(IN[0]=fase, IN[1]=tablas_excel, IN[2]=resultados_vacio, IN[3]=ok, IN[4]=ok, IN[5]=auditoria_z, IN[6]=tablas_excel)  # CPython3
# ---------- CIERRE.python (80 lines) ----------
# -*- coding: utf-8 -*-
# NODO CIERRE: escribe estado_pipeline.json y el log en Logs/
import os
import sys
import importlib

# ---------------------------------------------------------------------------
# Localizador del modulo pipeline.py. Sin rutas escritas: prueba, en orden,
#   1) ya importable (instalado con instalar.bat en el Python de Dynamo)
#   2) variable de entorno PIPELINE_HOME (carpeta que contiene pipeline.py)
#   3) carpeta del proyecto: subiendo hasta 3 niveles desde el DWG activo
#      (el mismo criterio con el que se localiza config_proyecto.xlsx)
# Si ninguna funciona, OUT es un KO legible con las rutas probadas.
# ---------------------------------------------------------------------------
def _cargar_pipeline():
    probadas = []
    try:
        import pipeline as _m
        importlib.reload(_m)
        return _m, "pipeline.py: importado desde " + str(getattr(_m, "__file__", "?"))
    except ImportError:
        probadas.append("import directo (site-packages de Dynamo)")
    candidatas = []
    ph = os.environ.get("PIPELINE_HOME", "")
    if ph:
        candidatas.append(ph)
    try:
        import clr
        clr.AddReference("AcMgd")
        from Autodesk.AutoCAD.ApplicationServices import Application as _A
        _doc = _A.DocumentManager.MdiActiveDocument
        if _doc is not None:
            _c = os.path.dirname(os.path.abspath(str(_doc.Name)))
            for _ in range(3):
                candidatas.append(_c)
                _p = os.path.dirname(_c)
                if _p == _c:
                    break
                _c = _p
    except Exception as ex:
        probadas.append("DWG activo no disponible: " + str(ex)[:80])
    for _r in candidatas:
        probadas.append(_r)
        if _r and os.path.exists(os.path.join(_r, "pipeline.py")):
            if _r not in sys.path:
                sys.path.insert(0, _r)
            import pipeline as _m
            importlib.reload(_m)
            return _m, "pipeline.py: cargado desde " + _r
    log = ["KO: no se encontro pipeline.py. Rutas probadas:"]
    log += ["  - " + p for p in probadas]
    log.append("Solucion: doble clic en instalar.bat, o copia pipeline.py a la")
    log.append("carpeta del proyecto (junto a config_proyecto.xlsx), o define")
    log.append("la variable de entorno PIPELINE_HOME con su carpeta.")
    return None, "\n".join(log)


pipeline, _msg_carga = _cargar_pipeline()
if pipeline is None:
    OUT = [False, _msg_carga + "\n" + (str(IN[1]) if IN[1] is not None else "")]
else:
    def _abool(v):
        # Acepta booleanos y toggles en texto ("S"/"N", "SI", "TRUE", "1")
        if isinstance(v, str):
            return v.strip().upper() in ("S", "SI", "TRUE", "1", "V")
        return bool(v)

    fase = str(IN[0])
    log_script = IN[1] if IN[1] is not None else ""
    resultados = IN[2]
    aplicado = _abool(IN[3]) if IN[3] is not None else False
    ok_script = _abool(IN[4]) if IN[4] is not None else True
    auditoria = str(IN[5]) if IN[5] is not None else "N/A"
    # IN[6]: barrera de sincronizacion (ignorada)

    OUT = pipeline.nodo_cierre(fase, log_script,
                               resultados=resultados,
                               aplicado=aplicado,
                               ok=ok_script,
                               auditoria_z=auditoria)
# ----------------------------------------
cierre_log_extraer = Python(IN[0]=CIERRE)  # CPython3; graph output; same code as config_log_extraer
CIERRE_LOG = Watch(cierre_log_extraer)
