# Dynamo graph PerfilesRasantesCorredores.dyn "Rasante_y_Corredores" (Dynamo 2.19.4.6671)
# Rasante_Viales (Paso 1-3) + Create_Corridors. Primero crea perfiles TN, ProfileViews y rasantes RAS <aname>, luego crea los corredores de caminos con la rasante de cada eje, asigna el MDT como target y construye las superficies TOP y DATUM con boundaries shrinkwrap.

# group: PASO 1 - Crear perfiles TN sobre cada eje
n01_capa_de_ejes = StringInput("C-ROAD")  # "01 Capa de ejes"; graph input
n02_superficie_tn = StringInput("MDT_IND-Formaciones_CVL")  # "02 Superficie TN"; graph input
n03_estilo_perfil_tn = StringInput("Existing Ground (Lynka)")  # "03 Estilo perfil TN"; graph input
paso_1_crear_perfiles_tn = Python(IN[0]=n01_capa_de_ejes, IN[1]=n02_superficie_tn, IN[2]=n03_estilo_perfil_tn)  # CPython3
# ---------- paso_1_crear_perfiles_tn.python (368 lines) ----------
# -*- coding: utf-8 -*-
# =============================================================================
# Rasante_Viales_Parte1.dyn - Representar ejes existentes con TN
#
# Los alignments ya estan creados en el dibujo. Este nodo:
#   1. Busca todos los alignments cuya capa coincida con la indicada
#   2. Para cada uno, crea (o regenera) un perfil TN muestreando la superficie
#   3. El perfil se llama "TN_<nombre_del_alignment>"
#
# Si al re-ejecutar ya existe un perfil con ese nombre, lo borra antes de
# crear el nuevo (idempotente).
#
# ENTRADAS:
#   IN[0] : str  Capa de los ejes (e.g. "EJES"). Vacio = todos los alignments
#   IN[1] : str  Nombre de la superficie TN (MDT)
#   IN[2] : str  Nombre del estilo de perfil TN (e.g. "Existing Ground (Lynka)")
#
# SALIDA (lista de 3 elementos):
#   [0] list[str]  nombres de los alignments procesados
#   [1] list[str]  nombres de los perfiles TN creados
#   [2] list[str]  log / diagnostico
# =============================================================================

import clr
import traceback

clr.AddReference("AcMgd")
clr.AddReference("AcDbMgd")
clr.AddReference("AcCoreMgd")
clr.AddReference("AeccDbMgd")

from System import String as SysString
from Autodesk.AutoCAD.ApplicationServices import Application
from Autodesk.AutoCAD.DatabaseServices import (
    OpenMode, ObjectId, LayerTableRecord
)
from Autodesk.Civil.ApplicationServices import CivilApplication
from Autodesk.Civil.DatabaseServices import Profile

layer_name    = str(IN[0]) if IN[0] else ""
surface_name  = str(IN[1]) if IN[1] else ""
tn_style_name = str(IN[2]) if IN[2] else ""
tn_prefix     = "TN_"
profile_layer = "0"          # capa por defecto para el perfil

log = []
alignments_found  = []
profiles_created  = []


def get_name_safe(obj):
    try:
        return obj.Name
    except Exception:
        return None


def ensure_layer(tr, db, name):
    """Busca/crea la capa indicada y devuelve su ObjectId."""
    lt = tr.GetObject(db.LayerTableId, OpenMode.ForRead)
    try:
        if lt.Has(name):
            return lt.get_Item(name)
    except Exception:
        pass
    try:
        lt.UpgradeOpen()
        ltr = LayerTableRecord()
        ltr.Name = name
        lid = lt.Add(ltr)
        tr.AddNewlyCreatedDBObject(ltr, True)
        return lid
    except Exception:
        try:
            return lt.get_Item("0")
        except Exception:
            return ObjectId.Null


def find_surface_by_name(cdoc, tr, name):
    """Busca una superficie por nombre exacto. Devuelve el objeto Surface o None."""
    try:
        sids = cdoc.GetSurfaceIds()
        for i in range(sids.Count):
            try:
                sid = sids.get_Item(i)
            except Exception:
                try:
                    sid = sids[i]
                except Exception:
                    continue
            try:
                surf = tr.GetObject(sid, OpenMode.ForRead)
                if get_name_safe(surf) == name:
                    return surf
            except Exception:
                pass
    except Exception:
        pass
    return None


def default_style_id(styles_col):
    try:
        if styles_col.Count > 0:
            try:
                return styles_col.get_Item(0)
            except Exception:
                return styles_col[0]
    except Exception:
        pass
    return ObjectId.Null


def get_profile_label_set_id(cdoc, tr):
    """Devuelve un ObjectId valido de ProfileLabelSetStyle. Civil 3D NO
    acepta ObjectId.Null para este parametro al crear un Profile, asi que
    siempre hay que darle uno. Preferimos uno con nombre estandar; si no,
    el primero disponible por indice."""
    try:
        coll = cdoc.Styles.LabelSetStyles.ProfileLabelSetStyles
    except Exception:
        return ObjectId.Null

    # Nombres tipicos de label sets "vacios" en plantillas Civil 3D
    for candidate in ("_No Labels", "No Labels", "_Sin etiquetas", "Standard"):
        # Metodo 1: get_Item(string)
        try:
            oid = coll.get_Item(candidate)
            if oid is not None and not oid.IsNull:
                return oid
        except Exception:
            pass
        # Metodo 2: indexer corchetes
        try:
            oid = coll[candidate]
            if oid is not None and not oid.IsNull:
                return oid
        except Exception:
            pass

    # Fallback: primer item por indice
    try:
        oid = coll.get_Item(0)
        if oid is not None and not oid.IsNull:
            return oid
    except Exception:
        pass

    # Fallback: iterar y tomar el primero
    try:
        for oid in coll:
            if oid is not None and not oid.IsNull:
                return oid
    except Exception:
        pass

    return ObjectId.Null


def find_profile_style_by_name(cdoc, tr, name, log):
    """Busca un estilo de Profile por nombre. Usa los 4 metodos en cascada
    (get_Item string, indexer, reflection, iter) para evitar el bug de
    pythonnet que impide leer .Name en objetos Style de Civil 3D."""
    if not name:
        return ObjectId.Null

    wanted = name.strip()
    try:
        coll = cdoc.Styles.ProfileStyles
    except Exception:
        return ObjectId.Null

    # Metodo 1: get_Item(string) - indexer .NET con clave string
    try:
        sid = coll.get_Item(wanted)
        if sid is not None and not sid.IsNull:
            log.append("Estilo perfil TN encontrado (get_Item): '{}'"
                       .format(wanted))
            return sid
    except Exception:
        pass

    # Metodo 2: indexer Python con corchetes
    try:
        sid = coll[wanted]
        if sid is not None and not sid.IsNull:
            log.append("Estilo perfil TN encontrado (indexer): '{}'"
                       .format(wanted))
            return sid
    except Exception:
        pass

    # Metodo 3: reflexion explicita
    try:
        ct = clr.GetClrType(coll.GetType())
        gi = ct.GetMethod("get_Item", [clr.GetClrType(SysString)])
        if gi is not None:
            sid = gi.Invoke(coll, [wanted])
            if sid is not None and not sid.IsNull:
                log.append("Estilo perfil TN encontrado (reflection): '{}'"
                           .format(wanted))
                return sid
    except Exception:
        pass

    # Metodo 4: iterar (bare except por el bug de .Name)
    try:
        for stid in coll:
            try:
                st = tr.GetObject(stid, OpenMode.ForRead)
                try:
                    nm = st.Name
                    if nm and nm.strip().lower() == wanted.lower():
                        log.append("Estilo perfil TN encontrado (iter): '{}'"
                                   .format(nm))
                        return stid
                except:
                    pass
            except Exception:
                pass
    except Exception:
        pass

    return ObjectId.Null


# ═══════════════════════════════════════════════════════════════════════
# Proceso
# ═══════════════════════════════════════════════════════════════════════

doc = Application.DocumentManager.MdiActiveDocument
db  = doc.Database

lck = None
tr  = None

try:
    lck = doc.LockDocument()
    tr  = db.TransactionManager.StartTransaction()

    cdoc = CivilApplication.ActiveDocument

    # ── Encontrar superficie ──────────────────────────────────────
    surface = find_surface_by_name(cdoc, tr, surface_name)
    if surface is None:
        log.append("ERROR: Superficie '{}' no encontrada".format(surface_name))
        # Listar superficies disponibles para diagnostico
        try:
            sids = cdoc.GetSurfaceIds()
            names = []
            for i in range(sids.Count):
                try:
                    sid = sids.get_Item(i)
                    s = tr.GetObject(sid, OpenMode.ForRead)
                    nm = get_name_safe(s)
                    if nm: names.append(nm)
                except Exception:
                    pass
            log.append("Superficies disponibles: " + str(names))
        except Exception:
            pass
        OUT = [[], [], log]
    else:
        log.append("Superficie encontrada: '{}'".format(surface_name))

        # ── Preparar estilo perfil TN y label set ────────────────
        prof_style_id = find_profile_style_by_name(cdoc, tr, tn_style_name, log)
        if tn_style_name and prof_style_id.IsNull:
            log.append("Estilo perfil TN '{}' NO encontrado. "
                       "Se usara el default del dibujo.".format(tn_style_name))

        # Label set: Civil 3D NO acepta null para este parametro.
        # Usamos uno estandar o el primero disponible.
        label_set_id = get_profile_label_set_id(cdoc, tr)
        if label_set_id.IsNull:
            log.append("AVISO: No se encontro ningun Profile Label Set.")

        layer_id = ensure_layer(tr, db, profile_layer)

        # ── Encontrar alignments en la capa ───────────────────────
        align_ids = cdoc.GetAlignmentIds()
        matching = []
        for i in range(align_ids.Count):
            try:
                aid = align_ids.get_Item(i)
            except Exception:
                try:
                    aid = align_ids[i]
                except Exception:
                    continue
            try:
                a = tr.GetObject(aid, OpenMode.ForRead)
                a_layer = getattr(a, "Layer", None)
                a_name  = get_name_safe(a) or "Align_?"
                if layer_name == "" or a_layer == layer_name:
                    matching.append((a_name, aid, a))
            except Exception:
                pass

        matching.sort(key=lambda x: x[0])
        log.append("Alignments en capa '{}': {} ({})".format(
            layer_name, len(matching),
            ", ".join(a[0] for a in matching)))

        # ── Para cada alignment: borrar TN previo y crear nuevo ───
        for aname, aid, a in matching:
            alignments_found.append(aname)
            tn_name = tn_prefix + aname

            # Borrar perfil con ese nombre (re-ejecucion limpia)
            try:
                prof_ids = a.GetProfileIds()
                for pi in range(prof_ids.Count):
                    try:
                        pid = prof_ids.get_Item(pi)
                    except Exception:
                        try:
                            pid = prof_ids[pi]
                        except Exception:
                            continue
                    try:
                        p = tr.GetObject(pid, OpenMode.ForRead)
                        if get_name_safe(p) == tn_name:
                            p.UpgradeOpen()
                            p.Erase()
                    except Exception:
                        pass
            except Exception:
                pass

            # Crear nuevo perfil TN
            try:
                new_pid = Profile.CreateFromSurface(
                    tn_name,
                    aid,
                    surface.ObjectId,
                    layer_id,
                    prof_style_id,
                    label_set_id
                )
                if new_pid and not new_pid.IsNull:
                    profiles_created.append(tn_name)
            except Exception as ex:
                log.append("{}: fallo creando perfil TN: {}".format(
                    aname, str(ex)))

        log.append("Perfiles TN creados: {}".format(len(profiles_created)))
        OUT = [alignments_found, profiles_created, log]

    tr.Commit()

except Exception:
    log.append("ERROR GLOBAL: " + traceback.format_exc())
    try:
        if tr: tr.Abort()
    except Exception:
        pass
    OUT = [alignments_found, profiles_created, log]
finally:
    try:
        if tr: tr.Dispose()
    except Exception:
        pass
    try:
        if lck: lck.Dispose()
    except Exception:
        pass
# ----------------------------------------
n0 = CodeBlock { 0; }  # "0"
n0_alignments = List.GetItemAtIndex(list=paso_1_crear_perfiles_tn, index=n0)  # "[0] alignments"
alignments_procesados = Watch(n0_alignments)  # graph output
n1 = CodeBlock { 1; }  # "1"
n1_tn_profiles = List.GetItemAtIndex(list=paso_1_crear_perfiles_tn, index=n1)  # "[1] TN profiles"
perfiles_tn_creados = Watch(n1_tn_profiles)  # graph output
n2 = CodeBlock { 2; }  # "2"
n2_log_p1 = List.GetItemAtIndex(list=paso_1_crear_perfiles_tn, index=n2)  # "[2] log P1"
log_paso_1 = Watch(n2_log_p1)  # graph output

# group: PASO 2 - Crear ProfileView en rejilla (con estilo + band set)
n04_origen_x = DoubleInput(526708.676)  # "04 Origen X"; graph input
n05_origen_y = DoubleInput(7421534.177)  # "05 Origen Y"; graph input
n06_numero_de_columnas = DoubleInput(2)  # "06 Numero de columnas"; graph input
n07_espaciado_x_m = DoubleInput(500)  # "07 Espaciado X (m)"; graph input
n08_espaciado_y_m = DoubleInput(150)  # "08 Espaciado Y (m)"; graph input
n09_estilo_profileview = StringInput("Planos Finales (Lynka Español)")  # "09 Estilo ProfileView"; graph input
n10_band_set = StringInput("Band Set (Lynka Español)")  # "10 Band Set"; graph input
paso_2_crear_profileviews = Python(IN[0]=n0_alignments, IN[1]=n04_origen_x, IN[2]=n05_origen_y, IN[3]=n06_numero_de_columnas, IN[4]=n07_espaciado_x_m, IN[5]=n08_espaciado_y_m, IN[6]=n09_estilo_profileview, IN[7]=n10_band_set)  # CPython3
# ---------- paso_2_crear_profileviews.python (393 lines) ----------
# -*- coding: utf-8 -*-
# =============================================================================
# Rasante_Viales - Paso 2: ProfileViews en rejilla (con estilo configurable)
#
# Toma la lista de nombres de alignments del Paso 1 (sync + evita re-scan) y
# crea una ProfileView por cada uno, distribuidas en rejilla. Aplica el
# estilo ProfileView indicado.
#
# Una vez creada la PV, Civil 3D incluye automaticamente todos los perfiles
# del alignment (incluido TN_<aname> creado en Paso 1).
#
# ENTRADAS:
#   IN[0] : list[str]  nombres alignments (output del Paso 1, barrera sync)
#   IN[1] : float      Origen X
#   IN[2] : float      Origen Y
#   IN[3] : float      Numero de columnas
#   IN[4] : float      Espaciado X (m, positivo hacia derecha)
#   IN[5] : float      Espaciado Y (m, positivo hacia arriba, negativo hacia abajo)
#   IN[6] : str        Nombre del estilo ProfileView
#
# SALIDA (lista de 2):
#   [0] list[str]  ProfileViews creadas con su coordenada
#   [1] list[str]  log / diagnostico
# =============================================================================

import clr
import traceback

clr.AddReference("AcMgd")
clr.AddReference("AcDbMgd")
clr.AddReference("AcCoreMgd")
clr.AddReference("AeccDbMgd")

from System import String as SysString
from Autodesk.AutoCAD.ApplicationServices import Application
from Autodesk.AutoCAD.DatabaseServices import OpenMode, ObjectId
from Autodesk.AutoCAD.Geometry import Point3d
from Autodesk.Civil.ApplicationServices import CivilApplication
from Autodesk.Civil.DatabaseServices import ProfileView

alignment_names = IN[0] if IN[0] is not None else []
if not isinstance(alignment_names, list):
    alignment_names = [alignment_names]

origin_x       = float(IN[1])
origin_y       = float(IN[2])
n_cols         = int(float(IN[3]))
spacing_x      = float(IN[4])
spacing_y      = float(IN[5])
pv_style_name  = str(IN[6]) if IN[6] else ""
bandset_name   = str(IN[7]) if IN[7] else ""

if n_cols < 1:
    n_cols = 1

# Sin prefijo: la PV se llama igual que el eje (CI01, CI02...)
pv_prefix = ""
log = []
pvs_created = []
pv_handles = []   # list de "name|handle" para pasar a Paso 3


def get_name_safe(obj):
    try:
        return obj.Name
    except Exception:
        return None


def find_alignment_by_name(cdoc, tr, name):
    try:
        align_ids = cdoc.GetAlignmentIds()
        for i in range(align_ids.Count):
            try:
                aid = align_ids.get_Item(i)
            except Exception:
                try:
                    aid = align_ids[i]
                except Exception:
                    continue
            try:
                a = tr.GetObject(aid, OpenMode.ForRead)
                if get_name_safe(a) == name:
                    return aid, a
            except Exception:
                pass
    except Exception:
        pass
    return None, None


def find_pv_style_by_name(cdoc, tr, name, log):
    """Busca un estilo PV por nombre. Replica la estrategia del script de
    trackers, que evita el bug de pythonnet al leer .Name de objetos Style.
    Prueba 4 metodos en cascada.
    """
    if not name:
        return ObjectId.Null

    wanted = name.strip()
    style_id = ObjectId.Null

    # Metodo 1: get_Item(string) en la coleccion (indexer .NET directo).
    # La coleccion mantiene un mapping interno nombre->ObjectId sin leer .Name.
    try:
        coll = cdoc.Styles.ProfileViewStyles
        try:
            style_id = coll.get_Item(wanted)
            if style_id is not None and not style_id.IsNull:
                log.append("Estilo PV encontrado (get_Item): '{}'".format(wanted))
                return style_id
        except Exception:
            pass
    except Exception:
        pass

    # Metodo 2: indexer con corchetes al estilo Python (this[string])
    try:
        coll = cdoc.Styles.ProfileViewStyles
        style_id = coll[wanted]
        if style_id is not None and not style_id.IsNull:
            log.append("Estilo PV encontrado (indexer): '{}'".format(wanted))
            return style_id
    except Exception:
        pass

    # Metodo 3: reflexion para invocar get_Item(String) explicitamente
    try:
        coll = cdoc.Styles.ProfileViewStyles
        ct = clr.GetClrType(coll.GetType())
        gi = ct.GetMethod("get_Item", [clr.GetClrType(SysString)])
        if gi is not None:
            style_id = gi.Invoke(coll, [wanted])
            if style_id is not None and not style_id.IsNull:
                log.append("Estilo PV encontrado (reflection): '{}'"
                           .format(wanted))
                return style_id
    except Exception:
        pass

    # Metodo 4: iterar con bare except (pythonnet tiene bug con .Name)
    try:
        coll = cdoc.Styles.ProfileViewStyles
        found_names = []
        for stid in coll:
            try:
                st = tr.GetObject(stid, OpenMode.ForRead)
                try:
                    nm = st.Name
                    found_names.append(nm)
                    if nm and nm.strip().lower() == wanted.lower():
                        log.append("Estilo PV encontrado (iter): '{}'".format(nm))
                        return stid
                except:
                    found_names.append("<ilegible>")
            except Exception:
                pass
        if found_names:
            log.append("Estilos encontrados al iterar: " + str(found_names))
    except Exception as ex:
        log.append("Error iterando estilos PV: " + str(ex))

    return ObjectId.Null


def list_pv_style_names(cdoc, tr):
    """Lista nombres de estilos PV (solo para diagnostico). Usa bare except
    porque .Name puede fallar en pythonnet."""
    names = []
    try:
        coll = cdoc.Styles.ProfileViewStyles
        for stid in coll:
            try:
                st = tr.GetObject(stid, OpenMode.ForRead)
                try:
                    nm = st.Name
                    if nm and nm not in names:
                        names.append(nm)
                except:
                    pass
            except Exception:
                pass
    except Exception:
        pass
    return names


def find_pv_bandset_by_name(cdoc, tr, name, log):
    """Busca un Band Set de ProfileView por nombre. Prueba varias rutas de
    coleccion (Civil 3D expone los band sets en distintas jerarquias segun
    version) y, dentro de cada ruta, 3 metodos de indexacion."""
    if not name:
        return ObjectId.Null

    wanted = name.strip()

    # Rutas candidatas donde puede vivir la coleccion de band sets de PV
    paths = []
    for accessor in (
        lambda: cdoc.Styles.ProfileViewBandSetStyles,
        lambda: cdoc.Styles.BandSetStyles.ProfileViewBandSetStyles,
        lambda: cdoc.Styles.BandSetStyles,
        lambda: cdoc.Styles.ProfileView.BandSetStyles,
    ):
        try:
            coll = accessor()
            if coll is not None:
                paths.append(coll)
        except Exception:
            pass

    for coll in paths:
        # Metodo 1: get_Item(string)
        try:
            bid = coll.get_Item(wanted)
            if bid is not None and not bid.IsNull:
                log.append("Band set encontrado (get_Item): '{}'".format(wanted))
                return bid
        except Exception:
            pass
        # Metodo 2: indexer
        try:
            bid = coll[wanted]
            if bid is not None and not bid.IsNull:
                log.append("Band set encontrado (indexer): '{}'".format(wanted))
                return bid
        except Exception:
            pass
        # Metodo 3: reflexion
        try:
            ct = clr.GetClrType(coll.GetType())
            gi = ct.GetMethod("get_Item", [clr.GetClrType(SysString)])
            if gi is not None:
                bid = gi.Invoke(coll, [wanted])
                if bid is not None and not bid.IsNull:
                    log.append("Band set encontrado (reflection): '{}'"
                               .format(wanted))
                    return bid
        except Exception:
            pass

    return ObjectId.Null


def apply_bandset_to_pv(pv_obj, bandset_id, log, aname):
    """Aplica un band set a una ProfileView. Intenta varias firmas del API
    porque el metodo exacto varia entre versiones de Civil 3D."""
    tried_errors = []

    # Metodo A: pv.ImportBandSet(id)
    try:
        pv_obj.ImportBandSet(bandset_id)
        return True
    except Exception as e:
        tried_errors.append("ImportBandSet: " + str(e))

    # Metodo B: pv.Bands.ImportBandSetStyle(id)
    try:
        pv_obj.Bands.ImportBandSetStyle(bandset_id)
        return True
    except Exception as e:
        tried_errors.append("Bands.ImportBandSetStyle: " + str(e))

    log.append("{}: no pude aplicar band set. Errores: {}".format(
        aname, " | ".join(tried_errors)))
    return False


# ═══════════════════════════════════════════════════════════════════════
doc = Application.DocumentManager.MdiActiveDocument
db  = doc.Database

lck = None
tr  = None

try:
    lck = doc.LockDocument()
    tr  = db.TransactionManager.StartTransaction()
    cdoc = CivilApplication.ActiveDocument

    # Buscar estilo PV por nombre
    pv_style_id = find_pv_style_by_name(cdoc, tr, pv_style_name, log)
    if pv_style_name and pv_style_id.IsNull:
        log.append("Estilo PV '{}' NO encontrado. Se usara el estilo por defecto."
                   .format(pv_style_name))
        log.append("Estilos PV disponibles (diagnostico): "
                   + str(list_pv_style_names(cdoc, tr)))

    # Buscar band set por nombre
    bandset_id = find_pv_bandset_by_name(cdoc, tr, bandset_name, log)
    if bandset_name and bandset_id.IsNull:
        log.append("Band Set '{}' NO encontrado. No se importara."
                   .format(bandset_name))

    n_rows = (len(alignment_names) + n_cols - 1) // n_cols if alignment_names else 0
    log.append("Rejilla: {} columnas x {} filas".format(n_cols, n_rows))

    for i, aname in enumerate(alignment_names):
        aname = str(aname)
        aid, a = find_alignment_by_name(cdoc, tr, aname)
        if aid is None:
            log.append("{}: alignment no encontrado, omitido".format(aname))
            continue

        pv_name = pv_prefix + aname

        # Posicion en la rejilla (fila por fila)
        col = i % n_cols
        row = i // n_cols
        x = origin_x + col * spacing_x
        y = origin_y + row * spacing_y
        origin = Point3d(x, y, 0.0)

        # Borrar PV existente con ese nombre (idempotente)
        try:
            pv_ids = a.GetProfileViewIds()
            to_erase = []
            for pi in range(pv_ids.Count):
                try:
                    pvid = pv_ids.get_Item(pi)
                except Exception:
                    try:
                        pvid = pv_ids[pi]
                    except Exception:
                        continue
                try:
                    pv = tr.GetObject(pvid, OpenMode.ForRead)
                    if get_name_safe(pv) == pv_name:
                        to_erase.append(pvid)
                except Exception:
                    pass
            for pvid in to_erase:
                try:
                    obj = tr.GetObject(pvid, OpenMode.ForWrite)
                    obj.Erase()
                except Exception:
                    pass
        except Exception:
            pass

        # Crear PV nueva
        try:
            new_pv_id = ProfileView.Create(aid, origin)
            if new_pv_id and not new_pv_id.IsNull:
                pv_obj = tr.GetObject(new_pv_id, OpenMode.ForWrite)
                # Renombrar
                try:
                    pv_obj.Name = pv_name
                except Exception as ex_rn:
                    log.append("{}: no pude renombrar: {}".format(
                        aname, str(ex_rn)))
                # Aplicar estilo PV
                if not pv_style_id.IsNull:
                    try:
                        pv_obj.StyleId = pv_style_id
                    except Exception as ex_st:
                        log.append("{}: no pude asignar estilo: {}".format(
                            aname, str(ex_st)))
                # Aplicar band set
                if not bandset_id.IsNull:
                    apply_bandset_to_pv(pv_obj, bandset_id, log, aname)
                pvs_created.append("{} @ ({:.2f}, {:.2f})".format(pv_name, x, y))
                try:
                    pv_handles.append("{}|{}".format(pv_name, pv_obj.Handle.ToString()))
                except Exception:
                    pv_handles.append("{}|".format(pv_name))
            else:
                log.append("{}: ProfileView.Create devolvio ObjectId nulo"
                           .format(aname))
        except Exception as ex:
            log.append("{}: fallo crear PV: {}".format(aname, str(ex)))

    log.append("PVs creadas: {}".format(len(pvs_created)))
    tr.Commit()

except Exception:
    log.append("ERROR: " + traceback.format_exc())
    try:
        if tr: tr.Abort()
    except Exception:
        pass
finally:
    try:
        if tr: tr.Dispose()
    except Exception:
        pass
    try:
        if lck: lck.Dispose()
    except Exception:
        pass


OUT = [pvs_created, log, pv_handles]
# ----------------------------------------
n0_pvs = List.GetItemAtIndex(list=paso_2_crear_profileviews, index=n0)  # "[0] PVs"
profileviews_creadas = Watch(n0_pvs)  # graph output
n1_log_p2 = List.GetItemAtIndex(list=paso_2_crear_profileviews, index=n1)  # "[1] log P2"
log_paso_2 = Watch(n1_log_p2)  # graph output

# group: PASO 2 - Crear ProfileView en rejilla (con estilo + band set) > PASO 3 - Rasante auto (muestreo + DP + pendientes + acuerdos)
n11_altura_rasante_sobre_tn_m = DoubleInput(0.1)  # "11 Altura rasante sobre TN (m)"; graph input
n12_pendiente_maxima = DoubleInput(10)  # "12 Pendiente maxima (%)"; graph input
n13_pendiente_minima = DoubleInput(0.5)  # "13 Pendiente minima (%)"; graph input
n14_longitud_acuerdo_vertical_m = DoubleInput(10)  # "14 Longitud acuerdo vertical (m)"; graph input
n15_intervalo_muestreo_tn_m = DoubleInput(5)  # "15 Intervalo muestreo TN (m)"; graph input
n16_estilo_perfil_rasante = StringInput("Estilo de diseño (Lynka)")  # "16 Estilo perfil rasante"; graph input
paso_3_generar_rasante_auto = Python(IN[0]=n0_alignments, IN[1]=n02_superficie_tn, IN[2]=n11_altura_rasante_sobre_tn_m, IN[3]=n12_pendiente_maxima, IN[4]=n13_pendiente_minima, IN[5]=n14_longitud_acuerdo_vertical_m, IN[6]=n15_intervalo_muestreo_tn_m, IN[7]=n16_estilo_perfil_rasante)  # CPython3
# ---------- paso_3_generar_rasante_auto.python (927 lines) ----------
# -*- coding: utf-8 -*-
# =============================================================================
# Rasante_Viales - Paso 3: Genera rasante auto para cada alignment
#
# Algoritmo (enfoque HIBRIDO - el script propone, el usuario ajusta):
#   1. Muestrear TN cada `intervalo` m a lo largo del eje
#        -> Alignment.PointLocation(sta, 0) + Surface.FindElevationAtXY(x,y)
#   2. Desplazar cotas +altura objetivo (p.ej. +10 cm)
#   3. Simplificar Douglas-Peucker con tolerancia 2*altura (~20 cm)
#        -> reduce la nube de puntos a los PVIs significativos
#   4. Fusionar PVIs demasiado cercanos (< 1.5 * long_acuerdo)
#        -> deja sitio para los acuerdos verticales
#   5. Corregir pendientes:
#        - si |s| > max -> capar a +/-max
#        - si |s| < min -> redondear a +/-min preservando signo
#   6. Crear Profile Layout con Profile.CreateByLayout
#   7. Insertar PVIs via profile.PVIs.AddPVI(Point2d(sta, elev))
#   8. Insertar acuerdos parabolicos simetricos de longitud = long_acuerdo
#
# El perfil resultante queda como Profile tipo Layout (editable en Civil 3D),
# por lo que el usuario puede arrastrar PVIs, cambiar longitudes de acuerdo,
# anyadir o borrar PVIs directamente en la ProfileView.
#
# ENTRADAS:
#   IN[0] : list[str]  nombres alignments (output Paso 1, barrera sync)
#   IN[1] : str        nombre superficie TN
#   IN[2] : float      altura objetivo rasante sobre TN (m)
#   IN[3] : float      pendiente maxima (%)
#   IN[4] : float      pendiente minima (%)
#   IN[5] : float      longitud minima acuerdo vertical (m)
#   IN[6] : float      intervalo muestreo TN (m)
#   IN[7] : str        nombre estilo perfil rasante
#
# SALIDA (lista de 2):
#   [0] list[str]  rasantes creadas (nombre: N_PVIs)
#   [1] list[str]  log / diagnostico
# =============================================================================

import clr
import math
import traceback

clr.AddReference("AcMgd")
clr.AddReference("AcDbMgd")
clr.AddReference("AcCoreMgd")
clr.AddReference("AeccDbMgd")

from System import String as SysString, Double
import System
from Autodesk.AutoCAD.ApplicationServices import Application
from Autodesk.AutoCAD.DatabaseServices import (
    OpenMode, ObjectId, LayerTableRecord
)
from Autodesk.AutoCAD.Geometry import Point2d
from Autodesk.Civil.ApplicationServices import CivilApplication
from Autodesk.Civil.DatabaseServices import Profile

# ═══════════════════════════════════════════════════════════════════════
# Inputs
# ═══════════════════════════════════════════════════════════════════════
alignment_names = IN[0] if IN[0] is not None else []
if not isinstance(alignment_names, list):
    alignment_names = [alignment_names]

surface_name        = str(IN[1]) if IN[1] else ""
target_h            = float(IN[2])          # m
max_slope           = float(IN[3]) / 100.0  # decimal
min_slope           = float(IN[4]) / 100.0  # decimal
min_curve_length    = float(IN[5])          # m
sampling_interval   = float(IN[6])          # m
rasante_style_name  = str(IN[7]) if IN[7] else ""

# IN[9]: lista de "name|handle" que viene de Paso 2 (barrera sync + datos)
pv_handles_in = IN[9] if (len(IN) > 9 and IN[9] is not None) else []
if not isinstance(pv_handles_in, list):
    pv_handles_in = [pv_handles_in]

# Parsear: dict nombre_PV -> handle (string hex)
pv_handle_by_name = {}
for s in pv_handles_in:
    try:
        parts = str(s).split("|", 1)
        if len(parts) == 2 and parts[1]:
            pv_handle_by_name[parts[0]] = parts[1]
    except Exception:
        pass

rasante_prefix = "RAS "
profile_layer  = "0"

# Derivados
dp_tolerance = target_h * 2.0              # tolerancia Douglas-Peucker (m)
min_pvi_distance = min_curve_length * 1.5  # separacion minima entre PVIs (m)

log = []
rasantes_created = []


# ═══════════════════════════════════════════════════════════════════════
# Helpers: lookup robustos (mismo patron que Pasos 1 y 2)
# ═══════════════════════════════════════════════════════════════════════

def get_name_safe(obj):
    try:
        return obj.Name
    except Exception:
        return None


def find_alignment_by_name(cdoc, tr, name):
    try:
        ids = cdoc.GetAlignmentIds()
        for i in range(ids.Count):
            try:
                aid = ids.get_Item(i)
            except Exception:
                try:
                    aid = ids[i]
                except Exception:
                    continue
            try:
                a = tr.GetObject(aid, OpenMode.ForRead)
                if get_name_safe(a) == name:
                    return aid, a
            except Exception:
                pass
    except Exception:
        pass
    return None, None


def find_surface_by_name(cdoc, tr, name):
    try:
        ids = cdoc.GetSurfaceIds()
        for i in range(ids.Count):
            try:
                sid = ids.get_Item(i)
            except Exception:
                try:
                    sid = ids[i]
                except Exception:
                    continue
            try:
                s = tr.GetObject(sid, OpenMode.ForRead)
                if get_name_safe(s) == name:
                    return s
            except Exception:
                pass
    except Exception:
        pass
    return None


def find_profile_style_by_name(cdoc, tr, name, log):
    """Patron 4-metodos ya probado (evita el bug de .Name)."""
    if not name:
        return ObjectId.Null
    wanted = name.strip()
    try:
        coll = cdoc.Styles.ProfileStyles
    except Exception:
        return ObjectId.Null

    try:
        sid = coll.get_Item(wanted)
        if sid is not None and not sid.IsNull:
            log.append("Estilo rasante encontrado (get_Item): '{}'".format(wanted))
            return sid
    except Exception:
        pass
    try:
        sid = coll[wanted]
        if sid is not None and not sid.IsNull:
            log.append("Estilo rasante encontrado (indexer): '{}'".format(wanted))
            return sid
    except Exception:
        pass
    try:
        ct = clr.GetClrType(coll.GetType())
        gi = ct.GetMethod("get_Item", [clr.GetClrType(SysString)])
        if gi is not None:
            sid = gi.Invoke(coll, [wanted])
            if sid is not None and not sid.IsNull:
                log.append("Estilo rasante encontrado (reflection): '{}'"
                           .format(wanted))
                return sid
    except Exception:
        pass
    return ObjectId.Null


def get_profile_label_set_id(cdoc, tr):
    """Civil 3D NO acepta null para labelSetId; devolvemos uno valido."""
    try:
        coll = cdoc.Styles.LabelSetStyles.ProfileLabelSetStyles
    except Exception:
        return ObjectId.Null

    for cand in ("_No Labels", "No Labels", "_Sin etiquetas", "Standard"):
        try:
            oid = coll.get_Item(cand)
            if oid is not None and not oid.IsNull:
                return oid
        except Exception:
            pass
        try:
            oid = coll[cand]
            if oid is not None and not oid.IsNull:
                return oid
        except Exception:
            pass

    try:
        oid = coll.get_Item(0)
        if oid is not None and not oid.IsNull:
            return oid
    except Exception:
        pass
    try:
        for oid in coll:
            if oid is not None and not oid.IsNull:
                return oid
    except Exception:
        pass
    return ObjectId.Null


def ensure_layer(tr, db, name):
    lt = tr.GetObject(db.LayerTableId, OpenMode.ForRead)
    try:
        if lt.Has(name):
            return lt.get_Item(name)
    except Exception:
        pass
    try:
        lt.UpgradeOpen()
        ltr = LayerTableRecord()
        ltr.Name = name
        lid = lt.Add(ltr)
        tr.AddNewlyCreatedDBObject(ltr, True)
        return lid
    except Exception:
        try:
            return lt.get_Item("0")
        except Exception:
            return ObjectId.Null


def find_pv_bandset_by_name(cdoc, tr, name, log):
    """Busca Band Set por nombre. Prueba varias rutas de coleccion y 3
    metodos de indexacion (mismo patron que Paso 2)."""
    if not name:
        return ObjectId.Null
    wanted = name.strip()

    paths = []
    for accessor in (
        lambda: cdoc.Styles.ProfileViewBandSetStyles,
        lambda: cdoc.Styles.BandSetStyles.ProfileViewBandSetStyles,
        lambda: cdoc.Styles.BandSetStyles,
        lambda: cdoc.Styles.ProfileView.BandSetStyles,
    ):
        try:
            coll = accessor()
            if coll is not None:
                paths.append(coll)
        except Exception:
            pass

    for coll in paths:
        try:
            bid = coll.get_Item(wanted)
            if bid is not None and not bid.IsNull:
                log.append("Band set encontrado (get_Item): '{}'".format(wanted))
                return bid
        except Exception:
            pass
        try:
            bid = coll[wanted]
            if bid is not None and not bid.IsNull:
                log.append("Band set encontrado (indexer): '{}'".format(wanted))
                return bid
        except Exception:
            pass
        try:
            ct = clr.GetClrType(coll.GetType())
            gi = ct.GetMethod("get_Item", [clr.GetClrType(SysString)])
            if gi is not None:
                bid = gi.Invoke(coll, [wanted])
                if bid is not None and not bid.IsNull:
                    log.append("Band set encontrado (reflection): '{}'"
                               .format(wanted))
                    return bid
        except Exception:
            pass
    return ObjectId.Null


def list_pv_band_methods(pv_obj, log):
    """Diagnostico: lista metodos de ProfileView relacionados con bandas."""
    try:
        ct = clr.GetClrType(pv_obj.GetType())
        found = []
        for m in ct.GetMethods():
            if "Band" in m.Name:
                params_str = ", ".join(
                    "{} {}".format(p.ParameterType.Name, p.Name)
                    for p in m.GetParameters())
                found.append("{}({})".format(m.Name, params_str))
        for s in found[:10]:
            log.append("  PV.{}".format(s))
    except Exception as ex:
        log.append("  list_pv_band_methods error: " + str(ex)[:100])


def apply_bandset_to_pv(pv_obj, bandset_id, log, label):
    """Aplica un band set a una ProfileView. Prueba 3 caminos:
       1) pv.ImportBandSet(id)
       2) pv.Bands.ImportBandSetStyle(id)
       3) Reflexion: buscar cualquier metodo que tome ObjectId y lo invoca"""
    tried = []

    # Intento 1
    try:
        pv_obj.ImportBandSet(bandset_id)
        log.append("  {}: band set aplicado via ImportBandSet".format(label))
        return True
    except Exception as e:
        tried.append("ImportBandSet: " + str(e)[:150])

    # Intento 2
    try:
        pv_obj.Bands.ImportBandSetStyle(bandset_id)
        log.append("  {}: band set aplicado via Bands.ImportBandSetStyle"
                   .format(label))
        return True
    except Exception as e:
        tried.append("Bands.ImportBandSetStyle: " + str(e)[:150])

    # Intento 3: reflexion sobre el objeto PV, buscar cualquier metodo con
    #            "Import" o "Band" que tome un ObjectId
    try:
        ct = clr.GetClrType(pv_obj.GetType())
        for m in ct.GetMethods():
            name = m.Name
            if not ("Band" in name and ("Import" in name or "Set" in name)):
                continue
            params = m.GetParameters()
            if len(params) != 1:
                continue
            pt_name = params[0].ParameterType.Name
            if pt_name != "ObjectId":
                continue
            try:
                args = System.Array[System.Object]([bandset_id])
                m.Invoke(pv_obj, args)
                log.append("  {}: band set aplicado via reflection.{}"
                           .format(label, name))
                return True
            except Exception as e_refl:
                tried.append("refl.{}: {}".format(name, str(e_refl)[:150]))
    except Exception as e:
        tried.append("reflection scan: " + str(e)[:100])

    log.append("{}: no pude aplicar band set. Intentos: {}".format(
        label, " || ".join(tried)))
    return False


def find_pv_for_alignment(alignment, alignment_id, tr, db, name_hint, log=None):
    """Busca la ProfileView asociada al alignment. 2 estrategias:
       1) alignment.GetProfileViewIds() — en teoria lo correcto
       2) Iterar ModelSpace filtrando ProfileView por nombre o AlignmentId
    """
    from Autodesk.Civil.DatabaseServices import ProfileView
    from Autodesk.AutoCAD.DatabaseServices import BlockTableRecord

    # Metodo 1
    pv_ids_count = -1
    try:
        pv_ids = alignment.GetProfileViewIds()
        pv_ids_count = pv_ids.Count
        if log is not None:
            log.append("  GetProfileViewIds devolvio {} PVs".format(pv_ids_count))
        for i in range(pv_ids_count):
            try:
                pvid = pv_ids.get_Item(i)
            except Exception:
                try:
                    pvid = pv_ids[i]
                except Exception:
                    continue
            try:
                return tr.GetObject(pvid, OpenMode.ForWrite)
            except Exception:
                pass
    except Exception as ex:
        if log is not None:
            log.append("  GetProfileViewIds ERROR: " + str(ex)[:100])

    # Metodo 2: iterar TODOS los BlockTableRecords (ModelSpace + Layouts)
    #           porque las ProfileViews pueden estar en un Layout (Paper Space)
    try:
        bt = tr.GetObject(db.BlockTableId, OpenMode.ForRead)
        n_checked = 0
        types_seen = {}
        containers_seen = {}
        pv_obj = None

        for btr_id in bt:
            try:
                btr = tr.GetObject(btr_id, OpenMode.ForRead)
                btr_name = "<?>"
                try:
                    btr_name = btr.Name
                except Exception:
                    pass
                n_in_btr = 0
                for oid in btr:
                    try:
                        obj = tr.GetObject(oid, OpenMode.ForRead)
                        n_checked += 1
                        n_in_btr += 1
                        type_name = obj.GetType().Name
                        types_seen[type_name] = types_seen.get(type_name, 0) + 1
                        if type_name == "ProfileView":
                            containers_seen[btr_name] = containers_seen.get(
                                btr_name, 0) + 1
                            try:
                                obj_name = obj.Name
                                if obj_name == name_hint:
                                    obj.UpgradeOpen()
                                    pv_obj = obj
                                    if log is not None:
                                        log.append(
                                            "  PV '{}' encontrada en '{}'"
                                            .format(name_hint, btr_name))
                                    break
                            except Exception:
                                pass
                            try:
                                if obj.AlignmentId == alignment_id:
                                    obj.UpgradeOpen()
                                    pv_obj = obj
                                    if log is not None:
                                        log.append(
                                            "  PV encontrada por AlignmentId en '{}'"
                                            .format(btr_name))
                                    break
                            except Exception:
                                pass
                    except Exception:
                        pass
                if pv_obj is not None:
                    break
            except Exception:
                pass

        if pv_obj is not None:
            return pv_obj

        if log is not None:
            tstr = ", ".join("{}:{}".format(k, v)
                             for k, v in sorted(types_seen.items()))
            log.append("  Scan full BT: {} objetos. Tipos: {}"
                       .format(n_checked, tstr))
            if containers_seen:
                log.append("  PVs vistas (pero sin coincidir): {}"
                           .format(dict(containers_seen)))
    except Exception as ex:
        if log is not None:
            log.append("  BlockTable iterate ERROR: " + str(ex)[:150])

    return None


# ═══════════════════════════════════════════════════════════════════════
# Algoritmo rasante
# ═══════════════════════════════════════════════════════════════════════

def alignment_xy_at_station(alignment, station, diag=None):
    """Devuelve (x, y) en la estacion. Prueba 4 metodos; si diag no es None
    apunta ahi los errores del primer fallo."""
    errors = []

    # Metodo A: out params vuelven como tupla (pythonnet CPython3 default)
    try:
        result = alignment.PointLocation(float(station), 0.0)
        if isinstance(result, (tuple, list)):
            if len(result) >= 2:
                return float(result[0]), float(result[1])
            errors.append("A: tupla con {} elems".format(len(result)))
        elif result is None:
            errors.append("A: returno None")
        else:
            errors.append("A: tipo={}".format(type(result).__name__))
    except Exception as e:
        errors.append("A: " + str(e)[:100])

    # Metodo B: clr.Reference[Double]
    try:
        e_ref = clr.Reference[Double](0.0)
        n_ref = clr.Reference[Double](0.0)
        alignment.PointLocation(float(station), 0.0, e_ref, n_ref)
        return float(e_ref.Value), float(n_ref.Value)
    except Exception as e:
        errors.append("B: " + str(e)[:100])

    # Metodo C: StrongBox
    try:
        from System.Runtime.CompilerServices import StrongBox
        e_box = StrongBox[Double](0.0)
        n_box = StrongBox[Double](0.0)
        alignment.PointLocation(float(station), 0.0, e_box, n_box)
        return float(e_box.Value), float(n_box.Value)
    except Exception as e:
        errors.append("C: " + str(e)[:100])

    # Metodo D: reflexion para llamar con System.Double refs
    try:
        ct = clr.GetClrType(alignment.GetType())
        methods = ct.GetMethods()
        for m in methods:
            if m.Name == "PointLocation":
                ps = m.GetParameters()
                if len(ps) == 4:
                    # Construir args: station, offset, e_out, n_out
                    args = System.Array[System.Object]([
                        float(station), 0.0, 0.0, 0.0])
                    m.Invoke(alignment, args)
                    return float(args[2]), float(args[3])
    except Exception as e:
        errors.append("D: " + str(e)[:100])

    if diag is not None:
        diag.append("XY@sta {:.2f}: fallaron los 4 metodos. {}"
                    .format(station, " | ".join(errors)))
    return None, None


def sample_tn(alignment, surface, start_sta, end_sta, interval, log,
              diagnose_first=False):
    """Muestrea cotas del TN cada `interval` m, incluido el final."""
    samples = []
    diag_info = []

    if diagnose_first:
        diag_info.append("alignment type: {}".format(type(alignment).__name__))
        diag_info.append("surface type: {}".format(type(surface).__name__))
        diag_info.append("stations: [{:.2f}, {:.2f}] len={:.2f}"
                         .format(start_sta, end_sta, end_sta - start_sta))

    first_xy_fail_logged = False
    first_elev_fail_logged = False
    n_xy_fail = 0
    n_elev_fail = 0

    s = start_sta
    idx = 0
    while s <= end_sta + 1e-6:
        xy_errs = [] if (diagnose_first and not first_xy_fail_logged) else None
        x, y = alignment_xy_at_station(alignment, s, xy_errs)

        if x is None:
            n_xy_fail += 1
            if xy_errs and not first_xy_fail_logged:
                diag_info.extend(xy_errs)
                first_xy_fail_logged = True
        else:
            try:
                elev = surface.FindElevationAtXY(float(x), float(y))
                samples.append((s, float(elev)))
                if diagnose_first and idx == 0:
                    diag_info.append("1a muestra OK: sta={:.2f} xy=({:.2f},{:.2f}) z={:.3f}"
                                     .format(s, x, y, float(elev)))
            except Exception as e:
                n_elev_fail += 1
                if diagnose_first and not first_elev_fail_logged:
                    diag_info.append("FindElevationAtXY fallo @sta={:.2f} xy=({:.2f},{:.2f}): {}"
                                     .format(s, x, y, str(e)[:150]))
                    first_elev_fail_logged = True

        s += interval
        idx += 1

    # Incluir estacion final
    if not samples or abs(samples[-1][0] - end_sta) > 0.01:
        x, y = alignment_xy_at_station(alignment, end_sta)
        if x is not None:
            try:
                elev = surface.FindElevationAtXY(float(x), float(y))
                samples.append((end_sta, float(elev)))
            except Exception:
                pass

    if diagnose_first:
        diag_info.append("total muestras: {}, XY fails: {}, elev fails: {}"
                         .format(len(samples), n_xy_fail, n_elev_fail))
        for line in diag_info:
            log.append("  [DIAG] " + line)

    return samples


def douglas_peucker(points, epsilon):
    """Simplifica polyline (sta, elev) por desviacion vertical maxima."""
    if len(points) <= 2:
        return list(points)

    s1, e1 = points[0]
    s2, e2 = points[-1]
    ds = s2 - s1

    max_dev = 0.0
    max_idx = 0
    for i in range(1, len(points) - 1):
        s, e = points[i]
        if abs(ds) < 1e-10:
            dev = abs(e - e1)
        else:
            t = (s - s1) / ds
            e_interp = e1 + t * (e2 - e1)
            dev = abs(e - e_interp)
        if dev > max_dev:
            max_dev = dev
            max_idx = i

    if max_dev > epsilon:
        left  = douglas_peucker(points[:max_idx + 1], epsilon)
        right = douglas_peucker(points[max_idx:],     epsilon)
        return left[:-1] + right
    return [points[0], points[-1]]


def merge_short_segments(pvis, min_length):
    """Descarta PVIs interiores demasiado pegados a un vecino."""
    if len(pvis) <= 2:
        return list(pvis)
    result = [pvis[0]]
    for i in range(1, len(pvis) - 1):
        ds_prev = pvis[i][0] - result[-1][0]
        ds_next = pvis[i + 1][0] - pvis[i][0]
        if ds_prev >= min_length and ds_next >= min_length:
            result.append(pvis[i])
    result.append(pvis[-1])
    return result


def correct_slopes(pvis, min_s, max_s):
    """Pasada forward: ajusta elevacion de cada PVI para cumplir
    pendiente en [min_s, max_s]."""
    if len(pvis) < 2:
        return list(pvis)
    corrected = [pvis[0]]
    for i in range(1, len(pvis)):
        s_prev, e_prev = corrected[-1]
        s_cur,  e_cur  = pvis[i]
        ds = s_cur - s_prev
        if ds <= 1e-6:
            corrected.append((s_cur, e_cur))
            continue
        slope = (e_cur - e_prev) / ds
        abs_s = abs(slope)
        if abs_s > max_s:
            sign = 1.0 if slope >= 0 else -1.0
            corrected.append((s_cur, e_prev + sign * max_s * ds))
        elif abs_s < min_s:
            # evitar slope=0 por drenaje: forzamos al minimo
            sign = 1.0 if slope >= 0 else -1.0
            if slope == 0.0:
                sign = 1.0  # ascendente por convencion
            corrected.append((s_cur, e_prev + sign * min_s * ds))
        else:
            corrected.append((s_cur, e_cur))
    return corrected


# ═══════════════════════════════════════════════════════════════════════
# Main
# ═══════════════════════════════════════════════════════════════════════

doc = Application.DocumentManager.MdiActiveDocument
db  = doc.Database

lck = None
tr  = None

try:
    lck = doc.LockDocument()
    tr  = db.TransactionManager.StartTransaction()
    cdoc = CivilApplication.ActiveDocument

    # -- Superficie TN --
    surface = find_surface_by_name(cdoc, tr, surface_name)
    if surface is None:
        log.append("ERROR: superficie '{}' no encontrada".format(surface_name))
        tr.Commit()
    else:
        log.append("Superficie: '{}'".format(surface_name))
        log.append("Params: h={:.2f}m, pendiente [{:.2f}%, {:.2f}%], "
                   "acuerdo>={:.1f}m, muestreo cada {:.1f}m"
                   .format(target_h, min_slope * 100, max_slope * 100,
                           min_curve_length, sampling_interval))

        style_id = find_profile_style_by_name(
            cdoc, tr, rasante_style_name, log)
        if rasante_style_name and style_id.IsNull:
            log.append("Estilo rasante '{}' NO encontrado. Uso el default."
                       .format(rasante_style_name))

        label_set_id = get_profile_label_set_id(cdoc, tr)
        if label_set_id.IsNull:
            log.append("AVISO: no encuentro ningun Profile Label Set.")

        layer_id = ensure_layer(tr, db, profile_layer)

        first_iter = True
        for aname in alignment_names:
            aname = str(aname)
            aid, alignment = find_alignment_by_name(cdoc, tr, aname)
            if aid is None:
                log.append("{}: alignment no encontrado".format(aname))
                continue

            try:
                start_sta = alignment.StartingStation
                end_sta   = alignment.EndingStation

                # 1. Muestrear TN (diagnostico detallado solo en el 1er eje)
                tn_samples = sample_tn(alignment, surface,
                                       start_sta, end_sta, sampling_interval,
                                       log, diagnose_first=first_iter)
                first_iter = False
                if len(tn_samples) < 2:
                    log.append("{}: muestreo TN insuficiente ({} puntos)"
                               .format(aname, len(tn_samples)))
                    continue

                # 2. Desplazar por altura objetivo
                target_poly = [(s, e + target_h) for s, e in tn_samples]

                # 3. Douglas-Peucker
                pvis_dp = douglas_peucker(target_poly, dp_tolerance)

                # 4. Fusionar PVIs cercanos
                pvis_merged = merge_short_segments(pvis_dp, min_pvi_distance)

                # 5. Corregir pendientes
                pvis_final = correct_slopes(pvis_merged, min_slope, max_slope)

                # 6. Borrar rasante previa con el mismo nombre
                rasante_name = rasante_prefix + aname
                try:
                    prof_ids = alignment.GetProfileIds()
                    to_erase = []
                    for pi in range(prof_ids.Count):
                        try:
                            pid = prof_ids.get_Item(pi)
                        except Exception:
                            try:
                                pid = prof_ids[pi]
                            except Exception:
                                continue
                        try:
                            p = tr.GetObject(pid, OpenMode.ForRead)
                            if get_name_safe(p) == rasante_name:
                                to_erase.append(pid)
                        except Exception:
                            pass
                    for pid in to_erase:
                        try:
                            obj = tr.GetObject(pid, OpenMode.ForWrite)
                            obj.Erase()
                        except Exception:
                            pass
                except Exception:
                    pass

                # 7. Crear Profile Layout
                new_prof_id = Profile.CreateByLayout(
                    rasante_name, aid, layer_id, style_id, label_set_id)

                if new_prof_id is None or new_prof_id.IsNull:
                    log.append("{}: CreateByLayout devolvio ObjectId nulo"
                               .format(aname))
                    continue

                new_prof = tr.GetObject(new_prof_id, OpenMode.ForWrite)

                # 8. Anyadir PVIs (prueba varias firmas porque varian
                #    entre versiones de Civil 3D)
                n_pvi_ok = 0
                first_pvi_method = None
                first_pvi_err = None
                for s, e in pvis_final:
                    added = False

                    # Firma 1: AddPVI(double station, double elevation)
                    if not added:
                        try:
                            new_prof.PVIs.AddPVI(float(s), float(e))
                            added = True
                            if first_pvi_method is None:
                                first_pvi_method = "AddPVI(sta, elev)"
                        except Exception as ex1:
                            if first_pvi_err is None:
                                first_pvi_err = "sig1: " + str(ex1)[:80]

                    # Firma 2: AddPVI(Point2d)
                    if not added:
                        try:
                            new_prof.PVIs.AddPVI(Point2d(float(s), float(e)))
                            added = True
                            if first_pvi_method is None:
                                first_pvi_method = "AddPVI(Point2d)"
                        except Exception as ex2:
                            if first_pvi_err is None:
                                first_pvi_err = (first_pvi_err or "") \
                                    + " | sig2: " + str(ex2)[:80]

                    if added:
                        n_pvi_ok += 1
                    else:
                        log.append("{}: PVI @sta {:.2f} fallo ({})"
                                   .format(aname, s, first_pvi_err))

                if first_pvi_method and n_pvi_ok > 0:
                    log.append("{}: PVIs con firma {} (total {}/{})"
                               .format(aname, first_pvi_method,
                                       n_pvi_ok, len(pvis_final)))

                # 9. Anyadir acuerdos: USO "AddFreeSymmetricParabolaByPVIAndCurveLength"
                #    (el metodo "por PVI") porque tiene 2 params claros (PVI, double)
                #    y corresponde al boton "Free Vertical Curve (Parabola)" del
                #    menu de Civil 3D.
                n_curves = 0
                curve_errors = []
                try:
                    entities = new_prof.Entities
                    n_ent = entities.Count

                    # Diagnostico (solo primer eje): firmas COMPLETAS de
                    # todos los metodos AddFreeSymmetric*
                    if first_iter:
                        try:
                            ct = clr.GetClrType(entities.GetType())
                            for m in ct.GetMethods():
                                if (m.Name.startswith("AddFree")
                                        and "Parabola" in m.Name):
                                    params_str = ", ".join(
                                        "{} {}".format(
                                            p.ParameterType.Name, p.Name)
                                        for p in m.GetParameters())
                                    log.append("  {}({})".format(
                                        m.Name, params_str))
                        except Exception as ex_r:
                            log.append("  Reflection error: "
                                       + str(ex_r)[:150])

                    # Iterar PVIs interiores (sin el 1o ni el ultimo)
                    pvi_coll = new_prof.PVIs
                    n_pvi = pvi_coll.Count
                    log.append("{}: PVI count en profile = {}"
                               .format(aname, n_pvi))

                    for pi in range(1, n_pvi - 1):
                        try:
                            pvi = pvi_coll.get_Item(pi)
                        except Exception:
                            try:
                                pvi = pvi_coll[pi]
                            except Exception as ex_g:
                                curve_errors.append(
                                    "PVI[{}] acceso: {}".format(
                                        pi, str(ex_g)[:100]))
                                continue
                        try:
                            entities.AddFreeSymmetricParabolaByPVIAndCurveLength(
                                pvi, float(min_curve_length))
                            n_curves += 1
                        except Exception as ex_c:
                            if len(curve_errors) < 3:
                                curve_errors.append(
                                    "PVI[{}] AddCurve: {}".format(
                                        pi, str(ex_c)[:300]))
                except Exception as ex_cv:
                    log.append("{}: error general acuerdos: {}"
                               .format(aname, str(ex_cv)[:200]))

                # Loguear resultado
                n_expected = max(0, len(pvis_final) - 2)
                log.append("{}: acuerdos OK={}/{} esperados"
                           .format(aname, n_curves, n_expected))
                if curve_errors:
                    for ce in curve_errors:
                        log.append("  {}: {}".format(aname, ce))

                rasantes_created.append(
                    "{}: {} PVIs, {} acuerdos (muestras TN={}, DP={})"
                    .format(rasante_name, n_pvi_ok, n_curves,
                            len(tn_samples), len(pvis_dp)))

            except Exception as ex:
                log.append("{}: fallo generar rasante: {}"
                           .format(aname, str(ex)))

        log.append("Rasantes creadas: {}".format(len(rasantes_created)))
        tr.Commit()

except Exception:
    log.append("ERROR GLOBAL: " + traceback.format_exc())
    try:
        if tr: tr.Abort()
    except Exception:
        pass
finally:
    try:
        if tr: tr.Dispose()
    except Exception:
        pass
    try:
        if lck: lck.Dispose()
    except Exception:
        pass


OUT = [rasantes_created, log]
# ----------------------------------------
n0_rasantes = List.GetItemAtIndex(list=paso_3_generar_rasante_auto, index=n0)  # "[0] rasantes"
rasantes_creadas = Watch(n0_rasantes)  # graph output
n1_log_p3 = List.GetItemAtIndex(list=paso_3_generar_rasante_auto, index=n1)  # "[1] log P3"
log_paso_3 = Watch(n1_log_p3)  # graph output

n17_assembly_del_corredor = StringInput("ANCHO 4m T1")  # "17 Assembly del corredor"; graph input
n18_prefijo_rasante_corredor = StringInput("RAS")  # "18 Prefijo rasante corredor"; graph input
paso_4_crear_corredores = Python(IN[0]=n17_assembly_del_corredor, IN[1]=n02_superficie_tn, IN[2]=n18_prefijo_rasante_corredor, IN[3]=n0_rasantes)  # CPython3
# ---------- paso_4_crear_corredores.python (387 lines) ----------
# -*- coding: utf-8 -*-
# =============================================================================
# Create_Corridors (integrado en Rasante_y_Corredores.dyn)
# Civil 3D 2024 / Dynamo / CPython3
#
# IN[0] : str   nombre del assembly
# IN[1] : str   nombre de la superficie MDT (target)
# IN[2] : str   prefijo rasante (ej. "RAS")
# IN[3] : any   SYNC BARRIER (output del Paso 3) - no se usa, solo fuerza orden
# =============================================================================

import clr
import traceback

clr.AddReference('AcMgd')
clr.AddReference('AcCoreMgd')
clr.AddReference('AcDbMgd')
clr.AddReference('AecBaseMgd')
clr.AddReference('AeccDbMgd')

from Autodesk.AutoCAD.ApplicationServices import Application as AcadApp
from Autodesk.AutoCAD.DatabaseServices import (
    OpenMode, ObjectIdCollection, SymbolUtilityServices, ObjectId
)
from Autodesk.Civil.ApplicationServices import CivilApplication
from Autodesk.Civil.DatabaseServices import (
    Alignment, Profile, Corridor, Assembly
)
from System import Enum
from System.Reflection import BindingFlags
from System import AppDomain

CORRIDOR_STYLE_NAME     = "Not display"
CODE_SET_STYLE_NAME     = "Plan View - Solid Hatch (Lynka)"
SURFACE_STYLE_NAME      = "_No Display"
TOP_PREFIX              = "TOP "
DATUM_PREFIX            = "DATUM "
TOP_CODE                = "Top"
DATUM_CODE              = "Datum"
BOUNDARY_NAME           = "Corridor Boundary(1)"
TARGET_SUBASM_PREFIXES  = ("C1 -", "F1 -", "C1-", "F1-")

log = []
def say(m): log.append(str(m))

assembly_name = str(IN[0]).strip()
mdt_name      = str(IN[1]).strip()
ras_prefix    = str(IN[2]).strip()
# IN[3] es el sync barrier desde Paso 3 (ignorado)

say("=== CREAR CORREDORES ===")
say("Assembly: '{}'".format(assembly_name))
say("MDT target: '{}'".format(mdt_name))
say("Prefijo rasante: '{}'".format(ras_prefix))
say("")

doc = AcadApp.DocumentManager.MdiActiveDocument
db  = doc.Database

def safe_name(obj):
    try: return obj.Name
    except: pass
    try: return obj.get_Name()
    except: pass
    return None

def find_type_by_name(simple_name):
    for asm in AppDomain.CurrentDomain.GetAssemblies():
        try:
            for t in asm.GetExportedTypes():
                if t.Name == simple_name:
                    return t
        except: continue
    return None

def find_style_id_in_collection(tr_local, coll, target_name):
    try:
        for sid in coll:
            try:
                s = tr_local.GetObject(sid, OpenMode.ForRead)
                nm = safe_name(s)
                if nm and nm.strip() == target_name:
                    return sid
            except: continue
    except: pass
    try:
        for i in range(coll.Count):
            sid = coll.get_Item(i) if hasattr(coll, 'get_Item') else coll[i]
            try:
                s = tr_local.GetObject(sid, OpenMode.ForRead)
                nm = safe_name(s)
                if nm and nm.strip() == target_name:
                    return sid
            except: continue
    except: pass
    return None

def get_subasm_name(ti):
    for attr in ("SubassemblyName", "SubAssemblyName",
                 "SubassemblyLogicalName", "AssemblyGroupName"):
        if hasattr(ti, attr):
            try:
                v = getattr(ti, attr)
                if v is not None:
                    return str(v)
            except: continue
    return ""

def starts_with_any(name, prefixes):
    n_lower = name.lower().strip()
    for p in prefixes:
        if n_lower.startswith(p.lower()):
            return True
    return False

oc_type   = find_type_by_name("OverhangCorrectionType")
csbt_type = find_type_by_name("CorridorSurfaceBoundaryType")
oc_top_links = None
oc_bottom_links = None
csbt_outside = None
if oc_type is not None:
    try: oc_top_links = Enum.Parse(oc_type, "TopLinks")
    except: pass
    try: oc_bottom_links = Enum.Parse(oc_type, "BottomLinks")
    except: pass
if csbt_type is not None:
    for cand in ("OutsideBoundary", "Outside", "Outer"):
        try:
            csbt_outside = Enum.Parse(csbt_type, cand)
            break
        except: continue

n_created = 0
n_skipped = 0
n_errors  = 0

doc_lock = doc.LockDocument()
try:
    tr = db.TransactionManager.StartTransaction()
    try:
        civDoc = CivilApplication.ActiveDocument

        mdt_surf_id = None
        for sid in civDoc.GetSurfaceIds():
            s = tr.GetObject(sid, OpenMode.ForRead)
            if safe_name(s) == mdt_name:
                mdt_surf_id = sid
                break
        if mdt_surf_id is None:
            raise Exception("Superficie '{}' no encontrada.".format(mdt_name))
        say("MDT: OK")

        assembly_id = None
        bt = tr.GetObject(db.BlockTableId, OpenMode.ForRead)
        ms_id = SymbolUtilityServices.GetBlockModelSpaceId(db)
        btr = tr.GetObject(ms_id, OpenMode.ForRead)
        for oid in btr:
            try:
                obj = tr.GetObject(oid, OpenMode.ForRead)
                if isinstance(obj, Assembly):
                    if safe_name(obj) == assembly_name:
                        assembly_id = oid
                        break
            except: continue
        if assembly_id is None:
            raise Exception("Assembly '{}' no encontrado.".format(assembly_name))
        say("Assembly: OK")

        surface_style_id = ObjectId.Null
        try:
            surf_styles = civDoc.Styles.SurfaceStyles
            surface_style_id = find_style_id_in_collection(
                tr, surf_styles, SURFACE_STYLE_NAME)
            if surface_style_id is None or surface_style_id == ObjectId.Null:
                say("AVISO: SurfaceStyle '{}' no encontrado".format(SURFACE_STYLE_NAME))
                surface_style_id = ObjectId.Null
        except Exception as ex:
            say("AVISO SurfaceStyles: {}".format(str(ex)[:150]))

        say("")
        corr_coll = civDoc.CorridorCollection
        align_ids = civDoc.GetAlignmentIds()
        say("Alignments en dibujo: {}".format(align_ids.Count))
        say("")

        for aidx in range(align_ids.Count):
            a_id = align_ids.get_Item(aidx)
            al = tr.GetObject(a_id, OpenMode.ForRead)
            align_name = safe_name(al)
            if align_name is None:
                n_skipped += 1
                continue

            rasante_id = None
            rasante_name = None
            prof_ids = al.GetProfileIds()
            pfx_lower = ras_prefix.lower()
            all_profiles = []
            for pidx in range(prof_ids.Count):
                p_id = prof_ids.get_Item(pidx)
                prof = tr.GetObject(p_id, OpenMode.ForRead)
                pname = safe_name(prof)
                if pname: all_profiles.append(pname)
                if pname and pname.strip().lower().startswith(pfx_lower):
                    rasante_id = p_id
                    rasante_name = pname
                    break
            if rasante_id is None:
                n_skipped += 1
                say("[SKIP] '{}': sin rasante. Perfiles: {}".format(
                    align_name, all_profiles))
                continue

            start_sta = al.StartingStation
            end_sta   = al.EndingStation
            corr_name = align_name

            try:
                for i in range(corr_coll.Count):
                    existing_id = corr_coll.get_Item(i)
                    try:
                        ec = tr.GetObject(existing_id, OpenMode.ForRead)
                        if safe_name(ec) == corr_name:
                            ec.UpgradeOpen()
                            ec.Erase()
                            break
                    except: continue
            except: pass

            try:
                new_corr_id = corr_coll.Add(corr_name)
                corridor = tr.GetObject(new_corr_id, OpenMode.ForWrite)

                try: corridor.StyleName = CORRIDOR_STYLE_NAME
                except: pass
                try: corridor.CodeSetStyleName = CODE_SET_STYLE_NAME
                except: pass

                bl_name = "BL_" + align_name
                if len(bl_name) > 80: bl_name = bl_name[:80]
                baseline = corridor.Baselines.Add(bl_name, a_id, rasante_id)

                region = baseline.BaselineRegions.Add(
                    "Region_1", assembly_id, start_sta, end_sta)

                # Frecuencia default de UI Civil 3D 2024
                try:
                    aas = region.AppliedAssemblySetting
                    aas.FrequencyAlongTangents                = 10.0
                    aas.FrequencyAlongCurves                  = 2.0
                    aas.FrequencyAlongSpirals                 = 10.0
                    aas.MODAlongCurves                        = 0.1
                    aas.AppliedAtHorizontalGeometryPoints     = True
                    aas.AppliedAtSuperelevationCriticalPoints = True
                    aas.FrequencyAlongProfileCurves           = 5.0
                    aas.AppliedAtProfileGeometryPoints        = True
                    aas.AppliedAtProfileHighLowPoints         = True
                    aas.AppliedAtOffsetTargetGeometryPoints   = True
                    aas.AppliedAdjacentToOffsetTargetStartEnd = True
                except Exception as ex_freq:
                    if n_created == 0:
                        say("  AVISO freq: {}".format(str(ex_freq)[:150]))

                # Targets: MDT solo en C1-/F1- con TargetType==1 (Surface)
                try:
                    tgts = region.GetTargets()
                    changed = False
                    first_log = (n_created == 0)
                    n_assigned = 0

                    for ti_idx in range(tgts.Count):
                        ti = tgts.get_Item(ti_idx)
                        sub_name = get_subasm_name(ti)
                        if not starts_with_any(sub_name, TARGET_SUBASM_PREFIXES):
                            continue
                        try: tt_int = int(ti.TargetType)
                        except: continue
                        if tt_int != 1:
                            continue
                        ids = ObjectIdCollection()
                        ids.Add(mdt_surf_id)
                        try:
                            ti.TargetIds = ids
                            changed = True
                            n_assigned += 1
                        except Exception as ex_set:
                            if first_log:
                                say("  TargetIds fail '{}': {}".format(
                                    sub_name, str(ex_set)[:80]))

                    if first_log:
                        say("  Targets MDT asignados: {}".format(n_assigned))
                    if changed:
                        region.SetTargets(tgts)
                except Exception as ex_tgt:
                    if n_created == 0:
                        say("  AVISO targets: {}".format(str(ex_tgt)[:120]))

                try: corridor.Rebuild()
                except Exception as ex_rb:
                    say("  AVISO Rebuild-1 '{}': {}".format(corr_name, str(ex_rb)[:100]))

                top_surf_name   = TOP_PREFIX   + align_name
                datum_surf_name = DATUM_PREFIX + align_name
                try: corridor.CorridorSurfaces.Remove(top_surf_name)
                except: pass
                try: corridor.CorridorSurfaces.Remove(datum_surf_name)
                except: pass

                top_surf = corridor.CorridorSurfaces.Add(top_surf_name)
                if surface_style_id is not None and surface_style_id != ObjectId.Null:
                    try: top_surf.SurfaceStyleId = surface_style_id
                    except: pass
                added_top = False
                for code_variant in (TOP_CODE, TOP_CODE.lower(), TOP_CODE.upper()):
                    try:
                        top_surf.AddLinkCode(code_variant, False)
                        added_top = True
                        break
                    except: continue
                if oc_top_links is not None:
                    try: top_surf.OverhangCorrection = oc_top_links
                    except: pass

                datum_surf = corridor.CorridorSurfaces.Add(datum_surf_name)
                if surface_style_id is not None and surface_style_id != ObjectId.Null:
                    try: datum_surf.SurfaceStyleId = surface_style_id
                    except: pass
                added_datum = False
                for code_variant in (DATUM_CODE, DATUM_CODE.lower(), DATUM_CODE.upper()):
                    try:
                        datum_surf.AddLinkCode(code_variant, False)
                        added_datum = True
                        break
                    except: continue
                if oc_bottom_links is not None:
                    try: datum_surf.OverhangCorrection = oc_bottom_links
                    except: pass

                try: corridor.Rebuild()
                except: pass

                try:
                    top_bnd = top_surf.Boundaries.AddCorridorExtentsBoundary(BOUNDARY_NAME)
                    if csbt_outside is not None:
                        try: top_bnd.BoundaryType = csbt_outside
                        except: pass
                except Exception as ex_b1:
                    say("  AVISO TOP boundary: {}".format(str(ex_b1)[:120]))
                try:
                    datum_bnd = datum_surf.Boundaries.AddCorridorExtentsBoundary(BOUNDARY_NAME)
                    if csbt_outside is not None:
                        try: datum_bnd.BoundaryType = csbt_outside
                        except: pass
                except Exception as ex_b2:
                    say("  AVISO DATUM boundary: {}".format(str(ex_b2)[:120]))

                try: corridor.Rebuild()
                except: pass

                n_created += 1
                status = "TOP:{} DATUM:{}".format(
                    "OK" if added_top else "FAIL",
                    "OK" if added_datum else "FAIL")
                say("[OK] '{}' | rasante '{}' | {:.1f}-{:.1f} | {}".format(
                    corr_name, rasante_name, start_sta, end_sta, status))

            except Exception as ex:
                n_errors += 1
                say("[ERROR] '{}': {}".format(align_name, str(ex)[:200]))
                if n_errors <= 2:
                    for line in traceback.format_exc().split("\n")[:6]:
                        say("    " + line)

        tr.Commit()
    finally:
        tr.Dispose()
finally:
    doc_lock.Dispose()

say("")
say("=== RESUMEN CORREDORES ===")
say("Corredores creados: {}".format(n_created))
say("Skipped (sin rasante): {}".format(n_skipped))
say("Errores: {}".format(n_errors))

OUT = log
# ----------------------------------------
log_corredores = Watch(paso_4_crear_corredores)
