# Dynamo graph Slope_Analysis_EW.dyn (Dynamo 2.19.4.6671)
# Analisis de pendientes E-W del terreno original para trackers 1P rigidos. Empareja cada tracker con su vecino Este y densifica 3 veces (9 puntos).

superficie_a_analizar = StringInput("Trackers_Proyecto")  # graph input
capa_de_contorno = StringInput("_Contornos")  # graph input
capa_de_trackers = StringInput("_Lineas_Rotura")  # graph input
pitch_minimo_m = DoubleInput(3)  # graph input
pitch_maximo_m = DoubleInput(15)  # graph input
pendiente_maxima_admisible = DoubleInput(7)  # graph input
pendiente_de_aviso = DoubleInput(5)  # graph input
nombre_de_la_nueva_superficie = StringInput("Slope_Analysis_E-W")  # graph input
iteraciones_de_subdivision = DoubleInput(3)  # graph input
slope_analysis_e_w = Python(IN[0]=superficie_a_analizar, IN[1]=capa_de_contorno, IN[2]=capa_de_trackers, IN[3]=pitch_minimo_m, IN[4]=pitch_maximo_m, IN[5]=pendiente_maxima_admisible, IN[6]=pendiente_de_aviso, IN[7]=nombre_de_la_nueva_superficie, IN[8]=iteraciones_de_subdivision)  # CPython3
# ---------- slope_analysis_e_w.python (398 lines) ----------
# -*- coding: utf-8 -*-
# =============================================================================
# Slope_Analysis_EW.dyn  -  Nodo Python principal
# Civil 3D 2024 / Dynamo / CPython3
#
# Entradas (puertos IN[0..8]):
#   IN[0] : str    nombre del MDT
#   IN[1] : str    nombre de capa del contorno
#   IN[2] : str    nombre de capa de los trackers
#   IN[3] : float  pitch minimo (m)
#   IN[4] : float  pitch maximo (m)
#   IN[5] : float  pendiente maxima admisible (%)
#   IN[6] : float  pendiente de aviso (%)
#   IN[7] : str    nombre de la nueva superficie TIN
#   IN[8] : int    iteraciones de subdivision (n -> 2^n+1 puntos por tracker)
#                  0 = solo extremos (2 pts), 1 = 3, 2 = 5, 3 = 9, 4 = 17
#
# Salida:
#   OUT   : str    log con el resumen del analisis
# =============================================================================

import clr
import math
import traceback

clr.AddReference('AcMgd')
clr.AddReference('AcCoreMgd')
clr.AddReference('AcDbMgd')
clr.AddReference('AecBaseMgd')
clr.AddReference('AeccDbMgd')

from Autodesk.AutoCAD.ApplicationServices import Application as AcadApp
from Autodesk.AutoCAD.DatabaseServices import (
    Transaction, OpenMode, BlockTable, BlockTableRecord,
    Polyline, SymbolUtilityServices
)
from Autodesk.AutoCAD.Geometry import Point2d, Point3d, Point3dCollection
from Autodesk.Civil import SurfaceBoundaryType
from Autodesk.Civil.ApplicationServices import CivilApplication
from Autodesk.Civil.DatabaseServices import (
    TinSurface, SurfaceAnalysisElevationData, SurfaceSlopeLabel
)

import System
from System import Array
from System.Drawing import Color

# --------------------------------------------------------------------------- #
# Inputs
# --------------------------------------------------------------------------- #
mdt_name       = str(IN[0])
contour_layer  = str(IN[1])
tracker_layer  = str(IN[2])
pitch_min      = float(IN[3])
pitch_max      = float(IN[4])
max_slope_pct  = float(IN[5])
warn_slope_pct = float(IN[6])
out_surf_name  = str(IN[7])
n_iter         = int(IN[8]) if len(IN) > 8 and IN[8] is not None else 3

log = []

def pip(px, py, poly):
    """Ray-casting point-in-polygon."""
    inside = False
    n = len(poly)
    if n < 3:
        return False
    j = n - 1
    for i in range(n):
        xi, yi = poly[i]
        xj, yj = poly[j]
        if ((yi > py) != (yj > py)) and \
           (px < (xj - xi) * (py - yi) / ((yj - yi) if (yj - yi) != 0 else 1e-12) + xi):
            inside = not inside
        j = i
    return inside

try:
    doc  = AcadApp.DocumentManager.MdiActiveDocument
    db   = doc.Database
    cdoc = CivilApplication.ActiveDocument

    dlock = doc.LockDocument()
    try:
        tr = db.TransactionManager.StartTransaction()
        try:

            # ---------------------------------------------------------------- #
            # 1. MDT
            # ---------------------------------------------------------------- #
            mdt_surf = None
            mdt_surf_id = None
            for sid in cdoc.GetSurfaceIds():
                s = tr.GetObject(sid, OpenMode.ForRead)
                if s.Name == mdt_name:
                    mdt_surf = s
                    mdt_surf_id = sid
                    break
            if mdt_surf is None:
                raise Exception("No se ha encontrado el MDT '{}'.".format(mdt_name))

            # ---------------------------------------------------------------- #
            # 2. Recorrer ModelSpace
            # ---------------------------------------------------------------- #
            bt  = tr.GetObject(db.BlockTableId, OpenMode.ForRead)
            ms_id = SymbolUtilityServices.GetBlockModelSpaceId(db)
            btr = tr.GetObject(ms_id, OpenMode.ForRead)

            contours = []
            trackers = []   # lista de dicts con vertices A(N) y B(S)

            for oid in btr:
                obj = tr.GetObject(oid, OpenMode.ForRead)
                if not isinstance(obj, Polyline):
                    continue
                lay = obj.Layer
                n = obj.NumberOfVertices
                if lay == contour_layer and n >= 3:
                    pts = []
                    for i in range(n):
                        p = obj.GetPoint2dAt(i)
                        pts.append((p.X, p.Y))
                    contours.append(pts)
                elif lay == tracker_layer and n >= 2:
                    p1 = obj.GetPoint2dAt(0)
                    p2 = obj.GetPoint2dAt(n - 1)
                    # Forzar A = Norte (mayor Y)
                    if p1.Y >= p2.Y:
                        ax, ay, bx, by = p1.X, p1.Y, p2.X, p2.Y
                    else:
                        ax, ay, bx, by = p2.X, p2.Y, p1.X, p1.Y
                    trackers.append({
                        "ax": ax, "ay": ay,
                        "bx": bx, "by": by,
                        "xmid": (ax + bx) / 2.0,
                        "ymin": min(ay, by),
                        "ymax": max(ay, by),
                        "handle": str(obj.Handle)
                    })

            if not contours:
                raise Exception("No hay polilineas en la capa de contorno '{}'.".format(contour_layer))
            if not trackers:
                raise Exception("No hay polilineas en la capa de trackers '{}'.".format(tracker_layer))

            log.append("Contornos encontrados: {}".format(len(contours)))
            log.append("Trackers encontrados:  {}".format(len(trackers)))

            # ---------------------------------------------------------------- #
            # 3. Filtrar trackers con ambos vertices dentro del contorno
            # ---------------------------------------------------------------- #
            inside_trackers = []
            n_out = 0
            for t in trackers:
                inA = any(pip(t["ax"], t["ay"], c) for c in contours)
                inB = any(pip(t["bx"], t["by"], c) for c in contours)
                if inA and inB:
                    inside_trackers.append(t)
                else:
                    n_out += 1

            if not inside_trackers:
                raise Exception("Ningun tracker dentro del contorno.")

            # ---------------------------------------------------------------- #
            # 4. Emparejamiento con vecino Este
            # ---------------------------------------------------------------- #
            def find_east_neighbor(T, pool, pmin, pmax):
                candidates = []
                for U in pool:
                    if U is T:
                        continue
                    dx = U["xmid"] - T["xmid"]
                    if dx <= 1e-6:
                        continue
                    if dx < pmin or dx > pmax:
                        continue
                    # Solape en Y
                    if min(T["ymax"], U["ymax"]) <= max(T["ymin"], U["ymin"]):
                        continue
                    candidates.append((dx, U))
                if not candidates:
                    return None
                candidates.sort(key=lambda c: c[0])   # mas cercano dentro del rango
                return candidates[0][1]

            pairs = []
            n_no_neighbor = 0
            for T in inside_trackers:
                N = find_east_neighbor(T, inside_trackers, pitch_min, pitch_max)
                if N is None:
                    n_no_neighbor += 1
                    continue
                pairs.append((T, N))

            if not pairs:
                raise Exception("Ningun tracker tiene vecino al Este. "
                                "Revisa el pitch o la geometria.")

            # ---------------------------------------------------------------- #
            # 5. Densificar y calcular pendientes por pareja
            # ---------------------------------------------------------------- #
            # n_iter iteraciones de insercion de punto medio -> 2^n+1 puntos
            n_pts = (1 << max(0, n_iter)) + 1   # 2^n + 1
            if n_pts < 2:
                n_pts = 2
            denom = float(n_pts - 1)
            t_params = [i / denom for i in range(n_pts)]

            # Para cada pareja guardamos (T, N, [(pT_xy, pN_xy, slope), ...])
            pair_data = []
            label_pairs = []   # n_pts etiquetas por pareja (1 por vertice densificado)
            n_ok = n_warn = n_ko = n_err = 0

            # Tolerancia para considerar horizontal un tracker (en metros)
            HORIZ_TOL = 0.1

            for T, N in pairs:
                Tax, Tay, Tbx, Tby = T["ax"], T["ay"], T["bx"], T["by"]
                Nax, Nay, Nbx, Nby = N["ax"], N["ay"], N["bx"], N["by"]

                pair_points = []

                for tp in t_params:
                    # Punto sobre T (equiespaciado)
                    px = Tax + tp * (Tbx - Tax)
                    py = Tay + tp * (Tby - Tay)

                    # ---------------------------------------------------------
                    # Proyección EXACTA horizontal sobre la recta del vecino N
                    # (extrapolando si es necesario)
                    # ---------------------------------------------------------
                    if abs(Nay - Nby) < 1e-9:
                        # N es horizontal: solo hay proyección si py está cerca de Nay
                        if abs(py - Nay) > HORIZ_TOL:
                            n_err += 1
                            continue
                        nx = px
                        ny = Nay
                    else:
                        # N no horizontal: resolver t_n tal que y = py
                        t_n = (py - Nay) / (Nby - Nay)
                        nx = Nax + t_n * (Nbx - Nax)
                        ny = py

                    # Distancia horizontal (dy = 0)
                    L = abs(nx - px)
                    if L < 1e-6:
                        n_err += 1
                        continue

                    try:
                        zT = mdt_surf.FindElevationAtXY(px, py)
                        zN = mdt_surf.FindElevationAtXY(nx, ny)
                    except:
                        n_err += 1
                        continue

                    slope_pct = (zN - zT) / L * 100.0

                    if abs(slope_pct) > max_slope_pct:
                        n_ko += 1
                    elif abs(slope_pct) > warn_slope_pct:
                        n_warn += 1
                    else:
                        n_ok += 1

                    pair_points.append(((px, py), (nx, ny), slope_pct))

                    # ---------------------------------------------------------
                    # Etiqueta solo si AMBOS puntos están dentro de ALGÚN contorno
                    # ---------------------------------------------------------
                    if contours:
                        inside_any = False
                        for c in contours:
                            if pip(px, py, c) and pip(nx, ny, c):
                                inside_any = True
                                break
                        if inside_any:
                            label_pairs.append((Point2d(px, py), Point2d(nx, ny)))

                pair_data.append((T, N, pair_points))

            # ---------------------------------------------------------------- #
            # 5b. Construir puntos de la superficie
            # ---------------------------------------------------------------- #
            surf_points = []
            for T, N, pp in pair_data:
                for (px, py), (nx, ny), sl in pp:
                    # Ambos puntos tienen la misma Y (horizontalidad garantizada)
                    surf_points.append(Point3d(px, py, sl))
                    surf_points.append(Point3d(nx, ny, sl))

            if not surf_points:
                raise Exception("No se han podido calcular pendientes.")

            # ---------------------------------------------------------------- #
            # 6. Crear superficie TIN
            # ---------------------------------------------------------------- #
            existing_id = None
            for sid in cdoc.GetSurfaceIds():
                s = tr.GetObject(sid, OpenMode.ForRead)
                if s.Name == out_surf_name:
                    existing_id = sid
                    break
            if existing_id is not None:
                sx = tr.GetObject(existing_id, OpenMode.ForWrite)
                sx.Erase()

            new_surf_id = TinSurface.Create(db, out_surf_name)
            new_surf    = tr.GetObject(new_surf_id, OpenMode.ForWrite)

            # Limitar longitud maxima de lado de triangulo
            max_tri_side = pitch_max * 1.5
            try:
                bops = new_surf.BuildOptions
                bops.UseMaximumTriangleLength = True
                bops.MaximumTriangleLength = max_tri_side
                new_surf.BuildOptions = bops
                log.append("Max triangle side: {:.2f} m".format(max_tri_side))
            except Exception as ex_bo:
                log.append("AVISO: no se pudo configurar max triangle side por API "
                           "({}). Configuralo a mano en Surface Properties -> "
                           "Definition -> Build -> Use maximum triangle length = "
                           "{:.2f} m.".format(ex_bo, max_tri_side))

            for p in surf_points:
                new_surf.AddVertex(p)

            # ---------------------------------------------------------------- #
            # 7. Contornos
            # ---------------------------------------------------------------- #
            first = True
            for c in contours:
                pc = Point3dCollection()
                for (x, y) in c:
                    pc.Add(Point3d(x, y, 0.0))
                if (c[0][0], c[0][1]) != (c[-1][0], c[-1][1]):
                    pc.Add(Point3d(c[0][0], c[0][1], 0.0))
                btype = SurfaceBoundaryType.Outer if first else SurfaceBoundaryType.Show
                new_surf.BoundariesDefinition.AddBoundaries(pc, 1.0, btype, True)
                first = False

            # ---------------------------------------------------------------- #
            # 8. Etiquetas de pendiente "Two points" sobre el MDT
            # ---------------------------------------------------------------- #
            slope_style_id = None
            try:
                lss = cdoc.Styles.LabelStyles.SurfaceLabelStyles.SlopeLabelStyles
                for stid in lss:
                    slope_style_id = stid
                    break
            except Exception as ex_ss:
                log.append("AVISO: no se pudo leer SlopeLabelStyles: {}".format(ex_ss))

            n_labels = 0
            n_label_err = 0
            first_err = None
            for pA, pB in label_pairs:
                try:
                    if slope_style_id is not None:
                        SurfaceSlopeLabel.Create(mdt_surf_id, pA, pB, slope_style_id)
                    else:
                        SurfaceSlopeLabel.Create(mdt_surf_id, pA, pB)
                    n_labels += 1
                except Exception as ex_lb:
                    n_label_err += 1
                    if first_err is None:
                        first_err = str(ex_lb)

            tr.Commit()
        finally:
            tr.Dispose()
    finally:
        dlock.Dispose()

    log.append("")
    log.append("=== RESUMEN E-W ===")
    log.append("Rango de pitch: [{} m, {} m]".format(pitch_min, pitch_max))
    log.append("Trackers fuera del contorno:     {}".format(n_out))
    log.append("Trackers sin vecino al Este:     {}".format(n_no_neighbor))
    log.append("Parejas analizadas:              {}".format(len(pairs)))
    log.append("Puntos calculados ({} por pareja):{}".format(n_pts, n_ok + n_warn + n_ko))
    log.append("  Verde   (|p| <= {} %):         {}".format(warn_slope_pct, n_ok))
    log.append("  Amarillo({} - {} %):           {}".format(warn_slope_pct, max_slope_pct, n_warn))
    log.append("  Rojo    (|p| > {} %):          {}".format(max_slope_pct, n_ko))
    log.append("Puntos con error de muestreo:    {}".format(n_err))
    log.append("Etiquetas creadas:               {}".format(n_labels))
    if n_label_err > 0:
        log.append("Etiquetas con error:             {}".format(n_label_err))
        log.append("Primer error: {}".format(first_err))
    log.append("Superficie creada:               {}".format(out_surf_name))

    OUT = "\n".join(log)

except Exception as ex:
    OUT = "ERROR:\n" + str(ex) + "\n\n" + traceback.format_exc()
# ----------------------------------------
log = Watch(slope_analysis_e_w)  # graph output
