# Dynamo graph Slope_Analysis_NS_1punto.dyn (Dynamo 2.19.4.6671)
# Analisis de pendientes N-S del terreno original para trackers 1P rigidos. Genera superficie TIN 'Slope_Analysis_N-S' con 3 rangos de color.

mdt_nombre_del_data_shortcut = StringInput("MdT_Apamate_Topografia_E")  # graph input
capa_de_contorno = StringInput("_contornos offset")  # graph input
capa_de_trackers = StringInput("_Lineas rotura")  # graph input
pendiente_maxima_admisible = DoubleInput(4)  # graph input
pendiente_de_aviso = DoubleInput(3.5)  # graph input
nombre_de_la_nueva_superficie = StringInput("Slope_Analysis_N-S_1punto")  # graph input
slope_analysis_n_s = Python(IN[0]=mdt_nombre_del_data_shortcut, IN[1]=capa_de_contorno, IN[2]=capa_de_trackers, IN[3]=pendiente_maxima_admisible, IN[4]=pendiente_de_aviso, IN[5]=nombre_de_la_nueva_superficie)  # CPython3
# ---------- slope_analysis_n_s.python (316 lines) ----------
# -*- coding: utf-8 -*-
# =============================================================================
# Slope_Analysis_NS.dyn  -  Nodo Python principal
# Civil 3D 2024 / Dynamo / CPython3
#
# Entradas (puertos IN[0..6]):
#   IN[0] : str    nombre del MDT (surface ya referenciado por data shortcut)
#   IN[1] : str    nombre de capa del contorno (polilineas cerradas)
#   IN[2] : str    nombre de capa de los trackers (polilineas de 2 vertices)
#   IN[3] : float  pendiente maxima admisible (%)  --> umbral rojo
#   IN[4] : float  pendiente de aviso (%)          --> umbral amarillo
#   IN[5] : str    nombre de la nueva superficie TIN (p.ej. "Slope_Analysis_N-S")
#   IN[6] : str    nombre del estilo de superficie a asignar
#                  (debe existir en el dibujo; "Standard" como fallback)
#
# Salida:
#   OUT   : str    log con el resumen del analisis
# =============================================================================

import clr
import math
import traceback

clr.AddReference('AcMgd')
clr.AddReference('AcCoreMgd')
clr.AddReference('AcDbMgd')
clr.AddReference('AecBaseMgd')
clr.AddReference('AeccDbMgd')

from Autodesk.AutoCAD.ApplicationServices import Application as AcadApp
from Autodesk.AutoCAD.DatabaseServices import (
    Transaction, OpenMode, BlockTable, BlockTableRecord,
    Polyline, SymbolUtilityServices
)
from Autodesk.AutoCAD.Geometry import Point2d, Point3d, Point3dCollection
from Autodesk.Civil import SurfaceBoundaryType
from Autodesk.Civil.ApplicationServices import CivilApplication
from Autodesk.Civil.DatabaseServices import (
    TinSurface, SurfaceAnalysisElevationData, SurfaceSlopeLabel
)

import System
from System import Array
from System.Drawing import Color

# --------------------------------------------------------------------------- #
# Inputs
# --------------------------------------------------------------------------- #
mdt_name       = str(IN[0])
contour_layer  = str(IN[1])
tracker_layer  = str(IN[2])
max_slope_pct  = float(IN[3])
warn_slope_pct = float(IN[4])
out_surf_name  = str(IN[5])

log = []

def pip(px, py, poly):
    """Ray-casting point-in-polygon (poly = list of (x,y), no need to close)."""
    inside = False
    n = len(poly)
    if n < 3:
        return False
    j = n - 1
    for i in range(n):
        xi, yi = poly[i]
        xj, yj = poly[j]
        if ((yi > py) != (yj > py)) and \
           (px < (xj - xi) * (py - yi) / ((yj - yi) if (yj - yi) != 0 else 1e-12) + xi):
            inside = not inside
        j = i
    return inside

try:
    doc  = AcadApp.DocumentManager.MdiActiveDocument
    db   = doc.Database
    cdoc = CivilApplication.ActiveDocument

    dlock = doc.LockDocument()
    try:
        tr = db.TransactionManager.StartTransaction()
        try:

            # ---------------------------------------------------------------- #
            # 1. Localizar el MDT por nombre
            # ---------------------------------------------------------------- #
            mdt_surf = None
            mdt_surf_id = None
            for sid in cdoc.GetSurfaceIds():
                s = tr.GetObject(sid, OpenMode.ForRead)
                if s.Name == mdt_name:
                    mdt_surf = s
                    mdt_surf_id = sid
                    break
            if mdt_surf is None:
                raise Exception("No se ha encontrado el MDT '{}'. "
                                "Comprueba que el data shortcut esta referenciado."
                                .format(mdt_name))

            # ---------------------------------------------------------------- #
            # 2. Recorrer ModelSpace y separar contornos / trackers
            # ---------------------------------------------------------------- #
            bt  = tr.GetObject(db.BlockTableId, OpenMode.ForRead)
            ms_id = SymbolUtilityServices.GetBlockModelSpaceId(db)
            btr = tr.GetObject(ms_id, OpenMode.ForRead)

            contours = []   # lista de poligonos [(x,y),...]
            trackers = []   # lista de ((xA,yA),(xB,yB), handle_str)

            for oid in btr:
                obj = tr.GetObject(oid, OpenMode.ForRead)
                if not isinstance(obj, Polyline):
                    continue
                lay = obj.Layer
                n = obj.NumberOfVertices
                if lay == contour_layer and n >= 3:
                    pts = []
                    for i in range(n):
                        p = obj.GetPoint2dAt(i)
                        pts.append((p.X, p.Y))
                    contours.append(pts)
                elif lay == tracker_layer and n >= 2:
                    p1 = obj.GetPoint2dAt(0)
                    p2 = obj.GetPoint2dAt(n - 1)
                    # Forzar que el primer vertice sea el del Norte (mayor Y)
                    if p1.Y >= p2.Y:
                        trackers.append(((p1.X, p1.Y),
                                         (p2.X, p2.Y),
                                         str(obj.Handle)))
                    else:
                        trackers.append(((p2.X, p2.Y),
                                         (p1.X, p1.Y),
                                         str(obj.Handle)))

            if not contours:
                raise Exception("No hay polilineas en la capa de contorno '{}'."
                                .format(contour_layer))
            if not trackers:
                raise Exception("No hay polilineas en la capa de trackers '{}'."
                                .format(tracker_layer))

            log.append("Contornos encontrados: {}".format(len(contours)))
            log.append("Trackers encontrados:  {}".format(len(trackers)))

            # ---------------------------------------------------------------- #
            # 3. Para cada tracker: filtrar por contorno, muestrear Z en MDT,
            #    calcular pendiente absoluta en %, acumular 2 puntos por tracker
            # ---------------------------------------------------------------- #
            surf_points = []   # Point3d con Z = pendiente(%)
            label_pairs = []   # [(Point3d_A, Point3d_B), ...] para etiquetas
            n_ok = n_warn = n_ko = n_out = n_err = 0

            for (xa, ya), (xb, yb), handle in trackers:

                # filtro: AMBOS vertices deben estar dentro de algun contorno
                inA = any(pip(xa, ya, c) for c in contours)
                inB = any(pip(xb, yb, c) for c in contours)
                if not (inA and inB):
                    n_out += 1
                    continue

                # muestreo de cotas en el MDT
                try:
                    za = mdt_surf.FindElevationAtXY(xa, ya)
                    zb = mdt_surf.FindElevationAtXY(xb, yb)
                except:
                    n_err += 1
                    continue

                dx = xb - xa
                dy = yb - ya
                L  = math.sqrt(dx * dx + dy * dy)
                if L < 1e-6:
                    n_err += 1
                    continue

                slope_pct = (zb - za) / L * 100.0

                if abs(slope_pct) > max_slope_pct:
                    n_ko += 1
                elif abs(slope_pct) > warn_slope_pct:
                    n_warn += 1
                else:
                    n_ok += 1

                # Opcion 1: 1 punto por tracker en el centroide 2D
                # con Z = pendiente para triangular entre centroides
                xm = (xa + xb) / 2.0
                ym = (ya + yb) / 2.0
                surf_points.append(Point3d(xm, ym, slope_pct))

                # Acumular para crear etiqueta despues (Point2d)
                label_pairs.append((Point2d(xa, ya), Point2d(xb, yb)))

            if not surf_points:
                raise Exception("Ningun tracker ha podido ser analizado "
                                "(todos fuera de contorno o errores de muestreo).")

            # ---------------------------------------------------------------- #
            # 4. Crear la superficie TIN (borrando la anterior si existe)
            # ---------------------------------------------------------------- #
            existing_id = None
            for sid in cdoc.GetSurfaceIds():
                s = tr.GetObject(sid, OpenMode.ForRead)
                if s.Name == out_surf_name:
                    existing_id = sid
                    break
            if existing_id is not None:
                sx = tr.GetObject(existing_id, OpenMode.ForWrite)
                sx.Erase()

            # Buscar estilo: eliminado. El usuario asigna estilo manualmente.

            new_surf_id = TinSurface.Create(db, out_surf_name)
            new_surf    = tr.GetObject(new_surf_id, OpenMode.ForWrite)

            # Anyadir vertices
            for p in surf_points:
                new_surf.AddVertex(p)

            # ---------------------------------------------------------------- #
            # 5. Anyadir contornos: el primero como Outer, los demas como Show
            # ---------------------------------------------------------------- #
            first = True
            for c in contours:
                pc = Point3dCollection()
                for (x, y) in c:
                    pc.Add(Point3d(x, y, 0.0))
                # cerrar si no esta cerrado
                if (c[0][0], c[0][1]) != (c[-1][0], c[-1][1]):
                    pc.Add(Point3d(c[0][0], c[0][1], 0.0))
                btype = SurfaceBoundaryType.Outer if first else SurfaceBoundaryType.Show
                new_surf.BoundariesDefinition.AddBoundaries(pc, 1.0, btype, True)
                first = False

            # ---------------------------------------------------------------- #
            # 6. Analisis de elevaciones: 3 rangos (verde / amarillo / rojo)
            # ---------------------------------------------------------------- #
            max_z = max(p.Z for p in surf_points)
            upper_red = max(max_z, max_slope_pct + 0.001)

            ranges_def = [
                (0.0,              warn_slope_pct, Color.FromArgb( 80, 200,  80)),  # verde
                (warn_slope_pct,   max_slope_pct,  Color.FromArgb(240, 220,  60)),  # amarillo
                (max_slope_pct,    upper_red,      Color.FromArgb(220,  50,  50)),  # rojo
            ]

            try:
                data_list = []
                for mn, mx, col in ranges_def:
                    d = SurfaceAnalysisElevationData()
                    d.MinimumElevation = mn
                    d.MaximumElevation = mx
                    d.Color            = col
                    data_list.append(d)
                arr = Array[SurfaceAnalysisElevationData](data_list)
                new_surf.Analysis.SetElevationData(arr)
                log.append("Rangos de color aplicados correctamente.")
            except Exception as ex_an:
                log.append("AVISO: no se pudieron aplicar los rangos por API "
                           "({}). Configuralos a mano en el estilo de la superficie."
                           .format(ex_an))

            # ---------------------------------------------------------------- #
            # 7. Etiquetas de pendiente "Two points" sobre el MDT
            # Firma correcta en Civil 3D 2024:
            #   SurfaceSlopeLabel.Create(surfaceId, Point2d, Point2d, styleId)
            # ---------------------------------------------------------------- #
            slope_style_id = None
            try:
                lss = cdoc.Styles.LabelStyles.SurfaceLabelStyles.SlopeLabelStyles
                for stid in lss:
                    slope_style_id = stid
                    break
            except Exception as ex_ss:
                log.append("AVISO: no se pudo leer SlopeLabelStyles: {}".format(ex_ss))

            n_labels = 0
            n_label_err = 0
            first_err = None
            for pA, pB in label_pairs:
                try:
                    if slope_style_id is not None:
                        SurfaceSlopeLabel.Create(mdt_surf_id, pA, pB, slope_style_id)
                    else:
                        SurfaceSlopeLabel.Create(mdt_surf_id, pA, pB)
                    n_labels += 1
                except Exception as ex_lb:
                    n_label_err += 1
                    if first_err is None:
                        first_err = str(ex_lb)
            log.append("Etiquetas de pendiente creadas: {}".format(n_labels))
            if n_label_err > 0:
                log.append("Etiquetas con error: {}".format(n_label_err))
                log.append("Primer error: {}".format(first_err))

            tr.Commit()
        finally:
            tr.Dispose()
    finally:
        dlock.Dispose()

    log.append("")
    log.append("=== RESUMEN ===")
    log.append("Trackers dentro del contorno:  {}".format(n_ok + n_warn + n_ko))
    log.append("  Verde   (<= {} %):          {}".format(warn_slope_pct, n_ok))
    log.append("  Amarillo({} - {} %):        {}".format(warn_slope_pct, max_slope_pct, n_warn))
    log.append("  Rojo    (> {} %):           {}".format(max_slope_pct, n_ko))
    log.append("Trackers fuera del contorno:   {}".format(n_out))
    log.append("Trackers con error de muestreo:{}".format(n_err))
    log.append("Superficie creada:             {}".format(out_surf_name))

    OUT = "\n".join(log)

except Exception as ex:
    OUT = "ERROR:\n" + str(ex) + "\n\n" + traceback.format_exc()
# ----------------------------------------
log = Watch(slope_analysis_n_s)  # graph output
