# Dynamo graph SuperficiesVolumen_MdT.dyn "Volumen_MDT" (Dynamo 2.19.4.6671)
# v6: Multi-zona. Una superficie de volumen por contorno con analysis y leyenda.

superficie_base_trackers = StringInput("Trackers_Apamate_E")  # graph input
superficie_comparacion_mdt = StringInput("MdT_Apamate_Topografia_E")  # "Superficie comparacion (MDT original)"; graph input
rugosidad_mm = DoubleInput(100)  # graph input
prefijo_nombre_volumen = StringInput("Volumen_MDT")  # graph input
capa_de_contornos = StringInput("_contornos offset")  # graph input
volumen_MDT = Python(IN[0]=superficie_base_trackers, IN[1]=superficie_comparacion_mdt, IN[2]=rugosidad_mm, IN[3]=prefijo_nombre_volumen, IN[4]=capa_de_contornos)  # CPython3
# ---------- volumen_MDT.python (294 lines) ----------
# -*- coding: utf-8 -*-
# =============================================================================
# Volumen_MDT.dyn  v31 (split) - Solo superficies de volumen + tablas
# Civil 3D 2024 / Dynamo / CPython3
#
# Crea por cada contorno cerrado en la capa indicada:
#   - Volumen_MDT_ZonaXX : TIN Volume Surface con analysis y tabla
#
# Las superficies se dejan con estilo "picking" (todo visible) porque
# asi el comando de tabla puede seleccionarlas correctamente.
#
# IN[0] : str    superficie base (trackers)
# IN[1] : str    superficie comparacion (MDT original)
# IN[2] : float  rugosidad en mm
# IN[3] : str    prefijo del nombre volumen (ej: Volumen_MDT)
# IN[4] : str    nombre de la capa de contornos
# =============================================================================

import clr
import traceback

clr.AddReference('AcMgd')
clr.AddReference('AcCoreMgd')
clr.AddReference('AcDbMgd')
clr.AddReference('AecBaseMgd')
clr.AddReference('AeccDbMgd')

from Autodesk.AutoCAD.ApplicationServices import Application as AcadApp
from Autodesk.AutoCAD.DatabaseServices import (
    OpenMode, ObjectId, Polyline, SymbolUtilityServices
)
from Autodesk.AutoCAD.Geometry import Point3d, Point3dCollection
from Autodesk.Civil.ApplicationServices import CivilApplication
from Autodesk.Civil.DatabaseServices import (
    TinVolumeSurface, SurfaceAnalysisElevationData
)
from Autodesk.Civil import SurfaceBoundaryType
from Autodesk.AutoCAD.Colors import Color as AcadColor

import System
from System import Array

base_surf_name = str(IN[0])
comp_surf_name = str(IN[1])
rugosidad_mm   = float(IN[2])
prefix         = str(IN[3])
contour_layer  = str(IN[4])
rugosidad_m    = rugosidad_mm / 1000.0

log = []
log.append("=== Volumen MDT v31 (split) - Crea volumenes ===")
log.append("")

try:
    doc  = AcadApp.DocumentManager.MdiActiveDocument
    db   = doc.Database
    cdoc = CivilApplication.ActiveDocument

    contours = []
    created_info = []

    green = AcadColor.FromRgb(80, 200, 80)
    red   = AcadColor.FromRgb(220, 50, 50)

    dlock = doc.LockDocument()
    try:
        base_id = None
        comp_id = None
        style_picking_id = None

        tr0 = db.TransactionManager.StartTransaction()
        try:
            # Localizar superficies
            for sid in cdoc.GetSurfaceIds():
                s = tr0.GetObject(sid, OpenMode.ForRead)
                try:
                    sn = s.Name
                except:
                    continue
                if sn == base_surf_name:
                    base_id = sid
                elif sn == comp_surf_name:
                    comp_id = sid
            if base_id is None:
                raise Exception("Base '{}' no encontrada.".format(
                    base_surf_name))
            if comp_id is None:
                raise Exception("Comp '{}' no encontrada.".format(
                    comp_surf_name))

            # Leer contornos
            ms_id = SymbolUtilityServices.GetBlockModelSpaceId(db)
            btr = tr0.GetObject(ms_id, OpenMode.ForRead)
            for oid in btr:
                obj = tr0.GetObject(oid, OpenMode.ForRead)
                if not isinstance(obj, Polyline):
                    continue
                if obj.Layer != contour_layer:
                    continue
                n = obj.NumberOfVertices
                if n < 3:
                    continue
                pts = []
                for i in range(n):
                    p = obj.GetPoint2dAt(i)
                    pts.append((p.X, p.Y))
                contours.append(pts)

            if not contours:
                raise Exception("Sin contornos en '{}'.".format(
                    contour_layer))
            contours.sort(key=lambda c: min(p[0] for p in c))
            log.append("Contornos: {}".format(len(contours)))

            # Eliminar volumenes anteriores con mismo prefijo
            vol_prefix = prefix + "_Zona"
            to_erase = []
            for sid in cdoc.GetSurfaceIds():
                s = tr0.GetObject(sid, OpenMode.ForRead)
                try:
                    sn = s.Name
                except:
                    continue
                if sn.startswith(vol_prefix):
                    to_erase.append(sid)
            for sid in to_erase:
                tr0.GetObject(sid, OpenMode.ForWrite).Erase()

            # Buscar estilo para picking (todo visible)
            ss = cdoc.Styles.SurfaceStyles
            for tv in ["analisis de pendientes",
                       "Analisis de pendientes",
                       "Analisis de Pendientes",
                       "ANALISIS DE PENDIENTES",
                       "Contours 1m and 5m (Background)",
                       "Standard",
                       "Triangles"]:
                try:
                    style_picking_id = ss.get_Item(tv)
                    log.append("Estilo picking: '{}'".format(tv))
                    break
                except:
                    continue

            # Fallback
            if style_picking_id is None:
                for sid_s in ss:
                    try:
                        s_obj = tr0.GetObject(sid_s, OpenMode.ForRead)
                        nm = s_obj.Name
                        if nm and not nm.startswith("_No"):
                            style_picking_id = sid_s
                            log.append("Picking (fallback): '{}'".format(nm))
                            break
                    except:
                        continue

            tr0.Commit()
        finally:
            tr0.Dispose()

        all_min_x = min(x for pts in contours for x, y in pts)
        all_max_x = max(x for pts in contours for x, y in pts)
        all_max_y = max(y for pts in contours for x, y in pts)
        width = all_max_x - all_min_x
        margin_x = max(width * 0.2, 100.0)
        table_x = all_max_x + margin_x
        table_spacing = 40.0

        # ============================================================== #
        # FASE 1: Crear volumenes
        # ============================================================== #
        tr = db.TransactionManager.StartTransaction()
        try:
            for i, pts in enumerate(contours):
                zn = i + 1
                zone_name = "{}_Zona{:02d}".format(prefix, zn)
                try:
                    vol_id = TinVolumeSurface.Create(
                        zone_name, base_id, comp_id)
                    vol_surf = tr.GetObject(vol_id, OpenMode.ForWrite)

                    if style_picking_id is not None:
                        vol_surf.StyleId = style_picking_id

                    pc = Point3dCollection()
                    for (x, y) in pts:
                        pc.Add(Point3d(x, y, 0.0))
                    if (pts[0][0], pts[0][1]) != (pts[-1][0], pts[-1][1]):
                        pc.Add(Point3d(pts[0][0], pts[0][1], 0.0))
                    vol_surf.BoundariesDefinition.AddBoundaries(
                        pc, 1.0, SurfaceBoundaryType.Outer, True)

                    min_e = -50.0; max_e = 50.0
                    try:
                        gp = vol_surf.GetGeneralProperties()
                        gt = clr.GetClrType(type(gp))
                        for p in gt.GetProperties():
                            pn = p.Name
                            if "min" in pn.lower() and "elev" in pn.lower():
                                min_e = p.GetValue(gp)
                            elif "max" in pn.lower() and "elev" in pn.lower():
                                max_e = p.GetValue(gp)
                    except:
                        pass

                    try:
                        d1 = SurfaceAnalysisElevationData(
                            min_e, -rugosidad_m, green)
                        d2 = SurfaceAnalysisElevationData(
                            rugosidad_m, max_e, red)
                        vol_surf.Analysis.SetElevationData(
                            Array[SurfaceAnalysisElevationData]([d1, d2]))
                    except:
                        pass

                    try:
                        vp = vol_surf.GetVolumeProperties()
                        r = (vp.UnadjustedCutVolume /
                             vp.UnadjustedFillVolume
                             if vp.UnadjustedFillVolume > 0 else 0)
                        log.append("  {}: C{:.0f} R{:.0f} r{:.2f}".format(
                            zone_name, vp.UnadjustedCutVolume,
                            vp.UnadjustedFillVolume, r))
                    except:
                        pass

                    cx = sum(p[0] for p in pts) / len(pts)
                    cy = sum(p[1] for p in pts) / len(pts)
                    created_info.append((zone_name, cx, cy))
                except Exception as ex_v:
                    log.append("  ERROR volumen: {}".format(ex_v))

            tr.Commit()
        finally:
            tr.Dispose()

        log.append("")
        log.append("{} volumenes creados.".format(len(created_info)))

        # ============================================================== #
        # FASE 2: Encolar tablas + LISP restaurar estilo "elevaciones"
        # en UNA sola llamada SendStringToExecute para garantizar orden
        # ============================================================== #
        if created_info:
            full_cmd = ""
            for i, (zone_name, zcx, zcy) in enumerate(created_info):
                table_y = all_max_y - i * table_spacing
                full_cmd += (
                    "_.ADDSURFACELEGENDTABLE\n"
                    "{},{}\n"
                    "E\n"
                    "D\n"
                    "{},{}\n"
                ).format(zcx, zcy, table_x, table_y)
                log.append("Zona {:02d}: tabla en ({:.1f}, {:.1f})".format(
                    i + 1, table_x, table_y))

            # LISP al final para restaurar "elevaciones"
            full_cmd += "(vl-load-com)\n"
            lisp_body = "(progn"
            for (zone_name, _, _) in created_info:
                lisp_body += (
                    " (vl-catch-all-apply (function (lambda ()"
                    " (vla-put-style"
                    " (vla-item"
                    " (vla-get-surfaces"
                    " (vla-get-civildocument"
                    " (vla-get-application"
                    " (vla-get-activedocument"
                    " (vlax-get-acad-object)))))"
                    " \"{}\")"
                    " \"elevaciones\"))))"
                ).format(zone_name)
            lisp_body += " (princ))\n"
            full_cmd += lisp_body

            doc.SendStringToExecute(full_cmd, True, False, False)
            log.append("")
            log.append(">>> {} tablas + restaurar estilo encolados.".format(
                len(created_info)))

    finally:
        dlock.Dispose()

    log.append("")
    log.append("=== Volumenes listos, pasando a nodo de tablas ===")
    # OUT devuelve (log_string, lista_tablas) para el siguiente nodo
    OUT = [log, table_info]

except Exception as ex:
    log.append("ERROR: {}".format(ex))
    log.append(traceback.format_exc())
    OUT = [log, []]
# ----------------------------------------
tablas_de_leyenda = Python(IN[0]=volumen_MDT)  # CPython3
# ---------- tablas_de_leyenda.python (73 lines) ----------
# -*- coding: utf-8 -*-
# =============================================================================
# Nodo 2: Crea tablas de leyenda por NOMBRE de superficie
#
# Recibe: IN[0] = [log_lista, [(nombre, table_x, table_y), ...]]
# Devuelve log agregado.
#
# Estrategia:
#   Usa ssget con filtro por nombre para PRESELECCIONAR la superficie
#   antes de lanzar el comando ADDSURFACELEGENDTABLE. Con la seleccion
#   ya hecha, el comando no pide picking.
# =============================================================================

import clr
import traceback

clr.AddReference('AcMgd')
clr.AddReference('AcCoreMgd')
clr.AddReference('AcDbMgd')

from Autodesk.AutoCAD.ApplicationServices import Application as AcadApp

log_prev, table_info = IN[0]
log = list(log_prev)
log.append("")
log.append("=== Nodo 2: tablas de leyenda ===")

try:
    if not table_info:
        log.append("Sin tablas que crear.")
        OUT = "\n".join(log)
    else:
        doc = AcadApp.DocumentManager.MdiActiveDocument

        # Construir UN unico string con TODOS los bloques preseleccion+tabla.
        # Por cada tabla:
        #   1. QSELECT via ssget con filtro DXF 2 (nombre) + 0 (tipo AECC_TIN_VOLUME_SURFACE)
        #   2. Comando ADDSURFACELEGENDTABLE - usara la seleccion previa
        #
        # En AutoCAD / Civil 3D, preseleccion se hace con:
        #   (sssetfirst nil (ssget "_X" '((0 . "AECC_TIN_VOLUME_SURFACE") (2 . "nombre"))))
        # Despues el comando ve la seleccion en "implied selection" y
        # salta el prompt de "Select a surface".

        full_cmd = ""
        for (name, tx, ty) in table_info:
            # LISP para preseleccionar por nombre
            full_cmd += (
                "(sssetfirst nil (ssget \"_X\" "
                "(list (cons 0 \"AECC_TIN_VOLUME_SURFACE\") "
                "(cons 2 \"{}\"))))\n"
            ).format(name)
            # Comando de tabla (con superficie ya preseleccionada)
            full_cmd += (
                "_.ADDSURFACELEGENDTABLE\n"
                "E\n"
                "D\n"
                "{},{}\n"
            ).format(tx, ty)
            log.append("  {}: tabla en ({:.1f},{:.1f})".format(
                name, tx, ty))

        doc.SendStringToExecute(full_cmd, True, False, False)
        log.append("")
        log.append(">>> {} tablas encoladas por NOMBRE.".format(
            len(table_info)))

        OUT = "\n".join(log)

except Exception as ex:
    log.append("ERROR: {}".format(ex))
    log.append(traceback.format_exc())
    OUT = "\n".join(log)
# ----------------------------------------
log = Watch(tablas_de_leyenda)  # graph output
