# Dynamo graph Superficies_Zonas_Manchas.dyn "Superficies_Zonas" (Dynamo 2.19.4.6671)
# Por cada contorno cerrado en la capa indicada crea: Trackers_ZonaXX (paste superficie trackers + outer boundary), Desmonte_ZonaXX (paste Trackers_ZonaXX), Terraplen_ZonaXX (paste Trackers_ZonaXX). Estilo _No Display. Numeracion por min_x (compatible con Volumen_MDT).

superficie_trackers_general = StringInput("Trackers_Apamate_E")  # graph input
superficie_mdt_original = StringInput("MdT_Apamate_Topografia_E")  # graph input
capa_de_contornos = StringInput("_contornos offset")  # graph input
superficies_Zonas = Python(IN[0]=superficie_trackers_general, IN[1]=superficie_mdt_original, IN[2]=capa_de_contornos)  # CPython3; graph input
# ---------- superficies_Zonas.python (764 lines) ----------
# -*- coding: utf-8 -*-
# =============================================================================
# Superficies_Zonas.dyn  v4.3
# Civil 3D 2024 / Dynamo / CPython3
#
# Por cada contorno cerrado en la capa indicada (ordenado por min_x asc,
# igual que Volumen_MDT.dyn para mantener la misma numeracion de zonas):
#
#   FASE 1 (por zona):
#     - Trackers_ZonaXX  : TinSurface vacia -> Paste(<tracker_surf>) ->
#                          Outer Boundary = contorno de la zona
#     - Desmonte_ZonaXX  : TinSurface vacia -> Paste(Trackers_ZonaXX)
#                          -> Raise(+min del intervalo positivo del Volumen)
#     - Terraplen_ZonaXX : TinSurface vacia -> Paste(Trackers_ZonaXX)
#                          -> Raise(max del intervalo negativo)   (baja)
#
#   FASE 2 (por zona): MANCHAS + BOUNDARIES
#     Para Desmonte y Terraplen:
#       a) Crear TinVolumeSurface temporal __tmp_vol_<tipo>_ZonaXX con
#          Base=<tipo>_ZonaXX, Comparison=MDT.
#       b) ExtractContoursAt(0.0) -> polylines en ModelSpace donde las dos
#          superficies se cruzan (las "manchas").
#       c) Mover esas polylines a la capa:
#            _Contornos_desmonte_ZonaXX  (color rojo, index 1)
#            _Contornos_terraplen_ZonaXX (color verde, index 3)
#          Crear la capa si no existe.
#       d) Anyadir las polylines como boundary de <tipo>_ZonaXX:
#          la primera como Outer, el resto como Show.
#       e) Borrar la TinVolumeSurface temporal.
#
# Las 3 superficies Trackers/Desmonte/Terraplen se crean con estilo
# '_No Display'. El MDT se pide como input para la comparacion de volumen
# y para validacion (typo-check).
#
# Re-ejecutable: superficies y capas previas con los prefijos del script
# se borran (o vacian) antes de recrearse.
#
# NOTA: Carpetas del Prospector (Zona01, ...) se crean a mano.
#
# IN[0] : str   nombre superficie de trackers general
# IN[1] : str   nombre superficie MDT original
# IN[2] : str   nombre capa de contornos de zonas
# =============================================================================

import clr
import traceback

clr.AddReference('AcMgd')
clr.AddReference('AcCoreMgd')
clr.AddReference('AcDbMgd')
clr.AddReference('AecBaseMgd')
clr.AddReference('AeccDbMgd')

from Autodesk.AutoCAD.ApplicationServices import Application as AcadApp
from Autodesk.AutoCAD.DatabaseServices import (
    OpenMode, Polyline, SymbolUtilityServices,
    LayerTable, LayerTableRecord, ObjectIdCollection
)
from Autodesk.AutoCAD.Geometry import Point3d, Point3dCollection
from Autodesk.AutoCAD.Colors import Color as AcadColor, ColorMethod
from Autodesk.Civil.ApplicationServices import CivilApplication
from Autodesk.Civil.DatabaseServices import (
    TinSurface, TinVolumeSurface
)
# ITerrainSurface puede no estar expuesto en el modulo raiz en algunas
# versiones; lo importamos aparte de forma tolerante.
try:
    from Autodesk.Civil.DatabaseServices import ITerrainSurface
    _HAS_ITERRAINSURFACE = True
except Exception:
    ITerrainSurface = None
    _HAS_ITERRAINSURFACE = False

from Autodesk.Civil import SurfaceBoundaryType

# Reflection para invocar metodos de interfaz explicita (pythonnet no
# expone ExtractContoursAt directamente en TinVolumeSurface porque la
# interfaz ITerrainSurface esta implementada explicitamente).
from System import Array, Double, Object
from System.Reflection import BindingFlags

VOLUME_PREFIX    = "Volumen_MDT"    # Volumen_MDT_ZonaXX
TMP_VOL_PREFIX   = "__tmp_vol_"     # para volumenes temporales de manchas
DES_LAYER_FMT    = "_Contornos_desmonte_Zona{:02d}"
TER_LAYER_FMT    = "_Contornos_terraplen_Zona{:02d}"
DES_COLOR_INDEX  = 1   # rojo
TER_COLOR_INDEX  = 3   # verde

tracker_surf_name = str(IN[0])
mdt_surf_name     = str(IN[1])
contour_layer     = str(IN[2])

log = []
log.append("=== Superficies_Zonas v4.3 ===")
log.append("Tracker surf : {}".format(tracker_surf_name))
log.append("MDT surf     : {}".format(mdt_surf_name))
log.append("Contour layer: {}".format(contour_layer))
log.append("")


def find_style_id(cdoc, candidates):
    ss = cdoc.Styles.SurfaceStyles
    for nm in candidates:
        try:
            return ss.get_Item(nm)
        except:
            continue
    return None


def extract_contours_at_iface(surface, elevation):
    """Invoca ITerrainSurface.ExtractContoursAt(double) via reflection.
    pythonnet no expone el metodo directamente en TinVolumeSurface porque
    la interfaz esta implementada explicitamente. Cuatro estrategias en
    orden de preferencia:
      1) Llamada directa (por si el runtime ya lo expone).
      2) Reflection sobre el tipo ITerrainSurface (si esta importado).
      3) Reflection sobre el tipo concreto, buscando por nombre exacto
         o nombre calificado 'Autodesk.Civil.DatabaseServices.ITerrainSurface.ExtractContoursAt'.
      4) Igual que 3 pero filtrando por 'termina en .ExtractContoursAt'
         y con parametro (double), captura cualquier nombre calificado
         aunque el namespace haya cambiado.
    Devuelve un ObjectIdCollection.
    """
    from System import Type as NetType
    double_elev = float(elevation)

    # Estrategia 1: directo
    try:
        return surface.ExtractContoursAt(double_elev)
    except Exception:
        pass

    args = Array[Object]([Double(double_elev)])
    type_arr_double = Array[NetType]([clr.GetClrType(Double)])

    # Estrategia 2: invocar a traves de ITerrainSurface (si esta importado)
    if _HAS_ITERRAINSURFACE and ITerrainSurface is not None:
        try:
            iface_type = clr.GetClrType(ITerrainSurface)
            m = iface_type.GetMethod("ExtractContoursAt", type_arr_double)
            if m is not None:
                return m.Invoke(surface, args)
        except Exception:
            pass

    # Estrategia 3 y 4: enumerar metodos del tipo concreto
    try:
        t = surface.GetType()
        flags = (BindingFlags.Instance |
                 BindingFlags.Public |
                 BindingFlags.NonPublic |
                 BindingFlags.FlattenHierarchy)
        double_clr = clr.GetClrType(Double)
        candidates = []
        for m in t.GetMethods(flags):
            name = m.Name
            # 'ExtractContoursAt' o cualquier nombre que acabe en '.ExtractContoursAt'
            if name == "ExtractContoursAt" or name.endswith(".ExtractContoursAt"):
                ps = m.GetParameters()
                if len(ps) == 1 and ps[0].ParameterType == double_clr:
                    candidates.append(m)
        # Probar todas las candidatas, priorizando la calificada (explicita)
        candidates.sort(key=lambda mm: 0 if "." in mm.Name else 1)
        for m in candidates:
            try:
                return m.Invoke(surface, args)
            except Exception:
                continue
    except Exception:
        pass

    # Estrategia 5: InternalExtractContoursAt(Double)
    # En Civil 3D 2024, los metodos publicos del guide son wrappers de
    # Internal* que si estan visibles en el tipo concreto. Confirmado por
    # diagnostico previo: 'InternalExtractContoursAt(Double)' existe.
    try:
        t = surface.GetType()
        flags = (BindingFlags.Instance |
                 BindingFlags.Public |
                 BindingFlags.NonPublic |
                 BindingFlags.FlattenHierarchy)
        double_clr = clr.GetClrType(Double)
        for m in t.GetMethods(flags):
            if m.Name == "InternalExtractContoursAt":
                ps = m.GetParameters()
                if len(ps) == 1 and ps[0].ParameterType == double_clr:
                    return m.Invoke(surface, args)
    except Exception:
        pass

    raise Exception("ExtractContoursAt no accesible ni por reflection.")


def get_deltas_from_volume(vol_surf):
    """Lee los intervalos de analisis del TinVolumeSurface y devuelve:
         (raise_d, raise_t)
       Criterio (borde mas cercano a 0 en ambos casos):
         - Desmonte  = intervalo POSITIVO (min>=0). Cojo su MIN.
                       Desmonte.RaiseSurface(+min)  -> sube.
         - Terraplen = intervalo NEGATIVO (max<=0). Cojo su MAX.
                       Terraplen.RaiseSurface(max)  (max <=0) -> baja.
       None si no hay intervalo de ese signo.
    """
    try:
        data = vol_surf.Analysis.GetElevationData()
    except Exception:
        return None, None
    if data is None:
        return None, None
    raise_d = None
    raise_t = None
    eps = 1e-6
    for d in data:
        try:
            mn = float(d.MinimumElevation)
            mx = float(d.MaximumElevation)
        except Exception:
            continue
        if mn >= -eps:
            cand = mn
            if raise_d is None or cand < raise_d:
                raise_d = cand
        if mx <= eps:
            cand = mx
            if raise_t is None or cand > raise_t:
                raise_t = cand
    return raise_d, raise_t



    """Ver docstring v3.1: devuelve (raise_d, raise_t) con borde mas cercano a 0."""
    try:
        data = vol_surf.Analysis.GetElevationData()
    except Exception:
        return None, None
    if data is None:
        return None, None
    raise_d = None
    raise_t = None
    eps = 1e-6
    for d in data:
        try:
            mn = float(d.MinimumElevation)
            mx = float(d.MaximumElevation)
        except Exception:
            continue
        if mn >= -eps:
            cand = mn
            if raise_d is None or cand < raise_d:
                raise_d = cand
        if mx <= eps:
            cand = mx
            if raise_t is None or cand > raise_t:
                raise_t = cand
    return raise_d, raise_t


def ensure_layer(tr, db, layer_name, color_index):
    """Crea la capa si no existe; si existe, fuerza su color. Devuelve
    el ObjectId del LayerTableRecord."""
    lt = tr.GetObject(db.LayerTableId, OpenMode.ForRead)
    if lt.Has(layer_name):
        ltr_id = lt.get_Item(layer_name)
        ltr = tr.GetObject(ltr_id, OpenMode.ForWrite)
    else:
        lt.UpgradeOpen()
        ltr = LayerTableRecord()
        ltr.Name = layer_name
        ltr_id = lt.Add(ltr)
        tr.AddNewlyCreatedDBObject(ltr, True)
    try:
        ltr.Color = AcadColor.FromColorIndex(ColorMethod.ByAci, color_index)
    except Exception as ex:
        # Fallback a RGB si FromColorIndex falla por algun motivo
        rgb_map = {1: (255, 0, 0), 3: (0, 255, 0)}
        r, g, b = rgb_map.get(color_index, (255, 255, 255))
        try:
            ltr.Color = AcadColor.FromRgb(r, g, b)
        except:
            pass
    return ltr_id


def erase_polylines_in_layer(tr, db, layer_name):
    """Borra todas las Polylines del ModelSpace que esten en la capa dada."""
    ms_id = SymbolUtilityServices.GetBlockModelSpaceId(db)
    btr = tr.GetObject(ms_id, OpenMode.ForRead)
    to_erase = []
    for oid in btr:
        try:
            obj = tr.GetObject(oid, OpenMode.ForRead)
        except:
            continue
        if isinstance(obj, Polyline) and obj.Layer == layer_name:
            to_erase.append(oid)
    for oid in to_erase:
        try:
            o = tr.GetObject(oid, OpenMode.ForWrite)
            o.Erase()
        except:
            pass
    return len(to_erase)


def extract_stain_boundaries(tr, db, cdoc, base_surf_id, base_surf_name,
                             mdt_surf_id, tmp_vol_name,
                             target_layer_name, log):
    """Crea un TinVolumeSurface temporal, extrae contornos a 0, los mueve
    a la capa target_layer_name y devuelve la lista de ObjectIds de esas
    polylines (ordenadas por longitud descendente, para que la mayor sea
    el Outer boundary). Borra la volume surface al terminar.

    Puede devolver lista vacia si la volume surface no cruza el cero
    (desmonte o terraplen irrelevante en esa zona)."""
    # 1) Crear volumen temporal
    vol_id = None
    try:
        vol_id = TinVolumeSurface.Create(
            tmp_vol_name, base_surf_id, mdt_surf_id)
    except Exception as ex:
        log.append("    ERROR creando volumen temporal '{}': {}".format(
            tmp_vol_name, ex))
        return []

    # 2) Extraer contornos a elevacion 0
    contour_ids_coll = ObjectIdCollection()
    try:
        vol_surf = tr.GetObject(vol_id, OpenMode.ForRead)
        # Invocar via reflection (ExtractContoursAt esta en ITerrainSurface
        # con implementacion explicita, no accesible directamente en
        # TinVolumeSurface desde pythonnet).
        contour_ids_coll = extract_contours_at_iface(vol_surf, 0.0)
    except Exception as ex:
        log.append("    ERROR ExtractContoursAt(0) en '{}': {}".format(
            base_surf_name, ex))
        # Diagnostico: listar los metodos del tipo que contengan "Contour"
        # o "Extract" (solo la primera vez, controlado con flag global).
        global _DIAG_DONE
        try:
            _DIAG_DONE
        except NameError:
            _DIAG_DONE = False
        if not _DIAG_DONE:
            _DIAG_DONE = True
            try:
                from System.Reflection import BindingFlags as BF
                t = vol_surf.GetType()
                log.append("    [diag] Tipo: {}".format(t.FullName))
                flags = (BF.Instance | BF.Public | BF.NonPublic |
                         BF.FlattenHierarchy)
                found = []
                for m in t.GetMethods(flags):
                    nm = m.Name
                    if "Contour" in nm or "Extract" in nm:
                        ps = m.GetParameters()
                        sig = ", ".join([p.ParameterType.Name for p in ps])
                        found.append("{}({})".format(nm, sig))
                log.append("    [diag] Metodos Extract*/Contour*:")
                for s in sorted(set(found))[:15]:
                    log.append("      {}".format(s))
            except Exception as ex2:
                log.append("    [diag] Error en diagnostico: {}".format(ex2))
        try:
            tr.GetObject(vol_id, OpenMode.ForWrite).Erase()
        except:
            pass
        return []

    # 3) Mover polylines a la capa destino + recoger IDs + longitudes
    polys_info = []   # (oid, length)
    for cid in contour_ids_coll:
        try:
            pl = tr.GetObject(cid, OpenMode.ForWrite)
            if not isinstance(pl, Polyline):
                continue
            pl.Layer = target_layer_name
            polys_info.append((cid, float(pl.Length)))
        except Exception as ex:
            log.append("    AVISO moviendo polyline a capa: {}".format(ex))

    # 4) Borrar volumen temporal
    try:
        tr.GetObject(vol_id, OpenMode.ForWrite).Erase()
    except Exception as ex:
        log.append("    AVISO borrando volumen temporal: {}".format(ex))

    # 5) Ordenar por longitud descendente (el mayor -> Outer)
    polys_info.sort(key=lambda x: x[1], reverse=True)
    return [oid for (oid, _) in polys_info]


def add_boundaries_from_polylines(tr, surf, poly_ids, log):
    """Anyade cada polyline como boundary de surf. La primera Outer,
    el resto Show. Anyade al log el recuento."""
    if not poly_ids:
        return 0
    added = 0
    for idx, pid in enumerate(poly_ids):
        try:
            pl = tr.GetObject(pid, OpenMode.ForRead)
            if not isinstance(pl, Polyline):
                continue
            # Point3dCollection con los vertices de la polyline
            pc = Point3dCollection()
            n = pl.NumberOfVertices
            for i in range(n):
                p3 = pl.GetPoint3dAt(i)
                pc.Add(Point3d(p3.X, p3.Y, 0.0))
            # Cerrar si no lo esta
            first = pl.GetPoint3dAt(0)
            last  = pl.GetPoint3dAt(n - 1)
            if (first.X, first.Y) != (last.X, last.Y):
                pc.Add(Point3d(first.X, first.Y, 0.0))
            btype = SurfaceBoundaryType.Outer if idx == 0 else SurfaceBoundaryType.Show
            surf.BoundariesDefinition.AddBoundaries(pc, 1.0, btype, True)
            added += 1
        except Exception as ex:
            log.append("    AVISO anyadiendo boundary #{}: {}".format(idx, ex))
    return added


try:
    doc  = AcadApp.DocumentManager.MdiActiveDocument
    db   = doc.Database
    cdoc = CivilApplication.ActiveDocument

    dlock = doc.LockDocument()
    try:
        tracker_surf_id = None
        mdt_surf_id     = None
        no_display_id   = None
        contours        = []
        vol_by_zone     = {}
        created_names   = []
        errors_count    = 0

        # ===================================================== #
        # FASE 0: Localizar superficies, estilo y contornos
        # ===================================================== #
        tr0 = db.TransactionManager.StartTransaction()
        try:
            for sid in cdoc.GetSurfaceIds():
                s = tr0.GetObject(sid, OpenMode.ForRead)
                try:
                    sn = s.Name
                except:
                    continue
                if sn == tracker_surf_name:
                    tracker_surf_id = sid
                elif sn == mdt_surf_name:
                    mdt_surf_id = sid
                else:
                    prefix = VOLUME_PREFIX + "_Zona"
                    if sn.startswith(prefix):
                        tail = sn[len(prefix):]
                        if len(tail) >= 2 and tail[:2].isdigit():
                            zn = int(tail[:2])
                            vol_by_zone[zn] = sid

            if tracker_surf_id is None:
                raise Exception("Superficie de trackers '{}' no encontrada.".format(
                    tracker_surf_name))
            if mdt_surf_id is None:
                raise Exception("Superficie MDT '{}' no encontrada.".format(
                    mdt_surf_name))

            log.append("Superficies de volumen detectadas: {}".format(
                len(vol_by_zone)))

            no_display_id = find_style_id(cdoc, [
                "_No Display", "_no display", "_NO DISPLAY",
                "_Sin Display", "_Sin Visualizacion",
            ])
            if no_display_id is None:
                log.append("AVISO: estilo '_No Display' no encontrado.")
            else:
                log.append("Estilo de superficie: '_No Display' OK.")

            ms_id = SymbolUtilityServices.GetBlockModelSpaceId(db)
            btr = tr0.GetObject(ms_id, OpenMode.ForRead)
            for oid in btr:
                obj = tr0.GetObject(oid, OpenMode.ForRead)
                if not isinstance(obj, Polyline):
                    continue
                if obj.Layer != contour_layer:
                    continue
                n = obj.NumberOfVertices
                if n < 3:
                    continue
                pts = []
                for i in range(n):
                    p = obj.GetPoint2dAt(i)
                    pts.append((p.X, p.Y))
                contours.append(pts)

            if not contours:
                raise Exception("Sin contornos cerrados en '{}'.".format(
                    contour_layer))
            contours.sort(key=lambda c: min(p[0] for p in c))
            log.append("Contornos encontrados: {}".format(len(contours)))

            # Limpieza de ejecuciones previas:
            # - Superficies Trackers_Zona*, Desmonte_Zona*, Terraplen_Zona*
            # - Superficies temporales __tmp_vol_*
            prefixes = ("Trackers_Zona", "Desmonte_Zona",
                        "Terraplen_Zona", TMP_VOL_PREFIX)
            to_erase = []
            for sid in cdoc.GetSurfaceIds():
                s = tr0.GetObject(sid, OpenMode.ForRead)
                try:
                    sn = s.Name
                except:
                    continue
                if sn.startswith(prefixes):
                    to_erase.append(sid)
            for sid in to_erase:
                tr0.GetObject(sid, OpenMode.ForWrite).Erase()
            if to_erase:
                log.append("Superficies previas borradas: {}".format(len(to_erase)))

            tr0.Commit()
        finally:
            tr0.Dispose()

        # ===================================================== #
        # FASE 1: Crear superficies por zona (+ raise/lower)
        # ===================================================== #
        tr = db.TransactionManager.StartTransaction()
        trk_ids = {}   # zn -> ObjectId Trackers_ZonaXX
        des_ids = {}   # zn -> ObjectId Desmonte_ZonaXX
        ter_ids = {}   # zn -> ObjectId Terraplen_ZonaXX
        try:
            for i, pts in enumerate(contours):
                zn = i + 1
                trk_name = "Trackers_Zona{:02d}".format(zn)
                des_name = "Desmonte_Zona{:02d}".format(zn)
                ter_name = "Terraplen_Zona{:02d}".format(zn)

                log.append("")
                log.append(">>> Zona {:02d}".format(zn))

                raise_d, raise_t = None, None
                vol_id = vol_by_zone.get(zn)
                if vol_id is None:
                    log.append("  AVISO: sin Volumen_MDT_Zona{:02d}.".format(zn))
                else:
                    try:
                        vol_surf = tr.GetObject(vol_id, OpenMode.ForRead)
                        raise_d, raise_t = get_deltas_from_volume(vol_surf)
                        if raise_d is not None:
                            log.append("  Delta desmonte : {:+.3f} m".format(raise_d))
                        else:
                            log.append("  AVISO: sin intervalo de desmonte.")
                        if raise_t is not None:
                            log.append("  Delta terraplen: {:+.3f} m".format(raise_t))
                        else:
                            log.append("  AVISO: sin intervalo de terraplen.")
                    except Exception as ex_v:
                        log.append("  ERROR leyendo volumen: {}".format(ex_v))

                pc = Point3dCollection()
                for (x, y) in pts:
                    pc.Add(Point3d(x, y, 0.0))
                if (pts[0][0], pts[0][1]) != (pts[-1][0], pts[-1][1]):
                    pc.Add(Point3d(pts[0][0], pts[0][1], 0.0))

                # ---- 1) Trackers_ZonaXX ----
                trk_id = None
                try:
                    trk_id = TinSurface.Create(db, trk_name)
                    trk_surf = tr.GetObject(trk_id, OpenMode.ForWrite)
                    if no_display_id is not None:
                        trk_surf.StyleId = no_display_id
                    trk_surf.PasteSurface(tracker_surf_id)
                    trk_surf.BoundariesDefinition.AddBoundaries(
                        pc, 1.0, SurfaceBoundaryType.Outer, True)
                    log.append("  OK {}".format(trk_name))
                    created_names.append(trk_name)
                    trk_ids[zn] = trk_id
                except Exception as ex_t:
                    log.append("  ERROR {}: {}".format(trk_name, ex_t))
                    errors_count += 1
                    continue

                # ---- 2) Desmonte_ZonaXX ----
                try:
                    des_id = TinSurface.Create(db, des_name)
                    des_surf = tr.GetObject(des_id, OpenMode.ForWrite)
                    if no_display_id is not None:
                        des_surf.StyleId = no_display_id
                    des_surf.PasteSurface(trk_id)
                    if raise_d is not None:
                        des_surf.RaiseSurface(float(raise_d))
                        log.append("  OK {}  (raise {:+.3f})".format(
                            des_name, raise_d))
                    else:
                        log.append("  OK {}  (sin raise)".format(des_name))
                    created_names.append(des_name)
                    des_ids[zn] = des_id
                except Exception as ex_d:
                    log.append("  ERROR {}: {}".format(des_name, ex_d))
                    errors_count += 1

                # ---- 3) Terraplen_ZonaXX ----
                try:
                    ter_id = TinSurface.Create(db, ter_name)
                    ter_surf = tr.GetObject(ter_id, OpenMode.ForWrite)
                    if no_display_id is not None:
                        ter_surf.StyleId = no_display_id
                    ter_surf.PasteSurface(trk_id)
                    if raise_t is not None:
                        ter_surf.RaiseSurface(float(raise_t))
                        log.append("  OK {}  (raise {:+.3f})".format(
                            ter_name, raise_t))
                    else:
                        log.append("  OK {}  (sin raise)".format(ter_name))
                    created_names.append(ter_name)
                    ter_ids[zn] = ter_id
                except Exception as ex_r:
                    log.append("  ERROR {}: {}".format(ter_name, ex_r))
                    errors_count += 1

            tr.Commit()
        finally:
            tr.Dispose()

        # ===================================================== #
        # FASE 2: Manchas (extraer contornos) + boundaries
        # ===================================================== #
        # Transaccion nueva: las superficies ya estan commiteadas y
        # ExtractContoursAt crea polylines en ModelSpace.
        log.append("")
        log.append("--- FASE 2: manchas + boundaries ---")

        tr2 = db.TransactionManager.StartTransaction()
        try:
            for zn in sorted(set(list(des_ids.keys()) + list(ter_ids.keys()))):
                log.append("")
                log.append(">>> Zona {:02d} (manchas)".format(zn))

                # ---- Desmonte ----
                des_id = des_ids.get(zn)
                if des_id is not None:
                    des_layer = DES_LAYER_FMT.format(zn)
                    des_name_short = "Desmonte_Zona{:02d}".format(zn)
                    try:
                        ensure_layer(tr2, db, des_layer, DES_COLOR_INDEX)
                        n_old = erase_polylines_in_layer(tr2, db, des_layer)
                        if n_old:
                            log.append("  Capa '{}': {} polylines previas borradas".format(
                                des_layer, n_old))
                        tmp_name = "{}des_{:02d}".format(TMP_VOL_PREFIX, zn)
                        pids = extract_stain_boundaries(
                            tr2, db, cdoc, des_id, des_name_short,
                            mdt_surf_id, tmp_name, des_layer, log)
                        log.append("  {} -> {} polyline(s) de mancha".format(
                            des_name_short, len(pids)))
                        if pids:
                            des_surf = tr2.GetObject(des_id, OpenMode.ForWrite)
                            added = add_boundaries_from_polylines(tr2, des_surf, pids, log)
                            log.append("  {}: {} boundaries anyadidas".format(
                                des_name_short, added))
                    except Exception as ex_d2:
                        log.append("  ERROR manchas desmonte Zona{:02d}: {}".format(
                            zn, ex_d2))
                        errors_count += 1

                # ---- Terraplen ----
                ter_id = ter_ids.get(zn)
                if ter_id is not None:
                    ter_layer = TER_LAYER_FMT.format(zn)
                    ter_name_short = "Terraplen_Zona{:02d}".format(zn)
                    try:
                        ensure_layer(tr2, db, ter_layer, TER_COLOR_INDEX)
                        n_old = erase_polylines_in_layer(tr2, db, ter_layer)
                        if n_old:
                            log.append("  Capa '{}': {} polylines previas borradas".format(
                                ter_layer, n_old))
                        tmp_name = "{}ter_{:02d}".format(TMP_VOL_PREFIX, zn)
                        pids = extract_stain_boundaries(
                            tr2, db, cdoc, ter_id, ter_name_short,
                            mdt_surf_id, tmp_name, ter_layer, log)
                        log.append("  {} -> {} polyline(s) de mancha".format(
                            ter_name_short, len(pids)))
                        if pids:
                            ter_surf = tr2.GetObject(ter_id, OpenMode.ForWrite)
                            added = add_boundaries_from_polylines(tr2, ter_surf, pids, log)
                            log.append("  {}: {} boundaries anyadidas".format(
                                ter_name_short, added))
                    except Exception as ex_t2:
                        log.append("  ERROR manchas terraplen Zona{:02d}: {}".format(
                            zn, ex_t2))
                        errors_count += 1

            tr2.Commit()
        finally:
            tr2.Dispose()

        # ===================================================== #
        # FASE 3: Cambiar estilo de Volumen_MDT_ZonaXX a 'elevaciones'
        # ===================================================== #
        log.append("")
        log.append("--- FASE 3: estilo de Volumen_MDT ---")
        tr3 = db.TransactionManager.StartTransaction()
        try:
            # Buscar el estilo (prioridad al nombre exacto 'elevaciones')
            vol_style_id = find_style_id(cdoc, [
                "elevaciones",
                "Elevaciones",
                "ELEVACIONES",
                "Elevation Banding 2D",
                "Elevation Banding 3D",
            ])
            if vol_style_id is None:
                log.append("  AVISO: estilo 'elevaciones' no encontrado. "
                           "Se deja el estilo actual de cada volumen.")
            else:
                log.append("  Estilo 'elevaciones' localizado.")
                n_updated = 0
                for zn, vid in sorted(vol_by_zone.items()):
                    vname = "Volumen_MDT_Zona{:02d}".format(zn)
                    try:
                        vsurf = tr3.GetObject(vid, OpenMode.ForWrite)
                        vsurf.StyleId = vol_style_id
                        log.append("  OK {} -> estilo 'elevaciones'".format(vname))
                        n_updated += 1
                    except Exception as ex_s:
                        log.append("  ERROR {} al aplicar estilo: {}".format(
                            vname, ex_s))
                        errors_count += 1
                log.append("  Volumenes actualizados: {} de {}".format(
                    n_updated, len(vol_by_zone)))
            tr3.Commit()
        finally:
            tr3.Dispose()

        # ===================================================== #
        # Resumen
        # ===================================================== #
        log.append("")
        log.append("=" * 50)
        n_zones = len(contours)
        expected = n_zones * 3
        log.append("RESUMEN")
        log.append("  Zonas procesadas : {}".format(n_zones))
        log.append("  Superficies OK   : {} de {}".format(
            len(created_names), expected))
        log.append("  ERRORES          : {}".format(errors_count))
        log.append("")
        log.append("SIGUIENTE PASO (manual): en Prospector > Surfaces")
        log.append("crear una carpeta por zona (Zona01, Zona02, ...) y")
        log.append("arrastrar Trackers_ZonaXX, Desmonte_ZonaXX,")
        log.append("Terraplen_ZonaXX y Volumen_MDT_ZonaXX a cada una.")

    finally:
        dlock.Dispose()

    OUT = "\n".join(log)

except Exception as ex:
    log.append("ERROR FATAL: {}".format(ex))
    log.append(traceback.format_exc())
    OUT = "\n".join(log)
# ----------------------------------------
watch = Watch(superficies_Zonas)  # graph input
